# Grasshopper definition 221212_Substructure.ghx (Grasshopper 1.0.7)

# ---- group: num. agents in each cluster
genes = GenePool(Decimals=0, Maximum=100, Minimum=0, Value=[34, 45, 42, 40])

# ----
genes_2 = GenePool(Decimals=2, Maximum=1, Minimum=0, Value=[0, 0.24, 0.52, 0.78])
dom = ConstructDomain(DomainStart=Slider(0.1, range=0..0.1), DomainEnd=Slider(0.3, range=0..1))
random = Random(Range=dom, Number=Slider(4, range=0..10), Seed=Slider(4, range=0..10))
range = Range(Domain=Domain(0, 1), Steps=genes)
bang = ExplodeTree(Data=range)  # -> Branch0, Branch1, Branch2, Branch3
ghpython_script = GhPythonScript(centers=genes_2, extend=random)  # -> out, intervals; inputs centers: list, extend: list
# ---------- ghpython_script: Python ----------
import math
import ghpythonlib.treehelpers as th


intervals=[]

for center, ext in zip(centers, extend):
    inter_from = center- ext
    inter_to = center + ext
    print type(inter_from)
    if inter_from < 0 : 
        inter_from =0
    if inter_to >1 :
        inter_to =1
    
    intervals.append([inter_from, inter_to])

intervals = th.list_to_tree(intervals)
# ---------- end ghpython_script ----------
graph = GraphMapper(
    bang.Branch0,
    x0=0,
    x1=1,
    y0=0,
    y1=1,
    container_name="Bezier",
    cpx=[0, 0.5314487219, 0.4586946666, 1],
    cpy=[0.01951313019, 0.01738131046, 1, 1])
graph_2 = GraphMapper(
    bang.Branch2,
    x0=0,
    x1=1,
    y0=0,
    y1=1,
    container_name="Sinc",
    Equation_X0=0.4748720825,
    Equation_X1=0.8188405633,
    Equation_Y0=0.9733063579,
    Equation_Y1=0)
graph_3 = GraphMapper(bang.Branch3, x0=0, x1=1, y0=0, y1=1, Cx=0.4874807298, Cy=0.7769420147, container_name="Conic")
graph_4 = GraphMapper(bang.Branch1, x0=0, x1=1, y0=0, y1=1, Ox=0.4780313373, Oy=1, Px=1, Py=0.1196134686, container_name="Parabola")
panel = Panel(ghpython_script.intervals)
merge = Merge(Data1=graph, Data2=graph_4, Data3=graph_2, Data4=graph_3)
bounds = Bounds(Numbers=merge)
sort = SortList(Keys=merge)  # -> Keys, ValuesA
remap = RemapNumbers(Value=sort.Keys, Source=bounds, Target=ghpython_script.intervals)  # -> Mapped, Clipped

# ---- group: No. Clusters
number_of_clusters = Panel("4")

# ---- group: num. agents in each cluster
genes_3 = GenePool(Decimals=0, Maximum=100, Minimum=0, Value=[34, 45, 42, 40])

# ----
genes_4 = GenePool(Decimals=2, Maximum=1, Minimum=0, Value=[0, 0.24, 0.52, 0.78])
dom_2 = ConstructDomain(DomainStart=Slider(0.1, range=0..0.1), DomainEnd=Slider(0.3, range=0..1))
random_2 = Random(Range=dom_2, Number=Slider(4, range=0..10), Seed=Slider(4, range=0..10))
range_2 = Range(Domain=Domain(0, 1), Steps=genes_3)
bang_2 = ExplodeTree(Data=range_2)  # -> Branch0, Branch1, Branch2, Branch3
ghpython_script_2 = GhPythonScript(centers=genes_4, extend=random_2)  # -> out, intervals; inputs centers: list, extend: list; same code as ghpython_script
graph_5 = GraphMapper(
    bang_2.Branch0,
    x0=0,
    x1=1,
    y0=0,
    y1=1,
    container_name="Bezier",
    cpx=[0, 0.5243950486, 0.4586946666, 1],
    cpy=[0, 0, 1, 1])
graph_6 = GraphMapper(
    bang_2.Branch2,
    x0=0,
    x1=1,
    y0=0,
    y1=1,
    container_name="Sinc",
    Equation_X0=0.4748720825,
    Equation_X1=0.8085743189,
    Equation_Y0=0.9733063579,
    Equation_Y1=0.05741548538)
graph_7 = GraphMapper(bang_2.Branch3, x0=0, x1=1, y0=0, y1=1, Cx=0.4874807298, Cy=0.7769420147, container_name="Conic")
graph_8 = GraphMapper(
    bang_2.Branch0,
    x0=0,
    x1=1,
    y0=0,
    y1=1,
    container_name="Bezier",
    cpx=[0, 0.5243950486, 0.4586946666, 1],
    cpy=[0, 0, 1, 1])
graph_9 = GraphMapper(bang_2.Branch1, x0=0, x1=1, y0=0, y1=1, Ox=0.4780313373, Oy=1, Px=1, Py=0.1196134686, container_name="Parabola")
graph_10 = GraphMapper(
    bang_2.Branch2,
    x0=0,
    x1=1,
    y0=0,
    y1=1,
    container_name="Sinc",
    Equation_X0=0.4748720825,
    Equation_X1=0.8085743189,
    Equation_Y0=0.9733063579,
    Equation_Y1=0.05741548538)
graph_11 = GraphMapper(bang_2.Branch3, x0=0, x1=1, y0=0, y1=1, Cx=0.4874807298, Cy=0.7769420147, container_name="Conic")
graph_12 = GraphMapper(bang_2.Branch1, x0=0, x1=1, y0=0, y1=1, Ox=0.4780313373, Oy=1, Px=1, Py=0.1196134686, container_name="Parabola")
merge_2 = Merge(Data1=graph_8, Data2=graph_12, Data3=graph_10, Data4=graph_11)
merge_3 = Merge(Data1=graph_5, Data2=graph_9, Data3=graph_6, Data4=graph_7)
bnd = Bounds(Numbers=merge_2)
bnd_2 = Bounds(Numbers=merge_3)  # -> flatten(Domain)
remap_2 = RemapNumbers(Value=merge_2, Source=bnd, Target=Domain(0, 1))  # -> Mapped, Clipped
sort_2 = SortList(Keys=merge_3)  # -> Keys, ValuesA
remap_3 = RemapNumbers(Value=sort_2.Keys, Source=bnd_2, Target=ghpython_script_2.intervals)  # -> Mapped, Clipped
panel_2 = Panel("C:\Users\eleni\Documents\GitHub\3d_printing_teamwork\Design_Substructure\substructure_khara.py")
number_slider = Slider(500, range=0..1000)
read_file = ReadFile(File=panel_2, PerLineParse=False)
ghpython_script_3 = GhPythonScript(
    Code=read_file,
    U_div=number_slider,
    V_div=number_slider,
    Coherence_rad=Slider(2.5, range=0..10),
    Coherence_fac=Slider(0.2, range=0..1))  # -> Out, A
panel_3 = Panel(ghpython_script_3.Out)
