# Grasshopper definition 221215_Substructure_MAIN_1.0.ghx (Grasshopper 1.0.7)

# ---- group: No. Clusters
number_of_clusters = Panel("4")  # disabled

# ---- group: MAS Multi-Agent-System Generation
dom = ConstructDomain(DomainStart=Slider(0.18, range=0..1), DomainEnd=Slider(0.3, range=0..1))
random = Random(Range=dom, Number=Slider(4, range=0..10), Seed=Slider(2, range=0..10))

# ---- group: MAS Multi-Agent-System Generation / num. agents in each cluster
genes = GenePool(Decimals=0, Maximum=20, Minimum=0, Value=[11, 10, 10, 12])

# ---- group: MAS Multi-Agent-System Generation / No. Clusters
number_of_clusters_2 = Panel("4")

# ---- group: MAS Multi-Agent-System Generation
range = Range(Domain=Domain(0, 1), Steps=genes)
bang = ExplodeTree(Data=range)  # -> Branch0, Branch1, Branch2, Branch3

# ---- group: num. agents in each cluster
genes_2 = GenePool(Decimals=0, Maximum=20, Minimum=0, Value=[11, 10, 10, 12])  # disabled

# ---- group: MAS Multi-Agent-System Generation / Target factor
graph = GraphMapper(bang.Branch1, x0=0, x1=1, y0=0, y1=1, Ox=0.5098851919, Oy=1, Px=1, Py=0.1483525634, container_name="Parabola")
graph_2 = GraphMapper(bang.Branch3, x0=0, x1=1, y0=0, y1=1, Cx=0.5553172827, Cy=0.8992747664, container_name="Conic")
graph_3 = GraphMapper(bang.Branch0, x0=0, x1=1, y0=0, y1=1, container_name="Bezier", cpx=[0, 0.5243950486, 0.3017984927, 1], cpy=[0, 0, 1, 1])
graph_4 = GraphMapper(
    bang.Branch2,
    x0=0,
    x1=1,
    y0=0,
    y1=1,
    container_name="Sinc",
    Equation_X0=0.4748720825,
    Equation_X1=1,
    Equation_Y0=0.9733063579,
    Equation_Y1=0.1758453846)
merge = Merge(Data1=graph_3, Data2=graph, Data3=graph_4, Data4=graph_2)
bnd = Bounds(Numbers=merge)
remap = RemapNumbers(Value=merge, Source=bnd, Target=Domain(0, 1))  # -> Mapped, Clipped

# ---- group: MAS Multi-Agent-System Generation / surface Candidates
geometry = Geometry(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)
geometry_2 = Geometry(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)
geometry_3 = Geometry(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)
geometry_4 = Geometry(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)
geometry_5 = Geometry(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)

# ---- group: MAS Multi-Agent-System Generation / Main Function
number_slider = Slider(10, range=10..20)
sub_goal_fac = Slider(7, range=0..10)
sub_goal_rad = Slider(20, range=0..100)
shift_factor_up = Slider(0.1, range=0.001..0.88)
shift_factor_down = Slider(0.3, range=0.001..0.88)

number_slider_2 = Slider(3, range=1..11)
number_slider_3 = Slider(22, range=0..100)
boolean_toggle = BooleanToggle(True)

coherence_rad = Slider(58, range=0..100)
align_rad = Slider(46, range=0..100)
align_fac = Slider(0.6, range=0..1)
avoid_rad = Slider(32, range=0..100)
avoid_fac = Slider(1, range=0..3)
coherence_fac = Slider(1.3, range=0..3)
boolean_toggle_2 = BooleanToggle(True)
boolean_toggle_3 = BooleanToggle(True)
boolean_toggle_4 = BooleanToggle(True)

coherence_rad_2 = Slider(13, range=0..100)
align_rad_2 = Slider(10, range=0..100)
avoid_fac_2 = Slider(0.4, range=0..3)
coherence_fac_2 = Slider(0.2, range=0..3)
align_fac_2 = Slider(0.8, range=0..1)
avoid_rad_2 = Slider(12, range=0..100)
boolean_toggle_5 = BooleanToggle(True)
boolean_toggle_6 = BooleanToggle(True)
boolean_toggle_7 = BooleanToggle(True)

t2 = Slider(400, range=0..500)
t1 = Slider(157, range=0..500)

# ----
geometry_6 = Geometry(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)  # disabled
geometry_7 = Geometry(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)  # disabled
geometry_8 = Geometry(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)  # disabled
geometry_9 = Geometry(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)  # disabled

number_slider_4 = Slider(16, range=10..20)  # disabled
sub_goal_rad_2 = Slider(1, range=0..100)  # disabled
sub_goal_fac_2 = Slider(2.5, range=0..3)  # disabled
number_slider_5 = Slider(0.05, range=0.001..0.88)  # disabled

number_slider_6 = Slider(3, range=1..11)  # disabled
number_slider_7 = Slider(22, range=0..100)  # disabled
boolean_toggle_8 = BooleanToggle(True)  # disabled

t2_2 = Slider(376, range=0..500)  # disabled
t1_2 = Slider(157, range=0..500)  # disabled

coherence_rad_3 = Slider(58, range=0..100)  # disabled
align_rad_3 = Slider(46, range=0..100)  # disabled
align_fac_3 = Slider(0.6, range=0..1)  # disabled
avoid_rad_3 = Slider(32, range=0..100)  # disabled
coherence_fac_3 = Slider(1.3, range=0..3)  # disabled
avoid_fac_3 = Slider(1, range=0..3)  # disabled
boolean_toggle_9 = BooleanToggle(True)  # disabled
boolean_toggle_10 = BooleanToggle(True)  # disabled
boolean_toggle_11 = BooleanToggle(True)  # disabled

coherence_rad_4 = Slider(13, range=0..100)  # disabled
align_rad_4 = Slider(10, range=0..100)  # disabled
avoid_fac_4 = Slider(1.4, range=0..3)  # disabled
coherence_fac_4 = Slider(0.2, range=0..3)  # disabled
align_fac_4 = Slider(0.3, range=0..1)  # disabled
avoid_rad_4 = Slider(12, range=0..100)  # disabled
boolean_toggle_12 = BooleanToggle(True)  # disabled
boolean_toggle_13 = BooleanToggle(True)  # disabled
boolean_toggle_14 = BooleanToggle(True)  # disabled

number_slider_8 = Slider(6, range=1..20)
extrz = Extremes()  # -> Mininum, Maximum
cir = Circle(Plane=PlaneXY(0, 0, 0), Radius=1)
xy = XYPlane(Origin=Point(0, 0, 0))  # disabled

# ---- group: MAS Multi-Agent-System Generation
genes_3 = GenePool(Decimals=2, Maximum=1, Minimum=0, Value=[0, 0.28, 0.61, 0.87])
ghpython_script = GhPythonScript(centers=genes_3, extend=random)  # -> out, intervals; inputs centers: list, extend: list
# ---------- ghpython_script: Python ----------
import math
import ghpythonlib.treehelpers as th


intervals=[]

for center, ext in zip(centers, extend):
    inter_from = center- ext
    inter_to = center + ext
    print type(inter_from)
    if inter_from < 0 : 
        inter_from =0
    if inter_to >1 :
        inter_to =1
    
    intervals.append([inter_from, inter_to])

intervals = th.list_to_tree(intervals)
# ---------- end ghpython_script ----------
panel = Panel("C:\Users\ahmed\OneDrive - Politecnico di Milano\ETH Zurich\MAS Dfab\P4_Mini Project\3d_printing_teamwork\Design_Substructure\221215_Substructure_khara_working.py")
dispatch = Dispatch(List=ghpython_script.intervals, DispatchPattern=[True, False])  # -> ListA, ListB
dom_2 = ConstructDomain(DomainStart=dispatch.ListA, DomainEnd=dispatch.ListB)
read_file = ReadFile(File=panel, PerLineParse=False)
surface = Surface(reparameterize(geometry_3))

# ---- group: MAS Multi-Agent-System Generation / u_pos_for_initial_agents
graph_5 = GraphMapper(bang.Branch1, x0=0, x1=1, y0=0, y1=1, Ox=0.4780313373, Oy=1, Px=1, Py=0.1196134686, container_name="Parabola")
graph_6 = GraphMapper(bang.Branch0, x0=0, x1=1, y0=0, y1=1, container_name="Bezier", cpx=[0, 0.5243950486, 0.08604718745, 1], cpy=[0, 0, 1, 1])
graph_7 = GraphMapper(bang.Branch3, x0=0, x1=1, y0=0, y1=1, Cx=0.4874807298, Cy=0.7769420147, container_name="Conic")
graph_8 = GraphMapper(
    bang.Branch2,
    x0=0,
    x1=1,
    y0=0,
    y1=1,
    container_name="Sinc",
    Equation_X0=0.4748720825,
    Equation_X1=0.9382023215,
    Equation_Y0=0.9733063579,
    Equation_Y1=0.2215337157)
merge_2 = Merge(Data1=graph_6, Data2=graph_5, Data3=graph_8, Data4=graph_7)
bnd_2 = Bounds(Numbers=merge_2)
sort = SortList(Keys=merge_2)  # -> Keys, ValuesA
remap_2 = RemapNumbers(Value=sort.Keys, Source=bnd_2, Target=dom_2)  # -> Mapped, Clipped

# ---- group: MAS Multi-Agent-System Generation / Main Function
resolution = Slider(514, range=0..1000)
ghpython_script_2 = GhPythonScript(
    Code=read_file,
    Seeed=Slider(2, range=0..10),
    Time_1=t1,
    Time_2=t2,
    Shift_up_factor=shift_factor_up,
    Shift_down_factor=shift_factor_down,
    Sub_goal_rad=sub_goal_rad,
    Sub_goal_fac=sub_goal_fac,
    Num_new_agents=number_slider,
    Coherence_rad2=coherence_rad_2,
    Coherence_fac2=coherence_fac_2,
    Coherence_T2=boolean_toggle_6,
    Align_rad2=align_rad_2,
    Align_fac2=align_fac_2,
    Alignment_T2=boolean_toggle_7,
    Avoid_rad2=avoid_rad_2,
    Avoid_fac2=avoid_fac_2,
    Separation_T2=boolean_toggle_5,
    Surface=surface,
    U_div=resolution,
    V_div=resolution,
    U_lists=remap_2.Mapped,
    Target_factors=remap.Clipped,
    Coherence_rad=coherence_rad,
    Coherence_fac=coherence_fac,
    Coherence_T=boolean_toggle_2,
    Align_rad=align_rad,
    Align_fac=align_fac,
    Alignment_T=boolean_toggle_3,
    Avoid_rad=avoid_rad,
    Avoid_fac=avoid_fac,
    Separation_T=boolean_toggle_4,
    Rebuild_points=number_slider_3,
    Rebuild_degree=number_slider_2,
    Rebuild_T=boolean_toggle)  # -> Out, Goals, Main_paths, Sec_paths

# ---- group: MAS Multi-Agent-System Generation (continued)
panel_2 = Panel(ghpython_script_2.Out)
geo = Geometry(ghpython_script_2.Goals)

# ---- group: MAS Multi-Agent-System Generation / Main Agents
curve = Curve(ghpython_script_2.Main_paths)

# ---- group: MAS Multi-Agent-System Generation / Sub Agents
curve_2 = Curve(ghpython_script_2.Sec_paths)

# ----
end = EndPoints(Curve=curve)  # -> Start, End
geo_2 = Geometry(end.End)
data = Data(end.Start)  # disabled
vec2pt = Vector2Pt(PointA=xy, PointB=data, Unitize=False)  # -> Vector, Length; disabled
move = Move(Motion=vec2pt.Vector)  # -> Geometry, Transform; disabled
extrcrv = ExtrudeAlong(Base=move.Geometry, Curve=curve)  # disabled

number_slider_9 = Slider(0.18, range=0..1)  # disabled
number_slider_10 = Slider(0.3, range=0..1)  # disabled
number_slider_11 = Slider(5, range=0..10)  # disabled
number_slider_12 = Slider(4, range=0..10)  # disabled
genes_4 = GenePool(Decimals=2, Maximum=1, Minimum=0, Value=[0, 0.28, 0.61, 0.87])  # disabled
dom_3 = ConstructDomain(DomainStart=number_slider_9, DomainEnd=number_slider_10)  # disabled
range_2 = Range(Domain=Domain(0, 1), Steps=genes_2)  # disabled
bang_2 = ExplodeTree(Data=range_2)  # -> Branch0, Branch1, Branch2, Branch3; disabled
graph_9 = GraphMapper(
    bang_2.Branch0,
    x0=0,
    x1=1,
    y0=0,
    y1=1,
    container_name="Bezier",
    cpx=[0, 0.5243950486, 0.08604718745, 1],
    cpy=[0, 0, 1, 1])  # disabled
graph_10 = GraphMapper(
    bang_2.Branch2,
    x0=0,
    x1=1,
    y0=0,
    y1=1,
    container_name="Sinc",
    Equation_X0=0.4748720825,
    Equation_X1=0.9382023215,
    Equation_Y0=0.9733063579,
    Equation_Y1=0.2215337157)  # disabled
graph_11 = GraphMapper(bang_2.Branch1, x0=0, x1=1, y0=0, y1=1, Ox=0.4780313373, Oy=1, Px=1, Py=0.1196134686, container_name="Parabola")  # disabled
graph_12 = GraphMapper(bang_2.Branch3, x0=0, x1=1, y0=0, y1=1, Cx=0.4874807298, Cy=0.7769420147, container_name="Conic")  # disabled
merge_3 = Merge(Data1=graph_9, Data2=graph_11, Data3=graph_10, Data4=graph_12)  # disabled
sort_2 = SortList(Keys=merge_3)  # -> Keys, ValuesA; disabled
bnd_3 = Bounds(Numbers=merge_3)  # disabled
panel_3 = Panel("C:\Users\ahmed\OneDrive - Politecnico di Milano\ETH Zurich\MAS Dfab\P4_Mini Project\3d_printing_teamwork\Design_Substructure\221214_Substructure_khara_working.py")  # disabled
read_file_2 = ReadFile(File=panel_3, PerLineParse=False)  # disabled
surface_2 = Surface(reparameterize(geometry_6))  # disabled
resolution_2 = Slider(514, range=0..1000)  # disabled
number_slider_13 = Slider(2, range=0..10)  # disabled
random_2 = Random(Range=dom_3, Number=number_slider_12, Seed=number_slider_13)  # disabled
ghpython_script_3 = GhPythonScript(centers=genes_4, extend=random_2)  # -> out, intervals; inputs centers: list, extend: list; disabled; same code as ghpython_script
panel_4 = Panel(ghpython_script_3.intervals)  # disabled
dispatch_2 = Dispatch(List=ghpython_script_3.intervals, DispatchPattern=[True, False])  # -> ListA, ListB; disabled
dom_4 = ConstructDomain(DomainStart=dispatch_2.ListA, DomainEnd=dispatch_2.ListB)  # disabled
remap_3 = RemapNumbers(Value=sort_2.Keys, Source=bnd_3, Target=dom_4)  # -> Mapped, Clipped; disabled
panel_5 = Panel(remap_3.Clipped)  # disabled
number_slider_14 = Slider(6, range=1..20)  # disabled
extrz_2 = Extremes()  # -> Mininum, Maximum; disabled
cir_2 = Circle(Plane=PlaneXY(0, 0, 0), Radius=1)  # disabled
pipe = Pipe(Radius=number_slider_14, Caps=0)  # disabled
xy_2 = XYPlane(Origin=Point(0, 0, 0))  # disabled

# ---- group: Target factor
graph_13 = GraphMapper(bang_2.Branch3, x0=0, x1=1, y0=0, y1=1, Cx=0.5553172827, Cy=0.8992747664, container_name="Conic")  # disabled
graph_14 = GraphMapper(bang_2.Branch1, x0=0, x1=1, y0=0, y1=1, Ox=0.5098851919, Oy=1, Px=1, Py=0.1483525634, container_name="Parabola")  # disabled
graph_15 = GraphMapper(
    bang_2.Branch2,
    x0=0,
    x1=1,
    y0=0,
    y1=1,
    container_name="Sinc",
    Equation_X0=0.4748720825,
    Equation_X1=1,
    Equation_Y0=0.9733063579,
    Equation_Y1=0.1758453846)  # disabled
graph_16 = GraphMapper(
    bang_2.Branch0,
    x0=0,
    x1=1,
    y0=0,
    y1=1,
    container_name="Bezier",
    cpx=[0, 0.5243950486, 0.3017984927, 1],
    cpy=[0, 0, 1, 1])  # disabled
merge_4 = Merge(Data1=graph_16, Data2=graph_14, Data3=graph_15, Data4=graph_13)  # disabled
bnd_4 = Bounds(Numbers=merge_4)  # disabled
remap_4 = RemapNumbers(Value=merge_4, Source=bnd_4, Target=Domain(0, 1))  # -> Mapped, Clipped; disabled

# ----
ghpython_script_4 = GhPythonScript(
    seeed=number_slider_13,
    time_1=t1_2,
    time_2=t2_2,
    shift_factor=number_slider_5,
    sub_goal_rad=sub_goal_rad_2,
    sub_goal_fac=sub_goal_fac_2,
    num_new_agents=number_slider_4,
    coherence_rad2=coherence_rad_4,
    coherence_fac2=coherence_fac_4,
    Coherence_T2=boolean_toggle_12,
    align_rad2=align_rad_4,
    align_fac2=align_fac_4,
    Alignment_T2=boolean_toggle_13,
    avoid_rad2=avoid_rad_4,
    avoid_fac2=avoid_fac_4,
    Separation_T2=boolean_toggle_14,
    surface=surface_2,
    u_div=resolution_2,
    v_div=resolution_2,
    u_lists=remap_3.Mapped,
    target_factors=remap_4.Clipped,
    coherence_rad=coherence_rad_3,
    coherence_fac=coherence_fac_3,
    Coherence_T=boolean_toggle_9,
    align_rad=align_rad_3,
    align_fac=align_fac_3,
    Alignment_T=boolean_toggle_10,
    avoid_rad=avoid_rad_3,
    avoid_fac=avoid_fac_3,
    Separation_T=boolean_toggle_11,
    rebuild_points=number_slider_7,
    rebuild_degree=number_slider_6,
    Rebuild_T=boolean_toggle_8)  # -> out, list_pts, goals, paths, sub_agents; inputs seeed: Int32, time_1: Int32, time_2: Int32, num_new_agents: Int32, Coherence_T2: Boolean, Alignment_T2: Boolean, Separation_T2: Boolean, surface: Surface, u_div: Int32, v_div: Int32, u_lists: tree, target_factors: tree, Coherence_T: Boolean, Alignment_T: Boolean, Separation_T: Boolean, rebuild_points: Int32, rebuild_degree: Int32, Rebuild_T: Boolean; disabled
# ---------- ghpython_script_4: Python ----------
import Rhino.Geometry as rg
import ghpythonlib.treehelpers as th
import math

#hellooo
tolerance = 0.001

#this class is focused on the properties and methods of each instance MAS (multi agent system)
class Environment(object):
    
    def __init__(self, u_div, v_div, surface, agents_list = [], repulsion_thresh = 0.5):
        #self.num_agents = 0    #total number of agents
        self.u_div = u_div
        self.v_div = v_div
        self.surface = surface
        self.agents = []

        self.finished_agents = []
        if len(agents_list) > 0:
            self.agents = agents_list

        self.repulsion_thresh = repulsion_thresh
        self.strongAgents = self.GenerateStrongAgentsList()
        

    #this function takes the u values and transform them into agents
    def populate_agents(self, u_vals, target_factors):
        # instantiatie all agents
        for u, t_fac in zip(u_vals,target_factors) :
            self.agents.append(Agent(u, 0, 0, t_fac / self.v_div,t_fac, self.surface)) 

    def update_agents_pos (self, coherence_rad, coherence_fac, align_rad, align_fac, avoid_rad, avoid_fac, Coherence_T, Alignment_T, Separation_T, repulsion_rad = 0, repulsion_fac = 0, Repulsion_T = False):
        # generate the new position of each agent by calculating their new direction and velocity
        #for each agent apply all the functions on it given the required factors for each parameter
        #if the agent arrives we pop out this agent from the list and add it to the finished list 
        # add a function that if everything is arrived just stop 
        #list of all effects so as not to change the behaviour of the agents during update
        effects_list = []
        for agent in self.agents:
            #always add a positive up vector in the beginning
            effects_vector = rg.Vector2d(0,agent.up_force)            
            
            if Repulsion_T and agent.unitized_upForce > self.repulsion_thresh: #we can apply repulsion
                print ("kharaaa")
                repulsion_vector = agent.Separation(repulsion_rad, self.strongAgents, self.u_div, self.v_div, repulsion_fac)
                if repulsion_vector.X > 0 and repulsion_vector.Y > 0:
                    effects_vector += repulsion_vector
                    effects_list.append(agent.UnitizeEffect(self.u_div, self.v_div, effects_vector))
                    print ("we are here")
                    continue

            if Coherence_T:
                coherence_vector = agent.Coherence(coherence_rad, self.agents, self.u_div, self.v_div, coherence_fac)
                effects_vector += coherence_vector

            if Alignment_T:
                alignment_vector = agent.Alignment(align_rad, self.agents, self.u_div, self.v_div, align_fac)
                effects_vector += alignment_vector

            if Separation_T:
                separation_vector = agent.Separation(avoid_rad, self.agents, self.u_div, self.v_div, avoid_fac)
                effects_vector += separation_vector

                #sum all of the vectors + the actual du and dv of the agent + unitize --> do nothing but add them to the effects_list
                effects_list.append(agent.AddTotalEffect(self.u_div, self.v_div, effects_vector))


        temp_removed_agents = []
        for agent, effect in zip(self.agents, effects_list):
            agent.AgentStep(effect)
            if agent.arrived:
                temp_removed_agents.append(agent)
       
        for fin_agent in temp_removed_agents:
            self.finished_agents.append(fin_agent)
            self.agents.remove(fin_agent)


        #pending: function that ensures all agents have reached the final destination
    #checks all agents in the environment if they are strong or not based on their direction vector
    def GenerateStrongAgentsList(self):
        strong_Agents_list = []
        for agent in self.agents:
            if agent.unitized_upForce > self.repulsion_thresh:
                strong_Agents_list.append(agent)
        return strong_Agents_list


class Agent(object):

#the main parameters are poisiton on the surface, velocity in both directions 
    def __init__(self, u, v, du, dv,unit_dv, surface):
        self.u = u
        self.v = v
        self.surface = surface
        self.position = self.surface.PointAt(self.u, self.v) ##for the surface

        #save the dv as the constant upward vector for the current agent
        self.up_force = dv
        self.unitized_upForce = unit_dv #unitized value of the up vector
        #print (self.unitized_upForce)
        self.du = du
        self.dv = dv
        self.pts = []
        self.pts.append(self.position)
        self.arrived = False
        

    def Coherence(self, radius, agents, u_div, v_div, coh_fac):
        # agents : list of agents in the environment
        # fx for Coherence
        """ 
        --- within the specified radius we need to iterate over each agent apart from ours and do the following:
        -> calculate the center (u,v) of the surrounding by 2 getting the average over all of the points 
        -> this shall be the point to aim at from the agent position 
        -> unitize the produced vector 
        """
        #coherence_distance = ra
        centerU= 0
        centerV= 0
        num_neighbors = 0
        for agent in agents:
            if not agent == self:
                dist = self.position.DistanceTo(agent.position)
                if dist<= radius:
                    num_neighbors +=1
                    centerU += agent.u
                    centerV += agent.v

        #get the average vector
        if  num_neighbors > 0:
            centerU /= num_neighbors
            centerV /= num_neighbors

            #unitize the product vector of the coherence  
            cohesion_unit_vect = rg.Vector2d(centerU-self.u, centerV-self.v)
            cohesion_unit_vect = self.UnitizeEffect(u_div, v_div,cohesion_unit_vect) * coh_fac

            return cohesion_unit_vect

        else:
            return rg.Vector2d(0,0)

    # fx for Alignment (match velocity)
    def Alignment(self, radius, agents, u_div, v_div, align_fac):
        
        """within the specified radius we need to iterate over each agent apart from ours and do the following:
        -> calculate the average velocity [adding all the velocities and dividing the result with the total number of neighbors]
        """
        #radius = 10

        average_du = 0
        average_dv = 0
        num_neighbors = 0

        for agent in agents:
            if not agent == self:
                dist = self.position.DistanceTo(agent.position)
                if dist <= radius:
                    num_neighbors +=1
                    average_du += agent.du
                    average_dv += agent.dv
        
        if  num_neighbors > 0:
            average_du /= num_neighbors
            average_dv /= num_neighbors

            align_unit_vect = rg.Vector2d(average_du, average_dv)
            align_unit_vect = self.UnitizeEffect(u_div, v_div,align_unit_vect) * align_fac

            return align_unit_vect

        else:
            return rg.Vector2d(0,0)
    
    #pending: trial
    def Separation (self, radius, agents, u_div, v_div, avoid_fac):
        # fx for Separation
        """within the specified radius we need to iterate over each agent apart from ours and do the following:
        -> define how close two agents can be [min distance before collision]
        -> define a new direction [maybe reversed]
        """
        move_dU= 0
        move_dV= 0

        min_dist = 1000000
        closest_agent = self

        for agent in agents:
            if not agent == self:
                dist = self.position.DistanceTo(agent.position)
                if dist<= radius:
                    if dist < min_dist:
                        min_dist = dist
                        closest_agent = agent
        if closest_agent != self:
            move_dU += self.u - closest_agent.u
            move_dV += self.v - closest_agent.v

            avoid_unit_vect = rg.Vector2d(move_dU, move_dV)
            avoid_unit_vect = self.UnitizeEffect(u_div, v_div,avoid_unit_vect) * avoid_fac
            return avoid_unit_vect

        else:
            return rg.Vector2d(0,0)
    

    #checks the boundaries and for end of life of agent
    def withinBounds (self): 
        """
        ->check if (0<=u,v<=1)
        ->if not mirror u (*-1)
        ->
        """
        if abs(0.5 - self.u) >= 0.5 :       
            if self.u < 0:
                self.u = 0

            elif self.u > 1:
                self.u = 1

            self.du *= -1
            
        #we check if it has arrived (finished)  
        if self.v >= 1:
            self.v = 1
            self.arrived = True

    
    
    # pending: fx for limiting speed?

    # helper fxs:7

    # add the effect to the new veloctity vector of the agent that will be added later to its current velocity
    # as an input is the vector of a certain effect, the function does the following
    # --> unitize the vector
    # --> multiply by the effect value 
    # --> add this value to sum of new velocity vector 
    # --> this fx is called in each effect fx 
    def UnitizeEffect(self, u_div, v_div, vector_2b_unitised):           
        vector_2b_unitised.Unitize()
        vector_2b_unitised = rg.Vector2d(vector_2b_unitised.X/u_div, vector_2b_unitised.Y/v_div)
        return vector_2b_unitised

    # adds the new velocty vector to the current velocity vector and unitizes it 
    def AddTotalEffect(self, u_div, v_div, effects_vector):
        effects_vector += rg.Vector2d(self.du, self.dv)
        return self.UnitizeEffect(u_div, v_div, effects_vector)

    # update the agent's params and move it one step forward while checking its elgibility for movement
    def AgentStep(self, effects_vector):

        self.du = effects_vector.X
        self.dv = effects_vector.Y
        self.u += self.du
        self.v += self.dv
        #checks the agent compliance with boundary
        self.withinBounds()

        self.pts.append(self.surface.PointAt(self.u, self.v))



    #hello Eleniiiii
    #hello Ahmed
######################################################################################################################################
# the execution function:
# given the list of different points to initiate the agents do:
# a for loop iterating over the lists, instantiating each agent in the list then instantaiting an environment given all these agents
# afterwards, for each environment do some action till a certain time t
# afterwards instantiate a bigger environment containing all agents and giving it a certain value for all parameters.

#Swap UV directions of surface if needed
corner_b= surface.PointAt(1,0)
corner_d= surface.PointAt(0,1)

if corner_b.Z > corner_d.Z:
    surface.Transpose(True)

all_agents = []
#strt with first phase (t1)
initial_env_list = []
u_lists = th.tree_to_list(u_lists)
target_factors = th.tree_to_list(target_factors)
for u_list, t_factor in zip(u_lists, target_factors):
    #instantiate an instance of the environment:
    new_env = Environment(u_div, v_div, surface)
    new_env.populate_agents(u_list, t_factor)
    #add all agents to the big list
    all_agents.extend(new_env.agents)
    initial_env_list.append(new_env)


#depending on the input timestep we update the agents
for t in range(time_1):
    for env in initial_env_list:
        env.update_agents_pos(coherence_rad, coherence_fac, align_rad, align_fac, avoid_rad, avoid_fac, Coherence_T, Alignment_T, Separation_T)

#Create a new env contaiing all agents
combined_env = Environment(u_div, v_div, surface, all_agents)

for t in range(time_2):
    combined_env.update_agents_pos(coherence_rad2, coherence_fac2, align_rad2, align_fac2, avoid_rad2, avoid_fac2, Coherence_T2, Alignment_T2, Separation_T2, repulsion_rad2, repulsion_fac2, Repulsion_T2)

list_pts = []
paths=[]
#for env in initial_env_list:
#   list_pts.append([agent.pts for agent in env.agents])
#    for agent in env.agents:
#        path = surface.InterpolatedCurveOnSurface(agent.pts,tolerance)
#       paths.append(path)
# 
for agent in all_agents:
    path = surface.InterpolatedCurveOnSurface(agent.pts,tolerance) 
    paths.append(path)  

paths = th.list_to_tree(paths)
list_pts = th.list_to_tree(list_pts)
# ---------- end ghpython_script_4 ----------
geometry_10 = Geometry(ghpython_script_4.list_pts)  # disabled
geo_3 = Geometry(ghpython_script_4.sub_agents)  # disabled
geo_4 = Geometry(ghpython_script_4.goals)  # disabled
panel_6 = Panel(ghpython_script_4.out)  # disabled
curve_3 = Curve(ghpython_script_4.paths)  # disabled
end_2 = EndPoints(Curve=curve_3)  # -> Start, End; disabled
geo_5 = Geometry(end_2.End)  # disabled
data_2 = Data(end_2.Start)  # disabled
vec2pt_2 = Vector2Pt(PointA=xy_2, PointB=data_2, Unitize=False)  # -> Vector, Length; disabled
move_2 = Move(Motion=vec2pt_2.Vector)  # -> Geometry, Transform; disabled
extrcrv_2 = ExtrudeAlong(Base=move_2.Geometry, Curve=curve_3)  # disabled
