# Grasshopper definition 221217_Substructure_Diagrams.ghx (Grasshopper 1.0.7)
# plug-ins: Pufferfish

# ---- group: MAS Multi-Agent-System Generation
dom = ConstructDomain(DomainStart=Slider(0.18, range=0..1), DomainEnd=Slider(0.3, range=0..1))
random = Random(Range=dom, Number=Slider(4, range=0..10), Seed=Slider(2, range=0..10))

# ---- group: MAS Multi-Agent-System Generation / num. agents in each cluster
genes = GenePool(Decimals=0, Maximum=20, Minimum=0, Value=[7, 7, 7, 6])

# ---- group: MAS Multi-Agent-System Generation / No. Clusters
number_of_clusters = Panel("4")

# ---- group: MAS Multi-Agent-System Generation
range = Range(Domain=Domain(0, 1), Steps=genes)
bang = ExplodeTree(Data=range)  # -> Branch0, Branch1, Branch2, Branch3

# ---- group: MAS Multi-Agent-System Generation / Target factor
graph = GraphMapper(bang.Branch1, x0=0, x1=1, y0=0, y1=1, Ox=0.5098851919, Oy=1, Px=1, Py=0.1483525634, container_name="Parabola")
graph_2 = GraphMapper(bang.Branch3, x0=0, x1=1, y0=0, y1=1, Cx=0.5553172827, Cy=0.8992747664, container_name="Conic")
graph_3 = GraphMapper(bang.Branch0, x0=0, x1=1, y0=0, y1=1, container_name="Bezier", cpx=[0, 0.5243950486, 0.3017984927, 1], cpy=[0, 0, 1, 1])
graph_4 = GraphMapper(
    bang.Branch2,
    x0=0,
    x1=1,
    y0=0,
    y1=1,
    container_name="Sinc",
    Equation_X0=0.4748720825,
    Equation_X1=1,
    Equation_Y0=0.9733063579,
    Equation_Y1=0.1758453846)
merge = Merge(Data1=graph_3, Data2=graph, Data3=graph_4, Data4=graph_2)
bnd = Bounds(Numbers=merge)
remap = RemapNumbers(Value=merge, Source=bnd, Target=Domain(0, 1))  # -> Mapped, Clipped

# ---- group: MAS Multi-Agent-System Generation / surface Candidates
geometry = Geometry(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)
geometry_2 = Geometry(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)
geometry_3 = Geometry(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)
geometry_4 = Geometry(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)
geometry_5 = Geometry(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)

# ----
srf = Surface(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)

# ---- group: MAS Multi-Agent-System Generation / Main Function
shift_factor_down = Slider(0.3, range=0.001..0.88)
number_slider = Slider(10, range=10..20)
shift_factor_up = Slider(0.1, range=0.001..0.88)
sub_goal_rad = Slider(20, range=0..100)
sub_goal_fac = Slider(7, range=0..10)

number_slider_2 = Slider(3, range=1..11)
number_slider_3 = Slider(22, range=0..100)
rebuild_toggle = BooleanToggle(True)

t2 = Slider(0, range=0..800)
t1 = Slider(11, range=0..500)

coherence_rad = Slider(13, range=0..100)
avoid_rad = Slider(20, range=0..100)
coherence_fac = Slider(0.2, range=0..3)
align_rad = Slider(10, range=0..100)
align_fac = Slider(0.8, range=0..1)
avoid_fac = Slider(1.5, range=0..3)
coherence_2_toggle = BooleanToggle(False)
separation2_toggle = BooleanToggle(False)
alignment_2_toggle = BooleanToggle(False)

coherence_rad_2 = Slider(58, range=0..100)
coherence_fac_2 = Slider(1, range=0..3)
align_rad_2 = Slider(46, range=0..100)
align_fac_2 = Slider(0.7, range=0..1)
avoid_rad_2 = Slider(10, range=0..100)
avoid_fac_2 = Slider(0.7, range=0..3)
separation_toggle = BooleanToggle(False)
coherence_toggle = BooleanToggle(False)
alignment_toggle = BooleanToggle(False)

# ----
number_slider_4 = Slider(12, range=1..20)
range_2 = Range(Domain=Domain(0, 1), Steps=expr("x-1", number_slider_4))
graph_5 = GraphMapper(
    reverse(range_2),
    x0=0,
    x1=1,
    y0=0,
    y1=1,
    container_name="Bezier",
    cpx=[0, 0.4317768514, 0.5574278831, 1],
    cpy=[0, 0.03870689869, 0.949685812, 1])

min_radius = Slider(2.168, range=0..10)

brep = Brep(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)
md_slider = MDSlider(SliderMode=0, slider_value=Point(0, 0, 0.5), x_domain=Domain(0, 1), y_domain=Domain(0, 1), z_domain=Domain(0, 1))

# ---- group: MAS Multi-Agent-System Generation
# Multi Agent System
genes_2 = GenePool(Decimals=2, Maximum=1, Minimum=0, Value=[0, 0.28, 0.61, 0.87])
ghpython_script = GhPythonScript(centers=genes_2, extend=random)  # -> out, intervals; inputs centers: list, extend: list
# ---------- ghpython_script: Python ----------
import math
import ghpythonlib.treehelpers as th


intervals=[]

for center, ext in zip(centers, extend):
    inter_from = center- ext
    inter_to = center + ext
    print type(inter_from)
    if inter_from < 0 : 
        inter_from =0
    if inter_to >1 :
        inter_to =1
    
    intervals.append([inter_from, inter_to])

intervals = th.list_to_tree(intervals)
# ---------- end ghpython_script ----------
# C:\Users\ahmed\OneDrive - Politecnico di Milano\ETH Zurich\MAS Dfab\P4_Mini Project\3d_printing_teamwork\Design_Substructure\221215_Substructure_khara_working.py
panel = Panel("C:\Users\eleni\Documents\GitHub\3d_printing_teamwork\Design_Substructure\221215_Substructure_khara_working.py")
dispatch = Dispatch(List=ghpython_script.intervals, DispatchPattern=[True, False])  # -> ListA, ListB
dom_2 = ConstructDomain(DomainStart=dispatch.ListA, DomainEnd=dispatch.ListB)
read_file = ReadFile(File=panel, PerLineParse=False)
# Surface Generation
surface = Surface(reparameterize(srf))

# ---- group: MAS Multi-Agent-System Generation / u_pos_for_initial_agents
graph_6 = GraphMapper(bang.Branch1, x0=0, x1=1, y0=0, y1=1, Ox=0.4780313373, Oy=1, Px=1, Py=0.1196134686, container_name="Parabola")
graph_7 = GraphMapper(bang.Branch3, x0=0, x1=1, y0=0, y1=1, Cx=0.4874807298, Cy=0.7769420147, container_name="Conic")
graph_8 = GraphMapper(bang.Branch0, x0=0, x1=1, y0=0, y1=1, container_name="Bezier", cpx=[0, 0.5243950486, 0.08604718745, 1], cpy=[0, 0, 1, 1])
graph_9 = GraphMapper(
    bang.Branch2,
    x0=0,
    x1=1,
    y0=0,
    y1=1,
    container_name="Sinc",
    Equation_X0=0.4748720825,
    Equation_X1=0.9382023215,
    Equation_Y0=0.9733063579,
    Equation_Y1=0.2215337157)
merge_2 = Merge(Data1=graph_8, Data2=graph_6, Data3=graph_9, Data4=graph_7)
bnd_2 = Bounds(Numbers=merge_2)
sort = SortList(Keys=merge_2)  # -> Keys, ValuesA
remap_2 = RemapNumbers(Value=sort.Keys, Source=bnd_2, Target=dom_2)  # -> Mapped, Clipped

# ---- group: MAS Multi-Agent-System Generation / Main Function
resolution = Slider(514, range=0..1000)
ghpython_script_2 = GhPythonScript(
    seeed=Slider(2, range=0..10),
    time_1=t1,
    time_2=t2,
    shift_up_factor=shift_factor_up,
    shift_down_factor=shift_factor_down,
    sub_goal_rad=sub_goal_rad,
    sub_goal_fac=sub_goal_fac,
    num_new_agents=number_slider,
    coherence_rad2=coherence_rad,
    coherence_fac2=coherence_fac,
    Coherence_T2=coherence_2_toggle,
    align_rad2=align_rad,
    align_fac2=align_fac,
    Alignment_T2=alignment_2_toggle,
    avoid_rad2=avoid_rad,
    avoid_fac2=avoid_fac,
    Separation_T2=separation2_toggle,
    surface=surface,
    u_div=resolution,
    v_div=resolution,
    u_lists=remap_2.Mapped,
    target_factors=remap.Clipped,
    coherence_rad=coherence_rad_2,
    coherence_fac=coherence_fac_2,
    Coherence_T=coherence_toggle,
    align_rad=align_rad_2,
    align_fac=align_fac_2,
    Alignment_T=alignment_toggle,
    avoid_rad=avoid_rad_2,
    avoid_fac=avoid_fac_2,
    Separation_T=separation_toggle,
    rebuild_points=number_slider_3,
    rebuild_degree=number_slider_2,
    Rebuild_T=rebuild_toggle)  # -> out, st_pts, goals, main_paths, up_factors, sec_paths; inputs seeed: Int32, time_1: Int32, time_2: Int32, num_new_agents: Int32, Coherence_T2: Boolean, Alignment_T2: Boolean, Separation_T2: Boolean, surface: Surface, u_div: Int32, v_div: Int32, u_lists: tree, target_factors: tree, Coherence_T: Boolean, Alignment_T: Boolean, Separation_T: Boolean, rebuild_points: Int32, rebuild_degree: Int32, Rebuild_T: Boolean
# ---------- ghpython_script_2: Python ----------
import Rhino.Geometry as rg
import ghpythonlib.treehelpers as th
import random
import math
from copy import deepcopy

#hellooo
random.seed(seeed)
tolerance = 0.001

#this class is focused on the properties and methods of each instance MAS (multi agent system)
class Environment(object):
    
    def __init__(self, u_div, v_div, surface, agents_list = [], repulsion_thresh = 0.5):
        #self.num_agents = 0    #total number of agents
        self.u_div = u_div
        self.v_div = v_div
        self.surface = surface
        self.agents = []
        self.main_agents = []
        self.sub_agents = []

        self.finished_agents = []
        if len(agents_list) > 0:
            self.agents = agents_list
            self.main_agents = [agent for agent in agents_list]
        self.repulsion_thresh = repulsion_thresh
        self.strong_agents = self.GenerateStrongAgentsList()

    #this function takes the u values and transform them into agents
    def populate_agents(self, u_vals, target_factors):
        # instantiatie all agents
        for u, t_fac in zip(u_vals,target_factors) :
            self.agents.append(Agent(u, 0, 0, t_fac / self.v_div,t_fac, self.surface)) 

    #generates new agents in the env 
    def populate_sub_agents(self, prev_envs, num_new_agents, shift_up_factor,shift_down_factor, sub_goal_fac):
        #rememeber to add to the full list of agents
        sub_agents = []
        goals=[]
        all_v = []
        for env in prev_envs:
            boundary = env.CalculateBoundaryRegion()
            all_v.append(boundary[-1])
            for i in range(num_new_agents):
                u = Remap(random.random(),0,1, boundary[0], boundary[1])
                v = Remap(random.random(),0,1, boundary[2], boundary[3])
                sub_agents.append(Agent(u,v,0,0,0,self.surface)) #pending !!

        #populate each point separately 
        #get the highest value of v 
        all_v.sort()
        lower_bound_v = all_v[-1]
        lower_bound_v += shift_up_factor 
        upper_bound_v = 1 - shift_down_factor
        for sub_agent in sub_agents:
            sub_agent.isSubAgent = True
            sub_agent.sub_goal_u = random.random()
            sub_agent.sub_goal_v = Remap(random.random(), 0, 1, lower_bound_v, upper_bound_v)
            goals.append(self.surface.PointAt( sub_agent.sub_goal_u, sub_agent.sub_goal_v))
            raw_du = sub_agent.sub_goal_u - sub_agent.u
            raw_dv = sub_agent.sub_goal_v - sub_agent.v
            vector = rg.Vector2d(raw_du, raw_dv)
            unit_vect = sub_agent.UnitizeEffect(self.u_div, self.v_div, vector)
            sub_agent.du = sub_goal_fac * unit_vect.X
            sub_agent.dv = sub_goal_fac * unit_vect.Y
            self.agents.append(sub_agent)
            self.sub_agents.append(sub_agent)
        return goals, [agent.pts for agent in sub_agents]
        
    



    def update_agents_pos (self, coherence_rad=0, coherence_fac=0, align_rad=0, align_fac=0, avoid_rad=0, avoid_fac=0, Coherence_T = False, Alignment_T= False, Separation_T= False, sub_goal_rad = 0, sub_goal_fac = 0):
        # generate the new position of each agent by calculating their new direction and velocity
        #for each agent apply all the functions on it given the required factors for each parameter
        #if the agent arrives we pop out this agent from the list and add it to the finished list 
        # add a function that if everything is arrived just stop 
        #list of all effects so as not to change the behaviour of the agents during update
        effects_list = []
        for agent in self.agents:
            #always add a positive up vector in the beginning
            if agent.isSubAgent:
                agent.UpdateSubAgentProgress(sub_goal_rad, sub_goal_fac, self.u_div, self.v_div)
            effects_vector = rg.Vector2d(agent.right_force,agent.up_force)            

            if Coherence_T:
                coherence_vector = agent.Coherence(coherence_rad, self.agents, self.u_div, self.v_div, coherence_fac)
                effects_vector += coherence_vector

            if Alignment_T:
                alignment_vector = agent.Alignment(align_rad, self.agents, self.u_div, self.v_div, align_fac)
                effects_vector += alignment_vector

            if Separation_T:
                separation_vector = agent.Separation(avoid_rad, self.agents, self.u_div, self.v_div, avoid_fac)
                effects_vector += separation_vector

            #sum all of the vectors + the actual du and dv of the agent + unitize --> do nothing but add them to the effects_list
            effects_list.append(agent.AddTotalEffect(self.u_div, self.v_div, effects_vector))


        temp_removed_agents = []
        for agent, effect in zip(self.agents, effects_list):
            agent.AgentStep(effect)
            if agent.arrived:
                temp_removed_agents.append(agent)
       
        for fin_agent in temp_removed_agents:
            self.finished_agents.append(fin_agent)
            self.agents.remove(fin_agent)


        #pending: function that ensures all agents have reached the final destination
    #checks all agents in the environment if they are strong or not based on their direction vector
    def GenerateStrongAgentsList(self):
        strong_Agents_list = []
        for agent in self.agents:
            if agent.unitized_upForce > self.repulsion_thresh:
                strong_Agents_list.append(agent)
        return strong_Agents_list

    #from an environment detects the minimum and maximum boundary
    def CalculateBoundaryRegion(self):
        all_u = [agent.u for agent in self.agents]
        all_u.sort()

        all_v = [agent.v for agent in self.agents]
        all_v.sort()

        return [all_u[0], all_u[-1],all_v[0], all_v[-1]]
    

            
class Agent(object):

#the main parameters are poisiton on the surface, velocity in both directions 
    def __init__(self, u, v, du, dv,unit_dv, surface):
        self.u = u
        self.v = v
        self.surface = surface
        self.position = self.surface.PointAt(self.u, self.v) ##for the surface

        #save the dv as the constant upward vector for the current agent
        self.up_force = dv

        self.right_force = 0
        self.unitized_upForce = unit_dv #unitized value of the up vector
        #print (self.unitized_upForce)
        self.du = du
        self.dv = dv
        self.pts = []
        self.pts.append(self.position)
        self.arrived = False

        self.isSubAgent = False
        self.sub_goal_u = 0
        self.sub_goal_v = 0

    def Coherence(self, radius, agents, u_div, v_div, coh_fac):
        # agents : list of agents in the environment
        # fx for Coherence
        """ 
        --- within the specified radius we need to iterate over each agent apart from ours and do the following:
        -> calculate the center (u,v) of the surrounding by 2 getting the average over all of the points 
        -> this shall be the point to aim at from the agent position 
        -> unitize the produced vector 
        """
        #coherence_distance = ra
        centerU= 0
        centerV= 0
        num_neighbors = 0
        for agent in agents:
            if not agent == self:
                dist = self.position.DistanceTo(agent.position)
                if dist<= radius:
                    num_neighbors +=1
                    centerU += agent.u
                    centerV += agent.v

        #get the average vector
        if  num_neighbors > 0:
            centerU /= num_neighbors
            centerV /= num_neighbors

            #unitize the product vector of the coherence  
            cohesion_unit_vect = rg.Vector2d(centerU-self.u, centerV-self.v)
            cohesion_unit_vect = self.UnitizeEffect(u_div, v_div,cohesion_unit_vect) * coh_fac

            return cohesion_unit_vect

        else:
            return rg.Vector2d(0,0)

    # fx for Alignment (match velocity)
    def Alignment(self, radius, agents, u_div, v_div, align_fac):
        
        """within the specified radius we need to iterate over each agent apart from ours and do the following:
        -> calculate the average velocity [adding all the velocities and dividing the result with the total number of neighbors]
        """
        #radius = 10

        average_du = 0
        average_dv = 0
        num_neighbors = 0

        for agent in agents:
            if not agent == self:
                dist = self.position.DistanceTo(agent.position)
                if dist <= radius:
                    num_neighbors +=1
                    average_du += agent.du
                    average_dv += agent.dv
        
        if  num_neighbors > 0:
            average_du /= num_neighbors
            average_dv /= num_neighbors

            align_unit_vect = rg.Vector2d(average_du, average_dv)
            align_unit_vect = self.UnitizeEffect(u_div, v_div,align_unit_vect) * align_fac

            return align_unit_vect

        else:
            return rg.Vector2d(0,0)
    
    #pending: trial
    def Separation (self, radius, agents, u_div, v_div, avoid_fac):
        # fx for Separation
        """within the specified radius we need to iterate over each agent apart from ours and do the following:
        -> define how close two agents can be [min distance before collision]
        -> define a new direction [maybe reversed]
        """
        move_dU= 0
        move_dV= 0

        min_dist = 1000000
        closest_agent = self

        for agent in agents:
            if not agent == self:
                dist = self.position.DistanceTo(agent.position)
                if dist<= radius:
                    if dist < min_dist:
                        min_dist = dist
                        closest_agent = agent
        if closest_agent != self:
            move_dU += self.u - closest_agent.u
            move_dV += self.v - closest_agent.v

            avoid_unit_vect = rg.Vector2d(move_dU, move_dV)
            avoid_unit_vect = self.UnitizeEffect(u_div, v_div,avoid_unit_vect) * avoid_fac
            return avoid_unit_vect

        else:
            return rg.Vector2d(0,0)
    

    #checks the boundaries and for end of life of agent
    def withinBounds (self): 
        """
        ->check if (0<=u,v<=1)
        ->if not mirror u (*-1)
        ->
        """
        if abs(0.5 - self.u) >= 0.5 :       
            if self.u < 0:
                self.u = 0

            elif self.u > 1:
                self.u = 1
            self.du*=-1
            #self.right_force *=-1
            #self.arrived=True
            
        #we check if it has arrived (finished)  
        if self.v >= 1:
            self.v = 1
            self.arrived = True

    #update the distance to goal until reaching the radius and then change direction and disable the agent 
    def UpdateSubAgentProgress(self, radius,factor, u_div, v_div):
        #calculate distance to the goal point at certain instant
        raw_du = self.sub_goal_u - self.u
        raw_dv = self.sub_goal_v - self.v
        vector = rg.Vector2d(raw_du, raw_dv)
        distance = vector.Length

        #update the direction unit towards the goal
        unitized_vector = self.UnitizeEffect(u_div, v_div, vector)
        self.right_force = unitized_vector.X * factor
        self.up_force = unitized_vector.Y * factor

        #if the goal was reached, flip the du and right_force (the latter will be contant till the end of the game)
        if distance <= radius:
            self.du *= -1  
            #disable subagent  
            self.isSubAgent = False 
            self.right_force *= -1    
            

        


    
    # pending: fx for limiting speed?

    # helper fxs:7

    # add the effect to the new veloctity vector of the agent that will be added later to its current velocity
    # as an input is the vector of a certain effect, the function does the following
    # --> unitize the vector
    # --> multiply by the effect value 
    # --> add this value to sum of new velocity vector 
    # --> this fx is called in each effect fx 
    def UnitizeEffect(self, u_div, v_div, vector_2b_unitised):           
        vector_2b_unitised.Unitize()
        vector_2b_unitised = rg.Vector2d(vector_2b_unitised.X/u_div, vector_2b_unitised.Y/v_div)
        return vector_2b_unitised

    # adds the new velocty vector to the current velocity vector and unitizes it 
    def AddTotalEffect(self, u_div, v_div, effects_vector):
        effects_vector += rg.Vector2d(self.du, self.dv)
        return self.UnitizeEffect(u_div, v_div, effects_vector)

    # update the agent's params and move it one step forward while checking its elgibility for movement
    def AgentStep(self, effects_vector):

        self.du = effects_vector.X
        self.dv = effects_vector.Y
        
        if self.dv< 0:
            self.dv *=-10
        self.u += self.du
        self.v += self.dv
        print "before", self.v
        #checks the agent compliance with boundary
        self.withinBounds()
        print self.v

        self.pts.append(self.surface.PointAt(self.u, self.v))

class SubGoal(object):

    def __init__(self):
        self.u = 0
        self.v = 0
        self.buffer_Zone = 0
         

    #hello Eleniiiii
    #hello Ahmed
######################################################################################################################################
# the execution function:
# given the list of different points to initiate the agents do:
# a for loop iterating over the lists, instantiating each agent in the list then instantaiting an environment given all these agents
# afterwards, for each environment do some action till a certain time t
# afterwards instantiate a bigger environment containing all agents and giving it a certain value for all parameters.
#helpful functions:
def Remap(value, min, max, new_min, new_max):
    old_range = max - min
    new_range = new_max - new_min
    return (((value - min)* new_range)/ old_range) + new_min


#Swap UV directions of surface if needed
corner_b= surface.PointAt(1,0)
corner_d= surface.PointAt(0,1)

if corner_b.Z > corner_d.Z:
    surface.Transpose(True)

all_agents = []
st_agents=[]
################################strt with first phase (t1)###############################
initial_env_list = []
u_lists = th.tree_to_list(u_lists)
target_factors = th.tree_to_list(target_factors)
for u_list, t_factor in zip(u_lists, target_factors):
    #instantiate an instance of the environment:
    new_env = Environment(u_div, v_div, surface)
    new_env.populate_agents(u_list, t_factor)
    #add all agents to the big list
    all_agents.extend(new_env.agents)
    st_agents.extend(new_env.agents)
    initial_env_list.append(new_env)

st_pts =[]
for ag in st_agents:
    st_pts.append(ag.position)
#st_agents = th.list_to_tree(st_agents)
pts_list = []
#depending on the input timestep we update the agents
for t in range(time_1):
    for env in initial_env_list:
        env.update_agents_pos(coherence_rad, coherence_fac, align_rad, align_fac, avoid_rad, avoid_fac, Coherence_T, Alignment_T, Separation_T)

###############################second phase (t2)#########################################
#Create a new env containing all agents

combined_env = Environment(u_div, v_div, surface, all_agents)
#add the new sub_agents

goals, sub_agents = combined_env.populate_sub_agents(initial_env_list, num_new_agents, shift_up_factor, shift_down_factor, sub_goal_fac)

for t in range(time_2):
    combined_env.update_agents_pos(coherence_rad2, coherence_fac2, align_rad2, align_fac2, avoid_rad2, avoid_fac2, Coherence_T2, Alignment_T2, Separation_T2, sub_goal_rad, sub_goal_fac)

list_pts = []
main_paths = []
sec_paths = []
up_factors = []

if time_1>0:
    for agent in combined_env.main_agents:
        #if agent.right_force != 0:
        path = surface.InterpolatedCurveOnSurface(agent.pts,tolerance)
        if Rebuild_T:
            path= path.Rebuild(rebuild_points, rebuild_degree, True)
            path.Domain = rg.Interval(0.0, 1.0)
            main_paths.append(path)  
            up_factors.append(agent.unitized_upForce)
    main_paths = th.list_to_tree(main_paths)
if time_2>0:
    for agent in combined_env.sub_agents:
        path = surface.InterpolatedCurveOnSurface(agent.pts,tolerance) 
        if Rebuild_T:
            path= path.Rebuild(rebuild_points, rebuild_degree, True)
            path.Domain = rg.Interval(0.0, 1.0)
            sec_paths.append(path)
    sec_paths = th.list_to_tree(sec_paths)

#sub_agents = th.list_to_tree(sub_agents)


up_factors = th.list_to_tree(up_factors)
list_pts = th.list_to_tree(list_pts)
# ---------- end ghpython_script_2 ----------

# ---- group: MAS Multi-Agent-System Generation (continued)
panel_2 = Panel(ghpython_script_2.out)
geo = Geometry(ghpython_script_2.goals)

# ---- group: MAS Multi-Agent-System Generation / Main Agents
up_factors = Data(ghpython_script_2.up_factors)
curve = Curve(ghpython_script_2.main_paths)

# ---- group: MAS Multi-Agent-System Generation / Sub Agents
curve_2 = Curve(ghpython_script_2.sec_paths)

# ----
# Surface
# Surface
colour_swatch = ColourSwatch(SwatchColor=RGB(255, 255, 255))
custom_preview = CustomPreview(Geometry=surface, Material=colour_swatch)

panel_3 = Panel(up_factors)

# ----
# Starting_position
number_slider_5 = Slider(2, range=0..10)
geometry_6 = Geometry(ghpython_script_2.st_pts)
sphere = Sphere(Base=geometry_6, Radius=number_slider_5)
custom_preview_2 = CustomPreview(Geometry=sphere, Material=ColourSwatch(SwatchColor=RGB(189, 72, 0)))

# ----
# Pipes- Sub Agents
number_slider_6 = Slider(1.5, range=0..10)
pipe = Pipe(Curve=curve_2, Radius=number_slider_6, Caps=1)  # -> flatten(Pipe)

# ----
# Main Paths
number_slider_7 = Slider(2, range=0..10)
list = ValueList({"None": "", "Dot": "0.1 1.0", "Dash": "1.0", "DashDot": "1.0 1.0 0.1 1.0"}, selected="None")
curve_display = CSharpScript(Curve=curve, Width=number_slider_7, Colour=ColourSwatch(SwatchColor=RGB(50, 85, 153)), Dash=list)  # inputs Curve: Curve, Width: Int32, Colour: Color, Dash: String
# ---------- curve_display: C# ----------
    if (Curve == null) return;
    if (Width <= 0) return;

    double[] pattern = ParseDashPattern(Dash);
    IEnumerable<Curve> segments = ApplyDashPattern(Curve, pattern);

    _clip = BoundingBox.Union(_clip, Curve.GetBoundingBox(false));
    foreach (Curve segment in segments)
    {
      _curves.Add(segment);
      _colors.Add(Colour);
      _widths.Add(Width);
    }
# ---------- curve_display: C# additional code ----------
  /// <summary>
  /// Parse a dash pattern.
  /// </summary>
  /// <param name="pattern">Pattern to parse.</param>
  /// <returns>Array of dashes and gaps.</returns>
  private double[] ParseDashPattern(string pattern)
  {
    if (string.IsNullOrWhiteSpace(pattern))
      return null;

    string[] fragments = pattern.Split(new char[] {' '});
    if (fragments == null || fragments.Length == 0)
      return null;

    double[] values = new double[fragments.Length];
    for (int i = 0; i < fragments.Length; i++)
    {
      double v;
      if (!double.TryParse(fragments[i], out v))
        throw new Exception(fragments[i] + " is a not a valid number.");

      if (v <= 0.0)
        throw new Exception("Dashes or gaps must have a strictly positive length.");

      values[i] = v;
    }

    return values;
  }
  /// <summary>
  /// Apply a dash+gap pattern to a curve.
  /// </summary>
  private IEnumerable<Curve> ApplyDashPattern(Curve curve, double[] pattern)
  {
    if (pattern == null || pattern.Length == 0)
      return new Curve[] { curve };

    double curveLength = curve.GetLength();
    List<Curve> dashes = new List<Curve>();

    double offset0 = 0.0;
    int index = 0;
    while(true)
    {
      // Get the current dash length.
      double dashLength = pattern[index++];
      if (index >= pattern.Length)
        index = 0;

      // Compute the offset of the current dash from the curve start.
      double offset1 = offset0 + dashLength;
      if (offset1 > curveLength)
        offset1 = curveLength;

      // Solve the curve parameters at the current dash start and end.
      double t0, t1;
      curve.LengthParameter(offset0, out t0);
      curve.LengthParameter(offset1, out t1);

      Curve dash = curve.Trim(t0, t1);
      if (dash != null)
        dashes.Add(dash);

      // Get the current gap length.
      double gapLength = pattern[index++];
      if (index >= pattern.Length)
        index = 0;

      // Set the start of the next dash to be the end of the current
      // dash + the length of the adjacent gap.
      offset0 = offset1 + gapLength;

      // Abort when we've reached the end of the curve.
      if (offset0 >= curveLength)
        break;
    }

    return dashes;
  }

  private BoundingBox _clip;
  private readonly List<Curve> _curves = new List<Curve>();
  private readonly List<Color> _colors = new List<Color>();
  private readonly List<int> _widths = new List<int>();

  /// <summary>
  /// This method will be called once every solution, before any calls to RunScript.
  /// </summary>
  public override void BeforeRunScript()
  {
    _clip = BoundingBox.Empty;
    _curves.Clear();
    _colors.Clear();
    _widths.Clear();
  }

  /// <summary>
  /// Return a BoundingBox that contains all the geometry you are about to draw.
  /// </summary>
  public override BoundingBox ClippingBox
  {
    get { return _clip; }
  }
  /// <summary>
  /// Draw all wires and points in this method.
  /// </summary>
  public override void DrawViewportWires(IGH_PreviewArgs args)
  {
    for (int i = 0; i < _curves.Count; i++)
      args.Display.DrawCurve(_curves[i], _colors[i], _widths[i]);
  }
# ---------- end curve_display ----------

# ----
# Pipes- Main Agents
python = GhPythonScript(
    paths_main=curve,
    count=number_slider_4,
    GM_fac_rad=graph_5,
    radius_fac=up_factors,
    max_radius=Slider(10, range=0..10),
    min_radius=min_radius)  # -> out, a; inputs paths_main: list of Curve, count: Int32, GM_fac_rad: list, radius_fac: list
# ---------- python: Python ----------
import Rhino.Geometry as rg
import ghpythonlib
import math

#for main pipes:

def SetMainPipes(paths, count, max_radius, min_radius, radius_fac, GM_fac_rad):
    #iterate over all paths  
    roots = []
    for i, path in enumerate(paths):
        curves = []
        #divide by count
        params = path.DivideByCount(count-1, True)
        for j, param in enumerate(params):
            #get the 
            center_pt = path.PointAt(param)
            center_plane = rg.Plane(center_pt, rg.Vector3d.XAxis, rg.Vector3d.YAxis)
            #print  radius_fac[i]
            circle = rg.Circle(center_pt, min_radius + (max_radius - min_radius) * radius_fac[i] * GM_fac_rad[j])
            curves.append(circle.ToNurbsCurve())
        loft = rg.Brep.CreateFromLoft(curves, rg.Point3d.Unset,rg.Point3d.Unset,rg.LoftType(1),False)
        print loft[0]
        roots.append(loft[0])
    return roots


a = SetMainPipes(paths_main, count, max_radius, min_radius, radius_fac, GM_fac_rad)
# ---------- end python ----------
panel_4 = Panel(graph_5)

# ---- group: PIpes - Main Agents
cap_holes = CapHoles(Brep=python.a)

# ---- group: Pipes Sub- Agents
brep_2 = Brep(pipe)

# ----
# Sec Paths
number_slider_8 = Slider(2, range=0..10)
list_2 = ValueList({"None": "", "Dot": "0.1 1.0", "Dash": "1.0", "DashDot": "1.0 1.0 0.1 1.0"}, selected="Dash")
curve_display_2 = CSharpScript(Curve=curve_2, Width=number_slider_8, Colour=ColourSwatch(SwatchColor=RGB(50, 85, 153)), Dash=list_2)  # inputs Curve: Curve, Width: Int32, Colour: Color, Dash: String; same code as curve_display

offset = OffsetSurface(Surface=surface, Distance=number_slider_6, Retrim=True)
offsrf = OffsetSurface(Surface=surface, Distance=number_slider_6, BothSides=Slider(-0.5, range=-10..10), CreateSolid=True)
evalsrf = EvaluateSurface(Surface=offset, Point=md_slider)  # -> Point, Normal, UDirection, VDirection, Frame
xy = XYPlane(Origin=evalsrf.Point)
deconstruct = Deconstruct(Point=evalsrf.Point)  # -> XComponent, YComponent, ZComponent
plntrimsrf = PlaneTrimSurface(Surface=brep, Plane=xy, Flip=False)  # -> Trimmed, Intersected
negative = Negative(Value=deconstruct.ZComponent)
geo_2 = Geometry(plntrimsrf.Trimmed)
unit_z = UnitZ(Factor=negative)
move = Move(Geometry=geo_2, Motion=unit_z)  # -> Geometry, Transform
cap_holes_2 = CapHoles(Brep=move.Geometry)
# Surface Generation
brep_3 = Brep(cap_holes_2)
merge_3 = Merge(Data1=brep_3, Data2=cap_holes)  # -> flatten(Result)
panel_5 = Panel(brep_2)
