# Grasshopper definition 221213_Substructure.ghx (Grasshopper 1.0.7)
# plug-ins: Kangaroo2 Components

# ---- group: No. Clusters
number_of_clusters = Panel("4")

# ---- group: num. agents in each cluster
genes = GenePool(Decimals=0, Maximum=20, Minimum=0, Value=[4, 8, 5, 9])

# ----
genes_2 = GenePool(Decimals=2, Maximum=1, Minimum=0, Value=[0.24, 0.49, 0.7, 0.82])
dom = ConstructDomain(DomainStart=Slider(0.1, range=0..0.1), DomainEnd=Slider(0.3, range=0..1))
random = Random(Range=dom, Number=Slider(4, range=0..10), Seed=Slider(5, range=0..10))
range = Range(Domain=Domain(0, 1), Steps=genes)
bang = ExplodeTree(Data=range)  # -> Branch0, Branch1, Branch2, Branch3
ghpython_script = GhPythonScript(centers=genes_2, extend=random)  # -> out, intervals; inputs centers: list, extend: list
# ---------- ghpython_script: Python ----------
import math
import ghpythonlib.treehelpers as th


intervals=[]

for center, ext in zip(centers, extend):
    inter_from = center- ext
    inter_to = center + ext
    if inter_from < 0 : 
        inter_from =0
    if inter_to >1 :
        inter_to =1
    
    intervals.append([inter_from, inter_to])

intervals = th.list_to_tree(intervals)
# ---------- end ghpython_script ----------
graph = GraphMapper(bang.Branch0, x0=0, x1=1, y0=0, y1=1, container_name="Bezier", cpx=[0, 0.5243950486, 0.4586946666, 1], cpy=[0, 0, 1, 1])
graph_2 = GraphMapper(
    bang.Branch2,
    x0=0,
    x1=1,
    y0=0,
    y1=1,
    container_name="Sinc",
    Equation_X0=0.4748720825,
    Equation_X1=0.8085743189,
    Equation_Y0=0.9733063579,
    Equation_Y1=0.05741548538)
graph_3 = GraphMapper(bang.Branch3, x0=0, x1=1, y0=0, y1=1, Cx=0.4874807298, Cy=0.7769420147, container_name="Conic")

# ---- group: Target factor
graph_4 = GraphMapper(bang.Branch0, x0=0, x1=1, y0=0, y1=1, container_name="Bezier", cpx=[0, 0.5243950486, 0.4586946666, 1], cpy=[0, 0, 1, 1])
graph_5 = GraphMapper(
    bang.Branch2,
    x0=0,
    x1=1,
    y0=0,
    y1=1,
    container_name="Sinc",
    Equation_X0=0.4748720825,
    Equation_X1=0.8085743189,
    Equation_Y0=0.9733063579,
    Equation_Y1=0.05741548538)
graph_6 = GraphMapper(bang.Branch3, x0=0, x1=1, y0=0, y1=1, Cx=0.4874807298, Cy=0.7769420147, container_name="Conic")
graph_7 = GraphMapper(bang.Branch1, x0=0, x1=1, y0=0, y1=1, Ox=0.4780313373, Oy=1, Px=1, Py=0.1196134686, container_name="Parabola")
merge = Merge(Data1=graph_4, Data2=graph_7, Data3=graph_5, Data4=graph_6)
bnd = Bounds(Numbers=merge)
remap = RemapNumbers(Value=merge, Source=bnd, Target=Domain(0, 1))  # -> Mapped, Clipped

# ----
graph_8 = GraphMapper(bang.Branch1, x0=0, x1=1, y0=0, y1=1, Ox=0.4780313373, Oy=1, Px=1, Py=0.1196134686, container_name="Parabola")
dispatch = Dispatch(List=ghpython_script.intervals, DispatchPattern=[True, False])  # -> ListA, ListB
merge_2 = Merge(Data1=graph, Data2=graph_8, Data3=graph_2, Data4=graph_3)
construct_domain = ConstructDomain(DomainStart=dispatch.ListA, DomainEnd=dispatch.ListB)
sort = SortList(Keys=merge_2)  # -> Keys, ValuesA
bnd_2 = Bounds(Numbers=merge_2)
remap_2 = RemapNumbers(Value=sort.Keys, Source=bnd_2, Target=construct_domain)  # -> Mapped, Clipped
panel = Panel("C:\Users\eleni\Documents\GitHub\3d_printing_teamwork\Design_Substructure\221213_Substructure_khara_working.py")
panel_2 = Panel(remap_2.Mapped)
number_slider = Slider(18, range=0..1000)
read_file = ReadFile(File=panel, PerLineParse=False)

geometry = Geometry(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)
geometry_2 = Geometry(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)
geometry_3 = Geometry(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)
geometry_4 = Geometry(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)

surface = Surface(reparameterize(geometry))
ghpython_script_2 = GhPythonScript(
    time_1=Slider(72, range=0..100),
    time_2=Slider(0, range=0..100),
    surface=surface,
    u_div=number_slider,
    v_div=number_slider,
    u_lists=remap_2.Mapped,
    target_factors=remap.Clipped,
    coherence_rad=Slider(60, range=0..100),
    coherence_fac=Slider(0.4, range=0..1),
    Coherence_T=Toggle(True),
    align_rad=Slider(25, range=0..100),
    align_fac=Slider(0.6, range=0..1),
    Alignment_T=Toggle(True),
    avoid_rad=Slider(14, range=0..100),
    avoid_fac=Slider(1, range=0..50),
    Separation_T=Toggle(True))  # -> out, list_pts, paths; inputs time_1: Int32, time_2: Int32, surface: Surface, u_div: Int32, v_div: Int32, u_lists: tree, target_factors: tree, Coherence_T: Boolean, Alignment_T: Boolean, Separation_T: Boolean
# ---------- ghpython_script_2: Python ----------
import Rhino.Geometry as rg
import ghpythonlib.treehelpers as th
import math

#hellooo
tolerance = 0.001

#this class is focused on the properties and methods of each instance MAS (multi agent system)
class Environment(object):
    
    def __init__(self, u_div, v_div, surface, agents_list = []):
        #self.num_agents = 0    #total number of agents
        self.u_div = u_div
        self.v_div = v_div
        self.surface = surface
        self.agents = []
        self.finished_agents = []
        if len(agents_list) > 0:
            self.agents = agents_list
        

    #this function takes the u values and transform them into agents
    def populate_agents(self, u_vals, target_factors):
        # instantiatie all agents
        for u, t_fac in zip(u_vals,target_factors) :
            self.agents.append(Agent(u, 0, 0, t_fac / self.v_div, self.surface)) 

    def update_agents_pos (self, coherence_rad, coherence_fac, align_rad, align_fac, avoid_rad, avoid_fac, Coherence_T, Alignment_T, Separation_T):
        # generate the new position of each agent by calculating their new direction and velocity
        #for each agent apply all the functions on it given the required factors for each parameter
        #if the agent arrives we pop out this agent from the list and add it to the finished list 
        # add a function that if everything is arrived just stop 
        #list of all effects so as not to change the behaviour of the agents during update
        effects_list = []
        for agent in self.agents:
            #always add a positive up vector in the beginning
            effects_vector = rg.Vector2d(0,agent.up_force)

            #new part added to create repulsion:
            # we need the bounds based on these bounds we calculate the percetage of the upforce
            # if the upforce is greater than a threshold then do the repulsion function and neglect the rest
            #cancelled for now !!

            if Coherence_T:
                coherence_vector = agent.Coherence(coherence_rad, self.agents, self.u_div, self.v_div, coherence_fac)
                effects_vector += coherence_vector

            if Alignment_T:
                alignment_vector = agent.Alignment(align_rad, self.agents, self.u_div, self.v_div, align_fac)
                effects_vector += alignment_vector

            if Separation_T:
                separation_vector = agent.Separation(avoid_rad, self.agents, self.u_div, self.v_div, avoid_fac)
                effects_vector += separation_vector

            #sum all of the vectors + the actual du and dv of the agent + unitize --> do nothing but add them to the effects_list
            effects_list.append(agent.AddTotalEffect(self.u_div, self.v_div, effects_vector))


        temp_removed_agents = []
        for agent, effect in zip(self.agents, effects_list):
            agent.AgentStep(effect)
            if agent.arrived:
                temp_removed_agents.append(agent)
       
        for fin_agent in temp_removed_agents:
            self.finished_agents.append(fin_agent)
            self.agents.remove(fin_agent)


        #pending: function that ensures all agents have reached the final destination

class Agent(object):

#the main parameters are poisiton on the surface, velocity in both directions 
    def __init__(self, u, v, du, dv, surface):
        self.u = u
        self.v = v
        self.surface = surface
        self.position = self.surface.PointAt(self.u, self.v) ##for the surface

        #save the dv as the constant upward vector for the current agent
        self.up_force = dv

        self.du = du
        self.dv = dv
        self.pts = []
        self.pts.append(self.position)
        self.arrived = False
        

    def Coherence(self, radius, agents, u_div, v_div, coh_fac):
        # agents : list of agents in the environment
        # fx for Coherence
        """ 
        --- within the specified radius we need to iterate over each agent apart from ours and do the following:
        -> calculate the center (u,v) of the surrounding by 2 getting the average over all of the points 
        -> this shall be the point to aim at from the agent position 
        -> unitize the produced vector 
        """
        #coherence_distance = ra
        centerU= 0
        centerV= 0
        num_neighbors = 0
        for agent in agents:
            if not agent == self:
                dist = self.position.DistanceTo(agent.position)
                if dist<= radius:
                    num_neighbors +=1
                    centerU += agent.u
                    centerV += agent.v

        #get the average vector
        if  num_neighbors > 0:
            centerU /= num_neighbors
            centerV /= num_neighbors

            #unitize the product vector of the coherence  
            cohesion_unit_vect = rg.Vector2d(centerU-self.u, centerV-self.v)
            cohesion_unit_vect = self.UnitizeEffect(u_div, v_div,cohesion_unit_vect) * coh_fac

            return cohesion_unit_vect

        else:
            return rg.Vector2d(0,0)

    # fx for Alignment (match velocity)
    def Alignment(self, radius, agents, u_div, v_div, align_fac):
        
        """within the specified radius we need to iterate over each agent apart from ours and do the following:
        -> calculate the average velocity [adding all the velocities and dividing the result with the total number of neighbors]
        """
        #radius = 10

        average_du = 0
        average_dv = 0
        num_neighbors = 0

        for agent in agents:
            if not agent == self:
                dist = self.position.DistanceTo(agent.position)
                if dist <= radius:
                    num_neighbors +=1
                    average_du += agent.du
                    average_dv += agent.dv
        
        if  num_neighbors > 0:
            average_du /= num_neighbors
            average_dv /= num_neighbors

            align_unit_vect = rg.Vector2d(average_du, average_dv)
            align_unit_vect = self.UnitizeEffect(u_div, v_div,align_unit_vect) * align_fac

            return align_unit_vect

        else:
            return rg.Vector2d(0,0)
    
    #pending: trial
    def Separation (self, radius, agents, u_div, v_div, avoid_fac):
        # fx for Separation
        """within the specified radius we need to iterate over each agent apart from ours and do the following:
        -> define how close two agents can be [min distance before collision]
        -> define a new direction [maybe reversed]
        """
        move_dU= 0
        move_dV= 0

        min_dist = 1000000
        closest_agent = self

        for agent in agents:
            if not agent == self:
                dist = self.position.DistanceTo(agent.position)
                if dist<= radius:
                    if dist < min_dist:
                        min_dist = dist
                        closest_agent = agent
        if closest_agent != self:
            move_dU += self.u - closest_agent.u
            move_dV += self.v - closest_agent.v

            avoid_unit_vect = rg.Vector2d(move_dU, move_dV)
            avoid_unit_vect = self.UnitizeEffect(u_div, v_div,avoid_unit_vect) * avoid_fac
            return avoid_unit_vect

        else:
            return rg.Vector2d(0,0)
    

    #checks the boundaries and for end of life of agent
    def withinBounds (self): 
        """
        ->check if (0<=u,v<=1)
        ->if not mirror u (*-1)
        ->
        """
        if abs(0.5 - self.u) >= 0.5 :       
            if self.u < 0:
                self.u = 0

            elif self.u > 1:
                self.u = 1

            self.du *= -1
            
        #we check if it has arrived (finished)  
        if self.v >= 1:
            self.v = 1
            self.arrived = True

    
    
    # pending: fx for limiting speed?

    # helper fxs:7

    # add the effect to the new veloctity vector of the agent that will be added later to its current velocity
    # as an input is the vector of a certain effect, the function does the following
    # --> unitize the vector
    # --> multiply by the effect value 
    # --> add this value to sum of new velocity vector 
    # --> this fx is called in each effect fx 
    def UnitizeEffect(self, u_div, v_div, vector_2b_unitised):           
        vector_2b_unitised.Unitize()
        vector_2b_unitised = rg.Vector2d(vector_2b_unitised.X/u_div, vector_2b_unitised.Y/v_div)
        return vector_2b_unitised

    # adds the new velocty vector to the current velocity vector and unitizes it 
    def AddTotalEffect(self, u_div, v_div, effects_vector):
        effects_vector += rg.Vector2d(self.du, self.dv)
        return self.UnitizeEffect(u_div, v_div, effects_vector)

    # update the agent's params and move it one step forward while checking its elgibility for movement
    def AgentStep(self, effects_vector):

        self.du = effects_vector.X
        self.dv = effects_vector.Y
        self.u += self.du
        self.v += self.dv
        #checks the agent compliance with boundary
        self.withinBounds()

        self.pts.append(self.surface.PointAt(self.u, self.v))



    #hello Eleniiiii
    #hello Ahmed
######################################################################################################################################
# the execution function:
# given the list of different points to initiate the agents do:
# a for loop iterating over the lists, instantiating each agent in the list then instantaiting an environment given all these agents
# afterwards, for each environment do some action till a certain time t
# afterwards instantiate a bigger environment containing all agents and giving it a certain value for all parameters.

#Swap UV directions of surface if needed
corner_b= surface.PointAt(1,0)
corner_d= surface.PointAt(0,1)

if corner_b.Z > corner_d.Z:
    surface.Transpose(True)

all_agents = []
#strt with first phase (t1)
initial_env_list = []
u_lists = th.tree_to_list(u_lists)
target_factors = th.tree_to_list(target_factors)
for u_list, t_factor in zip(u_lists, target_factors):
    #instantiate an instance of the environment:
    new_env = Environment(u_div, v_div, surface)
    new_env.populate_agents(u_list, t_factor)
    #add all agents to the big list
    all_agents.extend(new_env.agents)
    initial_env_list.append(new_env)


#depending on the input timestep we update the agents
for t in range(time_1):
    for env in initial_env_list:
        env.update_agents_pos(coherence_rad, coherence_fac, align_rad, align_fac, avoid_rad, avoid_fac, Coherence_T, Alignment_T, Separation_T)

#Create a new env contaiing all agents 
combined_env = Environment(u_div, v_div, surface, all_agents)
for t in range(time_2):
    combined_env.update_agents_pos(coherence_rad, coherence_fac, align_rad, align_fac, avoid_rad, avoid_fac, Coherence_T, Alignment_T, Separation_T)

list_pts = []
paths=[]
#for env in initial_env_list:
#   list_pts.append([agent.pts for agent in env.agents])
#    for agent in env.agents:
#        path = surface.InterpolatedCurveOnSurface(agent.pts,tolerance)
#       paths.append(path)
# 
for agent in all_agents:
    path = rg.NurbsCurve.CreateHSpline(agent.pts) 
    paths.append(path)  

paths = th.list_to_tree(paths)
list_pts = th.list_to_tree(list_pts)
# ---------- end ghpython_script_2 ----------
panel_3 = Panel([surface, number_slider])
curve = Curve(ghpython_script_2.paths)
geometry_5 = Geometry(ghpython_script_2.list_pts)
panel_4 = Panel(ghpython_script_2.out)
panel_5 = Panel(geometry_5)
reduce = RandomReduce(List=curve, Reduction=Slider(6, range=0..30), Seed=1)
crv = Curve(reduce)
divlength = DivideLength(Curve=crv, Length=Slider(5, range=0..10))  # -> flatten(Points), Tangents, Parameters
surface_2 = Surface(surface)
curve_2 = Curve([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])
prox = Proximity3D(Points=divlength.Points, Group=5, MinRadius=Slider(5, range=0..10))  # -> flatten(Links), Topology
surface_split = SurfaceSplit(Surface=surface_2, Curves=curve_2)
dupln = RemoveDuplicateLines(Lines=prox.Links, Tolerance=0.01)
lng = ListLength(List=dupln)
multiplication = Multiplication(A=lng, B=Slider(0, range=0..1))
area = Area(Geometry=surface_split)  # -> Area, Centroid
reduce_2 = RandomReduce(List=dupln, Reduction=multiplication, Seed=1)
larger_than = LargerThan(FirstNumber=area.Area, SecondNumber=Slider(80.69, range=0..1000))  # -> LargerThan, OrEqualTo
curve_3 = Curve(reduce_2)
cull_pattern = CullPattern(List=surface_split, CullPattern=larger_than.OrEqualTo)
cull_pattern_2 = CullPattern(List=cull_pattern, CullPattern=[False, False, True, True])
deconstruct_brep = DeconstructBrep(Brep=cull_pattern)  # -> Faces, Edges, Vertices
join_curves = JoinCurves(Curves=simplify(deconstruct_brep.Edges), Preserve=False)  # -> flatten(Curves)
offset_on_srf = OffsetOnSrf(Curve=join_curves, Distance=Slider(2.1, range=0..10), Surface=surface_2)
offset_on_srf_2 = OffsetOnSrf(
    Curve=[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],
    Distance=[165.8876943, 117.2842745, 329.6580969, 191.572437, 101.5195011, 152.0890603, 154.3906282, 124.2642386, 87.15760793, 145.3933772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],
    Surface=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)
rebuild_curve = RebuildCurve(Curve=offset_on_srf, Degree=Slider(3, range=0..10), Count=Slider(10, range=0..100), Tangents=False)
closed = Closed(Curve=rebuild_curve)  # -> Closed, Periodic
cull_pattern_3 = CullPattern(List=rebuild_curve, CullPattern=closed.Periodic)
surface_split_2 = SurfaceSplit(Surface=surface_2, Curves=flatten(cull_pattern_3))
area_2 = Area(Geometry=surface_split_2)  # -> Area, Centroid
sort_list = SortList(Keys=area_2.Area, ValuesA=surface_split_2)  # -> Keys, ValuesA
list_item = ListItem(List=sort_list.ValuesA, Index=-1, Wrap=True)
