# Grasshopper definition 221214_Substructure.ghx (Grasshopper 1.0.7)

# ---- group: No. Clusters
number_of_clusters = Panel("4")

# ---- group: num. agents in each cluster
genes = GenePool(Decimals=0, Maximum=20, Minimum=0, Value=[11, 10, 10, 12])

# ----
genes_2 = GenePool(Decimals=2, Maximum=1, Minimum=0, Value=[0, 0.28, 0.61, 0.87])
dom = ConstructDomain(DomainStart=Slider(0.18, range=0..1), DomainEnd=Slider(0.3, range=0..1))
random = Random(Range=dom, Number=Slider(4, range=0..10), Seed=Slider(5, range=0..10))
range = Range(Domain=Domain(0, 1), Steps=genes)
bang = ExplodeTree(Data=range)  # -> Branch0, Branch1, Branch2, Branch3
ghpython_script = GhPythonScript(centers=genes_2, extend=random)  # -> out, intervals; inputs centers: list, extend: list
# ---------- ghpython_script: Python ----------
import math
import ghpythonlib.treehelpers as th


intervals=[]

for center, ext in zip(centers, extend):
    inter_from = center- ext
    inter_to = center + ext
    print type(inter_from)
    if inter_from < 0 : 
        inter_from =0
    if inter_to >1 :
        inter_to =1
    
    intervals.append([inter_from, inter_to])

intervals = th.list_to_tree(intervals)
# ---------- end ghpython_script ----------

# ---- group: Target factor
graph = GraphMapper(bang.Branch3, x0=0, x1=1, y0=0, y1=1, Cx=0.5553172827, Cy=0.8992747664, container_name="Conic")
graph_2 = GraphMapper(bang.Branch1, x0=0, x1=1, y0=0, y1=1, Ox=0.5098851919, Oy=1, Px=1, Py=0.1483525634, container_name="Parabola")
graph_3 = GraphMapper(
    bang.Branch2,
    x0=0,
    x1=1,
    y0=0,
    y1=1,
    container_name="Sinc",
    Equation_X0=0.4748720825,
    Equation_X1=1,
    Equation_Y0=0.9733063579,
    Equation_Y1=0.1758453846)
graph_4 = GraphMapper(bang.Branch0, x0=0, x1=1, y0=0, y1=1, container_name="Bezier", cpx=[0, 0.5243950486, 0.3017984927, 1], cpy=[0, 0, 1, 1])
merge = Merge(Data1=graph_4, Data2=graph_2, Data3=graph_3, Data4=graph)
bnd = Bounds(Numbers=merge)
remap = RemapNumbers(Value=merge, Source=bnd, Target=Domain(0, 1))  # -> Mapped, Clipped

# ----
graph_5 = GraphMapper(bang.Branch0, x0=0, x1=1, y0=0, y1=1, container_name="Bezier", cpx=[0, 0.5243950486, 0.08604718745, 1], cpy=[0, 0, 1, 1])
graph_6 = GraphMapper(
    bang.Branch2,
    x0=0,
    x1=1,
    y0=0,
    y1=1,
    container_name="Sinc",
    Equation_X0=0.4748720825,
    Equation_X1=0.9382023215,
    Equation_Y0=0.9733063579,
    Equation_Y1=0.2215337157)
graph_7 = GraphMapper(bang.Branch1, x0=0, x1=1, y0=0, y1=1, Ox=0.4780313373, Oy=1, Px=1, Py=0.1196134686, container_name="Parabola")
graph_8 = GraphMapper(bang.Branch3, x0=0, x1=1, y0=0, y1=1, Cx=0.4874807298, Cy=0.7769420147, container_name="Conic")
panel = Panel(ghpython_script.intervals)
dispatch = Dispatch(List=ghpython_script.intervals, DispatchPattern=[True, False])  # -> ListA, ListB
merge_2 = Merge(Data1=graph_5, Data2=graph_7, Data3=graph_6, Data4=graph_8)
sort = SortList(Keys=merge_2)  # -> Keys, ValuesA
bnd_2 = Bounds(Numbers=merge_2)
dom_2 = ConstructDomain(DomainStart=dispatch.ListA, DomainEnd=dispatch.ListB)
remap_2 = RemapNumbers(Value=sort.Keys, Source=bnd_2, Target=dom_2)  # -> Mapped, Clipped
panel_2 = Panel(remap_2.Clipped)
panel_3 = Panel("C:\Users\ahmed\OneDrive - Politecnico di Milano\ETH Zurich\MAS Dfab\P4_Mini Project\3d_printing_teamwork\Design_Substructure\221213_Substructure_khara_working_ahm_2.py")

geometry = Geometry(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)
geometry_2 = Geometry(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)
geometry_3 = Geometry(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)
geometry_4 = Geometry(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)

read_file = ReadFile(File=panel_3, PerLineParse=False)

coherence_rad = Slider(58, range=0..100)
coherence_fac = Slider(1.3, range=0..3)
align_rad = Slider(46, range=0..100)
align_fac = Slider(0.6, range=0..1)
avoid_rad = Slider(32, range=0..100)
avoid_fac = Slider(1, range=0..3)

resolution = Slider(514, range=0..1000)

coherence_rad_2 = Slider(13, range=0..100)
coherence_fac_2 = Slider(1.3, range=0..3)
align_rad_2 = Slider(10, range=0..100)
avoid_rad_2 = Slider(12, range=0..100)
avoid_fac_2 = Slider(1.4, range=0..3)
align_fac_2 = Slider(0.6, range=0..1)

surface = Surface(reparameterize(geometry))
t2 = Slider(17, range=0..500)
repulsion_rad = Slider(5, range=0..100)
repulsion_fac = Slider(0.9, range=0..3)
number_slider = Slider(0.54, range=0..1)
t1 = Slider(146, range=0..500)
boolean_toggle = BooleanToggle(True)
ghpython_script_2 = GhPythonScript(
    Code=read_file,
    Time_1=t1,
    Time_2=t2,
    Coherence_rad2=coherence_rad_2,
    Coherence_fac2=coherence_fac_2,
    Coherence_T2=Toggle(True),
    Align_rad2=align_rad_2,
    Align_fac2=align_fac_2,
    Alignment_T2=Toggle(True),
    Avoid_rad2=avoid_rad_2,
    Avoid_fac2=avoid_fac_2,
    Separation_T2=Toggle(True),
    Surface=surface,
    U_div=resolution,
    V_div=resolution,
    U_lists=remap_2.Mapped,
    Target_factors=remap.Clipped,
    Coherence_rad=coherence_rad,
    Coherence_fac=coherence_fac,
    Coherence_T=Toggle(True),
    Align_rad=align_rad,
    Align_fac=align_fac,
    Alignment_T=Toggle(True),
    Avoid_rad=avoid_rad,
    Avoid_fac=avoid_fac,
    Separation_T=Toggle(True))  # -> Out, List_pts, Paths
panel_4 = Panel([surface, resolution])
curve = Curve(ghpython_script_2.Paths)
geometry_5 = Geometry(ghpython_script_2.List_pts)
panel_5 = Panel(ghpython_script_2.Out)
end = EndPoints(Curve=curve)  # -> Start, End
extrz = Extremes()  # -> Mininum, Maximum
cir = Circle(Plane=PlaneXY(0, 0, 0), Radius=1)
pipe = Pipe(Radius=Slider(6, range=1..20), Caps=0)
xy = XYPlane(Origin=Point(0, 0, 0))  # disabled
data = Data(end.Start)  # disabled
vec2pt = Vector2Pt(PointA=xy, PointB=data, Unitize=False)  # -> Vector, Length; disabled
move = Move(Motion=vec2pt.Vector)  # -> Geometry, Transform; disabled
extrcrv = ExtrudeAlong(Base=move.Geometry, Curve=curve)  # disabled
