# Grasshopper definition 20221010_Computational-Art_Glitch_AE_0.7.gh (Grasshopper 1.0.7)
# plug-ins: Kangaroo2 Components, Bifocals

number_slider = Slider(20, range=1..50)  # disabled
distance = Slider(10, range=1..20)  # disabled
number_slider_2 = Slider(656, range=0..1000)  # disabled
number_slider_3 = Slider(32, range=0..150)  # disabled
random = Random(Range=Domain(0, 1), Number=number_slider, Seed=2)  # disabled
number_slider_4 = Slider(63, range=0..150)  # disabled
number_slider_5 = Slider(122, range=10..150)  # disabled
number_slider_6 = Slider(58, range=10..150)  # disabled
number_slider_7 = Slider(10, range=0..10)  # disabled
number_slider_8 = Slider(26, range=5..50)  # disabled
# Ideas:
# 1. Movement of points in time t
# 2. dispersion of points
# 3. problem in the end of the point
# 4. rotators
# 5. for rotators add rotation directio in initialiation
crv = Curve(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)
explode = Explode(Curve=crv, Recursive=True)  # -> Segments, Vertices; disabled
eval = EvaluateCurve(Curve=reparameterize(graft(explode.Segments)), Parameter=random)  # -> simplify(Point), Tangent, Angle; disabled
number_slider_9 = Slider(19, range=2..100)  # disabled
number_slider_10 = Slider(35, range=2..100)  # disabled
crv_2 = Curve(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)
bang = ExplodeTree(Data=explode.Segments)  # -> Branch0, Branch1, Branch2, Branch3; disabled
pop2d = Populate2D(Region=crv, Count=number_slider_3, Seed=1)  # disabled
pt = Point(<point referenced from the Rhino model>)  # disabled
pt_2 = Point(<point referenced from the Rhino model>)  # disabled
jitter = Jitter(List=eval.Point, Jitter=1, Seed=number_slider_7)  # -> Values, Indices; disabled
pop2d_2 = Populate2D(Region=crv, Count=number_slider_4, Seed=1)  # disabled
number_slider_11 = Slider(-0.469, range=-1..0.9)  # disabled
weave = Weave(Pattern=[0, 1], NullGaps=False)  # disabled
flip = FlipMatrix(Data=jitter.Values)  # disabled

# ---- group: BACKUP-GEOMETRY_USED
crv_3 = Curve(Tree({0;0;0}: [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], {0;1;0}: [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], {0;2;0}: [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], {0;3;0}: [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], {0;4;0}: [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], {0;5;0}: [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]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))

# ---- group: Basic Radius
number_slider_12 = Slider(80, range=1..100)
point = Point(Point(210, 148.5, 0))
circle_cnr = CircleCNR(Center=point, Normal=Vector(0, 0, 1), Radius=number_slider_12)
xy_plane = XYPlane(Origin=Point(0, 0, 0))

# ----
# 1. Take a point from one side to any side
# 2. the goal is to direct the vector directly to this point
# 3. presence of attractors and repulsion points (that moves in time (or jiggle lets say))
# 4. when distance is close --> check if it came out of boudary(or it will be done automatically )
# 5. each attractor point has a life time (energy) that fades by time (can be function of radius and atractors)
# 6. attractor are given arbitrary radius
python = GhPythonScript(
    Rotator_pts=pop2d_2,
    Attractor_pts=pop2d,
    min_energy=number_slider_9,
    max_energy=number_slider_10,
    pt_1=pt_2,
    pt_2=pt,
    max_Rot=number_slider_8,
    min_r=number_slider_6,
    max_r=number_slider_5,
    time=number_slider_2,
    dist=distance,
    threshold=number_slider_11,
    points=flip)  # -> out, min_dist_list, min_dist_pts_tuple, min_dist_pts_list2, Curves, pts; inputs Rotator_pts: list of Point3d, Attractor_pts: list of Point3d, min_energy: Int32, max_energy: Int32, pt_1: Point3d, pt_2: Point3d, max_Rot: Int32, min_r: Int32, max_r: Int32, time: Int32, dist: Int32, points: list of Point3d; disabled
# ---------- python: Python ----------
__author__ = "ahmed"
__version__ = "2022.10.02"

import Rhino.Geometry as rg
from ghpythonlib.components import ColourRGB
import random
import math
from copy import deepcopy


def zerolistmaker(n):
    listofzeros = [0] * n
    return listofzeros



class Attractor(object):
    
    def __init__(self, location, radius):    #energy could be sine wave
        self.loc = location
        self.r = radius
        self.energy = random.randint(min_energy, max_energy)

        
class Rotator(Attractor):
    
    def __init__(self, location, radius): 
        Attractor.__init__(self, location, radius)
    
class Traveller():
    
    def __init__(self, start_point, end_point, rotators_list, max_rot):
        self.journey_vec = end_point - start_point
        self.journey_vec.Unitize()
        self.p = start_point
        self.prevp = start_point
        self.sp = start_point
        self.endp =  end_point
        self.pts = []
        self.pts.append(start_point)
        self.rotators = rotators_list
        self.currentRot = zerolistmaker(len(self.rotators))
        self.maxrot = max_rot
        
    def move(self, attractors_list):
        #check if the distance 
        #moves 1 unitized step towards the goal
        #is affected by the attractors if gets close to them 
        #calculate a vector from radius and add its unitized value and its sin curve and its energy is reduced
        
        #part 1 attractor
        att_Vectors = []
        for att in attractors_list:
             dist = self.p.DistanceTo(att.loc)
             if dist <= att.r:
                 att_vec = self.p - att.loc
                 att_vec.Unitize() # could be deleted
                 att_vec *= math.sin(math.pi * 0.5 * (1 - (dist/att.r)))
                 att_Vectors.append(att_vec)
        totalVector = self.endp - self.p
        totalVector.Unitize()
        for vec in att_Vectors:
            totalVector += vec
        
        #part 2 rotator
        rot_Vectors = []
        i = 0
        for rot in rotators_list:
            dist = self.p.DistanceTo(rot.loc)
            if dist <= rot.r:
                if self.currentRot[i] <= self.maxrot: #do the rotation
                    rot_vec1 =  rot.loc - self.p
                    rot_vec1.Unitize()
                    vec_to_rot = deepcopy(rot_vec1)
                    rot_vec1 *= math.sin(math.pi * 0.5 * (1 - (dist/att.r)))
                    rot_Vectors.append(rot_vec1)
                    trans = rg.Transform.Rotation(math.pi/2, self.p)
                    vec_to_rot.Transform(trans)
                    rot_vec2 = vec_to_rot * (1 - self.currentRot[i]/ self.maxrot)
                    rot_vec2.Unitize()
                    #print ("we are here")
                    rot_Vectors.append(rot_vec2)
                    #rot_vec2 *= 1 - self.currentRot[i]/self.maxrot
                    self.currentRot[i] += 1
                i+= 1
                
        for vec in rot_Vectors:
            totalVector += vec
        totalVector.Unitize()
        
        self.journey_vec = self.endp - self.p 
        self.journey_vec.Unitize() #could be delted!!!!!!
        test_vect1 = totalVector + self.journey_vec
        test_vect1.Unitize()
#        if len(self.pts) > 2:
#            prev_vect = self.p - self.prevp
#            prev_vect.Unitize()
#            k = 0
#            #print(rg.Vector3d.Multiply(prev_vect , test_vect1))
#            while rg.Vector3d.Multiply(prev_vect , test_vect1) < threshold:
#                trans = rg.Transform.Rotation(math.radians(k + 1), self.p)
#                test_vect1.Transform(trans)
#                k+=1
            #print(rg.Vector3d.Multiply(prev_vect , test_vect1))
        self.prevp = self.p
        print(self.prevp)
        self.p += test_vect1
        print(self.p)
        self.pts.append(self.p)



#solution 5ara
i = 0
min_dist_list = []
min_dist_pts_tuple = []
attractors_list = []

min_dist_pts_tuple_rot = []
min_dist_list_rot = []
rotators_list = []

for i in range(len(Attractor_pts)):
    min_dist = 1000000
    pt = None
    for j in range(len(Attractor_pts)):
        if i == j:
            continue
        else:
            dist = Attractor_pts[i].DistanceTo(Attractor_pts[j])
            if dist < min_dist:
                min_dist = dist
                pt = Attractor_pts[j]
    if not [Attractor_pts[i],Attractor_pts[j]] in min_dist_pts_tuple or not [Attractor_pts[j],Attractor_pts[i]] in min_dist_pts_tuple:
        min_dist_list.append(min_dist)
        min_dist_pts_tuple.append([Attractor_pts[i],pt])
    

for i in range(len(Rotator_pts)):
    min_dist = 1000000
    pt = None
    for j in range(len(Rotator_pts)):
        if i == j:
            continue
        else:
            dist = Rotator_pts[i].DistanceTo(Rotator_pts[j])
            if dist < min_dist:
                min_dist = dist
                pt = Rotator_pts[j]
    if not [Rotator_pts[i],Rotator_pts[j]] in min_dist_pts_tuple_rot or not [Rotator_pts[j],Rotator_pts[i]] in min_dist_pts_tuple_rot:
        min_dist_list_rot.append(min_dist)

#Instantiate attractors:


    
j = 0
for pt in Attractor_pts:
    attractors_list.append(Attractor(pt,min_dist_list[j])) #adjust radius!!!!
    j += 1
    
    
i = 0
for pt in Rotator_pts:
    rotators_list.append(Rotator(pt,random.randint(min_r, max_r))) #adjust radius!!!!
    i += 1



travellers = []


#for ptsList in points:
print(points)
travellers.append(Traveller(points[0], points[2], Rotator_pts, max_Rot))
travellers.append(Traveller(points[1], points[3], Rotator_pts, max_Rot))
travellers.append(Traveller(points[0], points[1], Rotator_pts, max_Rot))
travellers.append(Traveller(points[2], points[3], Rotator_pts, max_Rot))

pts = []

for t in range(time):
    for traveller in travellers:
        traveller.move(attractors_list)

Curves = []

for traveller in travellers:
    pts.append(traveller.pts)
    Curves.append(rg.NurbsCurve.Create(False, 5,traveller.pts ))

#Curves.append(rg.Curve.CreateInterpolatedCurve(traveller.pts,1))
























#rg.Curve.CreateInterpolatedCurve(self.pts,1)



#class Diffuser():
#    
#    def __init__(self,start_point,distance, vector_Direction, range_angle, last_curve, max_counter):
#        self.p = start_point
#        self.prevp = self.p
#        self.points = []
#        self.c = []  #curves
#        self.d = distance #distance
#        #self.e_max = energy_max
#        #self.e_min = energy_min
#        #self.energy = random.randint(self.e_min, self.e_max)
#        self.range_angle = range_angle
#        #self.start_vec = vector_Direction
#        vector_Direction.Unitize()
#        self.start_vec_unit = vector_Direction
#        self.current_vec_unit = self.start_vec_unit 
#        self.color = ColourRGB(255,255,255,255)   #change thattttt
#        self.max_counter = max_counter   #should be changed
#        self.glitch_Val = []
#        self.diffusers_pts = []
#        self.diffusers_curves = []
#
#    def GlitchPoints(self, intensity, pts_max, pts_min, part, specific_point=0.25):   
#        num_pts = 0 #random range between points 
#        #select num_points
#        if intensity == 1:
#            num_pts = pts_max + random.randint(0,pts_max - pts_min)
#        elif intensity == 2:
#            num_pts = pts_min + random.randint(0,pts_max - pts_min)
#        else:
#            num_pts = pts_min 
#        #Divide the graph on x 
#        x_list = []
#        for pt in range(num_pts):
#            x_list.append(random.uniform(0, 1 - random.uniform(0,0.25)))
#        #print(math.floor(len (x_list) / 2))
#        x_list1 = x_list[0: int(math.floor(len (x_list) / 2))]
#        x_list2 = x_list[int(math.floor(len (x_list) / 2) +1): len (x_list)]
#        
#        rotate_y_list1 = []
#        rotate_y_list2 = []
#        for x in x_list1:
#            rotate_y_list1.append(math.pow(2, x) - 1)
#            
#        for x in x_list2:
#            rotate_y_list2.append(math.pow(2, x) - 1)
#
#        rotate_y_list1.sort()
#
#        rotate_y_list2.sort()
#        print(rotate_y_list2)
#        rotate_y_list2.reverse()
#        
#        rotate_y_list = rotate_y_list1 + rotate_y_list2 
#        #return the points and x_list
#        return rotate_y_list, x_list
#        
#        
#    def Glitch(self,pts_max, pts_min, counter = 0):
#        intensity = random.randint(0,2)
#        
#        rotate_y_list_up, x_list_up = self.GlitchPoints(intensity, pts_max, pts_min, 0)
#        rotate_y_list_down, x_list_down = self.GlitchPoints(intensity, pts_max, pts_min, 1 , x_list_up[-1])
#        
#        direction_glitch = random.random()
#        if direction_glitch > 0.5:
#            angle_dir = -1 
#            
#        else:
#            angle_dir = 1 
#            
#        #start with the last vector
#        fst_p = deepcopy(self.p)
#        lst_p = deepcopy(self.prevp)
#        vector1 = fst_p - lst_p
#        vector2 = self.start_vec_unit #initial vector
#        
#        initial_vect = vector1 #+ vector2
#        initial_vect.Unitize()
#        
#        for y_vals in rotate_y_list_up:
#            trans = rg.Transform.Rotation(math.pi/2 * angle_dir * y_vals, self.p)
#            #print(y_vals)
#            var_vector = deepcopy(initial_vect)
#            var_vector.Transform(trans)
#            self.prevp = self.p
#            self.p = rg.Point3d.Add(self.prevp , var_vector)
#            self.points.append(self.p)
#            self.glitch_Val.append(y_vals)
#        
#        for y_vals in rotate_y_list_down:
#            trans = rg.Transform.Rotation(math.pi/2 * angle_dir *-1  * y_vals, self.p)
#            var_vector = deepcopy(initial_vect)
#            var_vector.Transform(trans)
#            self.prevp = self.p
#            self.p = rg.Point3d.Add(self.prevp , var_vector)
#            self.points.append(self.p)
#            self.glitch_Val.append(y_vals)
#        
#        self.max_counter = 0
#        
#
#        
#    def Grow(self, counter = 0):
#        while counter < self.max_counter - random.randint(0, self.max_counter):
#            # choose a random number between the allowed angle, try make node? 
#            angle = random.randint(-self.range_angle,self.range_angle)
#            angle_rad = self.AngleInRadians(angle)
#            trans1 = rg.Transform.Rotation(angle_rad, self.p)
#            #vector = deepcopy(v)
#            vector = self.p - self.prevp
#            if len(self.points) <= 0:
#                vector = rg.Vector3d(abs( random.random()*2), random.random(), 0)
#            
#            vector.Unitize()
#            vector.Transform(trans1)
#            p1 = rg.Point3d.Add(self.p, (vector))
#            self.prevp = self.p
#            self.p = p1
#            self.points.append(self.p)
#            self.glitch_Val.append(0)
#            counter+=1
#        #start glitch:
#        self.max_counter = max_counter
#        
#    def Diffuse(self,increment):
#        points_list = []
#        i = 0
#        for pt,glitch in zip(self.points, self.glitch_Val):
#            #if glitch < 0.1:
#            #increment * math.exp(-1* lamda * pt.X) * (math.cos(angular_freq  * pt.X + init_phase_angle) + math.sin(angular_freq  * pt.X + init_phase_angle))
#            increment = amplitude * math.sin(i * math.pi) * increment
#            num_increments.append(increment)
#            print(increment)
#            points_list.append(pt + rg.Vector3d(0,  increment,0))
#            #else:
#                #points_list.append(pt + rg.Vector3d(0, increment * 2, 0))
#            i+=1
#        self.diffusers_pts.append(points_list)
#        self.diffusers_curves.append(rg.Curve.CreateInterpolatedCurve(points_list, 3))
#        
#    def CalculateDistance(self, point):
#        vec2BProjected =  rg.Vector3d(point - self.p)
#        return abs((vec2BProjected * self.start_vec_unit)/self.d) 
#        
#    def AngleInRadians(self, angle):
#        return (angle* 2 * math.pi)/360
#
#Curves = []
#for point in Points1:
#    curve = Diffuser(point, Vectors[-1].X, Vectors[-1], angle_range, Lines[1], max_counter)
#    for i in range(num_actions):
#        vector = rg.Vector3d(1,0,0)
#        curve.Grow()
#        curve.Glitch(pts_max, pts_min)
#    
#    
#    curve.c.append(rg.Curve.CreateInterpolatedCurve(curve.points, 3)) 
#    curve.c.append(rg.NurbsCurve.Create(False, 3,curve.points )) 
#    Curves.append(curve.c)
#    
##    for increment in range(increments):
##        curve.Diffuse(increment_val * (increment +1))
##        Curves.append(curve.diffusers_curves)
# ---------- end python ----------
panel = Panel(flip)  # disabled

# ---- group: SECOND-CIRCLE_UNEEDED? / Extention for unevenness of curve endings !!!!
addition = Addition(A=number_slider_12, B=Slider(5.122, range=0.5..10))

# ----
python_2 = GhPythonScript(x=python.pts)  # -> out, a; disabled
# ---------- python_2: Python ----------
__author__ = "ahmed"
__version__ = "2022.10.07"

a = x
# ---------- end python_2 ----------
circle = CircleCNR(Center=point, Normal=Vector(0, 0, 1), Radius=Slider(132, range=10..500))
panel_2 = Panel(python_2.a)  # disabled

# ---- group: TRIM RECTANGLE / BOUNDARY
crv_4 = Curve(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)

# ----
crv_5 = Curve(python.Curves)  # disabled
pt_3 = Point(python_2.a)  # disabled

# ---- group: SECOND-CIRCLE_UNEEDED? / Basic Radius
point_2 = Point(Point(210, 148.5, 0))
xy_plane_2 = XYPlane(Origin=Point(0, 0, 0))
circle_cnr_2 = CircleCNR(Center=point_2, Normal=Vector(0, 0, 1), Radius=addition)

# ----
panel_3 = Panel("""18
23""")
panel_4 = Panel("""0
1""")
number_slider_13 = Slider(9, range=0..50)
panel_5 = Panel("""0
9
10
11
12
13
14
15
16
17
18
19
20
21
22
23
24
25
26
27
28
28
30
31
32
33
34
35""")
number_slider_14 = Slider(15, range=10..100)
number_slider_15 = Slider(48, range=10..100)

# ---- group: AHMED ORIGINAL CODE
# Ideas:
# 1. Movement of points in time t
# 2. dispersion of points
# 3. problem in the end of the point
# 4. rotators
# 5. for rotators add rotation directio in initialiation
number_slider_16 = Slider(20, range=1..50)  # disabled
crv_6 = Curve()  # disabled
number_slider_17 = Slider(314, range=0..1000)  # disabled
number_slider_18 = Slider(32, range=0..150)  # disabled
number_slider_19 = Slider(63, range=0..150)  # disabled
random_2 = Random(Range=Domain(0, 1), Number=number_slider_16, Seed=2)  # disabled
number_slider_20 = Slider(122, range=10..150)  # disabled
number_slider_21 = Slider(58, range=10..150)  # disabled
number_slider_22 = Slider(10, range=0..10)  # disabled
crv_7 = Curve(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)  # disabled
explode_2 = Explode(Curve=crv_7, Recursive=True)  # -> Segments, Vertices; disabled
eval_2 = EvaluateCurve(Curve=reparameterize(graft(explode_2.Segments)), Parameter=random_2)  # -> simplify(Point), Tangent, Angle; disabled
number_slider_23 = Slider(26, range=5..50)  # disabled
number_slider_24 = Slider(5, range=2..100)  # disabled
number_slider_25 = Slider(35, range=2..100)  # disabled
bang_2 = ExplodeTree(Data=explode_2.Segments)  # -> Branch0, Branch1, Branch2, Branch3; disabled
pop2d_3 = Populate2D(Region=crv_7, Count=number_slider_18, Seed=1)  # disabled
pt_4 = Point(<point referenced from the Rhino model>)  # disabled
pt_5 = Point(<point referenced from the Rhino model>)  # disabled
jitter_2 = Jitter(List=eval_2.Point, Jitter=1, Seed=number_slider_22)  # -> Values, Indices; disabled
number_slider_26 = Slider(-0.469, range=-1..0.9)  # disabled
pop2d_4 = Populate2D(Region=crv_7, Count=number_slider_19, Seed=1)  # disabled
weave_2 = Weave(Pattern=[0, 1], NullGaps=False)  # disabled
flip_2 = FlipMatrix(Data=jitter_2.Values)  # disabled
python_3 = GhPythonScript(
    Rotator_pts=pop2d_4,
    Attractor_pts=pop2d_3,
    min_energy=number_slider_24,
    max_energy=number_slider_25,
    pt_1=pt_5,
    pt_2=pt_4,
    max_Rot=number_slider_23,
    min_r=number_slider_21,
    max_r=number_slider_20,
    time=number_slider_17,
    threshold=number_slider_26,
    points=flip_2)  # -> out, min_dist_list, min_dist_pts_tuple, min_dist_pts_list2, Curves, pts; inputs Rotator_pts: list of Point3d, Attractor_pts: list of Point3d, min_energy: Int32, max_energy: Int32, pt_1: Point3d, pt_2: Point3d, max_Rot: Int32, min_r: Int32, max_r: Int32, time: Int32, points: list of Point3d; disabled; same code as python
panel_6 = Panel(flip_2)  # disabled
python_4 = GhPythonScript(x=python_3.pts)  # -> out, a; disabled; same code as python_2
panel_7 = Panel(python_4.a)  # disabled
number_slider_27 = Slider(32, range=1..100)  # disabled
crv_8 = Curve(python_3.Curves)  # disabled
pt_6 = Point(python_4.a)  # disabled
point_3 = Point(<point referenced from the Rhino model>)  # disabled
xy_plane_3 = XYPlane(Origin=Point(0, 0, 0))  # disabled
circle_cnr_3 = CircleCNR(Center=point_3, Normal=Vector(0, 0, 1), Radius=number_slider_27)  # disabled
trim_with_region = TrimWithRegion(Curve=crv_8, Region=circle_cnr_3, Plane=xy_plane_3)  # -> Inside, Outside; disabled
merge = Merge()  # disabled
ln = Line()  # disabled
dupln = RemoveDuplicateLines(Lines=ln, Tolerance=0.01)  # disabled
geometry = Geometry(trim_with_region.Inside)  # disabled
geometry_2 = Geometry(trim_with_region.Outside)  # disabled

# ---- group: USE WITH CAUTION !!! / DO NOT USE !!!!
geometry_3 = Geometry()  # disabled

# ---- group: LINES-NO-INT
geo = Geometry([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])
len = Length(Curve=geo)
larger = LargerThan(FirstNumber=len, SecondNumber=number_slider_14)  # -> LargerThan, OrEqualTo
dispatch = Dispatch(List=geo, DispatchPattern=larger.LargerThan)  # -> ListA, ListB
geo_2 = Geometry(dispatch.ListA)
crv_9 = Curve(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)
trim = TrimWithRegion(Curve=geo_2, Region=crv_9)  # -> Inside, Outside
crv_10 = Curve(trim.Inside)
flatten = FlattenTree(Tree=crv_10, Path="{0}")
end = EndPoints(Curve=flatten)  # -> Start, End
pt_7 = Point(end.Start)
crv_11 = Curve(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)
pt_8 = Point(end.End)
incurve = PointInCurve(Point=pt_7, Curve=crv_11)  # -> Relationship, Point
cset = CreateSet(List=incurve.Relationship)  # -> Set, Map
dispatch_2 = Dispatch(List=flatten, DispatchPattern=cset.Map)  # -> ListA, ListB
crv_12 = Curve(dispatch_2.ListB)
crv_13 = Curve(dispatch_2.ListA)
divide = DivideCurve(Curve=[crv_13, crv_12], Count=number_slider_15, Kinks=False)  # -> Points, Tangents, Parameters
intcrv = Interpolate(Vertices=divide.Points, Degree=3, Periodic=False, KnotStyle=1)  # -> Curve, Length, Domain

# ----
# Inputs
number_slider_28 = Slider(199, range=0..200)  # disabled
crv_14 = Curve([<curve referenced from the Rhino model> x8])  # disabled

# ---- group: True ONLY if outside curves !!
toggle = BooleanToggle(True)

toggle_2 = BooleanToggle(False)

toggle_3 = BooleanToggle(True)

toggle_4 = BooleanToggle(True)

# ----
panel_8 = Panel("""0
1
2""")

# ----
# SECOND ROBOT
# IP : 192.168.10.10
button = Button()  # disabled
robotic_drawing = GhPythonScript(send=button)  # -> out, way_planes; inputs way_planes: list of Plane; disabled
# ---------- robotic_drawing: Python ----------
from imp import reload

import simple_comm as com
reload(com)

import simple_ur_script as ur
reload(ur)

import Rhino.Geometry as rg

import math as m
import random as r

ROBOT_IP = "192.168.10.10"

## 1 ## ===== Setting robot base plane from pts =====
ORIGIN = rg.Point3d(510.29, 83.05, -10.07) #-10.07
X_AXIS = rg.Point3d(508.47, 503.04, -10.32) #-10.32
Y_POSITIVE_PLANE = rg.Point3d(211.56, 503.05, -10.29) #-10.29

def set_robot_base():
    robot_base = rg.Plane(ORIGIN,X_AXIS-ORIGIN,Y_POSITIVE_PLANE-ORIGIN)
    print (robot_base)
    return (robot_base)

def rhino_to_robot_space(_plane,robot_base):
    _r_matrix = rg.Transform.PlaneToPlane(rg.Plane.WorldXY,robot_base)
    _plane.Transform(_r_matrix)
    return _plane

## 2 ## ===== Robot base is set =====
robot_base =  set_robot_base()


## 3 ## ===== Transforming the rhino planes into robot planes =====
robot_planes = []
for plane in way_planes: 
    robot_planes.append(rhino_to_robot_space(plane, robot_base))

script = ""
#script += ur.set_tcp_by_angles(0.0,85.0,35.0,m.radians(-90.0),m.radians(180.0),m.radians(0))


## 5 ## ===== Assigning the translation movement =====
accel = 0.3
vel = 0.3

for plane in robot_planes:
    script += ur.move_l(plane,accel,vel)
#    script += ur.move_l_blend(plane,accel,vel,0.003)

## 6 ## ===== Creating one script file and sending to the controller =====
#send = False
if send:
    script = com.concatenate_script(script)
    com.send_script(script,ROBOT_IP)
# ---------- end robotic_drawing ----------
geometry_4 = Geometry(robotic_drawing.way_planes)  # disabled

xy = XYPlane(Origin=Point(0, 0, 0))
xy_2 = XYPlane(Origin=Point(0, 0, 0))
xy_3 = XYPlane(Origin=Point(0, 0, 0))
xy_4 = XYPlane(Origin=Point(0, 0, 0))
xy_5 = XYPlane(Origin=Point(0, 0, 0))
xy_6 = XYPlane(Origin=Point(0, 0, 0))
align_planes = AlignPlanes(Master=xy)
align_planes_2 = AlignPlanes(Master=xy_2)
align_planes_3 = AlignPlanes(Master=xy_3)
align_planes_4 = AlignPlanes(Master=xy_4)
xy_7 = XYPlane(Origin=Point(0, 0, 0))
align_planes_5 = AlignPlanes(Master=xy_5)
align_planes_6 = AlignPlanes(Master=xy_7)
plnaxis = PlaneAxis(P=align_planes, B=35)
plnaxis_2 = PlaneAxis(P=align_planes_2, B=35)
plnaxis_3 = PlaneAxis(P=align_planes_3, B=35)
plnaxis_4 = PlaneAxis(P=align_planes_4, B=35)
plnaxis_5 = PlaneAxis(P=align_planes_5, B=35)
xy_8 = XYPlane(Origin=Point(0, 0, 0))

# ---- group: TRIM RECTANGLE
crv_15 = Curve(Tree({0;0;0}: [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], {0;1;0}: [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], {0;2;0}: [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], {0;3;0}: [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], {0;4;0}: [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], {0;5;0}: [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]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))
trim_2 = TrimWithRegion(Curve=crv_15, Region=circle, Plane=xy_plane)  # -> Inside, Outside

# ----
geometry_5 = Geometry(trim_2.Inside)

# ---- group: SECOND-CIRCLE_UNEEDED?
trim_with_region_2 = TrimWithRegion(Curve=trim_2.Inside, Region=circle_cnr_2, Plane=xy_plane)  # -> Inside, Outside

# ---- group: CHECKING FOR CULLING
panel_9 = Panel("""16
18
21
23
30
40""")

# ---- group: TRIM RECTANGLE (continued)
collision_one_many = CollisionOneMany(Collider=geometry_5, Obstacles=circle_cnr)  # -> Collision, Index
dispatch_3 = Dispatch(List=geometry_5, DispatchPattern=collision_one_many.Collision)  # -> flatten(ListA), flatten(ListB)

# ---- group: CHECKING FOR CULLING (continued)
item = ListItem(List=dispatch_3.ListA, Index=Slider(40, range=0..42), Wrap=True)
geometry_6 = Geometry(item)

# ----
cull_index = CullIndex(List=dispatch_3.ListA, Indices=panel_3, Wrap=True)

# ---- group: TRIM RECTANGLE (continued)
trim_with_region_3 = TrimWithRegion(Curve=cull_index, Region=circle_cnr, Plane=xy_plane)  # -> flatten(Inside), Outside

# ----
clean = CleanTree(RemoveNulls=True, RemoveInvalid=True, RemoveEmpty=Toggle(True), Tree=trim_with_region_3.Outside)  # -> simplify(flatten(Tree))
dispatch_4 = Dispatch(List=clean, DispatchPattern=panel_4)  # -> ListA, ListB

_3_ex = Geometry(dispatch_4.ListB)
_2_in = Geometry(trim_with_region_3.Inside)
_1_ex = Geometry(dispatch_4.ListA)

list_item = ListItem(List=_2_in, Index=number_slider_13, Wrap=True)
list_item_2 = ListItem(List=_1_ex, Index=number_slider_13, Wrap=True)
list_item_3 = ListItem(List=_3_ex, Index=number_slider_13, Wrap=True)
merge_2 = Merge(Data1=list_item, Data2=list_item_2, Data3=list_item_3)

# ---- group: USE WITH CAUTION !!! / LINES NO INTERSECT
geometry_7 = Geometry(dispatch_3.ListB)

# ----
closed = Closed(Curve=geometry_7)  # -> Closed, Periodic
dispatch_5 = Dispatch(List=geometry_7, DispatchPattern=closed.Closed)  # -> ListA, ListB
cull_index_2 = CullIndex(List=dispatch_5.ListB, Indices=panel_5, Wrap=True)
curve = Curve(dispatch_5.ListB)
curve_2 = Curve(cull_index_2)
list_item_4 = ListItem(List=curve_2, Index=Slider(10, range=0..50), Wrap=True)
custom_preview = CustomPreview(
    Geometry=list_item_4,
    Material={diffuse=RGB(221, 160, 221), emission=RGB(66, 48, 66), shine=0.5, specular=RGB(255, 255, 255), transparency=0})
custom_preview_2 = CustomPreview(
    Geometry=curve_2,
    Material={diffuse=RGB(221, 160, 221), emission=RGB(66, 48, 66), shine=0.5, specular=RGB(255, 255, 255), transparency=0})
panel_10 = Panel(closed.Closed)

geo_3 = Geometry(_2_in)
len_2 = Length(Curve=geo_3)
larger_2 = LargerThan(FirstNumber=len_2, SecondNumber=number_slider_14)  # -> LargerThan, OrEqualTo
dispatch_6 = Dispatch(List=geo_3, DispatchPattern=larger_2.LargerThan)  # -> ListA, ListB
geo_4 = Geometry(dispatch_6.ListA)
crv_16 = Curve(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)
trim_3 = TrimWithRegion(Curve=geo_4, Region=crv_16)  # -> Inside, Outside
crv_17 = Curve(trim_3.Inside)
flatten_2 = FlattenTree(Tree=crv_17, Path="{0}")
end_2 = EndPoints(Curve=flatten_2)  # -> Start, End
pt_9 = Point(end_2.Start)
crv_18 = Curve(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)
pt_10 = Point(end_2.End)
incurve_2 = PointInCurve(Point=pt_9, Curve=crv_18)  # -> Relationship, Point
cset_2 = CreateSet(List=incurve_2.Relationship)  # -> Set, Map
dispatch_7 = Dispatch(List=flatten_2, DispatchPattern=cset_2.Map)  # -> ListA, ListB
crv_19 = Curve(dispatch_7.ListB)
crv_20 = Curve(dispatch_7.ListA)
divide_2 = DivideCurve(Curve=[crv_20, crv_19], Count=number_slider_15, Kinks=False)  # -> Points, Tangents, Parameters
intcrv_2 = Interpolate(Vertices=divide_2.Points, Degree=3, Periodic=False, KnotStyle=1)  # -> Curve, Length, Domain

geo_5 = Geometry(_1_ex)
len_3 = Length(Curve=geo_5)
larger_3 = LargerThan(FirstNumber=len_3, SecondNumber=number_slider_14)  # -> LargerThan, OrEqualTo
dispatch_8 = Dispatch(List=geo_5, DispatchPattern=larger_3.LargerThan)  # -> ListA, ListB
geo_6 = Geometry(dispatch_8.ListA)
crv_21 = Curve(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)
trim_4 = TrimWithRegion(Curve=geo_6, Region=crv_21)  # -> Inside, Outside
crv_22 = Curve(trim_4.Inside)
flatten_3 = FlattenTree(Tree=crv_22, Path="{0}")
end_3 = EndPoints(Curve=flatten_3)  # -> Start, End
pt_11 = Point(end_3.Start)
crv_23 = Curve(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)
pt_12 = Point(end_3.End)
incurve_3 = PointInCurve(Point=pt_11, Curve=crv_23)  # -> Relationship, Point
cset_3 = CreateSet(List=incurve_3.Relationship)  # -> Set, Map
dispatch_9 = Dispatch(List=flatten_3, DispatchPattern=cset_3.Map)  # -> ListA, ListB
crv_24 = Curve(dispatch_9.ListB)
crv_25 = Curve(dispatch_9.ListA)
divide_3 = DivideCurve(Curve=[crv_25, crv_24], Count=number_slider_15, Kinks=False)  # -> Points, Tangents, Parameters
intcrv_3 = Interpolate(Vertices=divide_3.Points, Degree=3, Periodic=False, KnotStyle=1)  # -> Curve, Length, Domain

geo_7 = Geometry(_3_ex)
len_4 = Length(Curve=geo_7)
larger_4 = LargerThan(FirstNumber=len_4, SecondNumber=number_slider_14)  # -> LargerThan, OrEqualTo
dispatch_10 = Dispatch(List=geo_7, DispatchPattern=larger_4.LargerThan)  # -> ListA, ListB
crv_26 = Curve(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)
geo_8 = Geometry(dispatch_10.ListA)
divide_4 = DivideCurve(Curve=geo_8, Count=number_slider_15, Kinks=False)  # -> Points, Tangents, Parameters
intcrv_4 = Interpolate(Vertices=divide_4.Points, Degree=3, Periodic=False, KnotStyle=1)  # -> Curve, Length, Domain

geo_9 = Geometry(geometry_7)
len_5 = Length(Curve=geo_9)
larger_5 = LargerThan(FirstNumber=len_5, SecondNumber=Slider(55, range=10..100))  # -> LargerThan, OrEqualTo
dispatch_11 = Dispatch(List=geo_9, DispatchPattern=larger_5.LargerThan)  # -> ListA, ListB
crv_27 = Curve(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)
geo_10 = Geometry(dispatch_11.ListA)
divide_5 = DivideCurve(Curve=geo_10, Count=number_slider_15, Kinks=False)  # -> Points, Tangents, Parameters
intcrv_5 = Interpolate(Vertices=divide_5.Points, Degree=3, Periodic=False, KnotStyle=1)  # -> Curve, Length, Domain

# ---- group: LINES-NO-INTERCEPT
geometry_8 = Geometry(flatten(intcrv_5.Curve))

# ----
# INSIDE CURVE: NO ANGLE OR DEPTH DIFFERENCE
geometry_9 = Geometry(flatten(intcrv_4.Curve))
geometry_10 = Geometry(flatten(intcrv_2.Curve))
geometry_11 = Geometry(flatten(intcrv_3.Curve))

panel_11 = Panel(geometry_8)
panel_12 = Panel(geometry_11)

# ----
# INSIDE CURVE: NO ANGLE OR DEPTH DIFFERENCE
# Modifiers : Angle, Height, etc
dist = Slider(10, range=1..20)
toggle_5 = BooleanToggle(True)
divide_curve_to_create_planes = GhPythonScript(curves=geometry_10, dist=dist, missing_point=toggle_5, flip_curve=toggle_2)  # -> allpts, allcounts; inputs curves: list of Curve, flip_curve: Boolean
# ---------- divide_curve_to_create_planes: Python ----------
import Rhino.Geometry as rg#
import math
import copy_reg



def remap(value,low1,high1, low2, high2):
    """
    value : original value
    low1 : original value's lower bound
    high1 : original value's upper bound
    low2 : remapped value's lower bound
    high2 : remapped value's upper bound
    """
    remapped_value = low2 + (value - low1) * (high2 - low2) / (high1 - low1)
    return remapped_value









#Copying the plane

#first_plane = planes[0]
#second_plane = first_plane.Clone()
#
##deep copy using copy
##second_plane = copy.deepcopy(first_plane)
#
#rg.plane.Translate()
#rg.Plane.ZAxis
#safe_distance = 50
#second_plane.Translate(second_plane.ZAxis * safe_distance)
#
##list.insert(index, value)
#planes.insert(0,second_plane)

allpts = []
allcounts = []

for curve in curves:
    if flip_curve:
        curve.Reverse()
    # 0. Divide curve into a set of points 
    params = curve.DivideByLength(dist, True)   #generates a lists of parameters (location of the point on the curve)
    params_list = []
    
    for p in params:
        params_list.append(p)
        

    pts = []                                    #creates empty list for adding pt
    for p in params_list:                            # iterates trough the list of params and ads a point at each location
        pt = curve.PointAt(p)
        pts.append(pt)
    if missing_point:
        pts.append(curve.PointAtEnd)
    
    allpts.append(pts)
    allcounts.append(len(pts))
# ---------- end divide_curve_to_create_planes ----------
avr = Average(Input=divide_curve_to_create_planes.allcounts)
int = Integer(avr)
number_slider_29 = Slider(15.305, range=0..50)
divide_curve_to_create_planes_2 = GhPythonScript(
    curves=geometry_10,
    dist=dist,
    rotation=Toggle(False),
    height=Toggle(False),
    function=Toggle(False),
    go_up_val=number_slider_29,
    missing_point=toggle_5,
    flip_curve=toggle_2)  # -> allpts, raw_tangents, all_X_axis, all_Y_axis, flatten(allplanes); inputs curves: list of Curve, angle_map: list, height_map: list, rotation: Boolean, height: Boolean, flip_curve: Boolean
# ---------- divide_curve_to_create_planes_2: Python ----------
import Rhino.Geometry as rg#
import math
import copy_reg
import ghpythonlib.treehelpers as th


def remap(value,low1,high1, low2, high2):
    """
    value : original value
    low1 : original value's lower bound
    high1 : original value's upper bound
    low2 : remapped value's lower bound
    high2 : remapped value's upper bound
    """
    remapped_value = low2 + (value - low1) * (high2 - low2) / (high1 - low1)
    return remapped_value









#Copying the plane

#first_plane = planes[0]
#second_plane = first_plane.Clone()
#
##deep copy using copy
##second_plane = copy.deepcopy(first_plane)
#
#rg.plane.Translate()
#rg.Plane.ZAxis
#safe_distance = 50
#second_plane.Translate(second_plane.ZAxis * safe_distance)
#
##list.insert(index, value)
#planes.insert(0,second_plane)

allpts = []
alltangents = []
allplanes = []
all_X_axis = []
all_Y_axis = []


for curve  in curves :

    
    if flip_curve:
        curve.Reverse()
    # 0. Divide curve into a set of points 
    params = curve.DivideByLength(dist, True)   #generates a lists of parameters (location of the point on the curve)
    params_list = []
    
    for p in params:
        params_list.append(p)
        
    #params_list.insert(0, curve.PointAtStart)
    #params_list.append(curve.PointAtEnd)
    #print(params)
    pts = []                                    #creates empty list for adding pt
    for p in params_list:                            # iterates trough the list of params and ads a point at each location
        pt = curve.PointAt(p)
        pts.append(pt)
    pts.insert(0, curve.PointAtStart)
    pts.append(curve.PointAtEnd)
    if missing_point:
        pts.append(curve.PointAtEnd)
    pts[0].Z += go_up_val
    pts[-1].Z += go_up_val
    
    allpts.append(pts)

    # 1. Create a list of tangents (x-axis) at each pt location 
    tangents = []                           #creates empty list for adding pt
    for p in params_list:                            #iterates trough the list of params and get the tangent at each location
        t = curve.TangentAt(p)
        tangents.append(t)
    
    tangents.append(curve.TangentAtStart)
    tangents.append(curve.TangentAtEnd)
    tangents.append(curve.TangentAtEnd)
    
    # 2. Create y-axis vector (normal) from world Zaxis and the xaxis 
    # rg.Vector3d.CrossProduct cross products are crucial when working with vectors https://en.wikipedia.org/wiki/Cross_product
    
    X_axis = []
    Y_axis = []
    
    for t in tangents:
        X_axis.append(t)                                         
        Yvec = rg.Vector3d.CrossProduct(rg.Vector3d(0,0,1), t)
        Y_axis.append(Yvec)

    # 3. Create planes from the pt, x-axis and y-axis
    planes = []
    
    for pt, x_vec, y_vec in zip (pts, X_axis, Y_axis):
        plane = rg.Plane(pt, x_vec, y_vec)
        planes.append(plane)
    

    # 4. Rotates (along Y-Axis) and translates (in Z-Axis) the planes 
    if rotation:
        for plane,angle in zip(planes,angle_map):
            #remap values to desired domain
            new_angle = remap(angle, 0.0, 1.0, 30, 0)
            #Rotate(self: Plane, angle: float, axis: Vector3d, centerOfRotation: Point3d) -> bool
            plane.Rotate(math.radians(new_angle),plane.XAxis,plane.Origin)
    
    if height:
        for plane,h in zip(planes,height_map):
            #remap values to desired domain
            new_height = remap(h, 0.0, 1.0, -2, -0)
            # Translate(self: Plane, delta: Vector3d) -> bool
            plane.Translate(rg.Vector3d(0,0,new_height))

    # 5. Varying parameters using mathematical functions 
    if function:
        for i,(plane,h) in enumerate(zip(planes,height_map)):
            #use random mathematical function
            h = (math.sin(i) + math.cos(i)) #domain of sin(theta) and cosine(theta) is -1 to 1 
            #remap values to desired domain
            new_height = remap(h, -2.0, 2.0, -2, 10)
            # Translate(self: Plane, delta: Vector3d) -> bool
            plane.Translate(rg.Vector3d(0,0,new_height))
            
    if flip_curve:
        planes.reverse()
        tangents.reverse()
        X_axis.reverse()
        Y_axis.reverse()
    allplanes.append(planes)
    alltangents.append(tangents)
    all_X_axis.append(X_axis)
    all_Y_axis.append(Y_axis)
# ---------- end divide_curve_to_create_planes_2 ----------
python_5 = GhPythonScript(
    x=divide_curve_to_create_planes_2.allpts,
    y=divide_curve_to_create_planes_2.all_X_axis,
    z=divide_curve_to_create_planes_2.all_Y_axis,
    mu=divide_curve_to_create_planes_2.allplanes)  # -> out, a, b, c, simplify(d)
# ---------- python_5: Python ----------
__author__ = "ahmed"
__version__ = "2022.10.08"

a = x
b = y 
c = z
d = mu
# ---------- end python_5 ----------
xy_9 = XYPlane(Origin=Point(0, 0, 0))
geo_11 = Geometry(python_5.d)
list_length = ListLength(List=divide_curve_to_create_planes_2.allpts)
align = AlignPlanes(Planes=geo_11, Master=xy_9)  # -> flatten(Planes)
vdis = VectorDisplay(Anchor=python_5.b, Vector=python_5.b)
vdis_2 = VectorDisplay(Anchor=python_5.a, Vector=divide_curve_to_create_planes_2.raw_tangents)
vdis_3 = VectorDisplay(Anchor=python_5.c, Vector=python_5.c)
points = PointList(Points=align, Size=Slider(1, range=0..100))
plnaxis_6 = PlaneAxis(P=align, B=35)

data = Data(python_5.d)
explode_tree = ExplodeTree(Data=data)  # -> Branch0, Branch1, Branch2, Branch3, Branch4, Branch5, Branch6, Branch7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

# ----
# STILL NEEDS TO BE TESTED
# Modifiers : Angle, Height, etc
panel_13 = Panel("310")  # disabled
dist_2 = Slider(10, range=1..20)  # disabled
toggle_6 = BooleanToggle(True)  # disabled
toggle_7 = BooleanToggle(True)  # disabled
toggle_8 = BooleanToggle(False)  # disabled

# ----
# Height
range = Range(Domain=Domain(0, 1), Steps=panel_13)  # disabled
graph = GraphMapper(reverse(range), x0=0, x1=1, y0=0, y1=1, Cx=0.9462112188, Cy=0.3656235933, container_name="Conic")  # disabled

# ----
# Angle
range_2 = Range(Domain=Domain(0, 1), Steps=panel_13)  # disabled
graph_2 = GraphMapper(reverse(range_2), x0=0, x1=1, y0=0, y1=1, Cx=0.9462112188, Cy=0.3656235933, container_name="Conic")  # disabled

panel_14 = Panel(graph)  # disabled
divide_curve_to_create_planes_3 = GhPythonScript(angle_map=graph_2, height_map=graph, dist=dist_2, rotation=toggle_6, height=toggle_7, function=toggle_8)  # -> flatten(pts), raw_tangents, X_axis, Y_axis, flatten(planes); inputs curve: Curve, angle_map: list, height_map: list, rotation: Boolean, height: Boolean; disabled
# ---------- divide_curve_to_create_planes_3: Python ----------
import Rhino.Geometry as rg#
import math
import copy_reg



def remap(value,low1,high1, low2, high2):
    """
    value : original value
    low1 : original value's lower bound
    high1 : original value's upper bound
    low2 : remapped value's lower bound
    high2 : remapped value's upper bound
    """
    remapped_value = low2 + (value - low1) * (high2 - low2) / (high1 - low1)
    return remapped_value

# ==============================================================================
# 0. Divide curve into a set of points 
# ==============================================================================
params = curve[0].DivideByLength(dist, True)   #generates a lists of parameters (location of the point on the curve)


pts = []                                    #creates empty list for adding pt
for p in params:                            # iterates trough the list of params and ads a point at each location
    pt = curve[0].PointAt(p)
    pts.append(pt)
    


# ==============================================================================
# 1. Create a list of tangents (x-axis) at each pt location 
# ==============================================================================

tangents = []                           #creates empty list for adding pt
for p in params:                            #iterates trough the list of params and get the tangent at each location
    t = curve[0].TangentAt(p)
    tangents.append(t)
    


# ==============================================================================
# 2. Create y-axis vector (normal) from world Zaxis and the xaxis 
# rg.Vector3d.CrossProduct cross products are crucial when working with vectors https://en.wikipedia.org/wiki/Cross_product
# ==============================================================================


X_axis = []
Y_axis = []


for t in tangents:
    X_axis.append(t)                                         
    Yvec = rg.Vector3d.CrossProduct(rg.Vector3d(0,0,1), t)
    Y_axis.append(Yvec)




# ==============================================================================
# 3. Create planes from the pt, x-axis and y-axis
# ==============================================================================

planes = []

for pt, x_vec, y_vec in zip (pts, X_axis, Y_axis):
    plane = rg.Plane(pt, x_vec, y_vec)
    planes.append(plane)

# ==============================================================================
# 4. Rotates (along Y-Axis) and translates (in Z-Axis) the planes 
# ==============================================================================


if rotation:
    for plane,angle in zip(planes,angle_map):
        #remap values to desired domain
        new_angle = remap(angle, 0.0, 1.0, -45.0, 45.0)
        #Rotate(self: Plane, angle: float, axis: Vector3d, centerOfRotation: Point3d) -> bool
        plane.Rotate(math.radians(new_angle),plane.XAxis,plane.Origin)

if height:
    for plane,h in zip(planes,height_map):
        #remap values to desired domain
        new_height = remap(h, 0.0, 1.0, -2, -0)
        # Translate(self: Plane, delta: Vector3d) -> bool
        plane.Translate(rg.Vector3d(0,0,new_height))
        
        

# ==============================================================================
# 5. Varying parameters using mathematical functions 
# ==============================================================================

if function:
    for i,(plane,h) in enumerate(zip(planes,height_map)):
        #use random mathematical function
        h = (math.sin(i) + math.cos(i)) #domain of sin(theta) and cosine(theta) is -1 to 1 
        #remap values to desired domain
        new_height = remap(h, -2.0, 2.0, -2, 10)
        # Translate(self: Plane, delta: Vector3d) -> bool
        plane.Translate(rg.Vector3d(0,0,new_height))


#Copying the plane

#first_plane = planes[0]
#second_plane = first_plane.Clone()
#
##deep copy using copy
##second_plane = copy.deepcopy(first_plane)
#
##rg.plane.Translate()
##rg.Plane.ZAxis
#safe_distance = 50
#second_plane.Translate(second_plane.ZAxis * safe_distance)
#
##list.insert(index, value)
#planes.insert(0,second_plane)
# ---------- end divide_curve_to_create_planes_3 ----------
vdis_4 = VectorDisplay(Anchor=divide_curve_to_create_planes_3.pts, Vector=divide_curve_to_create_planes_3.raw_tangents)  # disabled
vdis_5 = VectorDisplay(Anchor=divide_curve_to_create_planes_3.pts, Vector=divide_curve_to_create_planes_3.X_axis)  # disabled
vdis_6 = VectorDisplay(Anchor=divide_curve_to_create_planes_3.pts, Vector=divide_curve_to_create_planes_3.Y_axis)  # disabled
geo_12 = Geometry(divide_curve_to_create_planes_3.planes)  # disabled
list_length_2 = ListLength(List=divide_curve_to_create_planes_3.pts)  # disabled
panel_15 = Panel(divide_curve_to_create_planes_3.planes)  # disabled
panel_16 = Panel(list_length_2)  # disabled

panel_17 = Panel(graph_2)  # disabled
degrees = Degrees(Radians=panel_17)  # disabled
panel_18 = Panel(degrees)  # disabled

button_2 = Button()  # disabled
# SECOND ROBOT
# IP : 192.168.10.10
robotic_drawing_2 = GhPythonScript(way_planes=geo_12, send=button_2)  # -> out, way_planes; inputs way_planes: list of Plane; disabled
# ---------- robotic_drawing_2: Python ----------
from imp import reload

import simple_comm as com
reload(com)

import simple_ur_script as ur
reload(ur)

import Rhino.Geometry as rg

import math as m
import random as r

ROBOT_IP = "192.168.10.10"

## 1 ## ===== Setting robot base plane from pts =====
ORIGIN = rg.Point3d(509.31, 84.18, -11.72) #-11.72
X_AXIS = rg.Point3d(508.90, 294.65, -11.26) #-11.26
Y_POSITIVE_PLANE = rg.Point3d(213.53, 290.74, -11.54) #-11.54

def set_robot_base():
    robot_base = rg.Plane(ORIGIN,X_AXIS-ORIGIN,Y_POSITIVE_PLANE-ORIGIN)
    print (robot_base)
    return (robot_base)

def rhino_to_robot_space(_plane,robot_base):
    _r_matrix = rg.Transform.PlaneToPlane(rg.Plane.WorldXY,robot_base)
    _plane.Transform(_r_matrix)
    return _plane

## 2 ## ===== Robot base is set =====
robot_base =  set_robot_base()


## 3 ## ===== Transforming the rhino planes into robot planes =====
robot_planes = []
for plane in way_planes: 
    robot_planes.append(rhino_to_robot_space(plane, robot_base))

script = ""
#script += ur.set_tcp_by_angles(0.0,85.0,35.0,m.radians(-90.0),m.radians(180.0),m.radians(0))


## 5 ## ===== Assigning the translation movement =====
accel = 0.3
vel = 0.3

for plane in robot_planes:
#    script += ur.move_l(plane,accel,vel)
    script += ur.move_l_blend(plane,accel,vel,0.003)

## 6 ## ===== Creating one script file and sending to the controller =====
#send = False
if send:
    script = com.concatenate_script(script)
    com.send_script(script,ROBOT_IP)
# ---------- end robotic_drawing_2 ----------
geometry_12 = Geometry(robotic_drawing_2.way_planes)  # disabled

# ----
# OUTSIDE CURVES-NO-INTERCEPT
# Modifiers : Angle, Height, etc
dist_3 = Slider(10, range=1..20)
toggle_9 = BooleanToggle(True)
divide_curve_to_create_planes_4 = GhPythonScript(curves=geometry_8, dist=dist_3, missing_point=toggle_9, flip_curve=toggle)  # -> allpts, allcounts; inputs curves: list of Curve, flip_curve: Boolean; same code as divide_curve_to_create_planes
avr_2 = Average(Input=divide_curve_to_create_planes_4.allcounts)
int_2 = Integer(avr_2)
xy_10 = XYPlane(Origin=Point(0, 0, 0))

panel_19 = Panel(avr_2)

# ----
# Angle: REVERSED
range_3 = Range(Domain=Domain(0, 1), Steps=int_2)
graph_3 = GraphMapper(
    reverse(range_3),
    x0=0,
    x1=1,
    y0=0,
    y1=1,
    Ox=0.4743157029,
    Oy=0.4692577124,
    Px=0.9334875941,
    Py=0.2169666886,
    container_name="Parabola")

# ----
# Height: REVERSED
range_4 = Range(Domain=Domain(0, 1), Steps=int_2)
graph_4 = GraphMapper(
    reverse(range_4),
    x0=0,
    x1=1,
    y0=0,
    y1=1,
    Ox=0.5205396414,
    Oy=0.6471813917,
    Px=0.9355928898,
    Py=0.3834688663,
    container_name="Parabola")

panel_20 = Panel(graph_4)

divide_curve_to_create_planes_5 = GhPythonScript(
    curves=geometry_8,
    angle_map=graph_3,
    height_map=graph_4,
    dist=dist_3,
    rotation=Toggle(True),
    height=Toggle(True),
    function=Toggle(False),
    go_up_val=Slider(15.305, range=0..50),
    missing_point=toggle_9,
    flip_curve=toggle)  # -> allpts, raw_tangents, all_X_axis, all_Y_axis, flatten(allplanes); inputs curves: list of Curve, angle_map: list, height_map: list, rotation: Boolean, height: Boolean, flip_curve: Boolean
# ---------- divide_curve_to_create_planes_5: Python ----------
import Rhino.Geometry as rg#
import math
import copy_reg
import ghpythonlib.treehelpers as th


def remap(value,low1,high1, low2, high2):
    """
    value : original value
    low1 : original value's lower bound
    high1 : original value's upper bound
    low2 : remapped value's lower bound
    high2 : remapped value's upper bound
    """
    remapped_value = low2 + (value - low1) * (high2 - low2) / (high1 - low1)
    return remapped_value









#Copying the plane

#first_plane = planes[0]
#second_plane = first_plane.Clone()
#
##deep copy using copy
##second_plane = copy.deepcopy(first_plane)
#
#rg.plane.Translate()
#rg.Plane.ZAxis
#safe_distance = 50
#second_plane.Translate(second_plane.ZAxis * safe_distance)
#
##list.insert(index, value)
#planes.insert(0,second_plane)

allpts = []
alltangents = []
allplanes = []
all_X_axis = []
all_Y_axis = []


for curve  in curves :

    
    if flip_curve:
        curve.Reverse()
    # 0. Divide curve into a set of points 
    params = curve.DivideByLength(dist, True)   #generates a lists of parameters (location of the point on the curve)
    params_list = []
    
    for p in params:
        params_list.append(p)
        
    #params_list.insert(0, curve.PointAtStart)
    #params_list.append(curve.PointAtEnd)
    #print(params)
    pts = []                                    #creates empty list for adding pt
    for p in params_list:                            # iterates trough the list of params and ads a point at each location
        pt = curve.PointAt(p)
        pts.append(pt)
    pts.insert(0, curve.PointAtStart)
    pts.append(curve.PointAtEnd)
    if missing_point:
        pts.append(curve.PointAtEnd)
    pts[0].Z += go_up_val
    pts[-1].Z += go_up_val
    
    allpts.append(pts)

    # 1. Create a list of tangents (x-axis) at each pt location 
    tangents = []                           #creates empty list for adding pt
    for p in params_list:                            #iterates trough the list of params and get the tangent at each location
        t = curve.TangentAt(p)
        tangents.append(t)
    
    tangents.append(curve.TangentAtStart)
    tangents.append(curve.TangentAtEnd)
    tangents.append(curve.TangentAtEnd)
    
    # 2. Create y-axis vector (normal) from world Zaxis and the xaxis 
    # rg.Vector3d.CrossProduct cross products are crucial when working with vectors https://en.wikipedia.org/wiki/Cross_product
    
    X_axis = []
    Y_axis = []
    
    for t in tangents:
        X_axis.append(t)                                         
        Yvec = rg.Vector3d.CrossProduct(rg.Vector3d(0,0,1), t)
        Y_axis.append(Yvec)

    # 3. Create planes from the pt, x-axis and y-axis
    planes = []
    
    for pt, x_vec, y_vec in zip (pts, X_axis, Y_axis):
        plane = rg.Plane(pt, x_vec, y_vec)
        planes.append(plane)
    

    # 4. Rotates (along Y-Axis) and translates (in Z-Axis) the planes 
    if rotation:
        for plane,angle in zip(planes,angle_map):
            #remap values to desired domain
            new_angle = remap(angle, 0.0, 1.0, 45, 0)
            #Rotate(self: Plane, angle: float, axis: Vector3d, centerOfRotation: Point3d) -> bool
            plane.Rotate(math.radians(new_angle),plane.XAxis,plane.Origin)
    
    if height:
        for plane,h in zip(planes,height_map):
            #remap values to desired domain
            new_height = remap(h, 0.0, 1.0, -1.25, -0.75)
            # Translate(self: Plane, delta: Vector3d) -> bool
            plane.Translate(rg.Vector3d(0,0,new_height))

    # 5. Varying parameters using mathematical functions 
    if function:
        for i,(plane,h) in enumerate(zip(planes,height_map)):
            #use random mathematical function
            h = (math.sin(i) + math.cos(i)) #domain of sin(theta) and cosine(theta) is -1 to 1 
            #remap values to desired domain
            new_height = remap(h, -2.0, 2.0, -2, 10)
            # Translate(self: Plane, delta: Vector3d) -> bool
            plane.Translate(rg.Vector3d(0,0,new_height))
            
    if flip_curve:
        planes.reverse()
        tangents.reverse()
        X_axis.reverse()
        Y_axis.reverse()
    allplanes.append(planes)
    alltangents.append(tangents)
    all_X_axis.append(X_axis)
    all_Y_axis.append(Y_axis)
# ---------- end divide_curve_to_create_planes_5 ----------
python_6 = GhPythonScript(
    x=divide_curve_to_create_planes_5.allpts,
    y=divide_curve_to_create_planes_5.all_X_axis,
    z=divide_curve_to_create_planes_5.all_Y_axis,
    mu=divide_curve_to_create_planes_5.allplanes)  # -> out, a, b, c, simplify(d); same code as python_5
geo_13 = Geometry(python_6.d)
align_2 = AlignPlanes(Planes=geo_13, Master=xy_10)  # -> flatten(Planes)
list_length_3 = ListLength(List=divide_curve_to_create_planes_5.allpts)
vdis_7 = VectorDisplay(Anchor=python_6.b, Vector=python_6.b)
vdis_8 = VectorDisplay(Anchor=python_6.a, Vector=divide_curve_to_create_planes_5.raw_tangents)
vdis_9 = VectorDisplay(Anchor=python_6.c, Vector=python_6.c)
points_2 = PointList(Points=align_2, Size=Slider(1, range=0..100))
plnaxis_7 = PlaneAxis(P=align_2, B=35)

data_2 = Data(python_6.d)

# ----
# OUTSIDE CURVES 2 : ZERO TO MAX ANGLE
# Modifiers : Angle, Height, etc
dist_4 = Slider(10, range=1..20)
toggle_10 = BooleanToggle(True)
divide_curve_to_create_planes_6 = GhPythonScript(curves=geometry_11, dist=dist_4, missing_point=toggle_10, flip_curve=toggle_3)  # -> allpts, allcounts; inputs curves: list of Curve, flip_curve: Boolean; same code as divide_curve_to_create_planes
avr_3 = Average(Input=divide_curve_to_create_planes_6.allcounts)
int_3 = Integer(avr_3)
xy_11 = XYPlane(Origin=Point(0, 0, 0))

# ----
# Angle: REVERSED
range_5 = Range(Domain=Domain(0, 1), Steps=int_3)
graph_5 = GraphMapper(range_5, x0=0, x1=1, y0=0, y1=1, Cx=0.7953641415, Cy=0.4081155658, container_name="Conic")

# ----
# Height: REVERSED
range_6 = Range(Domain=Domain(0, 1), Steps=int_3)
graph_6 = GraphMapper(range_6, x0=0, x1=1, y0=0, y1=1, Cx=0.8178763986, Cy=0.3886466622, container_name="Conic")

divide_curve_to_create_planes_7 = GhPythonScript(
    curves=geometry_11,
    angle_map=graph_5,
    height_map=graph_6,
    dist=dist_4,
    rotation=Toggle(True),
    height=Toggle(True),
    function=Toggle(False),
    go_up_val=Slider(15.305, range=0..50),
    missing_point=toggle_10,
    flip_curve=toggle_3)  # -> allpts, raw_tangents, all_X_axis, all_Y_axis, flatten(allplanes); inputs curves: list of Curve, angle_map: list, height_map: list, rotation: Boolean, height: Boolean, flip_curve: Boolean
# ---------- divide_curve_to_create_planes_7: Python ----------
import Rhino.Geometry as rg#
import math
import copy_reg
import ghpythonlib.treehelpers as th


def remap(value,low1,high1, low2, high2):
    """
    value : original value
    low1 : original value's lower bound
    high1 : original value's upper bound
    low2 : remapped value's lower bound
    high2 : remapped value's upper bound
    """
    remapped_value = low2 + (value - low1) * (high2 - low2) / (high1 - low1)
    return remapped_value









#Copying the plane

#first_plane = planes[0]
#second_plane = first_plane.Clone()
#
##deep copy using copy
##second_plane = copy.deepcopy(first_plane)
#
#rg.plane.Translate()
#rg.Plane.ZAxis
#safe_distance = 50
#second_plane.Translate(second_plane.ZAxis * safe_distance)
#
##list.insert(index, value)
#planes.insert(0,second_plane)

allpts = []
alltangents = []
allplanes = []
all_X_axis = []
all_Y_axis = []


for curve  in curves :

    
    if flip_curve:
        curve.Reverse()
    # 0. Divide curve into a set of points 
    params = curve.DivideByLength(dist, True)   #generates a lists of parameters (location of the point on the curve)
    params_list = []
    
    for p in params:
        params_list.append(p)
        
    #params_list.insert(0, curve.PointAtStart)
    #params_list.append(curve.PointAtEnd)
    #print(params)
    pts = []                                    #creates empty list for adding pt
    for p in params_list:                            # iterates trough the list of params and ads a point at each location
        pt = curve.PointAt(p)
        pts.append(pt)
    pts.insert(0, curve.PointAtStart)
    pts.append(curve.PointAtEnd)
    if missing_point:
        pts.append(curve.PointAtEnd)
    pts[0].Z += go_up_val
    pts[-1].Z += go_up_val
    
    allpts.append(pts)

    # 1. Create a list of tangents (x-axis) at each pt location 
    tangents = []                           #creates empty list for adding pt
    for p in params_list:                            #iterates trough the list of params and get the tangent at each location
        t = curve.TangentAt(p)
        tangents.append(t)
    
    tangents.append(curve.TangentAtStart)
    tangents.append(curve.TangentAtEnd)
    tangents.append(curve.TangentAtEnd)
    
    # 2. Create y-axis vector (normal) from world Zaxis and the xaxis 
    # rg.Vector3d.CrossProduct cross products are crucial when working with vectors https://en.wikipedia.org/wiki/Cross_product
    
    X_axis = []
    Y_axis = []
    
    for t in tangents:
        X_axis.append(t)                                         
        Yvec = rg.Vector3d.CrossProduct(rg.Vector3d(0,0,1), t)
        Y_axis.append(Yvec)

    # 3. Create planes from the pt, x-axis and y-axis
    planes = []
    
    for pt, x_vec, y_vec in zip (pts, X_axis, Y_axis):
        plane = rg.Plane(pt, x_vec, y_vec)
        planes.append(plane)
    

    # 4. Rotates (along Y-Axis) and translates (in Z-Axis) the planes 
    if rotation:
        for plane,angle in zip(planes,angle_map):
            #remap values to desired domain
            new_angle = remap(angle, 0.0, 1.0, 30, 0) # 45, 0
            #Rotate(self: Plane, angle: float, axis: Vector3d, centerOfRotation: Point3d) -> bool
            plane.Rotate(math.radians(new_angle),plane.XAxis,plane.Origin)
    
    if height:
        for plane,h in zip(planes,height_map):
            #remap values to desired domain
            new_height = remap(h, 0.0, 1.0, -1.25, -0)
            # Translate(self: Plane, delta: Vector3d) -> bool
            plane.Translate(rg.Vector3d(0,0,new_height))

    # 5. Varying parameters using mathematical functions 
    if function:
        for i,(plane,h) in enumerate(zip(planes,height_map)):
            #use random mathematical function
            h = (math.sin(i) + math.cos(i)) #domain of sin(theta) and cosine(theta) is -1 to 1 
            #remap values to desired domain
            new_height = remap(h, -2.0, 2.0, -2, 10)
            # Translate(self: Plane, delta: Vector3d) -> bool
            plane.Translate(rg.Vector3d(0,0,new_height))
            
    if flip_curve:
        planes.reverse()
        tangents.reverse()
        X_axis.reverse()
        Y_axis.reverse()
    allplanes.append(planes)
    alltangents.append(tangents)
    all_X_axis.append(X_axis)
    all_Y_axis.append(Y_axis)
# ---------- end divide_curve_to_create_planes_7 ----------
python_7 = GhPythonScript(
    x=divide_curve_to_create_planes_7.allpts,
    y=divide_curve_to_create_planes_7.all_X_axis,
    z=divide_curve_to_create_planes_7.all_Y_axis,
    mu=divide_curve_to_create_planes_7.allplanes)  # -> out, a, b, c, simplify(d); same code as python_5
geo_14 = Geometry(python_7.d)
list_length_4 = ListLength(List=divide_curve_to_create_planes_7.allpts)
align_3 = AlignPlanes(Planes=geo_14, Master=xy_11)  # -> flatten(Planes)
vdis_10 = VectorDisplay(Anchor=python_7.b, Vector=python_7.b)
vdis_11 = VectorDisplay(Anchor=python_7.a, Vector=divide_curve_to_create_planes_7.raw_tangents)
vdis_12 = VectorDisplay(Anchor=python_7.c, Vector=python_7.c)
points_3 = PointList(Points=align_3, Size=Slider(1, range=0..100))
plnaxis_8 = PlaneAxis(P=align_3, B=35)

data_3 = Data(python_7.d)
panel_21 = Panel(data_3)
explode_tree_2 = ExplodeTree(Data=data_3)  # -> Branch0, Branch1, Branch2, Branch3, Branch4, Branch5, Branch6, Branch7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

# ----
# OUTSIDE CURVES 1 : MAX ANGLE TO ZERO
# Modifiers : Angle, Height, etc
dist_5 = Slider(10, range=1..20)
toggle_11 = BooleanToggle(True)
divide_curve_to_create_planes_8 = GhPythonScript(curves=geometry_9, dist=dist_5, missing_point=toggle_11, flip_curve=toggle_4)  # -> allpts, allcounts; inputs curves: list of Curve, flip_curve: Boolean; same code as divide_curve_to_create_planes
avr_4 = Average(Input=divide_curve_to_create_planes_8.allcounts)
int_4 = Integer(avr_4)
xy_12 = XYPlane(Origin=Point(0, 0, 0))

# ----
# Angle
range_7 = Range(Domain=Domain(0, 1), Steps=int_4)
graph_7 = GraphMapper(reverse(range_7), x0=0, x1=1, y0=0, y1=1, Cx=0.7797922492, Cy=0.4277209044, container_name="Conic")

# ----
# Height
range_8 = Range(Domain=Domain(0, 1), Steps=int_4)
graph_8 = GraphMapper(reverse(range_8), x0=0, x1=1, y0=0, y1=1, Cx=0.8178763986, Cy=0.3886466622, container_name="Conic")

divide_curve_to_create_planes_9 = GhPythonScript(
    curves=geometry_9,
    angle_map=graph_7,
    height_map=graph_8,
    dist=dist_5,
    rotation=Toggle(True),
    height=Toggle(True),
    function=Toggle(False),
    go_up_val=Slider(15.305, range=0..50),
    missing_point=toggle_11,
    flip_curve=toggle_4)  # -> allpts, raw_tangents, all_X_axis, all_Y_axis, flatten(allplanes); inputs curves: list of Curve, angle_map: list, height_map: list, rotation: Boolean, height: Boolean, flip_curve: Boolean
# ---------- divide_curve_to_create_planes_9: Python ----------
import Rhino.Geometry as rg#
import math
import copy_reg
import ghpythonlib.treehelpers as th


def remap(value,low1,high1, low2, high2):
    """
    value : original value
    low1 : original value's lower bound
    high1 : original value's upper bound
    low2 : remapped value's lower bound
    high2 : remapped value's upper bound
    """
    remapped_value = low2 + (value - low1) * (high2 - low2) / (high1 - low1)
    return remapped_value









#Copying the plane

#first_plane = planes[0]
#second_plane = first_plane.Clone()
#
##deep copy using copy
##second_plane = copy.deepcopy(first_plane)
#
#rg.plane.Translate()
#rg.Plane.ZAxis
#safe_distance = 50
#second_plane.Translate(second_plane.ZAxis * safe_distance)
#
##list.insert(index, value)
#planes.insert(0,second_plane)

allpts = []
alltangents = []
allplanes = []
all_X_axis = []
all_Y_axis = []


for curve  in curves :

    
    if flip_curve:
        curve.Reverse()
    # 0. Divide curve into a set of points 
    params = curve.DivideByLength(dist, True)   #generates a lists of parameters (location of the point on the curve)
    params_list = []
    
    for p in params:
        params_list.append(p)
        
    #params_list.insert(0, curve.PointAtStart)
    #params_list.append(curve.PointAtEnd)
    #print(params)
    pts = []                                    #creates empty list for adding pt
    for p in params_list:                            # iterates trough the list of params and ads a point at each location
        pt = curve.PointAt(p)
        pts.append(pt)
    pts.insert(0, curve.PointAtStart)
    pts.append(curve.PointAtEnd)
    if missing_point:
        pts.append(curve.PointAtEnd)
    pts[0].Z += go_up_val
    pts[-1].Z += go_up_val
    
    allpts.append(pts)

    # 1. Create a list of tangents (x-axis) at each pt location 
    tangents = []                           #creates empty list for adding pt
    for p in params_list:                            #iterates trough the list of params and get the tangent at each location
        t = curve.TangentAt(p)
        tangents.append(t)
    
    tangents.append(curve.TangentAtStart)
    tangents.append(curve.TangentAtEnd)
    tangents.append(curve.TangentAtEnd)
    
    # 2. Create y-axis vector (normal) from world Zaxis and the xaxis 
    # rg.Vector3d.CrossProduct cross products are crucial when working with vectors https://en.wikipedia.org/wiki/Cross_product
    
    X_axis = []
    Y_axis = []
    
    for t in tangents:
        X_axis.append(t)                                         
        Yvec = rg.Vector3d.CrossProduct(rg.Vector3d(0,0,1), t)
        Y_axis.append(Yvec)

    # 3. Create planes from the pt, x-axis and y-axis
    planes = []
    
    for pt, x_vec, y_vec in zip (pts, X_axis, Y_axis):
        plane = rg.Plane(pt, x_vec, y_vec)
        planes.append(plane)
    

    # 4. Rotates (along Y-Axis) and translates (in Z-Axis) the planes 
    if rotation:
        for plane,angle in zip(planes,angle_map):
            #remap values to desired domain
            new_angle = remap(angle, 0.0, 1.0, 30, 0)# 45, 0
            #Rotate(self: Plane, angle: float, axis: Vector3d, centerOfRotation: Point3d) -> bool
            plane.Rotate(math.radians(new_angle),plane.XAxis,plane.Origin)
    
    if height:
        for plane,h in zip(planes,height_map):
            #remap values to desired domain
            new_height = remap(h, 0.0, 1.0, -1.25, -0)
            # Translate(self: Plane, delta: Vector3d) -> bool
            plane.Translate(rg.Vector3d(0,0,new_height))

    # 5. Varying parameters using mathematical functions 
    if function:
        for i,(plane,h) in enumerate(zip(planes,height_map)):
            #use random mathematical function
            h = (math.sin(i) + math.cos(i)) #domain of sin(theta) and cosine(theta) is -1 to 1 
            #remap values to desired domain
            new_height = remap(h, -2.0, 2.0, -2, 10)
            # Translate(self: Plane, delta: Vector3d) -> bool
            plane.Translate(rg.Vector3d(0,0,new_height))
            
    if flip_curve:
        planes.reverse()
        tangents.reverse()
        X_axis.reverse()
        Y_axis.reverse()
    allplanes.append(planes)
    alltangents.append(tangents)
    all_X_axis.append(X_axis)
    all_Y_axis.append(Y_axis)
# ---------- end divide_curve_to_create_planes_9 ----------
python_8 = GhPythonScript(
    x=divide_curve_to_create_planes_9.allpts,
    y=divide_curve_to_create_planes_9.all_X_axis,
    z=divide_curve_to_create_planes_9.all_Y_axis,
    mu=divide_curve_to_create_planes_9.allplanes)  # -> out, a, b, c, simplify(d); same code as python_5
geo_15 = Geometry(python_8.d)
list_length_5 = ListLength(List=divide_curve_to_create_planes_9.allpts)
align_4 = AlignPlanes(Planes=geo_15, Master=xy_12)  # -> flatten(Planes)
vdis_13 = VectorDisplay(Anchor=python_8.b, Vector=python_8.b)
vdis_14 = VectorDisplay(Anchor=python_8.a, Vector=divide_curve_to_create_planes_9.raw_tangents)
vdis_15 = VectorDisplay(Anchor=python_8.c, Vector=python_8.c)
points_4 = PointList(Points=align_4, Size=Slider(1, range=0..100))
plnaxis_9 = PlaneAxis(P=align_4, B=35)

data_4 = Data(python_8.d)
explode_tree_3 = ExplodeTree(Data=data_4)  # -> Branch0, Branch1, Branch2, Branch3, Branch4, Branch5, Branch6, Branch7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

# ---- group: INDIVIDUAL-LINES
merge_3 = Merge(Data1=explode_tree_3.Branch4, Data2=explode_tree.Branch4, Data3=explode_tree_2.Branch4)
merge_4 = Merge(Data1=explode_tree_3.Branch7, Data2=explode_tree.Branch7, Data3=explode_tree_2.Branch7)
merge_5 = Merge(Data1=explode_tree_3.Branch9, Data2=explode_tree.Branch9, Data3=explode_tree_2.Branch9)
merge_6 = Merge(Data1=explode_tree_3.Branch8, Data2=explode_tree.Branch8, Data3=explode_tree_2.Branch8)
merge_7 = Merge(Data1=explode_tree_3.Branch10, Data2=explode_tree.Branch10, Data3=explode_tree_2.Branch10)
merge_8 = Merge(Data1=explode_tree_3.Branch34, Data2=explode_tree.Branch34, Data3=explode_tree_2.Branch34)
merge_9 = Merge(Data1=explode_tree_3.Branch24, Data2=explode_tree.Branch24, Data3=explode_tree_2.Branch24)
merge_10 = Merge(Data1=explode_tree_3.Branch6, Data2=explode_tree.Branch6, Data3=explode_tree_2.Branch6)
merge_11 = Merge(Data1=explode_tree_3.Branch25, Data2=explode_tree.Branch25, Data3=explode_tree_2.Branch25)
merge_12 = Merge(Data1=explode_tree_3.Branch3, Data2=explode_tree.Branch3, Data3=explode_tree_2.Branch3)
merge_13 = Merge(Data1=explode_tree_3.Branch5, Data2=explode_tree.Branch5, Data3=explode_tree_2.Branch5)
merge_14 = Merge(Data1=explode_tree_3.Branch30, Data2=explode_tree.Branch30, Data3=explode_tree_2.Branch30)
merge_15 = Merge(Data1=explode_tree_3.Branch2, Data2=explode_tree.Branch2, Data3=explode_tree_2.Branch2)
merge_16 = Merge(Data1=explode_tree_3.Branch12, Data2=explode_tree.Branch12, Data3=explode_tree_2.Branch12)
merge_17 = Merge(Data1=explode_tree_3.Branch13, Data2=explode_tree.Branch13, Data3=explode_tree_2.Branch13)
merge_18 = Merge(Data1=explode_tree_3.Branch27, Data2=explode_tree.Branch27, Data3=explode_tree_2.Branch27)
merge_19 = Merge(Data1=explode_tree_3.Branch29, Data2=explode_tree.Branch29, Data3=explode_tree_2.Branch29)
merge_20 = Merge(Data1=explode_tree_3.Branch11, Data2=explode_tree.Branch11, Data3=explode_tree_2.Branch11)
merge_21 = Merge(Data1=explode_tree_3.Branch15, Data2=explode_tree.Branch15, Data3=explode_tree_2.Branch15)
merge_22 = Merge(Data1=explode_tree_3.Branch31, Data2=explode_tree.Branch31, Data3=explode_tree_2.Branch31)
merge_23 = Merge(Data1=explode_tree_3.Branch1, Data2=explode_tree.Branch1, Data3=explode_tree_2.Branch1)
merge_24 = Merge(Data1=explode_tree_3.Branch33, Data2=explode_tree.Branch33, Data3=explode_tree_2.Branch33)
merge_25 = Merge(Data1=explode_tree_3.Branch37, Data2=explode_tree.Branch37, Data3=explode_tree_2.Branch37)
merge_26 = Merge(Data1=explode_tree_3.Branch14, Data2=explode_tree.Branch14, Data3=explode_tree_2.Branch14)
merge_27 = Merge(Data1=explode_tree_3.Branch17, Data2=explode_tree.Branch17, Data3=explode_tree_2.Branch17)
merge_28 = Merge(Data1=explode_tree_3.Branch21, Data2=explode_tree.Branch21, Data3=explode_tree_2.Branch21)
merge_29 = Merge(Data1=explode_tree_3.Branch32, Data2=explode_tree.Branch32, Data3=explode_tree_2.Branch32)
merge_30 = Merge(Data1=explode_tree_3.Branch18, Data2=explode_tree.Branch18, Data3=explode_tree_2.Branch18)
merge_31 = Merge(Data1=explode_tree_3.Branch22, Data2=explode_tree.Branch22, Data3=explode_tree_2.Branch22)
merge_32 = Merge(Data1=explode_tree_3.Branch20, Data2=explode_tree.Branch20, Data3=explode_tree_2.Branch20)
merge_33 = Merge(Data1=explode_tree_3.Branch35, Data2=explode_tree.Branch35, Data3=explode_tree_2.Branch35)
merge_34 = Merge(Data1=explode_tree_3.Branch0, Data2=explode_tree.Branch0, Data3=explode_tree_2.Branch0)
merge_35 = Merge(Data1=explode_tree_3.Branch23, Data2=explode_tree.Branch23, Data3=explode_tree_2.Branch23)
merge_36 = Merge(Data1=explode_tree_3.Branch19, Data2=explode_tree.Branch19, Data3=explode_tree_2.Branch19)

# ---- group: INDIVIDUAL-LINES / CHECKS FOR PLANAR-MOVE
list_item_5 = ListItem(List=merge_34, Index=Slider(0, range=0..100), Wrap=True)

# ---- group: INDIVIDUAL-LINES / SINGULARITY ISSUE
merge_37 = Merge(Data1=explode_tree_3.Branch16, Data2=explode_tree.Branch16, Data3=explode_tree_2.Branch16)

# ---- group: INDIVIDUAL-LINES / VERY CLOSE SINGULARITY
merge_38 = Merge(Data1=explode_tree_3.Branch28, Data2=explode_tree.Branch28, Data3=explode_tree_2.Branch28)

# ---- group: INDIVIDUAL-LINES / DIDNT RUN
merge_39 = Merge(Data1=explode_tree_3.Branch36, Data2=explode_tree.Branch36, Data3=explode_tree_2.Branch36)

# ---- group: INDIVIDUAL-LINES / ran
merge_40 = Merge(Data1=explode_tree_3.Branch26, Data2=explode_tree.Branch26, Data3=explode_tree_2.Branch26)

# ----
plnaxis_10 = PlaneAxis(P=merge_34, B=35)
merge_41 = Merge(Data1=merge_37, Data2=merge_38, Data3=merge_39)  # -> flatten(Result)
merge_42 = Merge(
    Data3=merge_18,
    Data4=merge_19,
    Data5=merge_14,
    Data6=merge_22,
    Data7=merge_29,
    Data8=merge_24,
    Data9=merge_8,
    Data10=merge_33,
    Data11=merge_25)  # -> flatten(Result)
merge_43 = Merge(Data8=merge_32, Data9=merge_28, Data10=merge_31, Data11=merge_35, Data12=merge_9)  # -> flatten(Result)
merge_44 = Merge(
    Data1=merge_23,
    Data2=merge_15,
    Data3=merge_12,
    Data4=merge_3,
    Data5=merge_13,
    Data6=merge_10,
    Data7=merge_4,
    Data8=merge_6,
    Data9=merge_5,
    Data10=merge_7,
    Data11=merge_20,
    Data12=merge_16)  # -> flatten(Result)
align_planes_7 = AlignPlanes(Planes=merge_41, Master=xy_8)

# ---- group: AFTER INITIAL_TEST
number_slider_30 = Slider(113, range=10..1000)
multiplication = Multiplication(A=number_slider_29, B=Slider(0.671, range=0..0.9))
circle_cnr_4 = CircleCNR(Center=point, Normal=Vector(0, 0, 1), Radius=number_slider_30)
ghpython_script = GhPythonScript(planes_list=align_planes_7, thresh_radius=number_slider_30, center_pt=point, thresh_height=multiplication)  # -> out, all_planes_list; inputs planes_list: list of Plane, center_pt: Point3d
# ---------- ghpython_script: Python ----------
__author__ = "josep"
__version__ = "2022.10.09"

import Rhino.Geometry as rg

all_planes_list = []

for plane in planes_list:
    if rg.Point3d(plane.OriginX, plane.OriginY, 0).DistanceTo(center_pt) < thresh_radius and plane.OriginZ > thresh_height:
        continue
    else:
        all_planes_list.append(plane)
# ---------- end ghpython_script ----------
data_5 = Data(ghpython_script.all_planes_list)

# ----
# SECOND ROBOT
# IP : 192.168.10.10
button_3 = Button()
robotic_drawing_3 = GhPythonScript(way_planes=data_5, send=button_3)  # -> out, way_planes; inputs way_planes: list of Plane
# ---------- robotic_drawing_3: Python ----------
from imp import reload

import simple_comm as com
reload(com)

import simple_ur_script as ur
reload(ur)

import Rhino.Geometry as rg

import math as m
import random as r

ROBOT_IP = "192.168.10.10"

## 1 ## ===== Setting robot base plane from pts =====
ORIGIN = rg.Point3d(507.27, 79.77, -10.31) #-10.31
X_AXIS = rg.Point3d(506.14, 499.58, -9.75) #-9.75
Y_POSITIVE_PLANE = rg.Point3d(211.65, 500.33, -9.25) #-9.25

def set_robot_base():
    robot_base = rg.Plane(ORIGIN,X_AXIS-ORIGIN,Y_POSITIVE_PLANE-ORIGIN)
    print (robot_base)
    return (robot_base)

def rhino_to_robot_space(_plane,robot_base):
    _r_matrix = rg.Transform.PlaneToPlane(rg.Plane.WorldXY,robot_base)
    _plane.Transform(_r_matrix)
    return _plane

## 2 ## ===== Robot base is set =====
robot_base =  set_robot_base()


## 3 ## ===== Transforming the rhino planes into robot planes =====
robot_planes = []
for plane in way_planes: 
    robot_planes.append(rhino_to_robot_space(plane, robot_base))

script = ""
#script += ur.set_tcp_by_angles(0.0,85.0,35.0,m.radians(-90.0),m.radians(180.0),m.radians(0))


## 5 ## ===== Assigning the translation movement =====
accel = 0.3
vel = 0.3

for plane in robot_planes:
#    script += ur.move_l(plane,accel,vel)
    script += ur.move_l_blend(plane,accel,vel,0.003)

## 6 ## ===== Creating one script file and sending to the controller =====
#send = False
if send:
    script = com.concatenate_script(script)
    com.send_script(script,ROBOT_IP)
# ---------- end robotic_drawing_3 ----------
geometry_13 = Geometry(robotic_drawing_3.way_planes)

plnaxis_11 = PlaneAxis(P=geometry_13, B=35)

# ---- group: LINES-THAT DONT INTERSECT
explode_tree_4 = ExplodeTree(Data=data_2)  # -> Branch0, Branch1, Branch2, Branch3, Branch4, Branch5, Branch6, Branch7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
plnaxis_12 = PlaneAxis(P=align_planes_6, B=35)

# ----
merge_45 = Merge(
    Data1=explode_tree_4.Branch0,
    Data2=explode_tree_4.Branch1,
    Data3=explode_tree_4.Branch2,
    Data4=explode_tree_4.Branch3,
    Data5=explode_tree_4.Branch4,
    Data6=explode_tree_4.Branch5,
    Data7=explode_tree_4.Branch6,
    Data8=explode_tree_4.Branch7,
    Data9=explode_tree_4.Branch8,
    Data10=explode_tree_4.Branch9,
    Data11=explode_tree_4.Branch10,
    Data12=explode_tree_4.Branch11,
    Data13=explode_tree_4.Branch12,
    Data14=explode_tree_4.Branch13,
    Data15=explode_tree_4.Branch14,
    Data16=explode_tree_4.Branch15,
    Data17=explode_tree_4.Branch16,
    Data18=explode_tree_4.Branch17)  # -> flatten(Result)
align_planes_8 = AlignPlanes(Planes=merge_45, Master=xy_6)
plnaxis_13 = PlaneAxis(P=align_planes_8, B=35)

# ---- group: LINES-THAT DONT INTERSECT
# SECOND ROBOT
# IP : 192.168.10.10
button_4 = Button()
robotic_drawing_4 = GhPythonScript(way_planes=align_planes_8, send=button_4)  # -> out, way_planes; inputs way_planes: list of Plane; same code as robotic_drawing_3
geometry_14 = Geometry(robotic_drawing_4.way_planes)

plnaxis_14 = PlaneAxis(P=geometry_14, B=35)

# ==== cluster PlaneAxis: show plane X Y Z axis.
P = ClusterInput()
B = ClusterInput()
deplane = DeconstructPlane(Plane=graft(P))  # -> Origin, XAxis, YAxis, ZAxis
multiplication = Multiplication(A=[deplane.XAxis, deplane.YAxis, deplane.ZAxis], B=B)
vdisex = VectorDisplayEx(
    Point=deplane.Origin,
    Vector=multiplication,
    Colour=[ColourSwatch(SwatchColor=RGB(235, 52, 52)), ColourSwatch(SwatchColor=RGB(90, 207, 48)), ColourSwatch(SwatchColor=RGB(54, 126, 227))],
    Width=2)
