# Grasshopper definition 220928_Flocking Behaviour.gh (Grasshopper 1.0.7)

number_slider = Slider(58, range=0..100)  # disabled
panel = Panel("1")  # disabled
number_slider_2 = Slider(67, range=0..100)  # disabled
panel_2 = Panel("0.01")  # disabled
vector_xyz = VectorXYZ(XComponent=0, YComponent=panel, ZComponent=0)  # -> Vector, Length; disabled
number_slider_3 = Slider(100, range=0..100)  # disabled
# --Ideas
# 
# .Experiment with different forces. Ex: implement gravity force
number_slider_4 = Slider(763, range=0..1000)  # disabled
number_slider_5 = Slider(58, range=0..100)
vector_xyz_2 = VectorXYZ(XComponent=0, YComponent=panel_2, ZComponent=0)  # -> Vector, Length; disabled
number_slider_6 = Slider(175, range=0..1000)  # disabled
number_slider_7 = Slider(236, range=0..1000)  # disabled
negative = Negative(Value=number_slider)  # disabled
negative_2 = Negative(Value=number_slider_2)  # disabled
vector_xyz_3 = VectorXYZ(XComponent=0, YComponent=0, ZComponent="-1")  # -> Vector, Length
number_slider_8 = Slider(6, range=0..10)  # disabled
construct_domain = ConstructDomain(DomainStart=negative, DomainEnd=number_slider)  # disabled
division = Division(A=vector_xyz.Vector, B=number_slider_3)  # disabled
negative_3 = Negative(Value=number_slider_5)
number_slider_9 = Slider(6, range=0..10)  # disabled
division_2 = Division(A=vector_xyz_2.Vector, B=number_slider_6)  # disabled
construct_domain_2 = ConstructDomain(DomainStart=negative_3, DomainEnd=number_slider_5)
division_3 = Division(A=vector_xyz_3.Vector, B=Slider(100, range=0..100))
domain_box = DomainBox(Base=PlaneXY(0, 0, 0), X=construct_domain, Y=construct_domain, Z=construct_domain)  # disabled
ghpython_script = GhPythonScript(count=number_slider_8, force=division, time=number_slider_4, bound=number_slider)  # -> out, trajectories, spheres; inputs count: Int32, force: Vector3d, time: Int32; disabled
# ---------- ghpython_script: Python ----------
import Rhino.Geometry as rg
import random
import math

class Bouncy():
    
    def __init__(self, p, v, a):
        self.p = p
        self.v= v
        self.a = a
        
        self.pts =[]
    
    def move(self, bound):
        
        self.v += self.a
        next_p = self.p + self.v
        
        # chekc if it is outside of boundary
        if abs(next_p.X) > bound:
            self.v.X *= -1
        
        if abs(next_p.Y) > bound:
            self.v.Y *= -1
        
        if abs(next_p.Z) > bound:
            self.v.Z *= -1
        
        #make the move
        self.p += self.v
        self.pts.append(self.p)
    
    def draw_path(self):
        if len(self.pts) >=2:
            return rg.Curve.CreateInterpolatedCurve(self.pts, 1)
        else:
            return
    
    def draw_sphere(self):
        return rg.Sphere(self.p, 3)

random.seed(0)

bouncies = []


for _ in range(count):
    bouncy = Bouncy (rg.Point3d(0,0,0), rg.Vector3d(random.uniform(-1,1),
                                                    random.uniform(-1,1),
                                                    random.uniform(-1,1)), force)
    bouncies.append(bouncy)

for _ in range(time):
    for bouncy in bouncies:
        bouncy.move(bound)

trajectories = []
spheres = []

for bouncy in bouncies:
    trajectories.append(bouncy.draw_path())
    spheres.append(bouncy.draw_sphere())
# ---------- end ghpython_script ----------
sphere = Sphere(Base=PlaneXY(0, 0, 0), Radius=number_slider_2)  # disabled
ghpython_script_2 = GhPythonScript(count=number_slider_9, force=division_2, time=number_slider_7, bound=number_slider_2)  # -> out, trajectories, spheres; inputs count: Int32, force: Vector3d, time: Int32; disabled
# ---------- ghpython_script_2: Python ----------
import Rhino.Geometry as rg
import random
import math

class Bouncy():
    
    def __init__(self, p, v, a):
        self.p = p
        self.v= v
        self.a = a
        
        self.pts =[self.p]
    
    def sphere_Move(self, bound):
        self.v += self.a
        self.p += self.v
        
        if self.p.DistanceTo(rg.Point3d(0,0,0)) > bound:
            normal = rg.Vector3d(self.p.X, self.p.Y, self.p.Z)
            rg.Vector3d.Unitize(normal)
            rg.Vector3d.Unitize(self.v)
            self.v = self.v - 2* (self.v * normal ) * normal # R = I - 2(I*N)*N

        self.pts.append(self.p)
    
    def draw_path(self):
        if len(self.pts) >=2:
            return rg.Curve.CreateInterpolatedCurve(self.pts, 1)
        else:
            return
    
    def draw_sphere(self):
        return rg.Sphere(self.p, 3)

random.seed(2)

bouncies = []


for _ in range(count):
    bouncy = Bouncy (rg.Point3d(0,0,0), rg.Vector3d(random.uniform(-1,1),
                                                    random.uniform(-1,1),
                                                    random.uniform(-1,1)), force)
    bouncies.append(bouncy)

for _ in range(time):
    for bouncy in bouncies:
        bouncy.sphere_Move(bound)

trajectories = []
spheres = []

for bouncy in bouncies:
    trajectories.append(bouncy.draw_path())
    spheres.append(bouncy.draw_sphere())
# ---------- end ghpython_script_2 ----------
brep_edges = BrepEdges(Brep=domain_box)  # -> Naked, Interior, NonManifold; disabled
domain_box_2 = DomainBox(Base=PlaneXY(0, 0, 0), X=construct_domain_2, Y=construct_domain_2, Z=construct_domain_2)
ghpython_script_3 = GhPythonScript(count=Slider(7, range=0..10), force=division_3, time=Slider(720, range=0..1000), bound=number_slider_5)  # -> out, trajectories, cones, colors; inputs count: Int32, force: Vector3d, time: Int32
# ---------- ghpython_script_3: Python ----------
import Rhino.Geometry as rg
import random
import math
from ghpythonlib.components import ColourRGB

class Bouncy():
    
    def __init__(self, p, v, a):
        self.p = p
        self.v= v
        self.a = a
        
        self.pts =[]
    
    def move(self, bound):
        
        self.v += self.a
        next_p = self.p + self.v
        
        # chekc if it is outside of boundary
        if abs(next_p.X) > bound:
            self.v.X *= -1
        
        if abs(next_p.Y) > bound:
            self.v.Y *= -1
        
        if abs(next_p.Z) > bound:
            self.v.Z *= -1
        
        #make the move
        self.p += self.v
        self.pts.append(self.p)
    
    def draw_path(self):
        if len(self.pts) >=2:
            return rg.Curve.CreateInterpolatedCurve(self.pts, 1)
        else:
            return
    
    def colors(self):
        return ColourRGB( 255, 255* (self.v.X *0,1), 0, 150* (self.v.Z *0,1))
    
    def draw_cones(self):
        return rg.Cone( rg.Plane(self.p, -self.v), 4, 2)



random.seed(0)

bouncies = []


for _ in range(count):
    bouncy = Bouncy (rg.Point3d(0,0,0), rg.Vector3d(random.uniform(-1,1),
                                                    random.uniform(-1,1),
                                                    random.uniform(-1,1)), force)
    bouncies.append(bouncy)

for _ in range(time):
    for bouncy in bouncies:
        bouncy.move(bound)
        
        #check id the bounce to each other:
    for i in range(len(bouncies)):
        for j in range(i+1, len(bouncies)):
            dist = bouncies[i].p.DistanceTo(bouncies[j].p)
            print (dist)
            if dist <= 6:
                 bouncies[i].v *= -1
                 bouncies[i].v *= -1



trajectories = []
cones = []
colors =[]

for bouncy in bouncies:
    trajectories.append(bouncy.draw_path())
    cones.append(bouncy.draw_cones())
    colors.append(bouncy.colors())
# ---------- end ghpython_script_3 ----------
brep_edges_2 = BrepEdges(Brep=domain_box_2)  # -> Naked, Interior, NonManifold
ghpython_script_4 = GhPythonScript(x=ghpython_script_3.colors)  # -> out, a
# ---------- ghpython_script_4: Python ----------
a =x
# ---------- end ghpython_script_4 ----------
number_slider_10 = Slider(67, range=0..100)
custom_preview = CustomPreview(Geometry=ghpython_script_3.trajectories, Material=ghpython_script_4.a)
vector_xyz_4 = VectorXYZ(XComponent=0, YComponent="1", ZComponent=0)  # -> Vector, Length
negative_4 = Negative(Value=number_slider_10)
division_4 = Division(A=vector_xyz_4.Vector, B=Slider(100, range=0..1000))
sphere_2 = Sphere(Base=PlaneXY(0, 0, 0), Radius=number_slider_10)
ghpython_script_5 = GhPythonScript(count=Slider(6, range=0..10), force=division_4, time=Slider(849, range=0..1000), bound=number_slider_10)  # -> out, trajectories, spheres; inputs count: Int32, force: Vector3d, time: Int32
# ---------- ghpython_script_5: Python ----------
import Rhino.Geometry as rg
import random
import math

class Bouncy():
    
    def __init__(self, p, v, a):
        self.p = p
        self.v= v
        self.a = a
        
        self.pts =[self.p]
    
    def sphereMove(self, bound): #! Zac Add this function
        self.v += self.a
        self.p += self.v
        if self.p.DistanceTo(rg.Point3d(0, 0, 0)) > bound: # Zac. If the point touches the boundary
            normal = rg.Vector3d(self.p.X, self.p.Y, self.p.Z) #Zac. Find the normal of the surface 
            
            temp = self.v.Length
            rg.Vector3d.Unitize(normal)  #Zac. Let length =1
            rg.Vector3d.Unitize(self.v) #Zac. Let length =1
            self.v = self.v - 2 * (self.v * normal) * normal 
            
            rg.Vector3d.Unitize(self.v) #After bouncing back, the velocity (v.Length()) of the balls should be the same as the one before bounce
            self.v *= temp 
            
            self.p += self.v #Once touch the boundary, jump back immediately. 

        self.pts.append(self.p)
    
    def draw_path(self):
        if len(self.pts) >=2:
            return rg.Curve.CreateInterpolatedCurve(self.pts, 1)
        else:
            return
    
    def draw_sphere(self):
        return rg.Sphere(self.p, 3)

random.seed(2)

bouncies = []


for _ in range(count):
    bouncy = Bouncy (rg.Point3d(0,0,0), rg.Vector3d(random.uniform(-1,1),
                                                    random.uniform(-1,1),
                                                    random.uniform(-1,1)), force)
    bouncies.append(bouncy)

for _ in range(time):
    for bouncy in bouncies:
        bouncy.sphereMove(bound)

trajectories = []
spheres = []

for bouncy in bouncies:
    trajectories.append(bouncy.draw_path())
    spheres.append(bouncy.draw_sphere())
# ---------- end ghpython_script_5 ----------
