# Grasshopper definition Computational Art Agent System.gh (Grasshopper 1.0.7)
# plug-ins: Weaverbird, Human, MarchingCubes, Mesh Pipe, LunchBox, Pufferfish, MeshEdit Components, Heteroptera, treesloth01, Kangaroo2 Components, Kangaroo Components

number_slider = Slider(0.065, range=0..1)
number_slider_2 = Slider(0.054, range=0..1)
number_slider_3 = Slider(0.029, range=0..1)
number_slider_4 = Slider(16, range=0..100)
number_slider_5 = Slider(30, range=0..100)
number_slider_6 = Slider(30, range=0..100)
python = GhPythonScript(
    x=number_slider_4,
    y=number_slider_4,
    z=number_slider_4,
    scaleX=number_slider,
    scaleY=number_slider,
    scaleZ=number_slider,
    shiftX=Slider(100, range=0..100),
    shiftY=Slider(26.68, range=0..100),
    shiftZ=Slider(26.68, range=0..100),
    domainStart=Slider(0, range=0..180),
    domainEnd=Slider(180, range=0..180),
    lowerLim=Slider(0.075, range=0..1),
    upperLim=Slider(0.369, range=0..1))  # -> out, pts_out; inputs x: Int32, y: Int32, z: Int32
# ---------- python: Python ----------
import rhinoscriptsyntax as rs
import perlin

sn = perlin.SimplexNoise()

pts = []

for i in range(x):
    for j in range(y):
        for k in range(z):
            perlinValue = sn.noise3((i+shiftX)*scaleX, (j+shiftY)*scaleY, (k+shiftZ)*scaleZ)
            if(perlinValue>lowerLim and perlinValue<upperLim):
                pt = rs.AddPoint(i, j, k)
                pts.append(pt)


pts_out = pts
# ---------- end python ----------
pt = Point(python.pts_out)
box = CenterBox(Base=pt, X="0.5", Y="0.5", Z="0.5")
previewmat = CustomPreviewMaterials(Geometry=box, DiffuseColor=RGB(255, 255, 255))
brep = Brep(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)
brep_2 = Brep(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)
sph = Sphere(Base=PlaneXY(0, 0, 0), Radius=Slider(5, range=0..100))
mesh = MeshBrep(
    Brep=brep,
    Settings={GridMaxCount=0, GridMinCount=16, JaggedSeams=False, MaxEdgeLength=0, MinEdgeLength=0.0001, MinTolerance=0, Refine=True, RefineAngle=0, RelativeTolerance=0.65, SimplePlanes=True, Tolerance=0})
mesh_2 = MeshBrep(
    Brep=brep_2,
    Settings={GridMaxCount=0, GridMinCount=16, JaggedSeams=False, MaxEdgeLength=0, MinEdgeLength=0.0001, MinTolerance=0, Refine=True, RefineAngle=0, RelativeTolerance=0.65, SimplePlanes=True, Tolerance=0})
popgeo = PopulateGeometry(Geometry=sph, Count=Slider(20, range=0..1000), Seed=1)
number_slider_7 = Slider(0.27, range=0..1)
filter = StreamFilter(Gate=Slider(0, range=0..1), Stream0=mesh, Stream1=mesh_2)
trigger = Trigger(Interval=10, TimerInterval=10, Target=[python_7, python_6, python_5])  # disabled
button = Button()
medges = MeshEdges(Mesh=filter)  # -> flatten(NakedEdges), InteriorEdges, NonManifoldEdges
pt_2 = Point(Point(12.05206202, 7.613035989, 7.447789568))
pt_3 = Point(Point(0.4007562961, -22.76139729, 0))
sph_2 = Sphere(Base=PlaneXY(0, 0, 0), Radius=Slider(2, range=0..10))  # -> reparameterize(Sphere)
pt_4 = ConstructPoint(XCoordinate=0, YCoordinate=0, ZCoordinate=0)
srf = Surface(reparameterize(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))

trigger_2 = Trigger(Interval=10, TimerInterval=10, Target=python_2)  # disabled
pt_5 = Point(Point(-10.94182891, 16.59666772, -9.418377431))
button_2 = Button()
python_2 = GhPythonScript(
    iReset=button_2,
    pts=pt,
    iAttractor=pt_5,
    iAttractorStrength=Slider(0, range=0..1),
    iSeparationDistance=Slider(0.76, range=0..1),
    iSeparationStrength=Slider(1, range=0..1),
    scale=Slider(0.061, range=0..1),
    shiftX=Slider(16.614, range=0..100),
    shiftY=Slider(32.336, range=0..100),
    shiftZ=Slider(23.46, range=0..100),
    perlinStrength=Slider(1, range=0..1),
    velocity=Slider(5, range=0..10))  # -> out, oAgentPositions, oAgentVelocities; inputs pts: list of Point3d, iAttractor: Point3d, iRepellerCurve: Curve, iSurface: Surface
# ---------- python_2: Python ----------
import Rhino.Geometry as rg
import random
from Rhino import RhinoApp
import perlin

class AgentSystem:
    
    def __init__(self):
        self.sn = perlin.SimplexNoise()
        self.Agents = []
        
        for i in range(0, len(pts)):
            randomInitialPosition = pts[i]
            agent = Agent(randomInitialPosition)
            agent.System = self
            self.Agents.append(agent)
    
    def Update(self):
        for agent in self.Agents:
            agent.ComputeDesiredVelocity()
            agent.Noise()
        
        for agent in self.Agents:
            agent.Update()
    


class Agent:
    
    def __init__(self, initialPosition):
        self.Position = initialPosition
        self.Velocity = rg.Vector3d(0.0, 0.0, 0.0)
        #self.PerlinVelocity = rg.Vector3d(0.0, 0.0, 0.0)
        
        
    def Noise(self):
        vecX = agent.System.sn.noise3(self.Position[0]*scale+shiftX, self.Position[1]*scale+shiftX, self.Position[2]*scale+shiftX)
        vecY = agent.System.sn.noise3(self.Position[0]*scale+shiftY, self.Position[1]*scale+shiftY, self.Position[2]*scale+shiftY)
        vecZ = agent.System.sn.noise3(self.Position[0]*scale+shiftZ, self.Position[1]*scale+shiftZ, self.Position[2]*scale+shiftZ)
        newVec = rg.Vector3d(vecX, vecY, vecZ)
        newVec.Unitize()
        newVec *= perlinStrength
        self.PerlinVelocity = newVec
        
        
        
    def ComputeDesiredVelocity(self):
        
        
        #Move toward the attractor point
        toAttractor = iAttractor - self.Position
        toAttractor.Unitize()
        toAttractor *= iAttractorStrength
        self.DesiredVelocity = toAttractor
        
        #Avoid other agents (i.e. separation behavior)
        for theOtherAgent in self.System.Agents:
            if self == theOtherAgent: continue
            getAway = self.Position - theOtherAgent.Position
            distance = getAway.Length
            if (distance > iSeparationDistance):continue
            getAway.Unitize()
            getAway *= iSeparationStrength / (distance + 1)
            self.DesiredVelocity += getAway
        
        
        
    def Update(self):
        self.Velocity = 0.99 * self.Velocity + 0.01 * self.DesiredVelocity + 1.0 * self.PerlinVelocity
        if (self.Velocity.Length > 0.1):
            self.Velocity.Unitize()
            self.Velocity *= 0.1
        self.Position += (self.Velocity *velocity)
        

# Main Script:

if iReset or not ("agentSystem" in globals()):
    agentSystem = AgentSystem()

else:
    agentSystem.Update()
    


# Generate visualization geometries:
agentPositions = []
agentVelocities = []

for agent in agentSystem.Agents:
    agentPositions.append(agent.Position)
    agentVelocities.append(agent.Velocity)
    
oAgentPositions = agentPositions
oAgentVelocities = agentVelocities
# ---------- end python_2 ----------
# 新增了新的干擾perlin，創建新的屬性在agent之
# 下，但是update時，系統會提示沒有perlin屬性
# ，我將agent數目設置成1個時可以運行，但是2
# 個以上時就會報錯。
vdis = VectorDisplay(Anchor=python_2.oAgentPositions, Vector=python_2.oAgentVelocities)

cir = Circle(Plane=pt_3, Radius=Slider(6, range=0..10))
number_slider_8 = Slider(12, range=0..100)  # disabled
number_slider_9 = Slider(36, range=0..100)  # disabled
item = ListItem(List=medges.NakedEdges, Index=0, Wrap=True)

# ---- group: Grid Sort Particles
number_slider_10 = Slider(6, range=0..10)  # disabled
number_slider_11 = Slider(44, range=0..100)  # disabled
number_slider_12 = Slider(36, range=0..100)  # disabled
python_3 = GhPythonScript(iLength=number_slider_11, iWidth=number_slider_12, iParticleSize=number_slider_10)  # -> oOrignalPt, oRadius, oSortPts, oSortPtsAccount; inputs iLength: Int32, iWidth: Int32; disabled
# ---------- python_3: Python ----------
# by weiqi xie
import Rhino.Geometry as rg
from Rhino import RhinoApp
import random



selfAgent = []
selfRadius =[]

for i in range(0, iLength):
    for j in range (0,iWidth):
        agentInitialPosition = rg.Point3d(0.0,i,j)
        selfAgent.append(agentInitialPosition)
        selfRadius.append(random.uniform(0, 10.0))
        
newAgent = [ ]
newRadius = [] 
 
for i in range (0,iLength*iWidth):
    if selfRadius[i] < iParticleSize: continue  # or selfRadius[i] > 1
    newAgent.append(selfAgent[i])
    newRadius.append(selfRadius[i])



oOrignalPt = selfAgent
oRadius = selfRadius
oSortPts= newAgent
oSortPtsAccount = len(newAgent)
# ---------- end python_3 ----------
pt_6 = Point(python_3.oOrignalPt)  # disabled
pt_7 = Point(python_3.oSortPts)  # disabled

# ----
number_slider_13 = Slider(6, range=0..10)  # disabled
sph_3 = Sphere(Base=PlaneXY(0, 0, 0), Radius=1)  # -> reparameterize(Sphere); disabled
number_slider_14 = Slider(19, range=0..100)  # disabled
number_slider_15 = Slider(6.1, range=0..10)  # disabled
number_slider_16 = Slider(15, range=0..100)  # disabled
pt_8 = ConstructPoint(XCoordinate=0, YCoordinate=0, ZCoordinate=0)  # disabled
end = EndPoints(Curve=item)  # -> Start, End
python_4 = GhPythonScript(loc=pt_4, surf=sph_2, unum=Slider(7, range=0..100), vnum=Slider(10, range=0..100), iParticleSize=Slider(7, range=0..10))  # -> out, oRadius, oSortPts, oSortPtsAccount; inputs loc: Point3d, surf: Surface, unum: Int32, vnum: Int32
# ---------- python_4: Python ----------
import Rhino.Geometry as rg
import rhinoscriptsyntax as rs
import random


domainU = rs.SurfaceDomain(surf, 0)
domainV = rs.SurfaceDomain(surf, 1)
du = (domainU[1] - domainU[0])/unum
dv = (domainV[1] - domainV[0])/vnum

selfAgent =[]
selfRadius =[]
for i in range(unum+1):
    for j in range(vnum+1):
        pt = rs.EvaluateSurface(surf, du*i, dv*j)
        selfRadius.append(random.uniform(0, 10.0))
        selfAgent.append(pt)

newAgent = [ ]
newRadius = [] 
 
for i in range (0,len(selfAgent)):
    if selfRadius[i] < iParticleSize: continue  # or selfRadius[i] > 1
    newAgent.append(selfAgent[i])
    newRadius.append(selfRadius[i])

oOrignalPt = selfAgent
oRadius = selfRadius
oSortPts= newAgent
oSortPtsAccount = len(newAgent)
# ---------- end python_4 ----------
project = Project(Curve=cir, Brep=srf, Direction=Vector(0, 0, 1))
group = Group(Objects=filter)
sph_4 = Sphere(Base=PlaneXY(0, 0, 0), Radius=Slider(5, range=0..100))
python_5 = GhPythonScript(
    iReset=button,
    iAttractor=pt_2,
    iAttractorStrength=number_slider_7,
    iSeparationDistance=Slider(0.76, range=0..1),
    iSeparationStrength=Slider(1, range=0..1))  # -> out, oAgentPositions, oAgentVelocities; inputs iAttractor: Point3d, iRepellerCurve: Curve, iSurface: Surface
# ---------- python_5: Python ----------
import Rhino.Geometry as rg
import random
from Rhino import RhinoApp

class AgentSystem:
    
    def __init__(self, agentCount):
        self.Agents = []
        for i in range(0, agentCount):
            randomInitialPosition = rg.Point3d(random.uniform(0.0, 10.0), random.uniform(0.0, 10.0), 0.0)
            agent = Agent(randomInitialPosition)
            agent.System = self
            self.Agents.append(agent)
    
    def Update(self):
        for agent in self.Agents:
            agent.ComputeDesiredVelocity()
        for agent in self.Agents:
            agent.Update()

class Agent:
    
    def __init__(self, initialPosition):
        self.Position = initialPosition
        self.Velocity = rg.Vector3d(0.0, 0.0, 0.0)
        
    def ComputeDesiredVelocity(self):
        
        #Move toward the attractor point
        toAttractor = iAttractor - self.Position
        toAttractor.Unitize()
        toAttractor *= iAttractorStrength
        self.DesiredVelocity = toAttractor
        
        #Avoid other agents (i.e. separation behavior)
        for theOtherAgent in self.System.Agents:
            if self == theOtherAgent: continue
            getAway = self.Position - theOtherAgent.Position
            distance = getAway.Length
            if (distance > iSeparationDistance):continue
            getAway.Unitize()
            getAway *= iSeparationStrength / (distance + 1)
            self.DesiredVelocity += getAway
        
    def Update(self):
        self.Velocity = 0.99 * self.Velocity + 0.01 * self.DesiredVelocity
        if (self.Velocity.Length > 0.1):
            self.Velocity.Unitize()
            self.Velocity *= 0.1
        self.Position += self.Velocity
        

# Main Script:

if iReset or not ("agentSystem" in globals()):
    agentSystem = AgentSystem(50)
else:
    agentSystem.Update()


# Generate visualization geometries:

agentPositions = []
agentVelocities = []

for agent in agentSystem.Agents:
    agentPositions.append(agent.Position)
    agentVelocities.append(agent.Velocity)
    
oAgentPositions = agentPositions
oAgentVelocities = agentVelocities
# ---------- end python_5 ----------
python_6 = GhPythonScript(iReset=button, iAttractor=pt_2, iAttractorStrength=number_slider_7)  # -> out, oAgentPositions, oAgentVelocities; inputs iAttractor: Point3d
# ---------- python_6: Python ----------
import Rhino.Geometry as rg
import random
from Rhino import RhinoApp

class AgentSystem:
    
    def __init__(self, agentCount):
        self.Agents = []
        for i in range(0, agentCount):
            randomInitialPosition = rg.Point3d(random.uniform(0.0, 10.0), random.uniform(0.0, 10.0), 0.0)
            agent = Agent(randomInitialPosition)
            #agent.System = self
            self.Agents.append(agent)
    
    def Update(self):
        for agent in self.Agents:
            agent.ComputeDesiredVelocity()
        for agent in self.Agents:
            agent.Update()

class Agent:
    
    def __init__(self, initialPosition):
        self.Position = initialPosition
        self.Velocity = rg.Vector3d(0.0, 0.0, 0.0)
        
    def ComputeDesiredVelocity(self):
        #self.DesiredVelocity = rg.Vector3d(0.1, 0.0, 0.0)
        #Move toward the attractor point
        toAttractor = iAttractor - self.Position
        toAttractor.Unitize()
        toAttractor *= iAttractorStrength
        self.DesiredVelocity = toAttractor
        
    def Update(self):
        self.Velocity = 0.97 * self.Velocity + 0.03 * self.DesiredVelocity
        if (self.Velocity.Length > 0.1):
            self.Velocity.Unitize()
            self.Velocity *= 0.1
        self.Position += self.Velocity
        

# Main Script:

if iReset or not ("agentSystem" in globals()):
    agentSystem = AgentSystem(50)
else:
    agentSystem.Update()


# Generate visualization geometries:

agentPositions = []
agentVelocities = []

for agent in agentSystem.Agents:
    agentPositions.append(agent.Position)
    agentVelocities.append(agent.Velocity)
    
oAgentPositions = agentPositions
oAgentVelocities = agentVelocities
# ---------- end python_6 ----------
python_7 = GhPythonScript(iReset=button, iAttractor=pt_2, iAttractorStrength=number_slider_7)  # -> out, oAgentPositions, oAgentVelocities; inputs iAttractor: Point3d
# ---------- python_7: Python ----------
import Rhino.Geometry as rg
import random
from Rhino import RhinoApp

class AgentSystem:
    
    def __init__(self, agentCount):
        self.Agents = []
        for i in range(0, agentCount):
            randomInitialPosition = rg.Point3d(random.uniform(0.0, 10.0), random.uniform(0.0, 10.0), 0.0)
            agent = Agent(randomInitialPosition)
            #agent.System = self
            self.Agents.append(agent)
    
    def Update(self):
        for agent in self.Agents:
            agent.ComputeDesiredVelocity()
        for agent in self.Agents:
            agent.Update()

class Agent:
    
    def __init__(self, initialPosition):
        self.Position = initialPosition
        self.Velocity = rg.Vector3d(0.0, 0.0, 0.0)
        
    def ComputeDesiredVelocity(self):
        #self.DesiredVelocity = rg.Vector3d(0.1, 0.0, 0.0)
        #Move toward the attractor point
        toAttractor = iAttractor - self.Position
        toAttractor.Unitize()
        toAttractor *= iAttractorStrength
        self.DesiredVelocity = toAttractor
        
    def Update(self):
        self.Velocity = self.DesiredVelocity
        #self.Position += rg.Vector3d(0.1, 0.0, 0.0)
        self.Position += self.Velocity
        

# Main Script:

if iReset or not ("agentSystem" in globals()):
    agentSystem = AgentSystem(50)
else:
    agentSystem.Update()


# Generate visualization geometries:

agentPositions = []
agentVelocities = []

for agent in agentSystem.Agents:
    agentPositions.append(agent.Position)
    agentVelocities.append(agent.Velocity)
    
oAgentPositions = agentPositions
oAgentVelocities = agentVelocities
# ---------- end python_7 ----------
srfsplit = SurfaceSplit(Surface=srf, Curves=project)
X = UnitX(Factor=end.Start)
lng = ListLength(List=python_4.oSortPts)
amp = Amplitude(Vector=python_5.oAgentVelocities, Amplitude=1)
popgeo_2 = PopulateGeometry(Geometry=sph_4, Count=Slider(200, range=0..1000), Seed=1)
python_8 = GhPythonScript(loc=pt_8, surf=sph_3, unum=number_slider_9, vnum=number_slider_8, iParticleSize=number_slider_13)  # -> out, oRadius, oSortPts, oSortPtsAccount; inputs loc: Point3d, surf: Surface, unum: Int32, vnum: Int32; disabled; same code as python_4
pt_9 = ConstructPoint(XCoordinate=Slider(0.9, range=0..1), YCoordinate=Slider(0.26, range=0..1), ZCoordinate=0)
python_9 = GhPythonScript(loc=pt_8, radius=number_slider_15, unum=number_slider_16, vnum=number_slider_14)  # -> out, pts; inputs loc: Point3d, radius: Int32, unum: Int32, vnum: Int32; disabled
# ---------- python_9: Python ----------
import Rhino.Geometry as rg
import rhinoscriptsyntax as rs

surf = rg.Sphere(loc, radius)
surf = rg.Sphere.ToRevSurface(surf)
domainU = rs.SurfaceDomain(surf, 0)
domainV = rs.SurfaceDomain(surf, 1)
du = (domainU[1] - domainU[0])/unum
dv = (domainV[1] - domainV[0])/vnum
pts =[]
for i in range(unum+1):
    for j in range(vnum+1):
        pt = rs.EvaluateSurface(surf, du*i, dv*j)
        pts.append(pt)

print(type(surf))
# ---------- end python_9 ----------
item_2 = ListItem(List=reverse(srfsplit), Index=0, Wrap=True)
panel = Panel(lng)
python_10 = GhPythonScript(
    pts=popgeo_2,
    step=Slider(200, range=0..200),
    scale=Slider(0.061, range=0..0.1),
    shiftX=Slider(16.614, range=0..100),
    shiftY=Slider(32.336, range=0..100),
    shiftZ=Slider(23.46, range=0..100))  # -> out, curveList_out; inputs pts: list of Point3d, step: Int32
# ---------- python_10: Python ----------
import rhinoscriptsyntax as rs
import perlin
import random as r

curveList = []
sn = perlin.SimplexNoise()


for i in range(len(pts)):
    newPtList = []
    pt = pts[i]

    for j in range(step):
        vecX = sn.noise3(pt[0]*scale+shiftX, pt[1]*scale+shiftX, pt[2]*scale+shiftX)
        vecY = sn.noise3(pt[0]*scale+shiftY, pt[1]*scale+shiftY, pt[2]*scale+shiftY)
        vecZ = sn.noise3(pt[0]*scale+shiftZ, pt[1]*scale+shiftZ, pt[2]*scale+shiftZ)
        newPt = [pt[0]+vecX, pt[1]+vecY, pt[2]+vecZ]
        newPtList.append(newPt)
        pt = newPt
    
    curve = rs.AddInterpCurve(newPtList)
    curveList.append(curve)

curveList_out = curveList
# ---------- end python_10 ----------
orient = OrientDirection(Geometry=group, PointA=end.Start, DirectionA=X, PointB=python_5.oAgentPositions, DirectionB=amp)  # -> Geometry, Transform
popgeo_3 = PopulateGeometry(Geometry=item_2, Count=Slider(11, range=0..100), Seed=1)
vdis_2 = VectorDisplay(Anchor=python_6.oAgentPositions, Vector=python_6.oAgentVelocities)  # disabled
vdis_3 = VectorDisplay(Anchor=python_7.oAgentPositions, Vector=python_7.oAgentVelocities)  # disabled
ungroup = Ungroup(Group=orient.Geometry)
vdis_4 = VectorDisplay(Anchor=python_5.oAgentPositions, Vector=python_5.oAgentVelocities)
lng_2 = ListLength(List=python_8.oRadius)  # disabled
panel_2 = Panel(pt_7)  # disabled
panel_3 = Panel(python_3.oSortPtsAccount)  # disabled
wbnaked = WeaverbirdsNakedBoundary(MeshClosedPolylines=ungroup)

trigger_3 = Trigger(Interval=10, TimerInterval=10, Target=python_11)  # disabled
pt_10 = Point(Point(11.4437535, -73.14329284, 10.29926632))
button_3 = Button()
python_11 = GhPythonScript(
    iReset=button_3,
    pts=popgeo_3,
    iAttractor=pt_10,
    iAttractorStrength=Slider(1, range=0..1),
    iSeparationDistance=Slider(0.76, range=0..1),
    iSeparationStrength=Slider(0.31, range=0..1),
    iSurface=srf,
    scale=Slider(0.061, range=0..1),
    shiftX=Slider(16.614, range=0..100),
    shiftY=Slider(32.336, range=0..100),
    shiftZ=Slider(23.46, range=0..100),
    perlinStrength=Slider(0.01, range=0..1),
    velocity=Slider(3.36, range=0..10))  # -> out, oAgentPositions, oAgentVelocities, oAgentPath; inputs pts: list of Point3d, iAttractor: Point3d, iSurface: Surface
# ---------- python_11: Python ----------
import Rhino.Geometry as rg
import random
from Rhino import RhinoApp
import perlin

class AgentSystem:
    
    def __init__(self):
        self.sn = perlin.SimplexNoise()
        self.Agents = []
        
        for i in range(0, len(pts)):
            randomInitialPosition = pts[i]
            agent = Agent(randomInitialPosition)
            agent.System = self
            self.Agents.append(agent)
    
    def Update(self):
        for agent in self.Agents:
            agent.ComputeDesiredVelocity()
            agent.Noise()
        
        for agent in self.Agents:
            agent.Update()
    


class Agent:
    
    def __init__(self, initialPosition):
        self.Position = initialPosition
        self.Velocity = rg.Vector3d(0.0, 0.0, 0.0)
        #self.PerlinVelocity = rg.Vector3d(0.0, 0.0, 0.0)
        self.History = [self.Position]
        
        
    def Noise(self):
        vecX = agent.System.sn.noise3(self.Position[0]*scale+shiftX, self.Position[1]*scale+shiftX, self.Position[2]*scale+shiftX)
        vecY = agent.System.sn.noise3(self.Position[0]*scale+shiftY, self.Position[1]*scale+shiftY, self.Position[2]*scale+shiftY)
        vecZ = agent.System.sn.noise3(self.Position[0]*scale+shiftZ, self.Position[1]*scale+shiftZ, self.Position[2]*scale+shiftZ)
        newVec = rg.Vector3d(vecX, vecY, vecZ)
        newVec.Unitize()
        newVec *= perlinStrength
        self.PerlinVelocity = newVec
        
        
        
    def ComputeDesiredVelocity(self):
        
        
        #Move toward the attractor point
        toAttractor = iAttractor - self.Position
        toAttractor.Unitize()
        toAttractor *= iAttractorStrength
        self.DesiredVelocity = toAttractor
        
        #Avoid other agents (i.e. separation behavior)
        for theOtherAgent in agentSystem.Agents:
            if self == theOtherAgent: continue
            getAway = self.Position - theOtherAgent.Position
            distance = getAway.Length
            if (distance > iSeparationDistance):continue
            getAway.Unitize()
            getAway *= iSeparationStrength / (distance + 1)
            self.DesiredVelocity += getAway
        
        
        
    def Update(self):
        self.Velocity = 0.99 * self.Velocity + 0.01 * self.DesiredVelocity + 1.0 * self.PerlinVelocity
        if (self.Velocity.Length > 0.1):
            self.Velocity.Unitize()
            self.Velocity *= 0.1
        self.Position += (self.Velocity *velocity)
        self.History.append(self.Position)
        
        #"Snap" the agent to the surface
        result = iSurface.ClosestPoint(self.Position)
        frame = iSurface.FrameAt(result[1], result[2])[1]
        self.Position = frame.Origin
        newVelocityTip = frame.ClosestPoint(self.Position + self.Velocity)
        newVelocity = newVelocityTip - frame.Origin
        newVelocity *= self.Velocity.Length / newVelocity.Length
        self.Velocity = newVelocity
        

# Main Script:

if iReset or not ("agentSystem" in globals()):
    agentSystem = AgentSystem()

else:
    agentSystem.Update()
    


# Generate visualization geometries:
agentPositions = []
agentVelocities = []
path = []

for agent in agentSystem.Agents:
    agentPositions.append(agent.Position)
    agentVelocities.append(agent.Velocity)
    path.append(rg.PolylineCurve(agent.History))
    
oAgentPositions = agentPositions
oAgentVelocities = agentVelocities
oAgentPath = path
# ---------- end python_11 ----------
vdis_5 = VectorDisplay(Anchor=python_11.oAgentPositions, Vector=python_11.oAgentVelocities)

datarec_boolean = DataRecBoolean(d=graft(python_2.oAgentPositions), reset=button_2)  # -> out, A; inputs d: tree
# ---------- datarec_boolean: VB ----------
    If reset = True Then
      out_tree.clear
      Else 
      For Each p As GH_Path In d.Paths
        Dim out_list As List(Of Object) = d.Branch(p)
        out_tree.AddRange(out_list, New GH_Path(p))
      Next
      
    End If

    A = out_tree
# ---------- datarec_boolean: VB additional code ----------
  Dim out_tree As New DataTree(Of Object)
# ---------- end datarec_boolean ----------
paraboloid = HyperbolicParaboloid(U=100, V=100, a=2, b=2, S=5, D1=Domain(-4, 4), D2=Domain(-4, 4))
button_4 = Button()  # disabled
geo = Geometry([wbnaked, orient.Geometry])
number_slider_17 = Slider(10, range=0..10)
pt_11 = Point(Point(5.415487374, 3.700096511, 0))  # disabled
reparamsrf = ReparameterizeSurface(Surface=paraboloid)  # -> Reparameterized, Original
timer = Timer(Interval=1, TimerInterval=5, Target=python_12)  # disabled
python_12 = GhPythonScript(iReset=button_4, iSortPts=python_8.oRadius, iSortPtsAccount=lng_2, iAttractor=pt_11)  # -> out, oAgentPositions, oAgentVelocities; inputs iReset: Boolean, iSortPts: list of Point3d, iSortPtsAccount: Int32, iAttractor: Point3d; disabled
# ---------- python_12: Python ----------
import Rhino.Geometry as rg
from Rhino import RhinoApp
import random

class AgentSystem: #整体的sysytem

    def __init__(self, agentPosition, agentCount):
        self.Agents = [] 
        for i in range(0, agentCount):
            agentInitialPosition = agentPosition[i]
            agent = Agent(agentInitialPosition)
            agent.System = self
            self.Agents.append(agent)
  
    def Update(self):
        for agent in self.Agents:
            agent.ComputeDesiredVelocity()
        for agent in self.Agents:
            agent.Update()

class Agent: #（每一个agent的function）

    def __init__(self, initialPosition):
        self.Position = initialPosition
        self.Velocity = rg.Vector3d(0.0, 0.0, 0.0)

    def ComputeDesiredVelocity(self):
        self.DesiredVelocity = rg.Vector3d(0.1, 0.0, 0.0)
  
    def Update(self):
        self.Velocity = self.DesiredVelocity 
        self.Position += rg.Vector3d(0.1, 0.0, 0.0)
        

# Main Script:
iSortPtsAccount = iSortPtsAccount - 1
if iReset or not ("agentSystem" in globals()):
    agentSystem = AgentSystem(iSortPts,iSortPtsAccount)
else:
    agentSystem.Update()


# Generate visualization geometries:

agentPositions = []
agentVelocities = []

for agent in agentSystem.Agents:
    agentPositions.append(agent.Position)
    agentVelocities.append(agent.Velocity)
    
oAgentPositions = agentPositions
oAgentVelocities = agentVelocities
# ---------- end python_12 ----------
intcrv = Interpolate(
    Vertices=Tree({0;0;0;0}: [Point(0.436823713, 4.836890806, 6.180500511), Point(0.8700633847, 4.656711806, 6.353239954), Point(1.292732073, 4.452064568, 6.524910243), Point(1.697486238, 4.217503482, 6.701418495), Point(2.076052326, 3.948567529, 6.886786157), Point(2.419178906, 3.642193615, 7.082743229)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], {0;0;0;1}: [Point(0.3363961032, 4.758707631, 7.280384833), Point(0.666337493, 4.496150457, 7.549089893), Point(0.9809462073, 4.207880269, 7.809707727), Point(1.272021257, 3.891843006, 8.065433683), Point(1.532613108, 3.547540816, 8.317520749), Point(1.758323785, 3.176255111, 8.564910352)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], {0;0;0;2}: [Point(0.241870181, 4.758283684, 8.364790403), Point(0.4781223496, 4.505810074, 8.725957939), Point(0.704963235, 4.24243578, 9.085370229), Point(0.9209417473, 3.969125419, 9.444054949), Point(1.127943917, 3.686744323, 9.80100175), Point(1.332350277, 3.39497472, 10.15184151)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], {0;0;0;3}: [Point(0.1641319221, 4.846682397, 9.44671515), Point(0.322824734, 4.734332716, 9.907360502), Point(0.4775810782, 4.694069565, 10.38110025), Point(0.6296112117, 4.761453707, 10.85263627), Point(0.7754932332, 4.951222805, 11.29161933), Point(0.9103539958, 5.233669821, 11.6815376)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], {0;0;0;4}: [Point(0.109555236, 5.057034336, 10.48450463), Point(0.2115202598, 5.222678368, 10.94511855), Point(0.3050587769, 5.486745278, 11.35926734), Point(0.3922399316, 5.812107246, 11.72877922), Point(0.476692167, 6.169920112, 12.06765645), Point(0.5614425148, 6.544645196, 12.38765409)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], {0;0;0;5}: [Point(0.2328815777, 5.883193545, 8.426758038), Point(0.453493585, 5.769850648, 8.860905167), Point(0.6543365342, 5.66902958, 9.307556286), Point(0.8293846974, 5.593311224, 9.769751993), Point(0.9756873104, 5.561512498, 10.24681005), Point(1.094986786, 5.594814367, 10.7312258)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]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),
    Degree=3,
    Periodic=False,
    KnotStyle=1)  # -> Curve, Length, Domain
python_13 = GhPythonScript()  # -> out, a
# ---------- python_13: Python ----------
import Rhino.Geometry as rg
import rhinoscriptsyntax as rs
import perlin

a = rg.Point3d(1,1,1)
print(a[0])
sn = perlin.SimplexNoise()
print(sn)
# ---------- end python_13 ----------
python_14 = GhPythonScript(x=reparamsrf.Reparameterized)  # -> out, a; inputs x: Surface
# ---------- python_14: Python ----------
import Rhino.Geometry as rg
import rhinoscriptsyntax as rs

frame = x.FrameAt(0.5, 0.5,)[1]
a = frame
# ---------- end python_14 ----------
crv = Curve(intcrv.Curve)
curve_charge = CurveCharge(Curve=intcrv.Curve, Radius=Slider(0.4, range=0..10), ChargeStrengths=Slider(100, range=0..100))  # -> flatten(CurveCharge)
cocoon = Cocoon(
    Charges=curve_charge,
    Iso=Slider(0.05, range=0..10),
    CellSize=Slider(0.4, range=0..10),
    Execute=Toggle(False),
    Simple=False)  # -> Mesh, RefinementData
vdis_6 = VectorDisplay(Anchor=python_12.oAgentPositions, Vector=python_12.oAgentVelocities)  # disabled
crv_2 = Curve(python_11.oAgentPath)
datarec_boolean_2 = DataRecBoolean(d=graft(python_11.oAgentPositions), reset=button_3)  # -> out, A; inputs d: tree; same code as datarec_boolean
msmooth = SmoothMesh(Mesh=cocoon.Mesh, Strength=0.5, SkipNaked=True, Iterations=Slider(8, range=0..10))
divide = DivideCurve(Curve=crv_2, Count=10, Kinks=False)  # -> flatten(Points), Tangents, Parameters; disabled
previewmat_2 = CustomPreviewMaterials(Geometry=msmooth, DiffuseColor=RGB(255, 255, 255))
intcrv_2 = Interpolate(Vertices=datarec_boolean_2.A, Degree=3, Periodic=False, KnotStyle=1)  # -> Curve, Length, Domain; disabled
convexhull = _3DConvexHull(Points=divide.Points)  # disabled
crv_3 = Curve(intcrv_2.Curve)  # disabled
mpipe = MeshPipe(Curve=crv_3, Radius=Slider(0.3, range=0..1), Accuracy=0.2, Rotation=0, Segments=10, Caps=2)
previewmat_3 = CustomPreviewMaterials(Geometry=mpipe, DiffuseColor=RGB(255, 255, 255))
number_slider_18 = Slider(100, range=0..100)
Z = UnitZ(Factor=1)
pt_12 = ConstructPoint(XCoordinate=0, YCoordinate=0, ZCoordinate=0)
line = LineSDL(Start=pt_12, Direction=Z, Length=Slider(194, range=0..1000))
divide_2 = DivideCurve(Curve=line, Count=Slider(5, range=0..10), Kinks=False)  # -> Points, Tangents, Parameters
cir_2 = Circle(Plane=divide_2.Points, Radius=1)
genes = GenePool(Decimals=2, Maximum=31, Minimum=0, Value=[15.95926829, 18.06, 20.76193548, 26.09225806, 31, 31])
divide_3 = DivideCurve(Curve=cir_2, Count="5", Kinks=False)  # -> simplify(Points), Tangents, Parameters
flip = FlipMatrix(Data=divide_3.Points)
vec2pt = Vector2Pt(PointA=divide_2.Points, PointB=flip, Unitize=False)  # -> Vector, Length
lng_3 = ListLength(List=vec2pt.Vector)
partition = PartitionList(List=genes, Size=flatten(lng_3))
amp_2 = Amplitude(Vector=vec2pt.Vector, Amplitude=partition)
dom = ConstructDomain(DomainStart=Slider(0, range=0..50), DomainEnd=Slider(31, range=0..50))
move = Move(Geometry=flip, Motion=amp_2)  # -> Geometry, Transform
intcrv_3 = Interpolate(Vertices=move.Geometry, Degree=3, Periodic=False, KnotStyle=1)  # -> Curve, Length, Domain
srf_2 = Surface(reparameterize(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))
gnc = GenePoolController(GenePool=genes, Count=Slider(6, range=0..10), Domain=dom, RandomizeAmount=Slider(0.41, range=0..1))
pt_13 = Point(Point(0.4007562961, -22.76139729, 0))
loft = Loft(
    Curves=flatten(intcrv_3.Curve),
    Options={Adjust=False, Closed=True, LoftEnds=0, LoftSimp=0, LoftType=0, Rebuild=10, Refit=0.01})
cir_3 = Circle(Plane=pt_13, Radius=Slider(6, range=0..10))
scale_nu = ScaleNU(Geometry=loft, Plane=PlaneXY(0, 0, 0), ScaleX=Slider(0.6, range=0..1), ScaleY=1, ScaleZ=1)  # -> Geometry, Transform
project_2 = Project(Curve=cir_3, Brep=srf_2, Direction=Vector(0, 0, 1))
sph_5 = Sphere(Base=PlaneXY(0, 0, 0), Radius=Slider(2, range=0..10))  # -> reparameterize(Sphere)
pt_14 = ConstructPoint(XCoordinate=0, YCoordinate=0, ZCoordinate=0)
capex = CapHolesEx(Brep=loft)  # -> Brep, Caps, Solid
srfsplit_2 = SurfaceSplit(Surface=srf_2, Curves=project_2)
item_3 = ListItem(List=reverse(srfsplit_2), Index=0, Wrap=True)
python_15 = GhPythonScript(loc=pt_14, surf=sph_5, unum=Slider(7, range=0..100), vnum=Slider(10, range=0..100), iParticleSize=Slider(7, range=0..10))  # -> out, oRadius, oSortPts, oSortPtsAccount; inputs loc: Point3d, surf: Surface, unum: Int32, vnum: Int32; same code as python_4

# ----
# Emitter
number_slider_19 = Slider(10, range=0..10)
pt_15 = Point(Point(1.739141636, 20.85804476, -11.63659314))
sph_6 = Sphere(Base=pt_15, Radius=number_slider_19)
popgeo_4 = PopulateGeometry(Geometry=sph_6, Count=Slider(30, range=0..100), Seed=1)

lng_4 = ListLength(List=python_15.oSortPts)
move_2 = Move(Geometry=item_3, Motion=Vector(0, 0, 10))  # -> Geometry, Transform

# ----
# AttachSurface
srf_3 = Surface(reparameterize(scale_nu.Geometry))

pt_16 = ConstructPoint(XCoordinate=Slider(0.93, range=0..1), YCoordinate=Slider(0.11, range=0..1), ZCoordinate=0)
panel_4 = Panel(lng_4)
evalsrf = EvaluateSurface(Surface=srf_2, Point=pt_16)  # -> Point, Normal, UDirection, VDirection, Frame
popgeo_5 = PopulateGeometry(Geometry=move_2.Geometry, Count=Slider(30, range=0..100), Seed=1)

trigger_4 = Trigger(Interval=10, TimerInterval=10, Target=python_16)  # disabled
pt_17 = Point(evalsrf.Point)
python_16 = GhPythonScript(
    iReset=Button(),
    pts=popgeo_5,
    iAttractor=pt_17,
    iAttractorStrength=Slider(1, range=0..1),
    iSeparationDistance=Slider(1, range=0..1),
    iSeparationStrength=Slider(1, range=0..1),
    iSurface=srf_2,
    iSurfStrength=Slider(0.275, range=0..1),
    scale=Slider(0.061, range=0..1),
    shiftX=Slider(16.614, range=0..100),
    shiftY=Slider(23.272, range=0..100),
    shiftZ=Slider(23.46, range=0..100),
    perlinStrength=Slider(0.01, range=0..1),
    velocity=Slider(3.36, range=0..10))  # -> out, oAgentPositions, oAgentVelocities, oAgentPath; inputs pts: list of Point3d, iAttractor: Point3d, iSurface: Surface
# ---------- python_16: Python ----------
import Rhino.Geometry as rg
import random
from Rhino import RhinoApp
import perlin

class AgentSystem:
    
    def __init__(self):
        self.sn = perlin.SimplexNoise()
        self.Agents = []
        
        for i in range(0, len(pts)):
            randomInitialPosition = pts[i]
            agent = Agent(randomInitialPosition)
            agent.System = self
            self.Agents.append(agent)
    
    def Update(self):
        for agent in self.Agents:
            agent.ComputeDesiredVelocity()
            agent.Noise()
        
        for agent in self.Agents:
            agent.Update()
    


class Agent:
    
    def __init__(self, initialPosition):
        self.Position = initialPosition
        self.Velocity = rg.Vector3d(0.0, 0.0, 0.0)
        #self.PerlinVelocity = rg.Vector3d(0.0, 0.0, 0.0)
        self.History = [self.Position]
        
        
    def Noise(self):
        vecX = agent.System.sn.noise3(self.Position[0]*scale+shiftX, self.Position[1]*scale+shiftX, self.Position[2]*scale+shiftX)
        vecY = agent.System.sn.noise3(self.Position[0]*scale+shiftY, self.Position[1]*scale+shiftY, self.Position[2]*scale+shiftY)
        vecZ = agent.System.sn.noise3(self.Position[0]*scale+shiftZ, self.Position[1]*scale+shiftZ, self.Position[2]*scale+shiftZ)
        newVec = rg.Vector3d(vecX, vecY, vecZ)
        newVec.Unitize()
        newVec *= perlinStrength
        self.PerlinVelocity = newVec
        
        
        
    def ComputeDesiredVelocity(self):
        
        
        #Move toward the attractor point
        toAttractor = iAttractor - self.Position
        toAttractor.Unitize()
        toAttractor *= iAttractorStrength
        self.DesiredVelocity = toAttractor
        
        #Avoid other agents (i.e. separation behavior)
        for theOtherAgent in agentSystem.Agents:
            if self == theOtherAgent: continue
            getAway = self.Position - theOtherAgent.Position
            distance = getAway.Length
            if (distance > iSeparationDistance):continue
            getAway.Unitize()
            getAway *= iSeparationStrength / (distance + 1)
            self.DesiredVelocity += getAway
        
        
        
    def Update(self):
        #"Snap" the agent to the surface
        result = iSurface.ClosestPoint(self.Position)
        frame = iSurface.FrameAt(result[1], result[2])[1]
        target = frame.Origin
        sttachVelocity = (target - self.Position)*iSurfStrength
        
        self.Velocity = 0.99 * self.Velocity + 0.01 * self.DesiredVelocity + 1.0 * self.PerlinVelocity + 0.01*sttachVelocity
        if (self.Velocity.Length > 0.1):
            self.Velocity.Unitize()
            self.Velocity *= 0.1
        self.Position += (self.Velocity *velocity)
        self.History.append(self.Position)
        
        

# Main Script:

if iReset or not ("agentSystem" in globals()):
    agentSystem = AgentSystem()

else:
    agentSystem.Update()
    


# Generate visualization geometries:
agentPositions = []
agentVelocities = []
path = []

for agent in agentSystem.Agents:
    agentPositions.append(agent.Position)
    agentVelocities.append(agent.Velocity)
    path.append(rg.PolylineCurve(agent.History))
    
oAgentPositions = agentPositions
oAgentVelocities = agentVelocities
oAgentPath = path
# ---------- end python_16 ----------
vdis_7 = VectorDisplay(Anchor=python_16.oAgentPositions, Vector=python_16.oAgentVelocities)

trigger_5 = Trigger(Interval=10, TimerInterval=10, Target=[python_17, counter])  # disabled
button_5 = Button()
counter = Counter(Reset=button_5)
project_3 = Project(Geometry=srf_2, Plane=PlaneXY(0, 0, 0))  # -> Geometry, Transform
srf_4 = Surface(srf_2)
debrep = DeconstructBrep(Brep=project_3.Geometry)  # -> Faces, graft(Edges), Vertices
debrep_2 = DeconstructBrep(Brep=srf_4)  # -> Faces, graft(Edges), Vertices
panel_5 = Panel(counter)
number_slider_20 = Slider(1, range=0..1)
number_slider_21 = Slider(2.58, range=0..10)
division = Division(A=counter, B=Slider(656, range=0..1000))

# ----
# Attractor
number_slider_22 = Slider(1, range=0..1)
crv_4 = Curve(<curve referenced from the Rhino model>)
eval = EvaluateCurve(Curve=reparameterize(crv_4), Parameter=division)  # -> Point, Tangent, Angle

brep_cp = BrepClosestPoint(Point=eval.Point, Brep=srf_3)  # -> Point, Normal, Distance
sph_7 = Sphere(Base=brep_cp.Point, Radius="3")
preview = CustomPreview(Geometry=sph_7, Material=ColourSwatch(SwatchColor=RGB(0, 255, 221)))  # disabled
pt_18 = Point(brep_cp.Point)
python_17 = GhPythonScript(
    iReset=button_5,
    pts=popgeo_4,
    iAttractor=pt_18,
    iAttractorStrength=Slider(1, range=0..1),
    iSeparationDistance=Slider(10, range=0..10),
    iSeparationStrength=Slider(1, range=0..1),
    iSurface=srf_3,
    iSurfStrength=Slider(0.275, range=0..1),
    scale=Slider(0.032, range=0..1),
    shiftX=Slider(16.614, range=0..100),
    shiftY=Slider(23.272, range=0..100),
    shiftZ=Slider(23.46, range=0..100),
    perlinStrength=Slider(0.01, range=0..1),
    velocity=Slider(3.36, range=0..10))  # -> out, oAgentPositions, oAgentVelocities, oAgentPath, oLines, a, connections; inputs pts: list of Point3d, iAttractor: Point3d, iSurface: Surface
# ---------- python_17: Python ----------
import Rhino.Geometry as rg
import random
from Rhino import RhinoApp
import perlin
from ghpythonlib.components import RandomReduce, Proximity3D, MeshPipe


class AgentSystem:
    
    def __init__(self):
        self.sn = perlin.SimplexNoise()
        self.Agents = []
        
        for i in range(0, len(pts)):
            randomInitialPosition = pts[i]
            agent = Agent(randomInitialPosition)
            agent.System = self
            self.Agents.append(agent)
    
    
    def Update(self):
        for agent in self.Agents:
            agent.ComputeDesiredVelocity()
            agent.Noise()
            agent.AttachVelocity()
        
        for agent in self.Agents:
            agent.Update()
    


class Agent:
    
    def __init__(self, initialPosition):
        self.Position = initialPosition
        self.Velocity = rg.Vector3d(0.0, 0.0, 0.0)
        #self.PerlinVelocity = rg.Vector3d(0.0, 0.0, 0.0)
        self.History = [self.Position]
        
        
    def Noise(self):
        vecX = agent.System.sn.noise3(self.Position[0]*scale+shiftX, self.Position[1]*scale+shiftX, self.Position[2]*scale+shiftX)
        vecY = agent.System.sn.noise3(self.Position[0]*scale+shiftY, self.Position[1]*scale+shiftY, self.Position[2]*scale+shiftY)
        vecZ = agent.System.sn.noise3(self.Position[0]*scale+shiftZ, self.Position[1]*scale+shiftZ, self.Position[2]*scale+shiftZ)
        newVec = rg.Vector3d(vecX, vecY, vecZ)
        newVec.Unitize()
        newVec *= perlinStrength
        self.PerlinVelocity = newVec
        
        
    def ComputeDesiredVelocity(self):
        #Move toward the attractor point
        toAttractor = iAttractor - self.Position
        toAttractor.Unitize()
        toAttractor *= iAttractorStrength
        self.DesiredVelocity = toAttractor
        
        #Avoid other agents (i.e. separation behavior)
        for theOtherAgent in agentSystem.Agents:
            if self == theOtherAgent: continue
            getAway = self.Position - theOtherAgent.Position
            distance = getAway.Length
            if (distance > iSeparationDistance):continue
            getAway.Unitize()
            getAway *= iSeparationStrength / (distance + 1)
            self.DesiredVelocity += getAway
        
        
    def AttachVelocity(self):
        #"Snap" the agent to the surface
        result = iSurface.ClosestPoint(self.Position)
        frame = iSurface.FrameAt(result[1], result[2])[1]
        target = frame.Origin
        attachVelocity = (target - self.Position)*iSurfStrength
        self.attachVelocity = attachVelocity
        
        
    def Update(self):
        
        self.Velocity = 0.99 * self.Velocity + 0.01 * self.DesiredVelocity + 1.0 * self.PerlinVelocity + 0.01*self.attachVelocity
        if (self.Velocity.Length > 0.1):
            self.Velocity.Unitize()
            self.Velocity *= 0.1
        self.Position += (self.Velocity *velocity)
        self.History.append(self.Position)
        
        

# Main Script:

if iReset or not ("agentSystem" in globals()):
    agentSystem = AgentSystem()

else:
    agentSystem.Update()
    


# Generate visualization geometries:
agentPositions = []
agentVelocities = []
path = []

for agent in agentSystem.Agents:
    agentPositions.append(agent.Position)
    agentVelocities.append(agent.Velocity)
    path.append(rg.PolylineCurve(agent.History))







oAgentPositions = agentPositions
oAgentVelocities = agentVelocities
oAgentPath = path
# ---------- end python_17 ----------
crv_5 = Curve(python_16.oAgentPath)
mesh_uv = MeshSurface(Surface=srf_2, UCount=Slider(150, range=10..500), VCount=Slider(200, range=10..500), Overhang=True, Equalize=False)
loft_2 = Loft(
    Curves=[debrep_2.Edges, debrep.Edges],
    Options={Adjust=False, Closed=False, LoftEnds=0, LoftSimp=0, LoftType=0, Rebuild=10, Refit=0.01})
Z_2 = UnitZ(Factor=Slider(3, range=0..10))
demesh = DeconstructMesh(Mesh=mesh_uv)  # -> Vertices, Faces, Colours, Normals
preview_2 = CustomPreview(Geometry=crv_5, Material=ColourSwatch(SwatchColor=RGB(255, 255, 255)))
move_3 = Move(Geometry=crv_5, Motion=Z_2)  # -> Geometry, Transform
join = BrepJoin(Breps=flatten([loft_2, srf_4, project_3.Geometry]))  # -> Breps, Closed
pt_19 = Point(Point(-62.68300061, -138.8669552, 0))
intcrv_4 = Interpolate(Vertices=crv_5, Degree=3, Periodic=False, KnotStyle=1)  # -> Curve, Length, Domain; disabled
division_2 = Division(A=number_slider_21, B="2")
reduce = RandomReduce(List=python_17.oAgentPath, Reduction=Slider(16, range=0..30), Seed=1)
sqgrid = Square(Plane=pt_19, Size=number_slider_21, ExtentX=Slider(43, range=0..100), ExtentY=Slider(71, range=0..100))  # -> Cells, flatten(Points)
series = Series(Start=0, Step=number_slider_21, Count=Slider(15, range=0..100))
vdis_8 = VectorDisplay(Anchor=python_17.oAgentPositions, Vector=python_17.oAgentVelocities)
box_2 = CenterBox(Base=PlaneXY(0, 0, 0), X=division_2, Y=division_2, Z=division_2)
pull = PullPoint(Point=demesh.Vertices, Geometry=move_3.Geometry, ClosestOnly=True)  # -> ClosestPoint, Distance; disabled
Z_3 = UnitZ(Factor=series)
crv_6 = Curve(intcrv_4.Curve)  # disabled
preview_3 = CustomPreview(Geometry=reduce, Material=ColourSwatch(SwatchColor=RGB(255, 255, 255)))
move_4 = Move(Geometry=sqgrid.Points, Motion=graft(Z_3))  # -> flatten(Geometry), Transform
crv_7 = Curve(reduce)
smaller = SmallerThan(FirstNumber=pull.Distance, SecondNumber=Slider(5, range=0..100))  # -> SmallerThan, OrEqualTo
volume = Volume(Geometry=box_2)  # -> Volume, Centroid
mbox = MeshBox(Base=box_2, XCount=1, YCount=1, ZCount=1)
vec2pt_2 = Vector2Pt(PointA=volume.Centroid, PointB=move_4.Geometry, Unitize=False)  # -> Vector, Length
mpipe_2 = MeshPipe(Curve=crv_6, Radius=Slider(0.3, range=0..1), Accuracy=0.2, Rotation=0, Segments=10, Caps=2)
area = Area(Geometry=mbox)  # -> Area, Centroid
dispatch = Dispatch(List=demesh.Vertices, DispatchPattern=smaller.SmallerThan)  # -> ListA, ListB
dispatch_2 = Dispatch(List=pull.Distance, DispatchPattern=smaller.SmallerThan)  # -> ListA, ListB
dispatch_3 = Dispatch(List=pull.ClosestPoint, DispatchPattern=smaller.SmallerThan)  # -> ListA, ListB
divlength = DivideLength(Curve=crv_7, Length=Slider(5, range=0..10))  # -> flatten(Points), Tangents, Parameters
crv_8 = Curve(python_17.oAgentPath)
pt_20 = Point(dispatch.ListA)
pt_21 = Point(dispatch_3.ListA)
move_5 = Move(Geometry=area.Centroid, Motion=vec2pt_2.Vector)  # -> Geometry, Transform
prox = Proximity3D(Points=divlength.Points, Group=5, MinRadius=Slider(0, range=0..10))  # -> flatten(Links), Topology
previewmat_4 = CustomPreviewMaterials(Geometry=mpipe_2, DiffuseColor=RGB(255, 255, 255))
python_18 = GhPythonScript(path=crv_8, reduction=Slider(16, range=0..100))  # -> out, connections, connectionsMidPt, a; inputs path: list of Curve; disabled
# ---------- python_18: Python ----------
import Rhino.Geometry as rg
from ghpythonlib.components import RandomReduce, Proximity3D, MeshPipe

connections = []
connectionsMidPt = []
connections.append(rg.Line(rg.Point3d(0,0,0),rg.Point3d(0,0,1)))
connectionsMidPt.append(rg.Point3d(0,0,0))


reducePath = RandomReduce(path, reduction, 0)


pathPts = []
for crv in reducePath:
    ptParams = rg.Curve.DivideByLength(crv, 2, 1)
    for param in ptParams:
        pt = crv.PointAt(param)
        pathPts.append(pt)

lines = Proximity3D(pathPts, 5, 0)[0]


for i in range(len(lines)):
    for j in range(len(connections)):
        tempFirstCrv = rg.NurbsCurve.CreateFromLine(lines[i])
        tempSecondCrv = rg.NurbsCurve.CreateFromLine(connections[j])
        ptFirst = rg.Curve.PointAt(tempFirstCrv, (lines[i].Length/2))
        ptSecond = rg.Curve.PointAt(tempSecondCrv, (connections[j].Length/2))
        if ptFirst not in connectionsMidPt:
            connections.append(lines[i])
            connectionsMidPt.append(ptFirst)
        else:
            pass
# ---------- end python_18 ----------
ln = Line(StartPoint=pt_21, EndPoint=pt_20)
python_19 = GhPythonScript()  # -> out, a
# ---------- python_19: Python ----------
list_1 = [0,0,4,3,6,6,1]

list_u = []
[list_u.append(v) for v in list_1 if v not in list_u]

print (list_u)

list_2 = [i*2 for i in list_1]
print(list_2)
# ---------- end python_19 ----------
brepinc = PointInBrep(Brep=join.Breps, Point=move_5.Geometry, Strict=False)
dupln = RemoveDuplicateLines(Lines=prox.Links, Tolerance=0.01)
Z_4 = UnitZ(Factor=1)
vec = Vector(ln)
lng_5 = ListLength(List=dupln)
dispatch_4 = Dispatch(List=vec2pt_2.Vector, DispatchPattern=brepinc)  # -> ListA, ListB
bnd = Bounds(Numbers=dispatch_2.ListA)
split = SplitList(List=crv_5, Index=Slider(30, range=0..30))  # -> ListA, ListB
neg = Negative(Value=Z_4)
multiplication = Multiplication(A=lng_5, B=Slider(0.7, range=0..1))
dom_2 = ConstructDomain(DomainStart=Slider(2.772, range=0..10), DomainEnd=Slider(0, range=0..10))
move_6 = Move(Geometry=mbox, Motion=dispatch_4.ListA)  # -> Geometry, Transform
dedomain = DeconstructDomain(Domain=bnd)  # -> Start, End
panel_6 = Panel(python_18.connections)
remap = RemapNumbers(Value=dispatch_2.ListA, Source=bnd, Target=dom_2)  # -> Mapped, Clipped
amp_3 = Amplitude(Vector=neg, Amplitude=remap.Mapped)
number_slider_23 = Slider(0.5, range=0..1)
crv_9 = Curve(split.ListA)
number_slider_24 = Slider(0.7, range=0..1)
reduce_2 = RandomReduce(List=dupln, Reduction=multiplication, Seed=1)
mcx = MeshCurve(Mesh=graft(move_6.Geometry), Curve=split.ListA)  # -> Points, Faces
panel_7 = Panel(python_18.connectionsMidPt)
move_7 = Move(Geometry=pt_20, Motion=amp_3)  # -> Geometry, Transform
shift = ShiftPaths(Data=mcx.Points, Offset=-1)
weave = Weave(Pattern=smaller.SmallerThan, Stream0=dispatch.ListB, Stream1=move_7.Geometry, NullGaps=False)
pt_22 = Point(<point referenced from the Rhino model>)
lng_6 = ListLength(List=shift)
number_slider_25 = Slider(100, range=0..100)
conmesh = ConstructMesh(Vertices=weave, Faces=demesh.Faces)
number_slider_26 = Slider(500, range=0..1000)
yz = YZPlane(Origin=pt_22)
dispatch_5 = Dispatch(List=graft(move_6.Geometry), DispatchPattern=lng_6)  # -> ListA, ListB
mirror = Mirror(Geometry=reduce_2, Plane=yz)  # -> Geometry, Transform
mpipe_3 = MeshPipe(Curve=[reduce_2, mirror.Geometry], Radius=number_slider_23, Accuracy=0.2, Rotation=0, Segments=10, Caps=0)
mesh_3 = Mesh(flatten(dispatch_5.ListB))
mirror_2 = Mirror(Geometry=crv_7, Plane=yz)  # -> Geometry, Transform
mpipe_4 = MeshPipe(Curve=[crv_7, mirror_2.Geometry], Radius=number_slider_24, Accuracy=0.2, Rotation=0, Segments=10, Caps=0)

# ---- group: voxel volume centers
# Extra
volume_2 = Volume(Geometry=mesh_3)  # -> Volume, Centroid
voxel = Voxel(Points=volume_2.Centroid, X=number_slider_21, Y=number_slider_21, Z=number_slider_21)

# ----
group_2 = Group(Objects=flatten([mpipe_3, mpipe_4]))
curve_charge_2 = CurveCharge(Curve=[reduce_2, mirror.Geometry], Radius=number_slider_23, ChargeStrengths=number_slider_26)  # disabled
curve_charge_3 = CurveCharge(Curve=[crv_7, mirror_2.Geometry], Radius=number_slider_24, ChargeStrengths=number_slider_26)  # disabled
curve_charge_4 = CurveCharge(Curve=mirror.Geometry, Radius=number_slider_23, ChargeStrengths=number_slider_26)  # disabled
curve_charge_5 = CurveCharge(Curve=mirror_2.Geometry, Radius=number_slider_24, ChargeStrengths=number_slider_26)  # disabled
swatch = ColourSwatch(SwatchColor=RGB(255, 255, 255))  # disabled
ungroup_2 = Ungroup(Group=group_2)  # disabled
wbcatmullclark = WeaverbirdsCatmullClarkSubdivision(MeshCurves=voxel, Level=1, SmoothNakedEdges=1)
number_slider_27 = Slider(0.8, range=0..10)  # disabled
number_slider_28 = Slider(0.1, range=0..10)  # disabled
weldvertices = MeshWeldVertices(Mesh=wbcatmullclark, Tolerance=0.01)  # -> RuntimeMessage, Mesh

# ---- group: smooth mesh
wbloop = WeaverbirdsLoopSubdivision(MeshCurves=voxel, Level=1, SmoothNakedEdges=1)
wblaplace = WeaverbirdsLaplacianSmoothing(MeshCurves=weldvertices.Mesh, Level=10, SmoothNakedEdges=1, Thin=1)
preview_4 = CustomPreview(Geometry=wblaplace, Shader=ColourSwatch(SwatchColor=RGB(196, 199, 32)))  # disabled

# ----
toggle = BooleanToggle(True)  # disabled
clean = CombineClean(Meshes=wbloop)
mcol = MeshColours(Mesh=ungroup_2, Colours=swatch)  # disabled
previewmat_5 = CustomPreviewMaterials(Geometry=mesh_3, DiffuseColor=RGB(255, 255, 255))
preview_5 = CustomPreview(
    Geometry=ungroup_2,
    Material={diffuse=RGB(250, 250, 250), emission=RGB(0, 0, 0), shine=0, specular=RGB(255, 255, 255), transparency=0})  # disabled
cocoon_2 = Cocoon(
    Charges=flatten([curve_charge_2, curve_charge_3, curve_charge_4, curve_charge_5]),
    Iso=number_slider_28,
    CellSize=number_slider_27,
    Execute=toggle,
    Simple=False)  # -> Mesh, RefinementData; disabled
number_slider_29 = Slider(3, range=0..10)  # disabled
msmooth_2 = SmoothMesh(Mesh=cocoon_2.Mesh, Strength=0.5, SkipNaked=True, Iterations=number_slider_29)  # disabled
mjoin = MeshJoin(Meshes=msmooth_2)  # disabled
wbcatmullclark_2 = WeaverbirdsCatmullClarkSubdivision(MeshCurves=mjoin, Level=1, SmoothNakedEdges=1)  # disabled

# ----
# add attach on surface
# avoid curve
srf_5 = Surface(reparameterize(<surface referenced from the Rhino model>))
crv_10 = Curve(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)
trigger_6 = Trigger(Interval=10, TimerInterval=10, Target=python_20)  # disabled

evalsrf_2 = EvaluateSurface(Surface=srf_5, Point=pt_9)  # -> Point, Normal, UDirection, VDirection, Frame

pt_23 = Point(evalsrf_2.Point)
python_20 = GhPythonScript(
    iReset=Button(),
    iAttractor=pt_23,
    iAttractorStrength=Slider(1, range=0..1),
    iSeparationDistance=Slider(0.76, range=0..1),
    iSeparationStrength=Slider(1, range=0..1),
    iRepellerCurve=crv_10,
    iRepellerCurveStrength=Slider(0, range=0..1),
    iSurface=srf_5,
    iSurfStrength=Slider(0.14, range=0..1),
    scale=Slider(0.013, range=0..1),
    shiftX=Slider(16.614, range=0..100),
    shiftY=Slider(32.336, range=0..100),
    shiftZ=Slider(23.46, range=0..100),
    perlinStrength=Slider(0.01, range=0..1),
    velocity=Slider(5, range=0..10))  # -> out, oAgentPositions, oAgentVelocities, opath; inputs iAttractor: Point3d, iRepellerCurve: Curve, iSurface: Surface
# ---------- python_20: Python ----------
import Rhino.Geometry as rg
import random
from Rhino import RhinoApp
import perlin

class AgentSystem:
    
    def __init__(self, count):
        self.sn = perlin.SimplexNoise()
        self.Agents = []
        
        for i in range(0, count):
            #randomInitialPosition = pts[i]
            randomInitialPosition = iSurface.PointAt(random.uniform(0,1), random.uniform(0,1))
            agent = Agent(randomInitialPosition)
            agent.System = self
            self.Agents.append(agent)
    
    def Update(self):
        for agent in self.Agents:
            agent.ComputeDesiredVelocity()
            agent.Noise()
        
        for agent in self.Agents:
            agent.Update()
    


class Agent:
    
    def __init__(self, initialPosition):
        self.Position = initialPosition
        self.Velocity = rg.Vector3d(0.0, 0.0, 0.0)
        #self.PerlinVelocity = rg.Vector3d(0.0, 0.0, 0.0)
        self.History = [self.Position]
        
        
    def Noise(self):
        vecX = agent.System.sn.noise3(self.Position[0]*scale+shiftX, self.Position[1]*scale+shiftX, self.Position[2]*scale+shiftX)
        vecY = agent.System.sn.noise3(self.Position[0]*scale+shiftY, self.Position[1]*scale+shiftY, self.Position[2]*scale+shiftY)
        vecZ = agent.System.sn.noise3(self.Position[0]*scale+shiftZ, self.Position[1]*scale+shiftZ, self.Position[2]*scale+shiftZ)
        newVec = rg.Vector3d(vecX, vecY, vecZ)
        newVec.Unitize()
        newVec *= perlinStrength
        self.PerlinVelocity = newVec
        
        
        
    def ComputeDesiredVelocity(self):
        
        
        #Move toward the attractor point
        toAttractor = iAttractor - self.Position
        toAttractor.Unitize()
        toAttractor *= iAttractorStrength
        self.DesiredVelocity = toAttractor
        
        #Avoid other agents (i.e. separation behavior)
        for theOtherAgent in agentSystem.Agents:
            if self == theOtherAgent: continue
            getAway = self.Position - theOtherAgent.Position
            distance = getAway.Length
            if (distance > iSeparationDistance):continue
            getAway.Unitize()
            getAway *= iSeparationStrength / (distance + 1)
            self.DesiredVelocity += getAway
            
        # Avoid the repeller curve
        t = iRepellerCurve.ClosestPoint(self.Position)[1]
        pointOnCurve = iRepellerCurve.PointAt(t)
        getAway = self.Position - pointOnCurve
        distance = getAway.Length
        getAway.Unitize()
        self.DesiredVelocity += iRepellerCurveStrength * getAway / (distance*distance)
        
        
        
    def Update(self):
        #"Snap" the agent to the surface
        result = iSurface.ClosestPoint(self.Position)
        frame = iSurface.FrameAt(result[1], result[2])[1]
        target = frame.Origin
        sttachVelocity = (target - self.Position)*iSurfStrength
        
        self.Velocity = 0.99 * self.Velocity + 0.01 * self.DesiredVelocity + 1.0 * self.PerlinVelocity + 0.01*sttachVelocity
        if (self.Velocity.Length > 0.1):
            self.Velocity.Unitize()
            self.Velocity *= 0.1
        self.Position += (self.Velocity *velocity)
        
        
        
        
        self.History.append(self.Position)
        

# Main Script:

if iReset or not ("agentSystem" in globals()):
    agentSystem = AgentSystem(10)

else:
    agentSystem.Update()
    


# Generate visualization geometries:
agentPositions = []
agentVelocities = []
path = []

for agent in agentSystem.Agents:
    agentPositions.append(agent.Position)
    agentVelocities.append(agent.Velocity)
    path.append(rg.PolylineCurve(agent.History))
    
oAgentPositions = agentPositions
oAgentVelocities = agentVelocities
opath = path
# ---------- end python_20 ----------
vdis_9 = VectorDisplay(Anchor=python_20.oAgentPositions, Vector=python_20.oAgentVelocities)

crv_11 = Curve(python_20.opath)
