# Grasshopper definition fabrication_and_visualization.ghx (Grasshopper 1.0.7)

# WORKING FILES
panel = Panel("/working_file_zac/excution.py")
ghpython_script = GhPythonScript()  # -> out, a; unedited script template
ghpython_script_2 = GhPythonScript(file_name="\fabrication\master_navigation_data.json")  # -> path
# ---------- ghpython_script_2: Python ----------
a = ghdoc.Path

path = a.split('3d_printing_teamwork')[0]+r'3d_printing_teamwork\\'+file_name
# ---------- end ghpython_script_2 ----------
ghpython_script_3 = GhPythonScript(file_name="\dependencies\fabrication.py")
# ---------- ghpython_script_3: Python ----------
import sys
a = ghdoc.Path

path = a.split('3d_printing_teamwork')[0]+r'3d_printing_teamwork\\'
print(path)
sys.path.append('path')
# ---------- end ghpython_script_3 ----------
ghpython_script_4 = GhPythonScript(file_name=panel)  # -> path; same code as ghpython_script_2
read_file = ReadFile(File=ghpython_script_4, PerLineParse=False)

# ----
# FABRICATION
debug_robot_acc = Slider(0.03, range=0..1)
debug_robot_vel = Slider(0.03, range=0..1)
send_debug_plane = Button()
X = Slider(0, range=-100..300)
Y = Slider(0, range=-100..300)
Z = Slider(0, range=-100..300)

construct_point = ConstructPoint(XCoordinate=X, YCoordinate=Y, ZCoordinate=Z)
python = GhPythonScript(
    Code=read_file,
    NAVIGATION_JSON=ghpython_script_2,
    DEBUG_ROBOT_ACC=debug_robot_acc,
    DEBUG_ROBOT_VEL=debug_robot_vel,
    Send_debug_plane=send_debug_plane,
    Debug_plane=construct_point)  # -> Out, Script
panel_2 = Panel(python.Out)
panel_3 = Panel(python.Script)

# ----
# VISUALIZATION
trigger = Trigger(Interval=1000, TimerInterval=1000, Target=ghpython_script_5)  # disabled
listen = BooleanToggle(True)

# ---- group: Get robot pose
ghpython_script_5 = GhPythonScript(listen=listen)  # -> out, config; inputs listen: Boolean
# ---------- ghpython_script_5: Python ----------
import simple_comm as comm

if listen:
    chunks =comm.listen_to_robot("192.168.10.10")
    config = chunks["actual_joints"]
# ---------- end ghpython_script_5 ----------

# ----
ghpython_script_6 = GhPythonScript(config=ghpython_script_5.config)  # -> configuration; inputs config: list
# ---------- ghpython_script_6: Python ----------
import math
from compas_fab.robots import Configuration
congifuration = []
for c in config:
    congifuration.append( math.radians(c))
    
    
configuration = Configuration.from_revolute_values(congifuration)
# ---------- end ghpython_script_6 ----------
ur10e = GhPythonScript()  # -> robot
# ---------- ur10e: Python ----------
import compas_fab
from compas.artists import Artist
from compas.robots import RobotModel
from compas.robots.resources import LocalPackageMeshLoader
from compas_fab.robots import Robot


urdf = compas_fab.get('universal_robot/ur_description/urdf/ur5.urdf')
model = RobotModel.from_urdf_file(urdf)

loader = LocalPackageMeshLoader(compas_fab.get('universal_robot'), 'ur_description')
model.load_geometry(loader)


robot = Robot(model)
robot.artist = Artist(model)
# ---------- end ur10e ----------

# ---- group: Base
geometry = Geometry([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])

# ---- group: Plate
geometry_2 = Geometry(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)

# ----
panel_4 = Panel(ghpython_script_5.out)
robot_visualize = COMPASFABRobotVisualize(
    robot=ur10e,
    configuration=ghpython_script_6,
    show_collision=Toggle(False),
    show_frames=True,
    show_cm=False,
    show_acm=False)  # -> visual, collision, collision_meshes, attached_meshes, frames, base_frame, ee_frame; inputs show_visual: Boolean, show_collision: Boolean, show_frames: Boolean, show_base_frame: Boolean, show_end_effector_frame: Boolean, show_cm: Boolean, show_acm: Boolean
#   port group: The planning group used for end-effector and base visualization.
#   port configuration: The robot's full configuration.
#   port show_visual: Whether or not to show the robot's visual meshes.
#   port show_collision: Whether or not to show the robot's collision meshes.
#   port show_frames: Whether or not to show the robot's joint frames.
#   port show_base_frame: Whether or not to show the robot's base frame.
#   port show_end_effector_frame: Whether or not to show the robot's end-effector frame.
#   port show_cm: Whether or not to show the collision meshes (if any).
#   port show_acm: Whether or not to show the attached collision meshes (if any).
#   port visual: Rhino meshes of the robot's visual geometry (if any).
#   port collision: Rhino meshes of the robot's collision geometry (if any).
#   port collision_meshes: Rhino meshes of the scene's collision meshes (if any).
#   port attached_meshes: Rhino meshes of the scene's attached collision meshes (if any).
#   port frames: The robot's joint frames as Rhino planes (if any).
#   port base_frame: The robot's base frame as a Rhino plane (if any).
#   port ee_frame: The robot's end-effector frame as a Rhino plane (if any).
# ---------- robot_visualize: Python ----------
"""
Visualizes the robot.

COMPAS FAB v0.27.0
"""
from compas.artists import Artist
from compas.geometry import Frame
from compas.geometry import Transformation
from compas_fab.robots import PlanningScene
from ghpythonlib.componentbase import executingcomponent as component
import Rhino.Geometry as rg


class RobotVisualize(component):
    def RunScript(
        self,
        robot,
        group,
        configuration,
        show_visual,
        show_collision,
        show_frames,
        show_base_frame,
        show_end_effector_frame,
        show_cm,
        show_acm,
    ):

        visual = None
        collision = None
        collision_meshes = None
        attached_meshes = None
        frames = None
        base_frame = None
        ee_frame = None

        if robot:
            show_visual = True if show_visual is None else show_visual
            show_cm = True if show_cm is None else show_cm
            show_acm = True if show_acm is None else show_acm
            configuration = configuration or robot.zero_configuration()

            robot.update(configuration, visual=show_visual, collision=show_collision)
            compas_frames = robot.transformed_frames(configuration, group)

            if show_visual:
                visual = robot.artist.draw_visual()

            if show_collision:
                collision = robot.artist.draw_collision()

            if show_base_frame:
                base_compas_frame = compas_frames[0]
                artist = Artist(base_compas_frame)
                base_frame = artist.draw()

            if show_end_effector_frame:
                ee_compas_frame = robot.forward_kinematics(
                    configuration, group, options=dict(solver="model")
                )
                artist = Artist(ee_compas_frame)
                ee_frame = artist.draw()

            if show_frames:
                frames = []
                for compas_frame in compas_frames[1:]:
                    artist = Artist(compas_frame)
                    frame = artist.draw()
                    frames.append(frame)

            if show_cm or show_acm:
                scene = PlanningScene(robot)
                scene = robot.client.get_planning_scene()

                collision_meshes = []
                attached_meshes = []

                if show_cm:
                    for co in scene.world.collision_objects:
                        header = co.header
                        frame_id = header.frame_id
                        cms = co.to_collision_meshes()

                        for cm in cms:
                            if cm.frame != Frame.worldXY():
                                t = Transformation.from_frame(cm.frame)
                                mesh = cm.mesh.transformed(t)
                            else:
                                mesh = cm.mesh

                            collision_meshes.append(Artist(mesh).draw())

                if show_acm:
                    for aco in scene.robot_state.attached_collision_objects:
                        for acm in aco.to_attached_collision_meshes():
                            frame_id = aco.object["header"]["frame_id"]
                            frame = robot.forward_kinematics(
                                configuration, options=dict(link=frame_id)
                            )
                            t = Transformation.from_frame(frame)

                            # Local CM frame
                            if (
                                acm.collision_mesh.frame
                                and acm.collision_mesh.frame != Frame.worldXY()
                            ):
                                t = t * Transformation.from_frame(
                                    acm.collision_mesh.frame
                                )

                            mesh = acm.collision_mesh.mesh.transformed(t)

                            attached_meshes.append(Artist(mesh).draw())
#        for v in visual:
#            v.Transform(rg.Transform.Scale(rg.Point3d(0,0,0),10))
        return (
            visual,
            collision,
            collision_meshes,
            attached_meshes,
            frames,
            base_frame,
            ee_frame,
        )
# ---------- end robot_visualize ----------
scale = Scale(Geometry=robot_visualize.visual, Center=Point(0, 0, 0), Factor=1000)  # -> Geometry, Transform
move = Move(Geometry=scale.Geometry, Motion=Vector(509.9608609, 518.7916699, 8))  # -> Geometry, Transform

# ----
# TO DO
free_drive = BooleanToggle(True)
toggle_freedrive = GhPythonScript(free_drive=free_drive, NAVIGATION_JSON=ghpython_script_2)
# ---------- toggle_freedrive: Python ----------
import os
from compas.rpc import Proxy
import json
with open(NAVIGATION_JSON, "r") as f:
    data = json.load(f)
ip = data["ip"]

if free_drive:   
    canvas = ghenv.Component.OnPingDocument()
    path = os.path.abspath(os.path.dirname(canvas.FilePath))
    rtde = Proxy('fabrication', path=path)                         # stay in teach moded(freedrive) as long as this is True
    a = rtde.start_teach_mode(ip=ip)            # send message to robot
    ghenv.Component.Message = "Freedrive on"    # display message on GH component
else:   
    canvas = ghenv.Component.OnPingDocument()
    path = os.path.abspath(os.path.dirname(canvas.FilePath))
    rtde = Proxy('fabrication', path=path)                          # stop teach mode if stop button pressed
    a = rtde.stop_teach_mode(ip=ip)             # send message to robot   
    ghenv.Component.Message = "Freedrive off"   # display message on GH component
# ---------- end toggle_freedrive ----------

get_config = GhPythonScript(send=Button())  # -> config, a
# ---------- get_config: Python ----------
import os
from scriptcontext import sticky as st
#sticky is a persistent dictionary which can save values and also be acessed by other GH components
#we use it here with a custom key to store values we read from the robot
from compas.rpc import Proxy

config_key = 'config_{}'.format(str(ghenv.Component.InstanceGuid))
new_key = 'new_key_{}'.format(str(ghenv.Component.InstanceGuid))
if config_key not in st:
    st[config_key] = None

if send:
    canvas = ghenv.Component.OnPingDocument()
    path = os.path.abspath(os.path.dirname(canvas.FilePath))
    rtde = Proxy('fabrication', path=path)
    
    st[config_key] = rtde.get_config(ip=ip)
    st[new_key] = rtde.get_config(ip=ip)
#    a = rtde.get_config(ip=ip)
config = st[config_key]
# ---------- end get_config ----------

# ----
# Get current config
# Send to a config using UR RTDE
# Send single target using UR RTDE
toggle = BooleanToggle(True)
panel_5 = Panel(get_config.config)
python_2 = GhPythonScript()  # -> out, a
# ---------- python_2: Python ----------
import Rhino.Geometry as rg

from scriptcontext import sticky

print sticky
# ---------- end python_2 ----------

move_to_config = GhPythonScript(config=get_config.config, speed=Slider(0.24, range=0..2), accel=Slider(0.1, range=0..3.14), send=Button())  # -> a
# ---------- move_to_config: Python ----------
import os
import math

from compas.rpc import Proxy

if send:
    if not config:
        ghenv.Component.Message = "No config to move to!"
    else:
        canvas = ghenv.Component.OnPingDocument()
        path = os.path.abspath(os.path.dirname(canvas.FilePath))
        rtde = Proxy('fabrication', path=path)
        nowait = True
        a = rtde.move_to_joints(config, speed, accel, nowait, ip=ip)
        ghenv.Component.Message = "Sent config"
# ---------- end move_to_config ----------

move_to_target = GhPythonScript(speed=Slider(0.3, range=0..2), accel=Slider(0.1, range=0..3.14), send=Button())  # -> a
# ---------- move_to_target: Python ----------
import os
import math
from compas.rpc import Proxy


if send:
    if not frame:
        ghenv.Component.Message = "No frame to move to!"
    else:
        canvas = ghenv.Component.OnPingDocument()
        path = os.path.abspath(os.path.dirname(canvas.FilePath))
        rtde = Proxy('fabrication', path=path)
        radius = 0.1
        a = rtde.move_to_target(frame, speed, accel, radius, ip=ip)
        ghenv.Component.Message = "Sent frame"
# ---------- end move_to_target ----------
