# Grasshopper definition release_elv.gh (Grasshopper 1.0.7)
# plug-ins: Pufferfish

curve = Curve(<curve referenced from the Rhino model>)
geometry = Geometry(<brep referenced from the Rhino model>)
control_points = ControlPoints(Curve=curve)  # -> Points, Weights, Knots
surface_closest_point = SurfaceClosestPoint(Point=control_points.Points, Surface=geometry)  # -> Point, UVPoint, Distance
evaluate_surface = EvaluateSurface(Surface=geometry, Point=surface_closest_point.UVPoint)  # -> Point, Normal, UDirection, VDirection, Frame
construct_plane = ConstructPlane(Origin=evaluate_surface.Point, XAxis=evaluate_surface.UDirection, YAxis=evaluate_surface.VDirection)
curve_2 = Curve(<curve referenced from the Rhino model>)
unit_y = UnitY(Factor=Slider(5, range=0..10))
flip_plane = FlipPlane(Plane=construct_plane, FlipX=False, FlipY=False, FlipZ=True)  # -> Flipped, ResultBoolean
end_points = EndPoints(Curve=curve_2)  # -> Start, End
move = Move(Geometry=end_points.Start, Motion=unit_y)  # -> Geometry, Transform
curve_3 = Curve(<curve referenced from the Rhino model>)

curve_4 = Curve(<curve referenced from the Rhino model>)
divide_curve = DivideCurve(Curve=curve_4, Count=20, Kinks=False)  # -> Points, Tangents, Parameters
timer = Timer(Interval=50, TimerInterval=50, Target=c_script)  # disabled
c_script = CSharpScript(zPoints=divide_curve.Points, zReset=Button(), zRadius="6", zEdge=curve_3, zMaxCounts="1500")  # -> out, zOutPoints; inputs zPoints: list of Point3d, zReset: Boolean, zRadius: Double, zEdge: Curve, zMaxCounts: Int32
# ---------- c_script: C# ----------
    if (zReset)
    { zInteration = 0;}
    zInteration++;
    List<Circle> circles = new List<Circle>();
    List<Point3d> OutPoint = new List<Point3d>();
    for (int iteration = 0; iteration < zInteration ; iteration++)
    {
      List<Vector3d> totalVector = new List<Vector3d>();
      List<double> counts = new List<double>();
      for  (int i = 0 ; i < zPoints.Count ; i++)
      {
        totalVector.Add(new Vector3d (0, 0, 0));
        counts.Add(0);}
      for  (int i = 0 ; i < zPoints.Count ; i++)
        for (int j = i + 1 ;j < zPoints.Count;j++)
        {
          double distance = zPoints[i].DistanceTo(zPoints[j]);
          if (2 * zRadius < distance ) continue;
          else
          {

            Vector3d subVector = zPoints[i] - zPoints[j];
            subVector.Unitize();
            subVector *= 0.5 * (  2 * zRadius - distance);
            totalVector[i] += subVector;
            totalVector[j] -= subVector;
            counts[i] += 1;
            counts[j] += 1;

          }
        }
      for (int k = 0 ; k < zPoints.Count; k++)
        if ( counts[k] != 0)
        {
          if (zEdge.Contains(zPoints[k]) == PointContainment.Inside)
          {Vector3d move = totalVector[k] / counts[k];
            zPoints[k] += move;}

        }
      if (zPoints.Count < zMaxCounts)
      {
        List<int> Indices = new List<int>();

        for (int i = 0 ; i < zPoints.Count - 1;i++)
        {
          if(zPoints[i].DistanceTo(zPoints[i + 1]) > zRadius)
          {Indices.Add(i + 1 + Indices.Count);}
        }
        foreach (int Index in Indices)
        {Point3d addPoint = 0.5 * (zPoints[Index - 1] + zPoints[Index]);
          zPoints.Insert(Index, addPoint);}
      }
    }

    foreach (Point3d point in zPoints)
    {
      OutPoint.Add(point);
    }
    zOutPoints = OutPoint;
# ---------- c_script: C# additional code ----------
  int zInteration = 0;
# ---------- end c_script ----------
panel = Panel(c_script.out)
polyline = PolyLine(Vertices=c_script.zOutPoints, Closed=False)

deconstruct_plane = DeconstructPlane(Plane=flip_plane.Flipped)  # -> Origin, XAxis, YAxis, ZAxis
line_sdl = LineSDL(Start=move.Geometry, Direction=Vector(0, -460.5443794, 0), Length=Slider(110, range=0..1000))
amplitude = Amplitude(Vector=deconstruct_plane.ZAxis, Amplitude=Slider(10, range=0..10))
linear_array = LinearArray(Geometry=line_sdl, Direction=Vector(10, 0, 0), Count=Slider(3, range=0..100))  # -> Geometry, Transform
move_2 = Move(Geometry=flip_plane.Flipped, Motion=amplitude)  # -> Geometry, Transform
number_slider = Slider(13, range=0..100)
dispatch = Dispatch(List=linear_array.Geometry, DispatchPattern=[True, False])  # -> ListA, ListB
polyline_2 = PolyLine(
    Vertices=[Point(333.6260694, 144.9547721, 0), Point(328.8998949, 148.0324358, 0), Point(324.5120047, 151.1757119, 0), Point(324.7381068, 149.9792698, 0), Point(325.236821, 144.8048167, 0), Point(325.6309301, 140.5924296, 0)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],
    Closed=False)
list_item = ListItem(List=move_2.Geometry, Index=Slider(61, range=0..100), Wrap=True)
divide_curve_2 = DivideCurve(Curve=dispatch.ListA, Count=number_slider, Kinks=False)  # -> Points, Tangents, Parameters
divide_curve_3 = DivideCurve(Curve=dispatch.ListB, Count=number_slider, Kinks=False)  # -> Points, Tangents, Parameters
panel_2 = Panel("""1
1
0
0""")
cull_pattern = CullPattern(List=divide_curve_3.Points, CullPattern=invert(panel_2))
cull_pattern_2 = CullPattern(List=divide_curve_2.Points, CullPattern=panel_2)
curve_5 = Curve(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)
geometry_2 = Geometry(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)
weave = Weave(Pattern=panel_2, Stream0=cull_pattern, Stream1=cull_pattern_2, NullGaps=False)
control_points_2 = ControlPoints(Curve=curve_5)  # -> Points, Weights, Knots
nurbs_curve = NurbsCurve(Vertices=weave, Degree=3, Periodic=False)  # -> Curve, Length, Domain
surface_closest_point_2 = SurfaceClosestPoint(Point=control_points_2.Points, Surface=geometry_2)  # -> Point, UVPoint, Distance
list_item_2 = ListItem(List=flatten(nurbs_curve.Curve), Index=Slider(5, range=0..10), Wrap=True)
evaluate_surface_2 = EvaluateSurface(Surface=geometry_2, Point=surface_closest_point_2.UVPoint)  # -> Point, Normal, UDirection, VDirection, Frame
linear_array_2 = LinearArray(Geometry=nurbs_curve.Curve, Direction=Vector(20, 0, 0), Count=Slider(5, range=0..10))  # -> Geometry, Transform
construct_plane_2 = ConstructPlane(Origin=evaluate_surface_2.Point, XAxis=evaluate_surface_2.UDirection, YAxis=evaluate_surface_2.VDirection)
unit_z = UnitZ(Factor=Slider(2, range=0..10))
flip_plane_2 = FlipPlane(Plane=construct_plane_2, FlipX=False, FlipY=False, FlipZ=True)  # -> Flipped, ResultBoolean
move_3 = Move(Geometry=linear_array_2.Geometry, Motion=unit_z)  # -> Geometry, Transform
geometry_3 = Geometry(Tree({0;0;0;0}: [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], {0;0;1;0}: [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]))
geometry_4 = Geometry(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)
geometry_5 = Geometry(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)
deconstruct_plane_2 = DeconstructPlane(Plane=flip_plane_2.Flipped)  # -> Origin, XAxis, YAxis, ZAxis

# ----
# Basic Parameters
velocity = Slider(15, range=0..50)
divide_interval = Slider(2.5, range=0..50)
layers = Slider(0, range=0..50)

st_distance = Slider(250, range=0..1000)
amplitude_2 = Amplitude(Vector=deconstruct_plane_2.ZAxis, Amplitude=Slider(1, range=0..1))
move_4 = Move(Geometry=flip_plane_2.Flipped, Motion=amplitude_2)  # -> Geometry, Transform
plane = Plane(move_4.Geometry)

# ----
# Printing parameters generator
curve_printpts = GhPythonScript(
    curve=geometry_4,
    st_dist=st_distance,
    divide_interval=divide_interval,
    layers=layers,
    layer_height=Slider(1, range=0..10),
    velocity=velocity)  # -> points, way_points, velocities, blend_radii, extruder_toggles; inputs curve: Curve, layers: Int32, velocity: Int32
# ---------- curve_printpts: Python ----------
import Rhino.Geometry as rg
import math as m
import random as r

def divide_crv(crv, divide_interval, endInc):
    """
    Function to divide a curve by closest integer multiple of length
    crv : input curve
    divide_interval : desired length of segments
    endInc : if you want to include the end point
    
    returns : list of points and normals"""
    crv_length = crv.GetLength()
    count = int(crv_length/divide_interval)
    params = crv.DivideByCount(count, endInc)
    points = [crv.PointAt(p) for p in params]
    pl = rg.Plane( rg.Point3d(0,0, -8.44), rg.Vector3d.ZAxis)
    T = rg.Transform.ProjectAlong(pl, rg.Vector3d.ZAxis)
    for p in points :
        p.Transform(T)
    tangents = [crv.TangentAt(p) for p in params]
    normals = [rg.Vector3d.CrossProduct(t, rg.Vector3d.ZAxis) for t in tangents]
    return points, normals


def calc_blend_radius(new_pts, buffer=0.1):
    """
    Function to calculate blend radius for a list of points
    new_pts : List(Point3d) list of points to iterate
    buffer : %age of inter point distance to be blended
    
    returns : List of blend radii
    """
    blend_radiuses = []
    for i in range(len (new_pts)-1):
        pt = new_pts[i]
        pt_1 = new_pts[i+1]
        dist = pt.DistanceTo(pt_1)
        blend_radius = dist*buffer
        blend_radiuses.append(blend_radius)
    blend_radiuses.append(blend_radiuses[-1])
    return blend_radiuses



##################################################################################################################################################

#As coding convention we separate the namespace thus the bottom part being the "main" part of the code, which is executed by the python interpreter

if __name__ == '__main__':
    #To simplify life, we can check the type of curve and generate printpoints based on that
    #if curve_degree == 1, it's a polyline
    #if curve_degree != 1, it's a curve
    curve_degree = curve.Degree #rg.Curve.Degree ---> Attribute of class Curve in Rhino.Geometry; notice no paranthesis ()
    #create an empty list of points
    points = [] 
    
    #If polyline
    if curve_degree ==1:
        #means it is a polyline or line curve
        if not curve.IsClosed:
            #if curve is open, we add the start point for the first segment and endpoints for all the rest
            crv_segs = curve.DuplicateSegments()
            for i,seg in enumerate(crv_segs):
                if i==0:
                    points.append(seg.PointAtStart)
                    points.append(seg.PointAtEnd)
                else:
                    points.append(seg.PointAtEnd)
        elif curve.IsClosed:
            #if it is closed, we can add all the endpoints since the start point is also the end of the last one
            crv_segs = curve.DuplicateSegments()
            for seg in crv_segs:
                points.append(seg.PointAtEnd)
    
    #If it is a curve
    elif curve_degree !=1:
        endInc = True
        points,_ = divide_crv(curve, divide_interval, endInc)
    
    way_points = []
    for i in range(layers): #iterate through required number of layers
        layer_points = []
        for pt in points: #go through points on curve and create them for different heights
            way_point = rg.Point3d(pt.X, pt.Y, pt.Z + i*layer_height)
            layer_points.append(way_point)
        #for open curves, reverse every alternate layer to continue the path
        if i%2==1 and not curve.IsClosed:
            layer_points.reverse()
        way_points.extend(layer_points)
    
    #Here we insert a start point in the beginning
    st_pt = points[0].Clone()
    v = curve.TangentAt(0)
    T = rg.Transform.Translation(-st_dist*v)
    st_pt.Transform(T)
    way_points.insert(0, st_pt)
    
    
    
    #Here we insert a safe point in the beginning
    safe_dis = 50.0
    Lift = rg.Transform.Translation(0, 0, safe_dis)
    safe_pt = way_points[0].Clone()
    safe_pt.Transform(Lift)
    way_points.insert(0,safe_pt)
    
    #Here we create a list of velocity
    velocities=[]
    for pt in way_points:
        velocities.append(velocity) #consrant vevlocity for all waypoints alternatively velocities = [velocity]*len(way_points)
    
    #Here we create a list of blend radius, call the function to calculate a list of blend radii
    blend_radii = calc_blend_radius(way_points, buffer=0.1)
    
    #Here we create a list of extruder toggle, True means the robot sends signal to the extruder motor
    extruder_toggles=[]
    #toggle False means extruder is OFF, True meaning it is ON
    for i,pt in enumerate(way_points):
        if i ==0 or i == len(way_points)-1:
            #for the first point(safety point) and the last point toggle is False
            extruder_toggles.append(False)      
        else:
            extruder_toggles.append(True)
# ---------- end curve_printpts ----------
