# Grasshopper definition 00_plane_premaking.ghx (Grasshopper 1.0.7)

ghpython_script = GhPythonScript()  # -> frames; inputs planes: list
# ---------- ghpython_script: Python ----------
from compas_rhino.conversions import plane_to_compas

frames = []
for p in planes:
    frames.append(plane_to_compas(p))
# ---------- end ghpython_script ----------
ghpython_script_2 = GhPythonScript(file_name="\simulation_visualization_fabrication\data\planes.json")  # -> path
# ---------- ghpython_script_2: Python ----------
a = ghdoc.Path

path = a.split('3d_printing_teamwork')[0]+r'3d_printing_teamwork\\'+file_name
# ---------- end ghpython_script_2 ----------
to_json = ToJSON(data=ghpython_script, pretty=Toggle(True))  # -> json; inputs pretty: Boolean
#   port data: COMPAS data objects to serialize.
#   port filepath: File path where to store the JSON file. If empty, it will not store to disk but instead return the JSON string.
#   port pretty: If True, JSON data will be formatted with indentation and key sorting.
#   port json: JSON file path or JSON string.
# ---------- to_json: Python ----------
"""
Serializes COMPAS objects to JSON.
"""
from ghpythonlib.componentbase import executingcomponent as component

import compas


class CompasInfo(component):
    def RunScript(self, data, filepath, pretty):
        json = filepath

        if filepath:
            compas.json_dump(data, filepath, pretty)
        else:
            json = compas.json_dumps(data, pretty)

        return json
# ---------- end to_json ----------
