# Grasshopper definition 01_freedrive_and_visualization.ghx (Grasshopper 1.0.7)
# plug-ins: Pufferfish

panel = Panel("\simulation_visualization_fabrication\data\master_navigation_data.json")
data_folder_name = Panel("data")
ghpython_script = GhPythonScript(file_name=panel)  # -> path
# ---------- ghpython_script: Python ----------
a = ghdoc.Path

path = a.split('3d_printing_teamwork')[0]+r'3d_printing_teamwork\\'+file_name
# ---------- end ghpython_script ----------

# ----
# Output
# Input
py = PythonScript()  # -> path
# ---------- py: Python ----------
import sys
import os

ghComp = ghenv.Component
ghDoc = ghComp.OnPingDocument()

# the full path of the gh file
path = ghDoc.FilePath
# the current directory 
path = os.path.abspath(os.path.join(path, ".."))

print path
# ---------- end py ----------

# ---- group: Folder name
data = Data(data_folder_name)

# ---- group: Path cross-section
# Visualization
xz = XZPlane(Origin=Point(0, 0, 0))
rectangle = Rectangle(Plane=xz, XSize=Slider(2.5, range=0..10), YSize=Slider(1, range=0..10), Radius=Slider(0.43, range=0..1))  # -> Rectangle, Length

# ----
# FreeDrive
free_drive = BooleanToggle(False)
toggle_freedrive = GhPythonScript(free_drive=free_drive, NAVIGATION_JSON=ghpython_script)  # -> out
# ---------- toggle_freedrive: Python ----------
import os
from compas.rpc import Proxy

import json
with open(NAVIGATION_JSON, "r") as f:
    data = json.load(f)
ip = data["ip"]

if free_drive:   
    canvas = ghenv.Component.OnPingDocument()
    path = os.path.abspath(os.path.dirname(canvas.FilePath))
    rtde = Proxy('data.rtde_wrapper', path=path)                         # stay in teach moded(freedrive) as long as this is True
    a = rtde.start_teach_mode(ip=ip)            # send message to robot
    ghenv.Component.Message = "Freedrive on"    # display message on GH component
else:   
    canvas = ghenv.Component.OnPingDocument()
    path = os.path.abspath(os.path.dirname(canvas.FilePath))
    rtde = Proxy('data.rtde_wrapper', path=path)                          # stop teach mode if stop button pressed
    a = rtde.stop_teach_mode(ip=ip)             # send message to robot   
    ghenv.Component.Message = "Freedrive off"   # display message on GH component
# ---------- end toggle_freedrive ----------

send_debug_plane = Button()
debug_robot_vel = Slider(0.03, range=0..1)
# Plane_Sending
debug_robot_acc = Slider(0.03, range=0..1)
X = Slider(0, range=-100..300)
Z = Slider(0, range=-100..300)
Y = Slider(200, range=-100..300)

# ----
# Load Slicer
panel_2 = Panel("slicer_data.json")
# In order for the components in this file to work, you need to add the correct folder to your paths in Rhino.
# In Rhino, type "EditPythonScript", go to Tools > Options > Add to search path and add the following folder:
# <path>/compas_slicer/src/grasshopper_visualization'
button = Button()
csloadslicer = CsLoadSlicer(recompute=button, json_name=panel_2, path=py, folder_name=data)  # -> out, mesh, paths, are_closed, all_points; inputs recompute: Boolean
# ---------- csloadslicer: Python ----------
"""
Loads a Slicer class from its json file in the 'output' folder.

"""

import compas_slicer_ghpython.visualization as gh_compas_slicer
gh_compas_slicer = reload(gh_compas_slicer)


if path and folder_name and json_name:
    mesh, paths, are_closed, all_points = gh_compas_slicer.load_slicer(path, folder_name, json_name)
    
else:
    gh_compas_slicer.missing_input()
# ---------- end csloadslicer ----------

# ----
# Load Printpoints
panel_3 = Panel("out_printpoints.json")
csloadprintpoints = CsLoadPrintpoints(recompute=Button(), json_name=panel_3, path=py, folder_name=data)  # -> out, geometry, points, frames, layer_heights, up_vectors, mesh_normals, closest_support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; inputs recompute: Boolean
# ---------- csloadprintpoints: Python ----------
"""
Loads a dictionaly of Printpoints from a json file in the 'output' folder.

"""

import compas_slicer_ghpython.visualization as gh_compas_slicer
gh_compas_slicer = reload(gh_compas_slicer)


if path and folder_name and json_name:
    points, frames, layer_heights, up_vectors, mesh_normals, closest_support, velocities, wait_times, \
    blend_radiuses, extruder_toggles = \
        gh_compas_slicer.load_printpoints(path, folder_name, json_name)
    
else:
    gh_compas_slicer.missing_input()
# ---------- end csloadprintpoints ----------

construct_point = ConstructPoint(XCoordinate=X, YCoordinate=Y, ZCoordinate=Z)
panel_4 = Panel(toggle_freedrive)
python = GhPythonScript(DEBUG_ROBOT_ACC=debug_robot_acc, DEBUG_ROBOT_VEL=debug_robot_vel, send_debug_plane=send_debug_plane)  # -> out, script; inputs send_debug_plane: Boolean, debug_planes: list of Plane
# ---------- python: Python ----------
import Rhino.Geometry as rg
import simple_ur_script as ur
import simple_comm as c
import json


def set_robot_base():
    pt_0 = rg.Point3d(data["origin"][0], data["origin"][1], data["origin"][2])  # base plane origin
    pt_1 = rg.Point3d(
        data["origin_x"][0], data["origin_x"][1], data["origin_x"][2]
    )  # point on positive x axis
    pt_2 = rg.Point3d(
        data["origin_y"][0], data["origin_y"][1], data["origin_y"][2]
    )  # point on positive xy plane
    robot_base = rg.Plane(pt_0, pt_1 - pt_0, pt_2 - pt_0)
    return robot_base


def rhino_to_robot_space(rhino_plane):
    plane = rhino_plane.Clone()
    rhino_matrix = rg.Transform.PlaneToPlane(rg.Plane.WorldXY, ROBOT_BASE)
    plane.Transform(rhino_matrix)
    return plane


def send(script):
    script = c.concatenate_script(script)
    c.send_script(script, ROBOT_IP)
    return script




script = ""
data = []
with open(NAVIGATION_JSON, "r") as f:
    data = json.load(f)
TCP = data["tcp"]
ROBOT_IP = data["ip"]
ROBOT_BASE = set_robot_base()
Z_OFFSET = data["offset_z"]
IO = data["io"]
script += ur.set_tcp_by_angles(TCP[0], TCP[1], TCP[2], TCP[3], TCP[4], TCP[5])

if send_debug_plane:
    script += ur.set_digital_out(IO, False)
    for debug_plane in debug_planes:
        script += ur.move_l(rhino_to_robot_space(rg.Plane(debug_plane.X,debug_plane.Y,debug_planeZ+Z_OFFSET)), DEBUG_ROBOT_ACC, DEBUG_ROBOT_VEL)
    script += ur.set_digital_out(IO,True)
    send(script)
# ---------- end python ----------
panel_5 = Panel(python.out)
panel_6 = Panel(python.script)
panel_7 = Panel(csloadprintpoints.out)

frames = Plane(csloadprintpoints.frames)
points = Point(csloadprintpoints.points)
cpts = Point(csloadprintpoints.closest_support)
up_vectors = Vector(csloadprintpoints.up_vectors)
mesh_normals = Vector(csloadprintpoints.mesh_normals)
layer_heights = Number(csloadprintpoints.layer_heights)

frames_2 = Plane(frames)
flippln = FlipPlane(Plane=frames_2, FlipX=False, FlipY=False, FlipZ=True)  # -> Flipped, R

mesh_normals_2 = Vector(mesh_normals)
points_2 = Point(points)
section = Curve(rectangle.Rectangle)

print_planes = Plane(flippln.Flipped)
tool_mesh = Mesh(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)

# ----
# Tool Visualization
number_slider = Slider(1494, range=0..2000)
tool_origin = Panel("""0
0
99.507""")
cstoolviz = CsToolViz(origin_coords=tool_origin, mesh=tool_mesh, planes=print_planes, index=number_slider)  # -> out, mesh, passed_path; inputs origin_coords: list, mesh: Mesh, planes: list, index: Int32
# ---------- cstoolviz: Python ----------
"""
Example visualization of tool motion during the print.

"""

import compas_slicer_ghpython.visualization as gh_compas_slicer
gh_compas_slicer = reload(gh_compas_slicer)

if origin_coords and mesh and planes and (index or index==0):
    mesh, passed_path = gh_compas_slicer.tool_visualization(origin_coords, mesh, planes, index)
else:
    gh_compas_slicer.missing_input()
# ---------- end cstoolviz ----------

mesh = Mesh(csloadslicer.mesh)
paths = Curve(csloadslicer.paths)
all_points = Point(csloadslicer.all_points)

velocities = Number(csloadprintpoints.velocities)
wait_times = Number(csloadprintpoints.wait_times)
blend_radiuses = Number(csloadprintpoints.blend_radiuses)
extruder_toggles = Number(csloadprintpoints.extruder_toggles)

# ----
# Ligthweight Path Visualization
number_slider_2 = Slider(2, range=0..10)
extruder_toggles_2 = Number(extruder_toggles)
all_points_2 = Point(points)
cslightpathviz = CsLightPathViz(points=all_points_2, extruder_toggles=extruder_toggles_2, pipe_diameter=number_slider_2)  # -> out, print_path_pipes, travel_path_lines; inputs points: list of Point3d, extruder_toggles: list of Boolean
# ---------- cslightpathviz: Python ----------
"""
Creates a lightweight visualization of the print paths. Segments with extruder_toggle=True are visualized as pipes, 
segments with extruder_toggle=False are visualized as lines.
Loads files from the 'output' folder.

"""

import compas_slicer_ghpython.visualization as gh_compas_slicer
gh_compas_slicer = reload(gh_compas_slicer)

pipe_resolution = 14

if points:
    
    # assign default values to parameters where possible. 
    if not extruder_toggles:
        extruder_toggles = [False for i in range(len(points))]
    if not pipe_diameter:
        pipe_diameter = 2.0
        
    print_path_pipes, travel_path_lines = \
        gh_compas_slicer.lightweight_path_visualization(points, extruder_toggles, pipe_diameter, pipe_resolution)
    
else:
    gh_compas_slicer.missing_input()
# ---------- end cslightpathviz ----------

# ----
# Render Path Visualization
toggle = BooleanToggle(False)
extruder_toggles_3 = Number(extruder_toggles)
layer_heights_2 = Number(layer_heights)
up_vectors_2 = Vector(up_vectors)
python_2 = CsRenderPathViz(
    points=points_2,
    mesh_normals=mesh_normals_2,
    layer_heights=layer_heights_2,
    up_vectors=up_vectors_2,
    extruder_toggles=extruder_toggles_3,
    cross_section=section,
    planar_printing=Toggle(True),
    compute=toggle)  # -> out, loft_surfaces, travel_path_lines; inputs points: list of Point3d, mesh_normals: list of Vector3d, layer_heights: list, up_vectors: list of Vector3d, extruder_toggles: list of Boolean, cross_section: Curve, planar_printing: Boolean, compute: Boolean
# ---------- python_2: Python ----------
"""
Creates a render visualization of the print paths with loft surfaces where extruder_toggle=True.
For large number of points, this can take a while to compute, so keep it turned off unless you need it.
Loads files from the 'output' folder.

"""

import compas_slicer_ghpython.visualization as gh_compas_slicer
gh_compas_slicer = reload(gh_compas_slicer)

pipe_resolution = 14

if points and mesh_normals and layer_heights and extruder_toggles and cross_section:
    if compute:
        loft_surfaces, travel_path_lines = \
            gh_compas_slicer.render_path_visualization(points, mesh_normals, layer_heights, up_vectors, extruder_toggles, cross_section, planar_printing)
    else:
        print('Compute is set to False')
else:
    gh_compas_slicer.missing_input()
# ---------- end python_2 ----------

# ---- group: Color output
geo = Geometry(cslightpathviz.travel_path_lines)
geo_2 = Geometry(cslightpathviz.print_path_pipes)
preview = CustomPreview(Geometry=geo_2, Material=ColourSwatch(SwatchColor=RGB(199, 199, 199)))
preview_2 = CustomPreview(Geometry=geo, Material=ColourSwatch(SwatchColor=RGB(255, 156, 36)))

geo_3 = Geometry(python_2.loft_surfaces)
geo_4 = Geometry(python_2.travel_path_lines)
preview_3 = CustomPreview(Geometry=geo_3, Material=ColourSwatch(SwatchColor=RGB(222, 222, 222)))
preview_4 = CustomPreview(Geometry=geo_4, Material=ColourSwatch(SwatchColor=RGB(255, 156, 36)))

# ----
mesh_2 = Mesh(cstoolviz.mesh)
geo_5 = Geometry(cstoolviz.passed_path)
preview_5 = CustomPreview(Geometry=mesh_2, Material=ColourSwatch(SwatchColor=RGB(171, 171, 171)))
preview_6 = CustomPreview(Geometry=geo_5, Material=ColourSwatch(SwatchColor=RGB(255, 156, 36)))

pline = PolyLine(Vertices=points, Closed=False)
vdis = VectorDisplay(Anchor=points, Vector=expr("x*5", up_vectors))

# ---- group: Select parameter to display
list = ValueList({"Velocity": 0, "Wait time": 1, "Blend radius": 2, "Extruder Toggle": 3}, selected="Blend radius")

# ----
filter = StreamFilter(Gate=list, Stream0=velocities, Stream1=wait_times, Stream2=blend_radiuses, Stream3=extruder_toggles)
num = Number(filter)
trigger = Trigger(Interval=50, TimerInterval=50, Target=get_config)  # disabled

# ---- group: Visualize parameter with text
tag_offset = Slider(1, range=0..100)
pdecon = Deconstruct(Point=points)  # -> XComponent, YComponent, ZComponent
addition = Addition(A=pdecon.ZComponent, B=tag_offset)
pt = ConstructPoint(XCoordinate=pdecon.XComponent, YCoordinate=pdecon.YComponent, ZCoordinate=addition)
tag = TextTag(Location=pt, Text=num, Colour=ColourSwatch(SwatchColor=RGB(50, 130, 186)))

# ---- group: Visualize parameter with color
bnd = Bounds(Numbers=num)
avr = Average(Input=num)
dedomain = DeconstructDomain(Domain=bnd)  # -> Start, End
average = Panel(avr)
gradient = Gradient(
    LowerLimit=dedomain.Start,
    UpperLimit=dedomain.End,
    Parameter=num,
    stops=[0: RGB(0, 128, 0), 0.5: RGB(255, 255, 0), 1: RGB(255, 0, 0)])
pt_2 = Point(points)
cloud = CloudDisplay(Points=pt_2, Colours=gradient, Size=Slider(3.96, range=0..10), SpriteType=0)

# ---- group: Slicer data
len = Length(Curve=flatten(paths))
lng = ListLength(List=flatten(paths))
ma = MassAddition(Input=len)  # -> Result, PartialResults
total_path_length = Panel(ma.Result)
total_number_of_paths = Panel(lng)

# ----
get_config = GhPythonScript(send=Toggle(True), NAVIGATION_JSON=ghpython_script)  # -> config
# ---------- get_config: Python ----------
import os
from scriptcontext import sticky as st
#sticky is a persistent dictionary which can save values and also be acessed by other GH components
#we use it here with a custom key to store values we read from the robot
from compas.rpc import Proxy

import json
with open(NAVIGATION_JSON, "r") as f:
    data = json.load(f)
ip = data["ip"]

config_key = 'config_{}'.format(str(ghenv.Component.InstanceGuid))
new_key = 'new_key_{}'.format(str(ghenv.Component.InstanceGuid))
if config_key not in st:
    st[config_key] = None

if send:
    canvas = ghenv.Component.OnPingDocument()
    path = os.path.abspath(os.path.dirname(canvas.FilePath))
    rtde = Proxy('data.rtde_wrapper', path=path)
    
    st[config_key] = rtde.get_config(ip=ip)
    st[new_key] = rtde.get_config(ip=ip)
#    a = rtde.get_config(ip=ip)
config = st[config_key]
# ---------- end get_config ----------
min = Panel(dedomain.Start)
max = Panel(dedomain.End)
ur10e = GhPythonScript()  # -> robot
# ---------- ur10e: Python ----------
import compas_fab
from compas.artists import Artist
from compas.robots import RobotModel
from compas.robots.resources import LocalPackageMeshLoader
from compas_fab.robots import Robot


urdf = compas_fab.get('universal_robot/ur_description/urdf/ur5.urdf')
model = RobotModel.from_urdf_file(urdf)

loader = LocalPackageMeshLoader(compas_fab.get('universal_robot'), 'ur_description')
model.load_geometry(loader)


robot = Robot(model)
robot.artist = Artist(model)
# ---------- end ur10e ----------
mesh_3 = Mesh(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)
attached_tool = AttachedTool(robot=ur10e, visual_mesh=mesh_3)  # -> robot; inputs visual_mesh: Mesh, collision_mesh: Mesh
#   port visual_mesh: A visual mesh for the tool.
#   port collision_mesh: A collision mesh for the tool.
#   port tcf_plane: The frame of the tool in tool0 frame.
#   port group: The planning group to which the tool should be attached.
# ---------- attached_tool: Python ----------
"""
Attach a tool to the robot.

COMPAS FAB v0.27.0
"""
from ghpythonlib.componentbase import executingcomponent as component
from compas_rhino.conversions import RhinoMesh
from compas_rhino.conversions import plane_to_compas_frame

from compas.geometry import Frame
from compas_fab.robots import Tool


class AttachToolComponent(component):
    def RunScript(self, robot, visual_mesh, collision_mesh, tcf_plane, group):
        if robot and robot.client and robot.client.is_connected and visual_mesh:
            if not collision_mesh:
                collision_mesh = visual_mesh

            c_visual_mesh = RhinoMesh.from_geometry(visual_mesh).to_compas()
            c_collision_mesh = RhinoMesh.from_geometry(collision_mesh).to_compas()

            if not tcf_plane:
                frame = Frame.worldXY()
            else:
                frame = plane_to_compas_frame(tcf_plane)
            tool = Tool(c_visual_mesh, frame, c_collision_mesh)

            robot.attach_tool(tool, group)

        return robot
# ---------- end attached_tool ----------

# ---- group: Base
geometry = Geometry([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])

# ---- group: Plate
geometry_2 = Geometry(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)

# ----
robot_visualize = COMPASFABRobotVisualize(
    robot=attached_tool,
    configuration=get_config,
    show_collision=Toggle(False),
    show_frames=True,
    show_cm=False,
    show_acm=False)  # -> visual, collision, collision_meshes, attached_meshes, frames, base_frame, ee_frame; inputs show_visual: Boolean, show_collision: Boolean, show_frames: Boolean, show_base_frame: Boolean, show_end_effector_frame: Boolean, show_cm: Boolean, show_acm: Boolean
#   port group: The planning group used for end-effector and base visualization.
#   port configuration: The robot's full configuration.
#   port show_visual: Whether or not to show the robot's visual meshes.
#   port show_collision: Whether or not to show the robot's collision meshes.
#   port show_frames: Whether or not to show the robot's joint frames.
#   port show_base_frame: Whether or not to show the robot's base frame.
#   port show_end_effector_frame: Whether or not to show the robot's end-effector frame.
#   port show_cm: Whether or not to show the collision meshes (if any).
#   port show_acm: Whether or not to show the attached collision meshes (if any).
#   port visual: Rhino meshes of the robot's visual geometry (if any).
#   port collision: Rhino meshes of the robot's collision geometry (if any).
#   port collision_meshes: Rhino meshes of the scene's collision meshes (if any).
#   port attached_meshes: Rhino meshes of the scene's attached collision meshes (if any).
#   port frames: The robot's joint frames as Rhino planes (if any).
#   port base_frame: The robot's base frame as a Rhino plane (if any).
#   port ee_frame: The robot's end-effector frame as a Rhino plane (if any).
# ---------- robot_visualize: Python ----------
"""
Visualizes the robot.

COMPAS FAB v0.27.0
"""
from compas.artists import Artist
from compas.geometry import Frame
from compas.geometry import Transformation
from compas_fab.robots import PlanningScene
from ghpythonlib.componentbase import executingcomponent as component
import Rhino.Geometry as rg


class RobotVisualize(component):
    def RunScript(
        self,
        robot,
        group,
        configuration,
        show_visual,
        show_collision,
        show_frames,
        show_base_frame,
        show_end_effector_frame,
        show_cm,
        show_acm,
    ):

        visual = None
        collision = None
        collision_meshes = None
        attached_meshes = None
        frames = None
        base_frame = None
        ee_frame = None

        if robot:
            show_visual = True if show_visual is None else show_visual
            show_cm = True if show_cm is None else show_cm
            show_acm = True if show_acm is None else show_acm
            configuration = configuration or robot.zero_configuration()

            robot.update(configuration, visual=show_visual, collision=show_collision)
            compas_frames = robot.transformed_frames(configuration, group)

            if show_visual:
                visual = robot.artist.draw_visual()

            if show_collision:
                collision = robot.artist.draw_collision()

            if show_base_frame:
                base_compas_frame = compas_frames[0]
                artist = Artist(base_compas_frame)
                base_frame = artist.draw()

            if show_end_effector_frame:
                ee_compas_frame = robot.forward_kinematics(
                    configuration, group, options=dict(solver="model")
                )
                artist = Artist(ee_compas_frame)
                ee_frame = artist.draw()

            if show_frames:
                frames = []
                for compas_frame in compas_frames[1:]:
                    artist = Artist(compas_frame)
                    frame = artist.draw()
                    frames.append(frame)

            if show_cm or show_acm:
                scene = PlanningScene(robot)
                scene = robot.client.get_planning_scene()

                collision_meshes = []
                attached_meshes = []

                if show_cm:
                    for co in scene.world.collision_objects:
                        header = co.header
                        frame_id = header.frame_id
                        cms = co.to_collision_meshes()

                        for cm in cms:
                            if cm.frame != Frame.worldXY():
                                t = Transformation.from_frame(cm.frame)
                                mesh = cm.mesh.transformed(t)
                            else:
                                mesh = cm.mesh

                            collision_meshes.append(Artist(mesh).draw())

                if show_acm:
                    for aco in scene.robot_state.attached_collision_objects:
                        for acm in aco.to_attached_collision_meshes():
                            frame_id = aco.object["header"]["frame_id"]
                            frame = robot.forward_kinematics(
                                configuration, options=dict(link=frame_id)
                            )
                            t = Transformation.from_frame(frame)

                            # Local CM frame
                            if (
                                acm.collision_mesh.frame
                                and acm.collision_mesh.frame != Frame.worldXY()
                            ):
                                t = t * Transformation.from_frame(
                                    acm.collision_mesh.frame
                                )

                            mesh = acm.collision_mesh.mesh.transformed(t)

                            attached_meshes.append(Artist(mesh).draw())
#        for v in visual:
#            v.Transform(rg.Transform.Scale(rg.Point3d(0,0,0),10))
        return (
            visual,
            collision,
            collision_meshes,
            attached_meshes,
            frames,
            base_frame,
            ee_frame,
        )
# ---------- end robot_visualize ----------
scale = Scale(Geometry=robot_visualize.visual, Center=Point(0, 0, 0), Factor=1000)  # -> Geometry, Transform
move = Move(Geometry=scale.Geometry, Motion=Vector(259.9608609, 268.7916699, 8))  # -> Geometry, Transform
