# Grasshopper definition combine.gh (Grasshopper 1.0.7)

panel = Panel("C:\Users\Zac\Desktop")
read_file = ReadFile(PerLineParse=False)

# ---- group: single_curve
curve = Curve(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)

# ----
surface = Surface(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)
surface_2 = Surface(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)
point = Point(Point(-556.4288437, 6.329469364, 0))

ghpython_script = GhPythonScript()  # -> Out, OutTemp
_0_to_1_00 = Slider(0, range=0..1)
_1_to_100 = Slider(0, range=0..100)
c_script = CSharpScript()  # -> Out, A
geometry = Geometry(<curve referenced from the Rhino model>)
geometry_2 = Geometry(<point referenced from the Rhino model>)

# ---- group: INPUT CRV, SRF, PT
geometry_3 = Geometry(<point referenced from the Rhino model>)
curve_2 = Curve(<curve referenced from the Rhino model>)
surface_3 = Surface(<surface referenced from the Rhino model>)

# ----
planes_spacing = Slider(10, range=0..20)
length = Length(Curve=geometry)
division = Division(A=length, B=planes_spacing)
integer = Integer(division)

divide_length = DivideLength(Curve=geometry, Length=Slider(3, range=0..10))  # -> Points, Tangents, Parameters

# ---- group: PRINT ADJUSTMENT LAYER VALUES
layer_nbr = Slider(15, range=0..100)

# ---- group: Layer variation plane adjustment
max_layer_height = Slider(1.2, range=0..10)
min_layer_height = Slider(0.5, range=0..10)

# ----
list_length = ListLength(List=divide_length.Points)

# ---- group: ALL PLANES
geometry_4 = Geometry([Point(20.11241087, -268.0994345, 166.8389438), Point(14.91492845, -266.6103508, 160.828328), Point(21.50814431, -265.3542559, 161.5611426), Point(21.37283391, -265.900737, 162.7330684), Point(18.20059355, -264.8780917, 158.4823961), Point(24.26334024, -262.2164061, 155.575904)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])
geometry_5 = Geometry([Point(20.11241087, -268.0994345, 166.8389438), Point(14.91492845, -266.6103508, 160.828328), Point(21.50814431, -265.3542559, 161.5611426), Point(21.37283391, -265.900737, 162.7330684), Point(18.20059355, -264.8780917, 158.4823961), Point(24.26334024, -262.2164061, 155.575904)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])
geometry_6 = Geometry([Point(20.11241087, -268.0994345, 166.8389438), Point(14.91492845, -266.6103508, 160.828328), Point(21.50814431, -265.3542559, 161.5611426), Point(21.37283391, -265.900737, 162.7330684), Point(18.20059355, -264.8780917, 158.4823961), Point(24.26334024, -262.2164061, 155.575904)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])

# ----
series = Series(Start=0, Step=expr("1/x", list_length), Count=list_length)

# ---- group: 10 PLANES
geometry_7 = Geometry([Plane(origin=(20.00949203, -267.6585518, 167.051147), x=(-0.9765919175, -0.212767767, -0.03159278532), y=(0.06244257573, -0.4209748274, 0.9049205045)), Plane(origin=(18.54185183, -253.8058761, 119.1938906), x=(-0.9698341398, -0.2434366882, -0.01266175937), y=(0.01972924504, -0.1301597398, 0.991296726)), Plane(origin=(2.716405825, -255.3842468, 81.32405356), x=(-0.9814958783, -0.1914477887, 0.003685800351), y=(-0.002470917068, 0.03191004211, 0.9994876907)), Plane(origin=(11.45670435, -257.5554686, 131.5667557), x=(-0.9742020149, -0.2245304731, -0.02272665285), y=(0.02265156901, -0.1974803183, 0.9800451165)), Plane(origin=(-4.043541148, -259.012895, 123.1589417), x=(-0.9824954775, -0.1849965287, -0.02188426413), y=(0.007849735981, -0.1584857942, 0.9873300536)), Plane(origin=(-19.7061908, -260.621374, 58.99762091), x=(-0.9917745565, -0.12704108, 0.01561387489), y=(0.0009991609617, 0.1142984493, 0.9934459553))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])
geometry_8 = Geometry([Plane(origin=(20.00949203, -267.6585518, 167.051147), x=(-0.9765919175, -0.212767767, -0.03159278532), y=(0.06244257573, -0.4209748274, 0.9049205045)), Plane(origin=(18.54185183, -253.8058761, 119.1938906), x=(-0.9698341398, -0.2434366882, -0.01266175937), y=(0.01972924504, -0.1301597398, 0.991296726)), Plane(origin=(2.716405825, -255.3842468, 81.32405356), x=(-0.9814958783, -0.1914477887, 0.003685800351), y=(-0.002470917068, 0.03191004211, 0.9994876907)), Plane(origin=(11.45670435, -257.5554686, 131.5667557), x=(-0.9742020149, -0.2245304731, -0.02272665285), y=(0.02265156901, -0.1974803183, 0.9800451165)), Plane(origin=(-4.043541148, -259.012895, 123.1589417), x=(-0.9824954775, -0.1849965287, -0.02188426413), y=(0.007849735981, -0.1584857942, 0.9873300536)), Plane(origin=(-19.7061908, -260.621374, 58.99762091), x=(-0.9917745565, -0.12704108, 0.01561387489), y=(0.0009991609617, 0.1142984493, 0.9934459553))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])
geometry_9 = Geometry([Plane(origin=(20.00949203, -267.6585518, 167.051147), x=(-0.9765919175, -0.212767767, -0.03159278532), y=(0.06244257573, -0.4209748274, 0.9049205045)), Plane(origin=(18.54185183, -253.8058761, 119.1938906), x=(-0.9698341398, -0.2434366882, -0.01266175937), y=(0.01972924504, -0.1301597398, 0.991296726)), Plane(origin=(2.716405825, -255.3842468, 81.32405356), x=(-0.9814958783, -0.1914477887, 0.003685800351), y=(-0.002470917068, 0.03191004211, 0.9994876907)), Plane(origin=(11.45670435, -257.5554686, 131.5667557), x=(-0.9742020149, -0.2245304731, -0.02272665285), y=(0.02265156901, -0.1974803183, 0.9800451165)), Plane(origin=(-4.043541148, -259.012895, 123.1589417), x=(-0.9824954775, -0.1849965287, -0.02188426413), y=(0.007849735981, -0.1584857942, 0.9873300536)), Plane(origin=(-19.7061908, -260.621374, 58.99762091), x=(-0.9917745565, -0.12704108, 0.01561387489), y=(0.0009991609617, 0.1142984493, 0.9934459553))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])

# ----
read_file_2 = ReadFile(File="C:\Zac\GitHub\3d_printing_teamwork\skinPattern\combine.py", PerLineParse=False)
graph_mapper = GraphMapper(series, x0=0, x1=1, y0=0, y1=1, container_name="Bezier", cpx=[0, 1, 0.5469563603, 1], cpy=[0, 0, 0.9756522775, 1])
entwine = Entwine(Branch00=geometry_8, Branch01=geometry_7, Branch02=geometry_9, FlattenInputs=True)  # -> simplify(Result)
param_viewer = ParamViewer(entwine)
ghpython_script_2 = GhPythonScript(
    Code=read_file_2,
    List_pts=divide_length.Points,
    Srf=surface_3,
    Flip_vect=Toggle(False),
    Layer_nbr=layer_nbr,
    Plns_height_pt=geometry_2,
    Plns_dir_pt=geometry_3,
    Min_layer_height=min_layer_height,
    Max_layer_height=max_layer_height,
    GraphMapper=graph_mapper)  # -> Out, Pts_divisions, Pts_planes, Moved_planes, Layered_planes
panel_2 = Panel(entwine)
geometry_10 = Geometry(ghpython_script_2.Layered_planes)
geometry_11 = Geometry(ghpython_script_2.Pts_divisions)
geometry_12 = Geometry(ghpython_script_2.Pts_planes)
geometry_13 = Geometry(ghpython_script_2.Moved_planes)
panel_3 = Panel(ghpython_script_2.Out)
geometry_14 = Geometry([Plane(origin=(38.13185217, -161.3493215, 190.5884341), x=(-0.6883613555, 0.5451203104, -0.4785420477), y=(-0.6911913365, -0.2928183073, 0.6606905292)), Plane(origin=(39.26932963, -163.0344636, 192.792849), x=(-0.6741881341, 0.5755939198, -0.4627764031), y=(-0.7014564657, -0.3029249456, 0.6451320052)), Plane(origin=(40.12870826, -164.7535916, 195.0946501), x=(-0.6610352009, 0.6037194012, -0.445595498), y=(-0.7105561949, -0.3128121296, 0.6302844322)), Plane(origin=(40.68806597, -166.4940898, 197.4715236), x=(-0.6490464662, 0.6290850466, -0.4277741096), y=(-0.7185371132, -0.3222313806, 0.616337046)), Plane(origin=(40.92963323, -168.2402285, 199.8972096), x=(-0.6383997276, 0.6515363026, -0.4098124378), y=(-0.7253753438, -0.3311866043, 0.6034451456)), Plane(origin=(41.19128103, -170.0015362, 202.2885664), x=(-0.6280570055, 0.6718973523, -0.3925536215), y=(-0.7320254455, -0.3390052033, 0.5909434992))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])

list_item = ListItem(List=geometry_10, Index=Slider(1000, range=0..1000), Wrap=True)

panel_4 = Panel(geometry_13)
