# Grasshopper definition 221212_Substructure.ghx (Grasshopper 1.0.7)

# ---- group: num. agents in each cluster
genes = GenePool(Decimals=0, Maximum=100, Minimum=0, Value=[34, 45, 42, 40])

# ----
genes_2 = GenePool(Decimals=2, Maximum=1, Minimum=0, Value=[0, 0.24, 0.52, 0.78])
dom = ConstructDomain(DomainStart=Slider(0.1, range=0..0.1), DomainEnd=Slider(0.3, range=0..1))
random = Random(Range=dom, Number=Slider(4, range=0..10), Seed=Slider(4, range=0..10))
range = Range(Domain=Domain(0, 1), Steps=genes)
bang = ExplodeTree(Data=range)  # -> Branch0, Branch1, Branch2, Branch3
ghpython_script = GhPythonScript(centers=genes_2, extend=random)  # -> out, intervals; inputs centers: list, extend: list
# ---------- ghpython_script: Python ----------
import math
import ghpythonlib.treehelpers as th


intervals=[]

for center, ext in zip(centers, extend):
    inter_from = center- ext
    inter_to = center + ext
    print type(inter_from)
    if inter_from < 0 : 
        inter_from =0
    if inter_to >1 :
        inter_to =1
    
    intervals.append([inter_from, inter_to])

intervals = th.list_to_tree(intervals)
# ---------- end ghpython_script ----------
graph = GraphMapper(
    bang.Branch0,
    x0=0,
    x1=1,
    y0=0,
    y1=1,
    container_name="Bezier",
    cpx=[0, 0.5314487219, 0.4586946666, 1],
    cpy=[0.01951313019, 0.01738131046, 1, 1])
graph_2 = GraphMapper(
    bang.Branch2,
    x0=0,
    x1=1,
    y0=0,
    y1=1,
    container_name="Sinc",
    Equation_X0=0.4748720825,
    Equation_X1=0.8188405633,
    Equation_Y0=0.9733063579,
    Equation_Y1=0)
graph_3 = GraphMapper(bang.Branch3, x0=0, x1=1, y0=0, y1=1, Cx=0.4874807298, Cy=0.7769420147, container_name="Conic")
graph_4 = GraphMapper(bang.Branch1, x0=0, x1=1, y0=0, y1=1, Ox=0.4780313373, Oy=1, Px=1, Py=0.1196134686, container_name="Parabola")
panel = Panel(ghpython_script.intervals)
merge = Merge(Data1=graph, Data2=graph_4, Data3=graph_2, Data4=graph_3)
bounds = Bounds(Numbers=merge)
sort = SortList(Keys=merge)  # -> Keys, ValuesA
remap = RemapNumbers(Value=sort.Keys, Source=bounds, Target=ghpython_script.intervals)  # -> Mapped, Clipped

# ---- group: No. Clusters
number_of_clusters = Panel("4")

# ---- group: num. agents in each cluster
genes_3 = GenePool(Decimals=0, Maximum=100, Minimum=0, Value=[2, 4])

# ----
range_2 = Range(Domain=Domain(0, 1), Steps=genes_3)
bang_2 = ExplodeTree(Data=range_2)  # -> Branch0, Branch1
graph_5 = GraphMapper(bang_2.Branch1, x0=0, x1=1, y0=0, y1=1, Ox=0.4780313373, Oy=1, Px=1, Py=0.1196134686, container_name="Parabola")
graph_6 = GraphMapper(
    bang_2.Branch0,
    x0=0,
    x1=1,
    y0=0,
    y1=1,
    container_name="Bezier",
    cpx=[0, 0.5243950486, 0.4586946666, 1],
    cpy=[0, 0, 1, 1])
graph_7 = GraphMapper(bang_2.Branch1, x0=0, x1=1, y0=0, y1=1, Ox=0.4780313373, Oy=1, Px=1, Py=0.1196134686, container_name="Parabola")
graph_8 = GraphMapper(
    bang_2.Branch0,
    x0=0,
    x1=1,
    y0=0,
    y1=1,
    container_name="Bezier",
    cpx=[0, 0.5243950486, 0.4586946666, 1],
    cpy=[0, 0, 1, 1])
genes_4 = GenePool(Decimals=2, Maximum=1, Minimum=0, Value=[0.21, 0.75])
dom_2 = ConstructDomain(DomainStart=Slider(0.1, range=0..0.1), DomainEnd=Slider(0.3, range=0..1))
random_2 = Random(Range=dom_2, Number=Slider(4, range=0..10), Seed=Slider(4, range=0..10))
merge_2 = Merge(Data1=graph_6, Data2=graph_5)
merge_3 = Merge(Data1=graph_8, Data2=graph_7)
bnd = Bounds(Numbers=merge_2)  # -> flatten(Domain)
bnd_2 = Bounds(Numbers=merge_3)
sort_2 = SortList(Keys=merge_2)  # -> Keys, ValuesA
ghpython_script_2 = GhPythonScript(centers=genes_4, extend=random_2)  # -> out, intervals; inputs centers: list, extend: list; same code as ghpython_script
remap_2 = RemapNumbers(Value=merge_3, Source=bnd_2, Target=Domain(0, 1))  # -> Mapped, Clipped
remap_3 = RemapNumbers(Value=sort_2.Keys, Source=bnd, Target=ghpython_script_2.intervals)  # -> Mapped, Clipped
panel_2 = Panel("C:\Users\ahmed\OneDrive - Politecnico di Milano\ETH Zurich\MAS Dfab\P4_Mini Project\3d_printing_teamwork\Design_Substructure\substructure_khara.py")  # disabled
python = GhPythonScript()  # -> out, a
# ---------- python: Python ----------
import Rhino

tolerance = Rhino.RhinoDoc.ActiveDoc.ModelAbsoluteTolerance
print (tolerance)
# ---------- end python ----------

geometry = Geometry(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)  # disabled
geometry_2 = Geometry(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)  # disabled
geometry_3 = Geometry(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)  # disabled
geometry_4 = Geometry(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)  # disabled

number_slider = Slider(17, range=0..1000)  # disabled
number_slider_2 = Slider(2.5, range=0..10)  # disabled
number_slider_3 = Slider(0.2, range=0..1)  # disabled
geometry_5 = Geometry(<brep referenced from the Rhino model>)  # disabled
number_slider_4 = Slider(2, range=0..10)  # disabled
read_file = ReadFile(File=panel_2, PerLineParse=False)  # disabled
srf = Surface(reparameterize(geometry_5))  # disabled
ghpython_script_3 = GhPythonScript(
    time_1=number_slider_4,
    surface=srf,
    u_div=number_slider,
    v_div=number_slider,
    u_lists=remap_3.Mapped,
    target_factors=remap_2.Mapped,
    coherence_rad=number_slider_2,
    coherence_fac=number_slider_3)  # -> out, a; inputs time_1: Int32, surface: Surface, u_div: Int32, v_div: Int32, u_lists: tree, target_factors: tree; disabled
# ---------- ghpython_script_3: Python ----------
import Rhino.Geometry as rg
import ghpythonlib.treehelpers as th


tolerance = 0.001



#this class is focused on the properties and methods of each instance MAS (multi agent system)

class Environment(object):
    
    def __init__(self, u_div, v_div, surface, agents_list = []):
        #self.num_agents = 0    #total number of agents
        self.u_div = u_div
        self.v_div = v_div
        self.surface = surface
        self.agents = []
        if len(agents_list) > 0:
            self.agents = agents_list

    #this function takes the u values and transform them into agents
    def populate_agents(self, u_vals, target_factors):
        # instantiatie all agents
        for u, t_fac in zip(u_vals,target_factors) :
            self.agents.append(Agent(u, 0, 0, t_fac / self.v_div, self.surface)) 

    def update_agents_pos (self, coherence_rad, coherence_fac):
        # generate the new position of each agent by calculating their new direction and velocity
        #for each agent apply all the functions on it given the required factors for each parameter
        #if the agent arrives we pop out this agent from the list and add it to the finished list 
        # add a function that if everything is arrived just stop 
        #list of all effects so as not to change the behaviour of the agents during update
        effects_list = []
        for agent in self.agents:
            effects_vector = rg.Vector2d(0,0)
            coherence_vector = agent.Coherence(coherence_rad, self.agents, self.u_div, self.v_div, coherence_fac)
            effects_vector += coherence_vector
            #sum all of the vectors + the actual du and dv of the agent + unitize --> do nothing but add them to the effects_list
            agent.AddTotalEffect(self.u_div, self.v_div, effects_vector)

        for agent, effect in zip(self.agents, effects_list):
            agent.AgentStep(effect)

    #function that ensures the agent has reached the final destination

class Agent(object):

#the main parameters are poisiton on the surface, velocity in both directions 
    def __init__(self, u, v, du, dv, surface):
        self.u = u
        self.v = v
        self.surface = surface
        pos_3d = self.surface.PointAt(self.u, self.v)
        self.position = rg.Point2d(pos_3d.X, pos_3d.Y) ##for the surface

        self.du = du
        self.dv = dv
        self.pts = []
        self.pts.append(self.surface.PointAt(self.u, self.v))
        self.arrived = False
        

    def Coherence(self, radius, agents, u_div, v_div, coh_fac):
        # agents : list of agents in the environment
        # fx for Coherence
        """ 
        --- within the specified radius we need to iterate over each agent apart from ours and do the following:
        -> calculate the center (u,v) of the surrounding by 2 getting the average over all of the points 
        -> this shall be the point to aim at from the agent position 
        -> unitize the produced vector 
        """
        #coherence_distance = ra
        centerU= 0
        centerV= 0
        num_neighbors = 0
        for agent in agents:
            if not agent == self:
                dist = self.surface.ShortPath(self.position, agent.position, tolerance).GetLength()
                if dist<= radius:
                    num_neighbors +=1
                    centerU += agent.u
                    centerV += agent.v

        #get the average vector
        if  num_neighbors > 0:
            centerU /= num_neighbors
            centerV /= num_neighbors

            #unitize the product vector of the coherence  
            cohesion_unit_vect = rg.Vector2d(centerU-self.u, centerV-self.v)
            cohesion_unit_vect = self.UnitizeEffect(u_div, v_div,cohesion_unit_vect) * coh_fac

            return cohesion_unit_vect

        else:
            return rg.Vector2d(0,0)

    def Alignment(self, radius, agents):
        # fx for Alignment (match velocity)
        """within the specified radius we need to iterate over each agent apart from ours and do the following:
        -> calculate the average velocity [adding all the velocities and dividing the result with the total number of neighbors]
        """
        #radius = 10

        average_du = 0
        average_dv = 0
        num_neighbors = 0

        for neighbor_agent in agents:
            if not neighbor_agent == self:
                dist = self.surface.ShortPath(self.position, neighbor_agent.position, tolerance).GetLength()
                if dist <= radius:
                    num_neighbors +=1
                    average_du += neighbor_agent.du
                    average_dv += neighbor_agent.dv
        
        average_du /= num_neighbors
        average_dv /= num_neighbors

        self.du += (average_du-self.u)*alignment_factor
        self.dv += (average_du-self.v)*alignment_factor


    def Separation (self):
        # fx for Separation
        """within the specified radius we need to iterate over each agent apart from ours and do the following:
        -> define how close two agents can be [min distance before collision]
        -> define a new direction [maybe reversed]
        """
        seperation_distance = 10


        for neighbor_agent in group_of_agents:
            if not neighbor_agent == self:
                dist = GivenSurface.ShortPath(self.position, neighbor_agent.position, tolerance).GetLength()
                if dist<= seperation_distance:
                    self.du *= -1


    # fx for Target reach
    """
    -> adds an upward vector to the velocity based on a certain criteria 
    """

    def withinBounds (self):
        # fx to keep within Bounds
        """
        ->check if (0<=u,v<=1)
        ->if not mirror u (*-1)
        ->
        """
        #to be cheked!!
        if self.u <= 0 or self.u>=1:
            self.du *= -1
        #pending: we need to rethink this point and check again!!!  

        if self.v >=1:
            self.arrived =True




    # pending: fx for limiting speed?

    # helper fxs:7

    # add the effect to the new veloctity vector of the agent that will be added later to its current velocity
    # as an input is the vector of a certain effect, the function does the following
    # --> unitize the vector
    # --> multiply by the effect value 
    # --> add this value to sum of new velocity vector 
    # --> this fx is called in each effect fx 
    def UnitizeEffect(self, u_div, v_div, vector_2b_unitised):           
        vector_2b_unitised.Unitize()
        vector_2b_unitised = rg.Vector2d(vector_2b_unitised.X/u_div, vector_2b_unitised.Y/v_div)
        return vector_2b_unitised

    # adds the new velocty vector to the current velocity vector and unitizes it 
    def AddTotalEffect(self, u_div, v_div, effects_vector):
        effects_vector += rg.Vector2d(self.du, self.dv)
        return self.UnitizeEffect(u_div, v_div, effects_vector)

    # update the agent's params and move it one step forward
    def AgentStep(self, effects_vector):
        self.du = effects_vector.x
        self.dv = effects_vector.y
        self.u += self.du
        self.v += self.dv
        self.pts.append(self.surface.PointAt(self.u, self.v))
       

    #hello Eleniiiii
    #hello Ahmed
######################################################################################################################################
# the execution function:
# given the list of different points to initiate the agents do:
# a for loop iterating over the lists, instantiating each agent in the list then instantaiting an environment given all these agents
# afterwards, for each environment do some action till a certain time t
# afterwards instantiate a bigger environment containing all agents and giving it a certain value for all parameters.

initial_env_list = []
u_lists = th.tree_to_list(u_lists)
target_factors = th.tree_to_list(target_factors)
for u_list, t_factor in zip(u_lists, target_factors):
    #instantiate an instance of the environment:
    new_env = Environment(u_div, v_div, surface)
    new_env.populate_agents(u_list, t_factor)
    initial_env_list.append(new_env)

#depending on the input timestep we update the agents
for t in range(time_1):
    for env in initial_env_list:
        env.update_agents_pos(coherence_rad, coherence_fac)

list_pts = []
for env in initial_env_list:
    list_pts.append([agent.pts for agent in env.agents])
# ---------- end ghpython_script_3 ----------
panel_3 = Panel(remap_3.Mapped)  # disabled
panel_4 = Panel(ghpython_script_3.out)
