# Grasshopper definition 221207_Basic_SubStructure.ghx (Grasshopper 1.0.7)

number_slider = Slider(15, range=0..100)
height = Slider(108, range=0..1000)
number_slider_2 = Slider(15, range=0..100)
layer_thickness = Slider(5, range=0..10)
division = Division(A=height, B=layer_thickness)
division_2 = Division(A=height, B=layer_thickness)
range = Range(Domain=Domain(0, 1), Steps=number_slider)
integer = Integer(division)
integer_2 = Integer(division_2)
range_2 = Range(Domain=Domain(0, 1), Steps=number_slider_2)
subtraction = Subtraction(A=integer, B="1")
subtraction_2 = Subtraction(A=integer_2, B="1")
graph_mapper = GraphMapper(range, x0=0, x1=1, y0=0, y1=1, Ox=0.5206329823, Oy=1, Px=0.9208520055, Py=0.4944922328, container_name="Parabola")
multiplication = Multiplication(B=2)
range_3 = Range(Domain=Domain(0, 1), Steps=subtraction_2)
graph_mapper_2 = GraphMapper(range_2, x0=0, x1=1, y0=0, y1=1, Ox=0.5206329823, Oy=1, Px=0.9208520055, Py=0.4944922328, container_name="Parabola")
range_4 = Range(Domain=Domain(0, 1), Steps=subtraction)
rotation_angle_per_layer = Slider(3, range=0..20)
pole_length = Slider(10, range=0..20)
divide_interval = Slider(7.68, range=0..10)
pole_count = Slider(4, range=0..200)
radius = Slider(45, range=0..500)
pole_width = Slider(9, range=0..20)
curve = Curve([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])
graph_mapper_3 = GraphMapper(reverse(range_3), x0=0, x1=1, y0=0, y1=1, Ox=0.6701620221, Oy=1, Px=0.8727272749, Py=1, container_name="Parabola")
graph_mapper_4 = GraphMapper(
    range_4,
    x0=0,
    x1=1,
    y0=0,
    y1=1,
    amplitude=0.01512652636,
    container_name="Perlin",
    decay=0.09323954582,
    frequency=0.1183966994,
    x_offset=0.514692843,
    y_offset=0.9674534798)
point = Point(Point(0, 0, 0))
curve_2 = Curve([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])
curve_3 = Curve([<curve referenced from the Rhino model> x2])
ghpython_script = GhPythonScript(
    crvs=curve_2,
    facade_height=Slider(48, range=0..100),
    floor_height=Slider(3.2, range=0..100),
    cnt=number_slider,
    extra_height=Slider(10.2, range=0..100),
    graph_h=graph_mapper,
    num_contours=Slider(10, range=0..10),
    num_columns=Slider(36, range=0..100),
    pipe_radius=Slider(1, range=0..10))  # -> out, base_surface, ct, pts, columns, test, breps, circles, print_pts_seg; inputs crvs: list of Curve, cnt: Int32, graph_h: list, num_contours: Int32, num_columns: Int32
# ---------- ghpython_script: Python ----------
import Rhino
import Rhino.Geometry as rg
import ghpythonlib
import math
from copy import deepcopy
import ghpythonlib.treehelpers as th
from itertools import islice

tolerance = Rhino.RhinoDoc.ActiveDoc.ModelAbsoluteTolerance

def div_crv(crv,cnt):
    param= rg.Curve.DivideByCount(crv, cnt, True)
 
    new_pts=[]
    for i, p in enumerate (param):
        new_pt = rg.Curve.PointAt(crv,p)
        new_pts.append(new_pt)
    return new_pts

def graph_crv(crv, cnt, graph_h, extra_height):
    
    param= rg.Curve.DivideByCount(crv, cnt, True)
 
    new_pts=[]
    for i, p in enumerate (param):
        new_pt = rg.Curve.PointAt(crv,p)
        new_pt.Z += graph_h[i]*extra_height
        new_pts.append(new_pt)
        
    new_crv = rg.Curve.CreateInterpolatedCurve(new_pts,3)
    return new_crv

def create_surface (crvs, facade_height, cnt, graph_h,extra_height):
    top = crvs[-1]
    T= rg.Transform.Translation(rg.Vector3d.ZAxis * facade_height)
    top.Transform(T)
    
    crvs[-1] = graph_crv(top, cnt, graph_h, extra_height)
    surface = rg.Brep.CreateFromLoft(crvs, rg.Point3d.Unset, rg.Point3d.Unset, 0, False)[0]
    return surface

def create_contours(crvs,num_contours):
    
    for crv in crvs:
        orientation = crv.ClosedCurveOrientation()
        if (orientation == rg.CurveOrientation.CounterClockwise):
            crv.Reverse()
            
    cont = rg.Curve.CreateTweenCurvesWithMatching(crvs[0], crvs[-1], num_contours-3, tolerance)
    
    contours = [c for c in cont]
    contours.insert(0, crvs[0])
    contours.append(crvs[-1])
    
    #c= rg.Curve.CreateTweenCurvesWithMatching(contours[0], contours[1], 1, tolerance)[0]
    #contours.insert(1, c)
    
    c2= rg.Curve.CreateTweenCurvesWithMatching(contours[-2], contours[-1], 1, tolerance)[0]
    contours.insert(-1, c2)
    
    return contours


base_surface= create_surface (crvs, facade_height, cnt, graph_h, extra_height)
contours= create_contours(crvs,num_contours)
ct=create_contours(crvs,num_contours)
pts=[]

for c in contours:
    temp =div_crv(c,num_columns)
    pts.append(temp)

columns=[]
circles=[]
for j, pt in islice(enumerate(pts[0]),0,None, 2):
    if j<num_columns:
        column_pts=[]
        circ =[]
        column_pts.append(pt)
        circ.append(rg.Circle(pt, pipe_radius).ToNurbsCurve())
        for k in range (1, num_contours):
            if k%2==1 or k==num_contours-2:
                column_pts.append(pts[k][j+1])
                circ.append(rg.Circle(pts[k][j+1], pipe_radius).ToNurbsCurve())
            else:
                column_pts.append(pts[k][j])
                circ.append(rg.Circle(pts[k][j], pipe_radius).ToNurbsCurve())
                
        column = rg.Curve.CreateInterpolatedCurve(column_pts,3,rg.CurveKnotStyle(3))
        c= rg.Brep.CreateFromLoft(circ, rg.Point3d.Unset, rg.Point3d.Unset, 0, False)
        circles.append(c)
        columns.append(column)
    if j> 0:
        column_pts=[]
        column_pts.append(pt)
        for k in range (1, num_contours): 
            if k%2==1 or k==num_contours-2: 
                column_pts.append(pts[k][j-1])
            else:
                column_pts.append(pts[k][j])
        column = rg.Curve.CreateInterpolatedCurve(column_pts,3, rg.CurveKnotStyle(3))
        columns.append(column)


breps=[]

for c in columns:
    brep = rg.Brep.CreatePipe(c, pipe_radius, True, rg.PipeCapMode(1), True, tolerance,tolerance)
    breps.append(brep)

circles = th.list_to_tree(circles)
breps =th.list_to_tree(breps)
pts= th.list_to_tree(pts)


def slice_pts(crvs, count):
    """
    this function will divide the sliced curves into points and return them
    
    crvs:   list of sliced curves
    count:  divide the curves by count
    """
    
    pts =  []

    for crv in crvs:
    # iterate through the curves, and check the orientation, if any is counterclockwise - then reverse it
        orientation = crv.ClosedCurveOrientation()
        if (orientation == rg.CurveOrientation.CounterClockwise):
            crv.Reverse()
    
    # divide the curve by count
        params = crv.DivideByCount(count, True)
        layer_pts = []
    
        for p in params:
            pt = crv.PointAt(p)
            layer_pts.append(pt)
        
        #append again the starting point
        layer_pts.append(crv.PointAt(0))
        
        pts.append(layer_pts)
    return pts
# ---------- end ghpython_script ----------
panel = Panel(graph_mapper_4)
ghpython_script_2 = GhPythonScript(
    crvs=curve_3,
    facade_height=Slider(150, range=0..250),
    floor_height=Slider(3.2, range=0..100),
    cnt=number_slider_2,
    extra_height=Slider(10.2, range=0..100),
    graph_h=graph_mapper_2,
    num_contours=Slider(9, range=0..40),
    num_columns=Slider(9, range=0..100),
    pipe_radius=Slider(5, range=0..10))  # -> out, base_surface, ct, pts, columns, test, breps, circles, print_pts_seg; inputs crvs: list of Curve, cnt: Int32, graph_h: list, num_contours: Int32, num_columns: Int32
# ---------- ghpython_script_2: Python ----------
import Rhino
import Rhino.Geometry as rg
import ghpythonlib
import math
from copy import deepcopy
import ghpythonlib.treehelpers as th
from itertools import islice

tolerance = Rhino.RhinoDoc.ActiveDoc.ModelAbsoluteTolerance

def div_crv(crv,cnt):
    param= rg.Curve.DivideByCount(crv, cnt, True)
 
    new_pts=[]
    for i, p in enumerate (param):
        new_pt = rg.Curve.PointAt(crv,p)
        new_pts.append(new_pt)
    return new_pts

def graph_crv(crv, cnt, graph_h, extra_height):
    
    param= rg.Curve.DivideByCount(crv, cnt, True)
 
    new_pts=[]
    for i, p in enumerate (param):
        new_pt = rg.Curve.PointAt(crv,p)
        new_pt.Z += graph_h[i]*extra_height
        new_pts.append(new_pt)
        
    new_crv = rg.Curve.CreateInterpolatedCurve(new_pts,3)
    return new_crv

def create_surface (crvs, facade_height, cnt, graph_h,extra_height):
    top = crvs[-1]
    T= rg.Transform.Translation(rg.Vector3d.ZAxis * facade_height)
    top.Transform(T)
    
    crvs[-1] = graph_crv(top, cnt, graph_h, extra_height)
    surface = rg.Brep.CreateFromLoft(crvs, rg.Point3d.Unset, rg.Point3d.Unset, 0, False)[0]
    return surface

def create_contours(crvs,num_contours):
    
    for crv in crvs:
        orientation = crv.ClosedCurveOrientation()
        if (orientation == rg.CurveOrientation.CounterClockwise):
            crv.Reverse()
            
    cont = rg.Curve.CreateTweenCurvesWithMatching(crvs[0], crvs[-1], num_contours-2, tolerance)
    
    contours = [c for c in cont]
    contours.insert(0, crvs[0])
    contours.append(crvs[-1])
    
    #c= rg.Curve.CreateTweenCurvesWithMatching(contours[0], contours[1], 1, tolerance)[0]
    #contours.insert(1, c)
    
    #c2= rg.Curve.CreateTweenCurvesWithMatching(contours[-2], contours[-1], 1, tolerance)[0]
    #contours.insert(-1, c2)
    
    return contours


base_surface= create_surface (crvs, facade_height, cnt, graph_h, extra_height)
contours= create_contours(crvs,num_contours)
ct=create_contours(crvs,num_contours)
pts=[]

for c in contours:
    temp =div_crv(c,num_columns)
    pts.append(temp)

columns=[]
circles=[]
for j, pt in islice(enumerate(pts[0]),0,None, 2):
    if j<num_columns:
        column_pts=[]
        circ =[]
        column_pts.append(pt)
        circ.append(rg.Circle(pt, pipe_radius).ToNurbsCurve())
        for k in range (1, num_contours):
            if k%2==1: #or k==num_contours-2:
                column_pts.append(pts[k][j+1])
                circ.append(rg.Circle(pts[k][j+1], pipe_radius).ToNurbsCurve())
            else:
                column_pts.append(pts[k][j])
                circ.append(rg.Circle(pts[k][j], pipe_radius).ToNurbsCurve())
                
        column = rg.Curve.CreateInterpolatedCurve(column_pts,3,rg.CurveKnotStyle(3))
        c= rg.Brep.CreateFromLoft(circ, rg.Point3d.Unset, rg.Point3d.Unset, 0, False)
        circles.append(c)
        columns.append(column)
    if j> 0:
        column_pts=[]
        circ =[]
        column_pts.append(pt)
        circ.append(rg.Circle(pt, pipe_radius).ToNurbsCurve())
        for k in range (1, num_contours): 
            if k%2==1: #or k==num_contours-2: 
                column_pts.append(pts[k][j-1])
                circ.append(rg.Circle(pts[k][j-1], pipe_radius).ToNurbsCurve())
            else:
                column_pts.append(pts[k][j])
                circ.append(rg.Circle(pts[k][j], pipe_radius).ToNurbsCurve())
        column = rg.Curve.CreateInterpolatedCurve(column_pts,3, rg.CurveKnotStyle(3))
        c= rg.Brep.CreateFromLoft(circ, rg.Point3d.Unset, rg.Point3d.Unset, 0, False)
        circles.append(c)
        columns.append(column)


breps=[]

for c in columns:
    brep = rg.Brep.CreatePipe(c, pipe_radius, True, rg.PipeCapMode(1), True, tolerance,tolerance)
    breps.append(brep)


circles = th.list_to_tree(circles)
breps =th.list_to_tree(breps)
pts= th.list_to_tree(pts)


def slice_pts(crvs, count):
    """
    this function will divide the sliced curves into points and return them
    
    crvs:   list of sliced curves
    count:  divide the curves by count
    """
    
    pts =  []

    for crv in crvs:
    # iterate through the curves, and check the orientation, if any is counterclockwise - then reverse it
        orientation = crv.ClosedCurveOrientation()
        if (orientation == rg.CurveOrientation.CounterClockwise):
            crv.Reverse()
    
    # divide the curve by count
        params = crv.DivideByCount(count, True)
        layer_pts = []
    
        for p in params:
            pt = crv.PointAt(p)
            layer_pts.append(pt)
        
        #append again the starting point
        layer_pts.append(crv.PointAt(0))
        
        pts.append(layer_pts)
    return pts
# ---------- end ghpython_script_2 ----------
ghpython_script_3 = GhPythonScript(
    origin_pt=point,
    div_count=Slider(10, range=0..10),
    jump=Slider(7, range=0..10),
    radius=radius,
    brep_height=height,
    layer_thickness=layer_thickness,
    pole_count=pole_count,
    pole_width=pole_length,
    pole_length=pole_width,
    divide_interval=divide_interval,
    rot_angle=rotation_angle_per_layer,
    pole_graph=graph_mapper_4,
    graph_val=graph_mapper_3)  # -> out, test_pts, print_pts, print_pts_seg; inputs origin_pt: Point3d, div_count: Int32, jump: Int32, radius: Int32, pole_count: Int32, rot_angle: Int32, pole_graph: list, graph_val: list
# ---------- ghpython_script_3: Python ----------
import Rhino.Geometry as rg
import ghpythonlib
import math
from copy import deepcopy
import ghpythonlib.treehelpers as th


layer_cnt = int(brep_height/layer_thickness)


def slice_pts(crvs, count):
    """
    this function will divide the sliced curves into points and return them
    
    crvs:   list of sliced curves
    count:  divide the curves by count
    """
    
    pts =  []

    for crv in crvs:
    # iterate through the curves, and check the orientation, if any is counterclockwise - then reverse it
        orientation = crv.ClosedCurveOrientation()
        if (orientation == rg.CurveOrientation.CounterClockwise):
            crv.Reverse()
    
    # divide the curve by count
        params = crv.DivideByCount(count, True)
        layer_pts = []
    
        for p in params:
            pt = crv.PointAt(p)
            layer_pts.append(pt)
        
        #append again the starting point
        layer_pts.append(crv.PointAt(0))
        
        pts.append(layer_pts)
    return pts

contours = []
contour_srf = []
contour_arc = []

for i, value in enumerate(graph_val):
    center_pt = origin_pt + rg.Vector3d(0,0,i*layer_thickness)
    #use the rg.vector to create the world xy origin, but not have it exist relation to the origin
    center_plane = rg.Plane(center_pt, rg.Vector3d.XAxis, rg.Vector3d.YAxis)
    contour = rg.Circle(center_plane, radius*graph_val[i])
    contour.Rotate(math.radians(i*rot_angle),rg.Vector3d.ZAxis)
    cont_arc = rg.ArcCurve(contour)
    contour_arc.append(cont_arc)
    contours.append(contour)





pts= []
x_axis = []
y_axis = []

for c in contours:
    cont_pts = []
    temp = []
    crv = c.ToNurbsCurve(2,5)
    params = crv.DivideByCount(pole_count, True)
    for i in params:
        pt = crv.PointAt(i)
        vec = rg.Vector3d(c.Center - pt)
        temp.append(vec)
        cont_pts.append(pt)
    y_axis.append(temp)
    pts.append(cont_pts)


pole_crvs = []
print_pts=[]

#printing them layer by layer
for j, value in enumerate(pole_graph):
    temp = []
    pole_circ = []
    for i in range(pole_count):
        pole_center_plane = rg.Plane(pts[j][i], rg.Vector3d.CrossProduct(rg.Vector3d.ZAxis,y_axis[j][i]), y_axis[j][i])
        pole_rect= rg.Circle(pole_center_plane, pole_length*(pole_graph[j]))
        pole_rect.Rotate(math.radians(90), pole_rect.Normal)
        p_r= pole_rect.ToNurbsCurve()
        temp.append(p_r)
    print_pts.append(slice_pts(temp,div_count))


print (layer_cnt)

#len(print_pts[layer_cnt-1][pole_count-1])=div_count+1
print_pts_seg=[]


##printing by segments
for k in range (0,layer_cnt, jump):
    print k
    for i in range (pole_count):
        for j in range (jump):
            if (j+k)>=layer_cnt:break  
            if j<( jump-1):
                seg= print_pts[j+k][i][:-1]
            else:
                seg= print_pts[j+k][i]

            print_pts_seg.append(seg)

print_pts = th.list_to_tree(print_pts)

#temp_p=[]
#for pole in poles:
#    print type(pole)
#    foo= deepcopy(pole)
#    T= rg.Transform.Mirror(rg.Plane.WorldYZ)
#    foo[0].Transform(T)
#    temp_p.append(foo[0])
#
#poles.extend(temp_p)
# ---------- end ghpython_script_3 ----------
number_slider_3 = Slider(10, range=0..100)
geometry = Geometry(ghpython_script.pts)
geometry_2 = Geometry(ghpython_script.base_surface)
geometry_3 = Geometry(ghpython_script.columns)
ghpython_script_4 = GhPythonScript(x=ghpython_script_3.print_pts_seg)  # -> out, a
# ---------- ghpython_script_4: Python ----------
a=x
# ---------- end ghpython_script_4 ----------
geometry_4 = Geometry(ghpython_script.test)
geometry_5 = Geometry(ghpython_script.breps)
geometry_6 = Geometry(ghpython_script.circles)
geometry_7 = Geometry(ghpython_script_2.pts)
geometry_8 = Geometry(ghpython_script_2.base_surface)
geometry_9 = Geometry(ghpython_script_2.test)
geometry_10 = Geometry(ghpython_script_2.breps)
geometry_11 = Geometry(ghpython_script_2.circles)
geometry_12 = Geometry(ghpython_script_4.a)
geometry_13 = Geometry(ghpython_script.ct)
geometry_14 = Geometry(ghpython_script_2.ct)
geometry_15 = Geometry(ghpython_script_3.print_pts)
list_item = ListItem(List=geometry_3, Index=Slider(0, range=0..100), Wrap=True)
list_item_2 = ListItem(List=flatten(geometry_12), Index=Slider(36, range=0..1000), Wrap=True)
geometry_16 = Geometry(ghpython_script_2.columns)
ghpython_script_5 = GhPythonScript(layer_thickness=Slider(1, range=0..1), crvs=geometry_16)  # -> out, points; inputs crvs: list of Curve
# ---------- ghpython_script_5: Python ----------
import Rhino
import Rhino.Geometry as rg
import ghpythonlib.treehelpers as th


# get rhino's zero zolerance constant, which is 2^-32.
zero = Rhino.RhinoMath.ZeroTolerance

def slice_crv(crv, layer_thickness):

    # get the min_z, max_z and height
    crv_bounding_box = crv.GetBoundingBox(rg.Plane.WorldXY)

    max_x, max_y, max_z = crv_bounding_box.Max
    min_x, min_y, min_z = crv_bounding_box.Min
    
    # intersect brep with a series of planes 
    slice_pts = []
    
    height = min_z
    
    for i in range (1000):
        height += layer_thickness
        if height < max_z:
            intersection_plane = rg.Plane(rg.Point3d(0,0, height), rg.Vector3d.XAxis, rg.Vector3d.YAxis)
            intersection_events = rg.Intersect.Intersection.CurvePlane(crv, intersection_plane, zero)
            
            # if intersection is True
            if intersection_events[0]:
                # append the intersection point into the list
                
                for coordinate in intersection_events[0].PointB:
                    #pt= rg.Point3d(coordinate[0], coordinate[1],coordinate[2])
                    slice_pts.append(coordinate)
            # if intersection is false, then print this message
            else:
                print "sorry, intersection went wrong"
                
        # if the height has reached the max_z of value of the brep, then break 
        else:
            break
        
    return slice_pts

coordinates=[]
#for c in crvs:
#    p= slice_crv(c, layer_thickness)
#    points.append(p)

p= slice_crv(crvs[0], layer_thickness)
coordinates.append(p)
print len(coordinates[0])

points=[]
for list in coordinates:
    pts=[]
    for i in range(0,len(list),3):
        print i
        pt= rg.Point3d(coordinates[i], coordinates[i+1], coordinates[i+2])
        pts.append(pt)
    points.append(pts)



print points[0]

points= th.list_to_tree(points)
# ---------- end ghpython_script_5 ----------
panel_2 = Panel(geometry_15)
point_2 = Point(ghpython_script_5.points)
list_item_3 = ListItem(List=geometry_16, Index=Slider(0, range=0..100), Wrap=True)
