# Grasshopper definition 221209_Surface.gh (Grasshopper 1.0.7)
# plug-ins: Pufferfish

number_slider = Slider(15, range=0..100)
range = Range(Domain=Domain(0, 1), Steps=number_slider)
graph_mapper = GraphMapper(range, x0=0, x1=1, y0=0, y1=1, Ox=0.5206329823, Oy=1, Px=0.9208520055, Py=0.4944922328, container_name="Parabola")
height = Slider(75, range=0..1000)
layer_thickness = Slider(1, range=0..10)
curve = Curve([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])
division = Division(A=height, B=layer_thickness)
division_2 = Division(A=height, B=layer_thickness)
curve_2 = Curve([<curve referenced from the Rhino model> x2])
integer = Integer(division)
integer_2 = Integer(division_2)
ghpython_script = GhPythonScript(
    crvs=curve_2,
    facade_height=Slider(154.8, range=0..250),
    floor_height=Slider(3.2, range=0..100),
    cnt=number_slider,
    extra_height=Slider(54.6, range=0..100),
    graph_h=graph_mapper,
    num_contours=Slider(9, range=0..40),
    num_columns=Slider(9, range=0..100),
    pipe_radius=Slider(5, range=0..10))  # -> out, base_surface, ct, pts, columns, test, breps, circles, print_pts_seg; inputs crvs: list of Curve, cnt: Int32, graph_h: list, num_contours: Int32, num_columns: Int32
# ---------- ghpython_script: Python ----------
import Rhino
import Rhino.Geometry as rg
import ghpythonlib
import math
from copy import deepcopy
import ghpythonlib.treehelpers as th
from itertools import islice

tolerance = Rhino.RhinoDoc.ActiveDoc.ModelAbsoluteTolerance

def div_crv(crv,cnt):
    param= rg.Curve.DivideByCount(crv, cnt, True)
 
    new_pts=[]
    for i, p in enumerate (param):
        new_pt = rg.Curve.PointAt(crv,p)
        new_pts.append(new_pt)
    return new_pts

def graph_crv(crv, cnt, graph_h, extra_height):
    
    param= rg.Curve.DivideByCount(crv, cnt, True)
 
    new_pts=[]
    for i, p in enumerate (param):
        new_pt = rg.Curve.PointAt(crv,p)
        new_pt.Z += graph_h[i]*extra_height
        new_pts.append(new_pt)
        
    new_crv = rg.Curve.CreateInterpolatedCurve(new_pts,3)
    return new_crv

def create_surface (crvs, facade_height, cnt, graph_h,extra_height):
    top = crvs[-1]
    T= rg.Transform.Translation(rg.Vector3d.ZAxis * facade_height)
    top.Transform(T)
    
    crvs[-1] = graph_crv(top, cnt, graph_h, extra_height)
    surface = rg.Brep.CreateFromLoft(crvs, rg.Point3d.Unset, rg.Point3d.Unset, 0, False)[0]
    return surface

def create_contours(crvs,num_contours):
    
    for crv in crvs:
        orientation = crv.ClosedCurveOrientation()
        if (orientation == rg.CurveOrientation.CounterClockwise):
            crv.Reverse()
            
    cont = rg.Curve.CreateTweenCurvesWithMatching(crvs[0], crvs[-1], num_contours-2, tolerance)
    
    contours = [c for c in cont]
    contours.insert(0, crvs[0])
    contours.append(crvs[-1])
    
    #c= rg.Curve.CreateTweenCurvesWithMatching(contours[0], contours[1], 1, tolerance)[0]
    #contours.insert(1, c)
    
    #c2= rg.Curve.CreateTweenCurvesWithMatching(contours[-2], contours[-1], 1, tolerance)[0]
    #contours.insert(-1, c2)
    
    return contours


base_surface= create_surface (crvs, facade_height, cnt, graph_h, extra_height)
contours= create_contours(crvs,num_contours)
ct=create_contours(crvs,num_contours)
pts=[]

for c in contours:
    temp =div_crv(c,num_columns)
    pts.append(temp)

columns=[]
circles=[]
for j, pt in islice(enumerate(pts[0]),0,None, 2):
    if j<num_columns:
        column_pts=[]
        circ =[]
        column_pts.append(pt)
        circ.append(rg.Circle(pt, pipe_radius).ToNurbsCurve())
        for k in range (1, num_contours):
            if k%2==1: #or k==num_contours-2:
                column_pts.append(pts[k][j+1])
                circ.append(rg.Circle(pts[k][j+1], pipe_radius).ToNurbsCurve())
            else:
                column_pts.append(pts[k][j])
                circ.append(rg.Circle(pts[k][j], pipe_radius).ToNurbsCurve())
                
        column = rg.Curve.CreateInterpolatedCurve(column_pts,3,rg.CurveKnotStyle(3))
        c= rg.Brep.CreateFromLoft(circ, rg.Point3d.Unset, rg.Point3d.Unset, 0, False)
        circles.append(c)
        columns.append(column)
    if j> 0:
        column_pts=[]
        circ =[]
        column_pts.append(pt)
        circ.append(rg.Circle(pt, pipe_radius).ToNurbsCurve())
        for k in range (1, num_contours): 
            if k%2==1: #or k==num_contours-2: 
                column_pts.append(pts[k][j-1])
                circ.append(rg.Circle(pts[k][j-1], pipe_radius).ToNurbsCurve())
            else:
                column_pts.append(pts[k][j])
                circ.append(rg.Circle(pts[k][j], pipe_radius).ToNurbsCurve())
        column = rg.Curve.CreateInterpolatedCurve(column_pts,3, rg.CurveKnotStyle(3))
        c= rg.Brep.CreateFromLoft(circ, rg.Point3d.Unset, rg.Point3d.Unset, 0, False)
        circles.append(c)
        columns.append(column)


breps=[]

for c in columns:
    brep = rg.Brep.CreatePipe(c, pipe_radius, True, rg.PipeCapMode(1), True, tolerance,tolerance)
    breps.append(brep)


circles = th.list_to_tree(circles)
breps =th.list_to_tree(breps)
pts= th.list_to_tree(pts)


def slice_pts(crvs, count):
    """
    this function will divide the sliced curves into points and return them
    
    crvs:   list of sliced curves
    count:  divide the curves by count
    """
    
    pts =  []

    for crv in crvs:
    # iterate through the curves, and check the orientation, if any is counterclockwise - then reverse it
        orientation = crv.ClosedCurveOrientation()
        if (orientation == rg.CurveOrientation.CounterClockwise):
            crv.Reverse()
    
    # divide the curve by count
        params = crv.DivideByCount(count, True)
        layer_pts = []
    
        for p in params:
            pt = crv.PointAt(p)
            layer_pts.append(pt)
        
        #append again the starting point
        layer_pts.append(crv.PointAt(0))
        
        pts.append(layer_pts)
    return pts
# ---------- end ghpython_script ----------
subtraction = Subtraction(A=integer, B="1")
subtraction_2 = Subtraction(A=integer_2, B="1")
multiplication = Multiplication(B=2)
range_2 = Range(Domain=Domain(0, 1), Steps=subtraction_2)
range_3 = Range(Domain=Domain(0, 1), Steps=subtraction)
rotation_angle_per_layer = Slider(0, range=0..20)
divide_interval = Slider(7.68, range=0..10)
pole_length = Slider(10, range=0..20)
pole_count = Slider(4, range=0..200)
radius = Slider(190, range=0..500)
pole_width = Slider(10, range=0..20)
graph_mapper_2 = GraphMapper(
    reverse(range_2),
    x0=0,
    x1=1,
    y0=0,
    y1=1,
    Ox=0.6592248082,
    Oy=0.1425827742,
    Px=0.8530326486,
    Py=0.1419959664,
    container_name="Parabola")
graph_mapper_3 = GraphMapper(
    range_3,
    x0=0,
    x1=1,
    y0=0,
    y1=1,
    amplitude=0.49954319,
    container_name="Perlin",
    decay=0.09323954582,
    frequency=0.1183966994,
    x_offset=0.5,
    y_offset=0.5)
geometry = Geometry(ghpython_script.pts)
geometry_2 = Geometry(ghpython_script.test)
geometry_3 = Geometry(ghpython_script.breps)
geometry_4 = Geometry(ghpython_script.circles)
point = Point(Point(0, 0, 0))
geometry_5 = Geometry(ghpython_script.ct)
panel = Panel(graph_mapper_3)

# ----
# HERE
geometry_6 = Geometry(ghpython_script.base_surface)

ghpython_script_2 = GhPythonScript(
    origin_pt=point,
    count=Slider(10, range=0..10),
    jump=Slider(5, range=0..10),
    radius=radius,
    brep_height=height,
    layer_thickness=layer_thickness,
    pole_count=pole_count,
    pole_width=pole_length,
    pole_length=pole_width,
    divide_interval=divide_interval,
    rot_angle=rotation_angle_per_layer,
    pole_graph=graph_mapper_3,
    graph_val=graph_mapper_2)  # -> out, print_pts; inputs origin_pt: Point3d, count: Int32, jump: Int32, radius: Int32, pole_count: Int32, rot_angle: Int32, pole_graph: list, graph_val: list
# ---------- ghpython_script_2: Python ----------
import Rhino.Geometry as rg
import ghpythonlib
import math
from copy import deepcopy
import ghpythonlib.treehelpers as th


layer_cnt = int(brep_height/layer_thickness)
contours = []
contour_srf = []
contour_arc = []

def slice_pts(crvs, count):
    """
    this function will divide the sliced curves into points and return them
    
    crvs:   list of sliced curves
    count:  divide the curves by count
    """
    
    pts =  []

    for crv in crvs:
    # iterate through the curves, and check the orientation, if any is counterclockwise - then reverse it
        orientation = crv.ClosedCurveOrientation()
        if (orientation == rg.CurveOrientation.CounterClockwise):
            crv.Reverse()
    
    # divide the curve by count
        params = crv.DivideByCount(count, True)
        layer_pts = []
    
        for p in params:
            pt = crv.PointAt(p)
            layer_pts.append(pt)
        
        #append again the starting point
        layer_pts.append(crv.PointAt(0))
        
        pts.append(layer_pts)
    return pts



for i, value in enumerate(graph_val):
    center_pt = origin_pt + rg.Vector3d(0,0,i*layer_thickness)
    #use the rg.vector to create the world xy origin, but not have it exist relation to the origin
    center_plane = rg.Plane(center_pt, rg.Vector3d.XAxis, rg.Vector3d.YAxis)
    contour = rg.Circle(center_plane, radius*graph_val[i])
    contour.Rotate(math.radians(i*rot_angle),rg.Vector3d.ZAxis)
    cont_arc = rg.ArcCurve(contour)
    contour_arc.append(cont_arc)
    contours.append(contour)
contour_srf = rg.Brep.CreateFromLoft(contour_arc, rg.Point3d.Unset,rg.Point3d.Unset,rg.LoftType(1),False)





pts= []
x_axis = []
y_axis = []

for c in contours:
    cont_pts = []
    temp = []
    crv = c.ToNurbsCurve(2,5)
    params = crv.DivideByCount(pole_count, True)
    for i in params:
        pt = crv.PointAt(i)
        vec = rg.Vector3d(c.Center - pt)
        temp.append(vec)
        cont_pts.append(pt)
    y_axis.append(temp)
    pts.append(cont_pts)


pole_crvs = []
print_pts=[]

for j, value in enumerate(pole_graph):
    temp = []
    pole_circ = []
    for i in range(pole_count):
        pole_center_plane = rg.Plane(pts[j][i], rg.Vector3d.CrossProduct(rg.Vector3d.ZAxis,y_axis[j][i]), y_axis[j][i])
        pole_rect= rg.Circle(pole_center_plane, pole_length*(pole_graph[j]))
        pole_rect.Rotate(math.radians(90), pole_rect.Normal)
        p_r= pole_rect.ToNurbsCurve()
        temp.append(p_r)
    print_pts.append(slice_pts(temp,count))

print_pts = th.list_to_tree(print_pts)

#temp_p=[]
#for pole in poles:
#    print type(pole)
#    foo= deepcopy(pole)
#    T= rg.Transform.Mirror(rg.Plane.WorldYZ)
#    foo[0].Transform(T)
#    temp_p.append(foo[0])
#
#poles.extend(temp_p)
# ---------- end ghpython_script_2 ----------
geometry_7 = Geometry(ghpython_script.columns)
ghpython_script_3 = GhPythonScript(layer_thickness=Slider(1, range=0..1), crvs=geometry_7)  # -> out, points; inputs crvs: list of Curve
# ---------- ghpython_script_3: Python ----------
import Rhino
import Rhino.Geometry as rg
import ghpythonlib.treehelpers as th


# get rhino's zero zolerance constant, which is 2^-32.
zero = Rhino.RhinoMath.ZeroTolerance

def slice_crv(crv, layer_thickness):

    # get the min_z, max_z and height
    crv_bounding_box = crv.GetBoundingBox(rg.Plane.WorldXY)

    max_x, max_y, max_z = crv_bounding_box.Max
    min_x, min_y, min_z = crv_bounding_box.Min
    
    # intersect brep with a series of planes 
    slice_pts = []
    
    height = min_z
    
    for i in range (1000):
        height += layer_thickness
        if height < max_z:
            intersection_plane = rg.Plane(rg.Point3d(0,0, height), rg.Vector3d.XAxis, rg.Vector3d.YAxis)
            intersection_events = rg.Intersect.Intersection.CurvePlane(crv, intersection_plane, zero)
            
            # if intersection is True
            if intersection_events[0]:
                # append the intersection point into the list
                
                for coordinate in intersection_events[0].PointB:
                    #pt= rg.Point3d(coordinate[0], coordinate[1],coordinate[2])
                    slice_pts.append(coordinate)
            # if intersection is false, then print this message
            else:
                print "sorry, intersection went wrong"
                
        # if the height has reached the max_z of value of the brep, then break 
        else:
            break
        
    return slice_pts

coordinates=[]
#for c in crvs:
#    p= slice_crv(c, layer_thickness)
#    points.append(p)

p= slice_crv(crvs[0], layer_thickness)
coordinates.append(p)
print len(coordinates[0])

points=[]
for list in coordinates:
    pts=[]
    for i in range(0,len(list),3):
        print i
        pt= rg.Point3d(coordinates[i], coordinates[i+1], coordinates[i+2])
        pts.append(pt)
    points.append(pts)



print points[0]

points= th.list_to_tree(points)
# ---------- end ghpython_script_3 ----------
geometry_8 = Geometry(flatten(ghpython_script_2.print_pts))
point_2 = Point(ghpython_script_3.points)
list_item = ListItem(List=geometry_7, Index=Slider(0, range=0..100), Wrap=True)
number_slider_2 = Slider(11, range=0..100)
plane = Plane(geometry_8)
curve_3 = Curve(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)
geometry_9 = Geometry(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)
data_folder_name = Panel("data")
control_points = ControlPoints(Curve=curve_3)  # -> Points, Weights, Knots
ghpython_script_4 = GhPythonScript(file_name="\PlaneFabrication\data\master_navigation_data.json")  # -> path
# ---------- ghpython_script_4: Python ----------
a = ghdoc.Path

path = a.split('3d_printing_teamwork')[0]+r'3d_printing_teamwork\\'+file_name
# ---------- end ghpython_script_4 ----------

# ----
# Output
# Input
py = PythonScript()  # -> path
# ---------- py: Python ----------
import sys
import os

ghComp = ghenv.Component
ghDoc = ghComp.OnPingDocument()

# the full path of the gh file
path = ghDoc.FilePath
# the current directory 
path = os.path.abspath(os.path.join(path, ".."))

print path
# ---------- end py ----------

# ---- group: Folder name
data = Data(data_folder_name)

# ----
surface_closest_point = SurfaceClosestPoint(Point=control_points.Points, Surface=geometry_9)  # -> Point, UVPoint, Distance
evaluate_surface = EvaluateSurface(Surface=geometry_9, Point=surface_closest_point.UVPoint)  # -> Point, Normal, UDirection, VDirection, Frame
construct_plane = ConstructPlane(Origin=evaluate_surface.Point, XAxis=evaluate_surface.UDirection, YAxis=evaluate_surface.VDirection)

X = Slider(7, range=-500..500)
Y = Slider(-106, range=-500..500)
Z = Slider(132, range=0..1000)

flip_plane = FlipPlane(Plane=construct_plane, FlipX=False, FlipY=False, FlipZ=True)  # -> Flipped, ResultBoolean

# ----
# FreeDrive
free_drive = BooleanToggle(True)
toggle_freedrive = GhPythonScript(free_drive=free_drive, NAVIGATION_JSON=ghpython_script_4)  # -> out
# ---------- toggle_freedrive: Python ----------
import os
from compas.rpc import Proxy

import json
with open(NAVIGATION_JSON, "r") as f:
    data = json.load(f)
ip = data["ip"]

if free_drive:   
    canvas = ghenv.Component.OnPingDocument()
    path = os.path.abspath(os.path.dirname(canvas.FilePath))
    rtde = Proxy('data.rtde_wrapper', path=path)                         # stay in teach moded(freedrive) as long as this is True
    a = rtde.start_teach_mode(ip=ip)            # send message to robot
    ghenv.Component.Message = "Freedrive on"    # display message on GH component
else:   
    canvas = ghenv.Component.OnPingDocument()
    path = os.path.abspath(os.path.dirname(canvas.FilePath))
    rtde = Proxy('data.rtde_wrapper', path=path)                          # stop teach mode if stop button pressed
    a = rtde.stop_teach_mode(ip=ip)             # send message to robot   
    ghenv.Component.Message = "Freedrive off"   # display message on GH component
# ---------- end toggle_freedrive ----------

trigger = Trigger(Interval=50, TimerInterval=50, Target=get_config)  # disabled
flippln = FlipPlane(FlipX=False, FlipY=False, FlipZ=True)  # -> Flipped, R
construct_point = ConstructPoint(XCoordinate=X, YCoordinate=Y, ZCoordinate=Z)
deconstruct_plane = DeconstructPlane(Plane=flip_plane.Flipped)  # -> Origin, XAxis, YAxis, ZAxis

# ----
# Ligthweight Path Visualization
number_slider_3 = Slider(2, range=0..10)
all_points = Point(plane)
# Visualization
list_length = ListLength(List=all_points)
repeat_data = RepeatData(Data=True, Length=list_length)
extruder_toggles = Number(repeat_data)
cslightpathviz = CsLightPathViz(points=all_points, extruder_toggles=extruder_toggles, pipe_diameter=number_slider_3)  # -> out, print_path_pipes, travel_path_lines; inputs points: list of Point3d, extruder_toggles: list of Boolean
# ---------- cslightpathviz: Python ----------
"""
Creates a lightweight visualization of the print paths. Segments with extruder_toggle=True are visualized as pipes, 
segments with extruder_toggle=False are visualized as lines.
Loads files from the 'output' folder.

"""

import compas_slicer_ghpython.visualization as gh_compas_slicer
gh_compas_slicer = reload(gh_compas_slicer)

pipe_resolution = 14

if points:
    
    # assign default values to parameters where possible. 
    if not extruder_toggles:
        extruder_toggles = [False for i in range(len(points))]
    if not pipe_diameter:
        pipe_diameter = 2.0
        
    print_path_pipes, travel_path_lines = \
        gh_compas_slicer.lightweight_path_visualization(points, extruder_toggles, pipe_diameter, pipe_resolution)
    
else:
    gh_compas_slicer.missing_input()
# ---------- end cslightpathviz ----------

plane_2 = Plane(construct_point)

print_planes = Plane([flippln.Flipped, plane])
tool_mesh = Mesh(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)

# ----
# Tool Visualization
number_slider_4 = Slider(282, range=-1..2000)
tool_origin = Panel("""0
0
99.507""")
cstoolviz = CsToolViz(origin_coords=tool_origin, mesh=tool_mesh, planes=print_planes, index=number_slider_4)  # -> out, mesh, passed_path; inputs origin_coords: list, mesh: Mesh, planes: list, index: Int32
# ---------- cstoolviz: Python ----------
"""
Example visualization of tool motion during the print.

"""

import compas_slicer_ghpython.visualization as gh_compas_slicer
gh_compas_slicer = reload(gh_compas_slicer)

if origin_coords and mesh and planes and (index or index==0):
    mesh, passed_path = gh_compas_slicer.tool_visualization(origin_coords, mesh, planes, index)
else:
    gh_compas_slicer.missing_input()
# ---------- end cstoolviz ----------

python = GhPythonScript(path=py, folder_name=data, file_name="master_navigation_data.json", fabricate=Button(), debug_plane=plane_2)  # -> out, script; inputs fabricate: Boolean, debug_plane: Plane
# ---------- python: Python ----------
from imp import reload
import Rhino.Geometry as rg
import simple_ur_script as ur
# reload(ur)
import simple_comm as c
import json
# reload(c)

def tcp(script):
    script += ur.set_tcp_by_angles(TCP[0], TCP[1], TCP[2], TCP[3], TCP[4], TCP[5])
    return script

def set_robot_base():
    pt_0 = rg.Point3d(origin[0], origin[1],origin[2])# base plane origin
    pt_1 = rg.Point3d(origin_x[0], origin_x[1],origin_x[2])
    pt_2 = rg.Point3d(origin_y[0], origin_y[1],origin_y[2])
    robot_base = rg.Plane(pt_0, pt_1 - pt_0, pt_2 - pt_0)
    return robot_base

def rhino_to_robot_space(rhino_plane):
    plane = rhino_plane.Clone()
    robot_base_plane = set_robot_base()
    rhino_matrix = rg.Transform.PlaneToPlane(rg.Plane.WorldXY, robot_base_plane)
    plane.Transform(rhino_matrix)
    return plane

def send(script):
    script = c.concatenate_script(script)
    c.send_script(script, IP_ADDRESS)
    return script

path =path + '\\' + folder_name + '\\'+  file_name

with open(path, "r") as f:
    data = json.load(f)

origin = data["origin"]
origin_x = data["origin_x"]
origin_y = data["origin_y"]
TCP = data["tcp"]
Z_OFFSET = data["offset_z"]
IP_ADDRESS = data["ip"]  # string with IP Address

test_plane = debug_plane.Clone()
MAX_SPEED = .50  # mm/s float
MAX_ACCEL = .50  # mm/s2 float
# the_stop_plane = stop_plane.Clone()
# stop_configurations.reverse()

script = ""
script = tcp(script)


script += ur.move_l(rhino_to_robot_space(test_plane), MAX_ACCEL, MAX_SPEED)
    

if fabricate:
    send(script)
# ---------- end python ----------
panel_2 = Panel(toggle_freedrive)
amplitude = Amplitude(Vector=deconstruct_plane.ZAxis, Amplitude=Slider(2, range=0..10))

# ----
# Robot Visualization
get_config = GhPythonScript(send=Toggle(False), NAVIGATION_JSON=ghpython_script_4)  # -> config
# ---------- get_config: Python ----------
import os
from scriptcontext import sticky as st
#sticky is a persistent dictionary which can save values and also be acessed by other GH components
#we use it here with a custom key to store values we read from the robot
from compas.rpc import Proxy

import json
with open(NAVIGATION_JSON, "r") as f:
    data = json.load(f)
ip = data["ip"]

config_key = 'config_{}'.format(str(ghenv.Component.InstanceGuid))
new_key = 'new_key_{}'.format(str(ghenv.Component.InstanceGuid))
if config_key not in st:
    st[config_key] = None

if send:
    canvas = ghenv.Component.OnPingDocument()
    path = os.path.abspath(os.path.dirname(canvas.FilePath))
    rtde = Proxy('data.rtde_wrapper', path=path)
    
    st[config_key] = rtde.get_config(ip=ip)
    st[new_key] = rtde.get_config(ip=ip)
#    a = rtde.get_config(ip=ip)
config = st[config_key]
# ---------- end get_config ----------
ur10e = GhPythonScript()  # -> robot
# ---------- ur10e: Python ----------
import compas_fab
from compas.artists import Artist
from compas.robots import RobotModel
from compas.robots.resources import LocalPackageMeshLoader
from compas_fab.robots import Robot


urdf = compas_fab.get('universal_robot/ur_description/urdf/ur5.urdf')
model = RobotModel.from_urdf_file(urdf)

loader = LocalPackageMeshLoader(compas_fab.get('universal_robot'), 'ur_description')
model.load_geometry(loader)


robot = Robot(model)
robot.artist = Artist(model)
# ---------- end ur10e ----------
mesh = Mesh(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)
attached_tool = AttachedTool(robot=ur10e, visual_mesh=mesh)  # -> robot; inputs visual_mesh: Mesh, collision_mesh: Mesh
#   port visual_mesh: A visual mesh for the tool.
#   port collision_mesh: A collision mesh for the tool.
#   port tcf_plane: The frame of the tool in tool0 frame.
#   port group: The planning group to which the tool should be attached.
# ---------- attached_tool: Python ----------
"""
Attach a tool to the robot.

COMPAS FAB v0.27.0
"""
from ghpythonlib.componentbase import executingcomponent as component
from compas_rhino.conversions import RhinoMesh
from compas_rhino.conversions import plane_to_compas_frame

from compas.geometry import Frame
from compas_fab.robots import Tool


class AttachToolComponent(component):
    def RunScript(self, robot, visual_mesh, collision_mesh, tcf_plane, group):
        if robot and robot.client and robot.client.is_connected and visual_mesh:
            if not collision_mesh:
                collision_mesh = visual_mesh

            c_visual_mesh = RhinoMesh.from_geometry(visual_mesh).to_compas()
            c_collision_mesh = RhinoMesh.from_geometry(collision_mesh).to_compas()

            if not tcf_plane:
                frame = Frame.worldXY()
            else:
                frame = plane_to_compas_frame(tcf_plane)
            tool = Tool(c_visual_mesh, frame, c_collision_mesh)

            robot.attach_tool(tool, group)

        return robot
# ---------- end attached_tool ----------
robot_visualize = COMPASFABRobotVisualize(
    robot=attached_tool,
    configuration=get_config,
    show_collision=Toggle(False),
    show_frames=True,
    show_end_effector_frame=Toggle(True),
    show_cm=False,
    show_acm=False)  # -> visual, collision, collision_meshes, attached_meshes, frames, base_frame, ee_frame; inputs show_visual: Boolean, show_collision: Boolean, show_frames: Boolean, show_base_frame: Boolean, show_end_effector_frame: Boolean, show_cm: Boolean, show_acm: Boolean
#   port group: The planning group used for end-effector and base visualization.
#   port configuration: The robot's full configuration.
#   port show_visual: Whether or not to show the robot's visual meshes.
#   port show_collision: Whether or not to show the robot's collision meshes.
#   port show_frames: Whether or not to show the robot's joint frames.
#   port show_base_frame: Whether or not to show the robot's base frame.
#   port show_end_effector_frame: Whether or not to show the robot's end-effector frame.
#   port show_cm: Whether or not to show the collision meshes (if any).
#   port show_acm: Whether or not to show the attached collision meshes (if any).
#   port visual: Rhino meshes of the robot's visual geometry (if any).
#   port collision: Rhino meshes of the robot's collision geometry (if any).
#   port collision_meshes: Rhino meshes of the scene's collision meshes (if any).
#   port attached_meshes: Rhino meshes of the scene's attached collision meshes (if any).
#   port frames: The robot's joint frames as Rhino planes (if any).
#   port base_frame: The robot's base frame as a Rhino plane (if any).
#   port ee_frame: The robot's end-effector frame as a Rhino plane (if any).
# ---------- robot_visualize: Python ----------
"""
Visualizes the robot.

COMPAS FAB v0.27.0
"""
from compas.artists import Artist
from compas.geometry import Frame
from compas.geometry import Transformation
from compas_fab.robots import PlanningScene
from ghpythonlib.componentbase import executingcomponent as component
import Rhino.Geometry as rg


class RobotVisualize(component):
    def RunScript(
        self,
        robot,
        group,
        configuration,
        show_visual,
        show_collision,
        show_frames,
        show_base_frame,
        show_end_effector_frame,
        show_cm,
        show_acm,
    ):

        visual = None
        collision = None
        collision_meshes = None
        attached_meshes = None
        frames = None
        base_frame = None
        ee_frame = None

        if robot:
            show_visual = True if show_visual is None else show_visual
            show_cm = True if show_cm is None else show_cm
            show_acm = True if show_acm is None else show_acm
            configuration = configuration or robot.zero_configuration()

            robot.update(configuration, visual=show_visual, collision=show_collision)
            compas_frames = robot.transformed_frames(configuration, group)

            if show_visual:
                visual = robot.artist.draw_visual()

            if show_collision:
                collision = robot.artist.draw_collision()

            if show_base_frame:
                base_compas_frame = compas_frames[0]
                artist = Artist(base_compas_frame)
                base_frame = artist.draw()

            if show_end_effector_frame:
                ee_compas_frame = robot.forward_kinematics(
                    configuration, group, options=dict(solver="model")
                )
                artist = Artist(ee_compas_frame)
                ee_frame = artist.draw()

            if show_frames:
                frames = []
                for compas_frame in compas_frames[1:]:
                    artist = Artist(compas_frame)
                    frame = artist.draw()
                    frames.append(frame)

            if show_cm or show_acm:
                scene = PlanningScene(robot)
                scene = robot.client.get_planning_scene()

                collision_meshes = []
                attached_meshes = []

                if show_cm:
                    for co in scene.world.collision_objects:
                        header = co.header
                        frame_id = header.frame_id
                        cms = co.to_collision_meshes()

                        for cm in cms:
                            if cm.frame != Frame.worldXY():
                                t = Transformation.from_frame(cm.frame)
                                mesh = cm.mesh.transformed(t)
                            else:
                                mesh = cm.mesh

                            collision_meshes.append(Artist(mesh).draw())

                if show_acm:
                    for aco in scene.robot_state.attached_collision_objects:
                        for acm in aco.to_attached_collision_meshes():
                            frame_id = aco.object["header"]["frame_id"]
                            frame = robot.forward_kinematics(
                                configuration, options=dict(link=frame_id)
                            )
                            t = Transformation.from_frame(frame)

                            # Local CM frame
                            if (
                                acm.collision_mesh.frame
                                and acm.collision_mesh.frame != Frame.worldXY()
                            ):
                                t = t * Transformation.from_frame(
                                    acm.collision_mesh.frame
                                )

                            mesh = acm.collision_mesh.mesh.transformed(t)

                            attached_meshes.append(Artist(mesh).draw())
#        for v in visual:
#            v.Transform(rg.Transform.Scale(rg.Point3d(0,0,0),10))
        return (
            visual,
            collision,
            collision_meshes,
            attached_meshes,
            frames,
            base_frame,
            ee_frame,
        )
# ---------- end robot_visualize ----------
scale = Scale(Geometry=robot_visualize.visual, Center=Point(0, 0, 0), Factor=1000)  # -> Geometry, Transform

move = Move(Geometry=flip_plane.Flipped, Motion=amplitude)  # -> Geometry, Transform

# ---- group: Base
geometry_10 = Geometry([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])

# ---- group: Plate
geometry_11 = Geometry(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)

# ----
number_slider_5 = Slider(300, range=0..1000)

ghpython_script_5 = GhPythonScript(planes=plane)  # -> compasPlanes; inputs planes: list
# ---------- ghpython_script_5: Python ----------
from compas_rhino.conversions import plane_to_compas_frame

compasPlanes = []
for p in planes:
    compasPlanes.append(plane_to_compas_frame(p))
# ---------- end ghpython_script_5 ----------
ghpython_script_6 = GhPythonScript(path=py, folder_name=data, file_name="out_printpoints.json")  # -> path
# ---------- ghpython_script_6: Python ----------
a = ghdoc.Path

path =path + '\\' + folder_name + '\\output\\'+  file_name
# ---------- end ghpython_script_6 ----------
to_json = ToJSON(data=ghpython_script_5, filepath=ghpython_script_6, pretty=Toggle(True))  # -> json; inputs data: list, pretty: Boolean
#   port data: COMPAS data objects to serialize.
#   port filepath: File path where to store the JSON file. If empty, it will not store to disk but instead return the JSON string.
#   port pretty: If True, JSON data will be formatted with indentation and key sorting.
#   port json: JSON file path or JSON string.
# ---------- to_json: Python ----------
"""
Serializes COMPAS objects to JSON.
"""
from ghpythonlib.componentbase import executingcomponent as component

import compas


class CompasInfo(component):
    def RunScript(self, data, filepath, pretty):
        json = filepath

        if filepath:
            compas.json_dump(data, filepath, pretty)
        else:
            json = compas.json_dumps(data, pretty)

        return json
# ---------- end to_json ----------

plane_3 = Plane(move.Geometry)
deconstruct_plane_2 = DeconstructPlane(Plane=plane_3)  # -> Origin, XAxis, YAxis, ZAxis

mesh_2 = Mesh(cstoolviz.mesh)
geo = Geometry(cstoolviz.passed_path)
preview = CustomPreview(Geometry=mesh_2, Material=ColourSwatch(SwatchColor=RGB(171, 171, 171)))
preview_2 = CustomPreview(Geometry=geo, Material=ColourSwatch(SwatchColor=RGB(255, 156, 36)))

# ---- group: Color output
geo_2 = Geometry(cslightpathviz.travel_path_lines)
geo_3 = Geometry(cslightpathviz.print_path_pipes)
preview_3 = CustomPreview(Geometry=geo_3, Material=ColourSwatch(SwatchColor=RGB(199, 199, 199)))
preview_4 = CustomPreview(Geometry=geo_2, Material=ColourSwatch(SwatchColor=RGB(255, 156, 36)))

# ----
panel_3 = Panel(to_json)
subtraction_3 = Subtraction(B=45)
move_2 = Move(Geometry=scale.Geometry, Motion=Vector(333.6417568, 240.1738705, 0.7486044052))  # -> Geometry, Transform
rotate_3d = Rotate3D(
    Geometry=plane_3,
    Angle=degrees(Slider(-10, range=-100..250)),
    Center=deconstruct_plane_2.Origin,
    Axis=deconstruct_plane_2.XAxis)  # -> reverse(Geometry), Transform
rotate_plane = RotatePlane(Plane=rotate_3d.Geometry, Angle=degrees(Slider(180, range=0..1000)))
