# Grasshopper definition 221214_Substructure-pipes-and-surface.ghx (Grasshopper 1.0.7)
# plug-ins: Pufferfish

curve = Curve([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])
number_slider = Slider(2, range=0..10)
geometry = Geometry(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)
negative = Negative(Value=number_slider)
construct_domain = ConstructDomain(DomainStart=Slider(4, range=0..10), DomainEnd=Slider(7.5, range=0..10))
rebuild_curve = RebuildCurve(Curve=curve, Degree=Slider(2, range=0..10), Count=Slider(4, range=0..10), Tangents=False)
list_length = ListLength(List=rebuild_curve)
random = Random(Range=construct_domain, Number=list_length, Seed=2)
number_slider_2 = Slider(6, range=0..10)
end_points = EndPoints(Curve=rebuild_curve)  # -> Start, End
circle_cnr = CircleCNR(Center=end_points.Start, Normal=Vector(0, 0, 1), Radius=random)
extrude_along = ExtrudeAlong(Base=circle_cnr, Curve=rebuild_curve)

offset_surface = OffsetSurface(Surface=geometry, Distance=number_slider, BothSides=negative, CreateSolid=True)
cap_holes = CapHoles(Brep=extrude_along)
