# Grasshopper definition 221214_Substructure.ghx (Grasshopper 1.0.7)

brep = Brep(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)
number_slider = Slider(0.1, range=0..10)

python = GhPythonScript(brep=brep, layer_height="1.5", count=Slider(275, range=0..1000), shift=Toggle(False), p=Slider(4, range=0..10))  # -> out, slice_crvs, slice_pts, first_pts, safe_pts, a; inputs brep: Brep, layer_height: Int32, count: Int32, shift: Boolean, p: Int32
# ---------- python: Python ----------
"""
MasDfab 22-23
T1 Miniproject
How to slice a strange surface

"""

import Rhino
import Rhino.Geometry as rg
import ghpythonlib.treehelpers as th


# get rhino's zero zolerance constant, which is 2^-32.
zero = Rhino.RhinoMath.ZeroTolerance

def slice_brep(brep, layer_thickness):
    """
    this function will slice the closed brep and return the curves
    brep:   any closed brep
    layer height:   layer height
    """
    # get the min_z, max_z and height
    brep_bounding_box = brep.GetBoundingBox(rg.Plane.WorldXY)

    max_x, max_y, max_z = brep_bounding_box.Max
    min_x, min_y, min_z = brep_bounding_box.Min
    
    # intersect brep with a series of planes 
    slice_crvs = []
    
    height = min_z
    
    for i in range (1000):
        height += layer_thickness
        temp_crvs=[]
        if height < max_z:
            intersection_plane = rg.Plane(rg.Point3d(0,0, height), rg.Vector3d.XAxis, rg.Vector3d.YAxis)
            intersection_events = rg.Intersect.Intersection.BrepPlane(brep, intersection_plane, zero)
            
            # if intersection is True
            if intersection_events[0]:
                # append the intersection curve into the list
                for crv in intersection_events[1]:
                    temp_crvs.append(crv)
                join_crv = rg.Curve.JoinCurves(temp_crvs)
                slice_crvs.append(join_crv[0])
            # if intersection is false, then print this message
            else:
                print "sorry, intersection went wrong"
                
        # if the height has reached the max_z of value of the brep, then break 
        else:
            break
        
    return slice_crvs

def slice_pts(crvs, count):
    """
    this function will divide the sliced curves into points and return them
    
    crvs:   list of sliced curves
    count:  divide the curves by count
    """
    
    pts =  []

    for crv in crvs:
        
    # iterate through the curves, and check the orientation, if any is counterclockwise - then reverse it

    
    # divide the curve by count

        params = crv.DivideByCount(count, True)
        layer_pts = []
        for p in params:
            pt = crv.PointAt(p)
            layer_pts.append(pt)
        
        pts.append(layer_pts)
        
    # if we need to shift the curve seam
    if shift:
        new_pts = []
        print ("shift")
        k = 0
        for list in pts:
            k += 1
            if k > len(list):
                k = k - len(list)
            list = list[k:] + list[:k]
            new_pts.append(list)
        pts = new_pts
    return pts

def safe_pts (crvs, pts):
    """
    this function will return the first drag point and last safe point = "home position"
    
    crvs:   list of sliced curves
    pts:    nested list of points that curves were divided with
    """
    
    # the first point "dragging" point
    crv = slice_crvs[0]
    pt_zero = slice_pts[0][0].Clone()
    
    t = crv.TangentAt(rg.Curve.ClosestPoint(crv,pt_zero)[0])
    v = rg.Vector3d.CrossProduct(rg.Vector3d.ZAxis,t)
    pt_zero.Transform(rg.Transform.Translation(v*50))
    
    # the last point is the center of curve
    crv_last = slice_crvs[-1]
    b = crv_last.GetBoundingBox(rg.Plane.WorldXY)
    pt_last = b.Center
    pt_last.Transform(rg.Transform.Translation(rg.Vector3d.ZAxis * 50))
    
    return [pt_zero, pt_last]
    pass

# slicing brep and getting slicing crvs out
slice_crvs = slice_brep(brep,layer_height)
a= slice_crvs[2]

# diving the curves into points and getting nested list out
slice_pts = slice_pts(slice_crvs, count)

# getting the point zero and last point
safe_pts = safe_pts(slice_crvs, slice_pts)

## extra steps: extending the list with safe points
#flat_list = [j for i in slice_pts for j in i]
#flat_list.insert(0, safe_pts[0])
#flat_list.append(safe_pts[1])
## extra steps: and slicing for fabrication
#t = 1000
#parts_list = [i for i in flat_list[(p*t):(p*t+t)]]

first_pts = [i[0] for i in slice_pts]
slice_pts = th.list_to_tree(slice_pts)
# ---------- end python ----------
pt = Point(python.slice_pts)
pt_2 = Point(python.first_pts)
geo = Geometry(python.slice_crvs)
pt_3 = Point(python.safe_pts)

geometry = Geometry(python.a)

# ----
# HERE
xy = XYPlane(Origin=pt)  # -> flatten(Plane)

pln = Plane(xy)
preview = CustomPreview(Geometry=pln, Material=ColourSwatch(SwatchColor=RGBA(84, 189, 200, 178)))
