# Grasshopper definition 221215_Combined_Substructure.gh (Grasshopper 1.0.7)

ghpython_script = GhPythonScript()  # -> out, main_breps, sec_breps; inputs main_paths: list of Curve, sec_paths: list of Curve; unedited script template

# ---- group: Choose the Geometry Type
meshes_t = BooleanToggle(False)
breps_t = BooleanToggle(False)

# ---- group: Breps
brep = Brep()

# ----
merge = Merge()

# ----
# Boolean Union
mesh_brep = MeshBrep(
    Brep=brep,
    Settings={GridMaxCount=0, GridMinCount=16, JaggedSeams=False, MaxEdgeLength=0, MinEdgeLength=0.0001, MinTolerance=0, Refine=True, RefineAngle=0, RelativeTolerance=0.65, SimplePlanes=True, Tolerance=0})
ghpython_script_2 = GhPythonScript(meshes=flatten(mesh_brep), Meshes_T=meshes_t, breps=flatten(brep), Breps_T=breps_t)  # -> out, Union_Mesh, Union_Brep; inputs meshes: list of Mesh, Meshes_T: Boolean, breps: list of Brep
# ---------- ghpython_script_2: Python ----------
import Rhino.Geometry as rg
from copy import deepcopy

def Union_Breps( breps, counter):
    
    threshold=50
    if counter>=threshold or len(breps)==1:
        pass
    else:
        #print counter
        isUnion=False
        for m in range(1, len(breps)):
            #print 'x'
            union_brep = rg.Brep.CreateBooleanUnion([breps[0],breps[m]], 0.001)
            #print union_brep
            #print len(union_brep)
            if (not union_brep == None) and len(union_brep)==1:
                print len(union_brep)
                #new_list = deepcopy(breps)
                #new_list.RemoveAt(m)
                #new_list[0]= union_brep[0]
                #breps= new_list
                breps.remove(breps[m])
                breps.remove(breps[0])
                breps.insert(0,union_brep[0])

                isUnion= True
                break
        if isUnion:
            counter +=1
        else:
            item = breps.pop(0)
            breps.append(item)
            counter += 1
        Union_Breps(breps, counter)
        
    return breps


def Union_Meshes( meshes, counter):
    
    threshold=50
    if counter>=threshold or len(meshes)==1:
        pass
    else:
        isUnion=False
        for m in range(1, len(meshes)):
            union_mesh = rg.Mesh.CreateBooleanUnion([meshes[0],meshes[m]])
            if (not union_mesh == None) and len(union_mesh)==1:
                meshes.remove(meshes[m])
                meshes.remove(meshes[0])
                meshes.insert(0,union_mesh[0])
                isUnion= True
                break
        if isUnion:
            counter +=1
        else:
            item = meshes.pop(0)
            meshes.append(item)
            counter += 1
        Union_Meshes(meshes, counter)
        
    return meshes

if Meshes_T:
Union_Mesh = Union_Meshes(meshes,0)

if Breps_T:
Union_Brep = Union_Breps(breps,0)
# ---------- end ghpython_script_2 ----------

union_mesh = Geometry(ghpython_script_2.Union_Mesh)

# ---- group: Union_Brep
geometry = Geometry(ghpython_script_2.Union_Brep)

# ---- group: the start of the seam , to be chosen at a point to be hidden and mostly flat
number_slider = Slider(0.63, range=0.001..1)

# ----
mesh = Mesh(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)

# ----
# Mesh Slicing
count = Slider(306, range=0..1000)
seam_shift = BooleanToggle(False)
python = GhPythonScript(
    mesh=mesh,
    layer_height="1.5",
    count=count,
    shift=seam_shift,
    start_t=number_slider,
    p=Slider(0, range=0..10),
    length=Slider(1.002, range=0..10),
    byLength=Toggle(False))  # -> out, slice_crvs, slice_pts, first_pts, safe_pts, a, b; inputs mesh: Mesh, layer_height: Int32, count: Int32, shift: Boolean, p: Int32, byLength: Boolean
# ---------- python: Python ----------
"""
MasDfab 22-23
T1 Miniproject
How to slice a strange surface

"""

import Rhino
import Rhino.Geometry as rg
import ghpythonlib.treehelpers as th
from copy import deepcopy

# get rhino's zero zolerance constant, which is 2^-32.
zero = Rhino.RhinoMath.ZeroTolerance

def slice_mesh(mesh, layer_thickness):
    """
    this function will slice the closed brep and return the curves
    brep:   any closed brep
    layer height:   layer height
    """
    # get the min_z, max_z and height
    mesh_bounding_box = mesh.GetBoundingBox(rg.Plane.WorldXY)

    max_x, max_y, max_z = mesh_bounding_box.Max
    min_x, min_y, min_z = mesh_bounding_box.Min
    
    # intersect brep with a series of planes 
    slice_crvs = []
    
    height = min_z
    
    for i in range (1000):
        height += layer_thickness
        temp_nurbs_Curve=[]
        if height < max_z:
            intersection_plane = rg.Plane(rg.Point3d(0,0, height), rg.Vector3d.XAxis, rg.Vector3d.YAxis)
            polylines = rg.Intersect.Intersection.MeshPlane(mesh, intersection_plane)
            
            # if intersection is True
            if polylines.Count > 0:
                # append the intersection curve into the list
                for polyline in polylines:
                    temp_nurbs_Curve.append(rg.Polyline.ToNurbsCurve(polyline))
                join_crv = rg.Curve.JoinCurves(temp_nurbs_Curve)
                join_crv[0].Domain = rg.Interval(0.0, 1.0)
                slice_crvs.append(join_crv[0])
            # if intersection is false, then print this message
            else:
                print "sorry, intersection went wrong"
                
        # if the height has reached the max_z of value of the brep, then break 
        else:
            break
        
    return slice_crvs

def slice_pts(crvs, count, start_t, length = 0):
    """
    this function will divide the sliced curves into points and return them
    
    crvs:   list of sliced curves
    count:  divide the curves by count
    start_t: is the desirable t to start from at the beginning bitch
    """
    pts = []
    i = 0
    # divide the curve by count
    for crv in crvs:
        crv.ChangeClosedCurveSeam(start_t)
        if byLength:
            params = crv.DivideByLength(length, False)
        else:
            params = crv.DivideByCount(count, True)
        layer_pts = []
        for p in params:
            pt = crv.PointAt(p)
            layer_pts.append(pt)
            
        pts.append(layer_pts)
        
        #get closest point up 
        if crvs[-1] != crv:
            test_pt = crv.PointAt(params[1])
            height = crvs[i+1].PointAtEnd.Z
            start_t = crvs[i+1].ClosestPoint(rg.Point3d(test_pt.X, test_pt.Y, height))[1]
        i += 1
            
    # if we need to shift the curve seam
    if shift:
        new_pts = []
        print ("shift")
        k = 0
        for list in pts:
            k += 1
            if k > len(list):
                k = k - len(list)
            list = list[k:] + list[:k]
            new_pts.append(list)
        pts = new_pts
    return pts, crvs[0].PointAtNormalizedLength(start_t)

def rearrange_pts(slice_pts, start_t, firstCrv):
    """
    this function rearranges the fucked up pts based on the desired start point for the seam
    it then propagates the same start for the upper curves
    """

    #get into the loop and find the closest point in each level 
    

def safe_pts (crvs, pts):
    """
    this function will return the first drag point and last safe point = "home position"
    
    crvs:   list of sliced curves
    pts:    nested list of points that curves were divided with
    """
    
    # the first point "dragging" point
    crv = slice_crvs[0]
    pt_zero = slice_pts[0][0].Clone()
    
    t = crv.TangentAt(rg.Curve.ClosestPoint(crv,pt_zero)[0])
    v = rg.Vector3d.CrossProduct(rg.Vector3d.ZAxis,t)
    pt_zero.Transform(rg.Transform.Translation(v*50))
    
    # the last point is the center of curve
    crv_last = slice_crvs[-1]
    b = crv_last.GetBoundingBox(rg.Plane.WorldXY)
    pt_last = b.Center
    pt_last.Transform(rg.Transform.Translation(rg.Vector3d.ZAxis * 50))
    
    return [pt_zero, pt_last]
    pass

# slicing brep and getting slicing crvs out
slice_crvs = slice_mesh(mesh,layer_height)
b = slice_crvs[0]

# diving the curves into points and getting nested list out
slice_pts, a = slice_pts(slice_crvs, count, start_t, length)

# getting the point zero and last point
safe_pts = safe_pts(slice_crvs, slice_pts)

## extra steps: extending the list with safe points
#flat_list = [j for i in slice_pts for j in i]
#flat_list.insert(0, safe_pts[0])
#flat_list.append(safe_pts[1])
## extra steps: and slicing for fabrication
#t = 1000
#parts_list = [i for i in flat_list[(p*t):(p*t+t)]]

first_pts = [i[0] for i in slice_pts]
slice_pts = th.list_to_tree(slice_pts)
# ---------- end python ----------
geo = Geometry(python.slice_crvs)
pt = Point(python.first_pts)
pt_2 = Point(python.slice_pts)
pt_3 = Point(python.safe_pts)

# ---- group: Debugging
geometry_2 = Geometry(python.a)
geometry_3 = Geometry(python.b)

# ----
# Planes
# for execution
xy = XYPlane(Origin=pt_2)  # -> flatten(Plane)

pln = Plane(xy)
preview = CustomPreview(Geometry=pln, Material=ColourSwatch(SwatchColor=RGBA(84, 189, 200, 178)))
