# Grasshopper definition 11172022_chainmail_testing-elv.ghx (Grasshopper 1.0.7)
# plug-ins: Moonlight, Pufferfish, Axolotl Info, NGon

# ---- group: Ori Pt
# UR5/10 Calibration Points & Work Area
# 
# Tool tip should just touch the ruler!!!
panel = Panel("462.54")
pt = ConstructPoint(XCoordinate=panel, YCoordinate="397.55", ZCoordinate="-3.49")

# ---- group: yAxis_pt
pt_2 = ConstructPoint(XCoordinate="228.62", YCoordinate="85.20", ZCoordinate="-3.8")

# ---- group: Safe_pt
pt_3 = ConstructPoint(XCoordinate="93.00", YCoordinate="316.4", ZCoordinate="244.75")

# ----
# Reference geometries
robot_base = Geometry([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])
# 4 type of input curves
inputbase_pt = Point(Point(792.59, 125.4, -8.42))
boundary = Curve(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)

# ---- group: Degree =1 , Closed
crv = Curve(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)

# ---- group: Degree =1 , Open
crv_2 = Curve(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)

# ---- group: Degree =3 , Closed
crv_3 = Curve(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)

# ---- group: Degree =3 , Open
crv_4 = Curve(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)

# ----
# Basic Parameters
divide_interval = Slider(3, range=0..50)
velocity = Slider(15, range=0..50)
layers = Slider(1, range=0..50)
number_slider = Slider(1, range=0..10)

# ---- group: xAxis_pt
pt_4 = ConstructPoint(XCoordinate="228.62", YCoordinate="397.55", ZCoordinate="-3.49")

# ---- group: Initial-Shape
curve = Curve([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])

# ----
curve_2 = Curve(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)
curve_3 = Curve(<curve referenced from the Rhino model>)

# ---- group: Select Target Pt
# Here you can select which point sent to UR
list = ValueList({"Ori_Pt": 0, "xAxis_Pt": 1, "yAxis_Pt": 2, "Safe_Pt": 3}, selected="Ori_Pt")
filter = StreamFilter(Gate=list, Stream0=pt, Stream1=pt_4, Stream2=pt_2, Stream3=pt_3)

# ----
# Printing parameters generator: Muiltiple Curves
curve_printpts = GhPythonScript(curve=curve, divide_interval=divide_interval, layers=layers, layer_height=number_slider, velocity=velocity)  # -> points, way_points, velocities, blend_radii, extruder_toggles; inputs curve: list of Curve, layers: Int32, velocity: Int32
# ---------- curve_printpts: Python ----------
import Rhino.Geometry as rg
import math as m
import random as r

def divide_crv(crv, divide_interval, endInc):
    """
    Function to divide a curve by closest integer multiple of length
    crv : input curve
    divide_interval : desired length of segments
    endInc : if you want to include the end point
    
    returns : list of points and normals"""
    crv_length = crv.GetLength()
    count = int(crv_length/divide_interval)
    params = crv.DivideByCount(count, endInc)
    points = [crv.PointAt(p) for p in params] 
    tangents = [crv.TangentAt(p) for p in params]
    normals = [rg.Vector3d.CrossProduct(t, rg.Vector3d.ZAxis) for t in tangents]
    return points, normals

def calc_blend_radius(new_pts, buffer=0.1):
    """
    Function to calculate blend radius for a list of points
    new_pts : List(Point3d) list of points to iterate
    buffer : %age of inter point distance to be blended
    
    returns : List of blend radii
    """
    blend_radiuses = []
    for i in range(len (new_pts)-1):
        pt = new_pts[i]
        pt_1 = new_pts[i+1]
        dist = pt.DistanceTo(pt_1)
        blend_radius = dist*buffer
        blend_radiuses.append(blend_radius)
    blend_radiuses.append(blend_radiuses[-1])
    return blend_radiuses



##################################################################################################################################################

#As coding convention we separate the namespace thus the bottom part being the "main" part of the code, which is executed by the python interpreter

if __name__ == '__main__':
    #To simplify life, we can check the type of curve and generate printpoints based on that
    #if curve_degree == 1, it's a polyline
    #if curve_degree != 1, it's a curve
    #    curve_degree = curve.Degree #rg.Curve.Degree ---> Attribute of class Curve in Rhino.Geometry; notice no paranthesis ()
    #create an empty list of points
    points = [] 
    way_points = []
    
    #If polyline
    for c in curve:
        if c.Degree ==1:
            #means it is a polyline or line curve
            if not c.IsClosed:
                #if curve is open, we add the start point for the first segment and endpoints for all the rest
                crv_segs = c.DuplicateSegments()
                for i,seg in enumerate(crv_segs):
                    if i==0:
                        points.append(seg.PointAtStart)
                        points.append(seg.PointAtEnd)
                    else:
                        points.append(seg.PointAtEnd)
            elif c.IsClosed:
                #if it is closed, we can add all the endpoints since the start point is also the end of the last one
                crv_segs = c.DuplicateSegments()
                for seg in crv_segs:
                    points.append(seg.PointAtEnd)
    
            #If it is a curve
        elif c.Degree !=1:
                endInc = True
                points,_ = divide_crv(c, divide_interval, endInc)
        
        
        for i in range(layers): #iterate through required number of layers
            layer_points = []
            print len(points)
            for pt in points: #go through points on curve and create them for different heights
                way_point = rg.Point3d(pt.X, pt.Y, pt.Z + i*layer_height)
                layer_points.append(way_point)
            #for open curves, reverse every alternate layer to continue the path
            if i%2==1 and not curve.IsClosed:
                layer_points.reverse()
            way_points.extend(layer_points)
        #Here we insert a safe point in the beginning
        safe_dis = 10.0
        Lift = rg.Transform.Translation(0, 0, safe_dis)
        safe_pt = way_points[0].Clone()
        safe_pt.Transform(Lift)
        way_points.insert(0,safe_pt)
        
        #Here we create a list of velocity
        velocities=[]
        for pt in way_points:
            velocities.append(velocity) #consrant vevlocity for all waypoints alternatively velocities = [velocity]*len(way_points)
        
        #Here we create a list of blend radius, call the function to calculate a list of blend radii
        blend_radii = calc_blend_radius(way_points, buffer=0.1)
        
        #Here we create a list of extruder toggle, True means the robot sends signal to the extruder motor
        extruder_toggles=[]
        #toggle False means extruder is OFF, True meaning it is ON
        for i,pt in enumerate(way_points):
            if i ==0 or i == len(way_points)-1:
                #for the first point(safety point) and the last point toggle is False
                extruder_toggles.append(False)      
            else:
                extruder_toggles.append(True)
# ---------- end curve_printpts ----------

offset_curve = OffsetCurve(
    Curve=curve_3,
    Plane=PlaneXY(0, 0, 0),
    Distance=Slider(1.75, range=0..10),
    BothSides=0,
    Kinks=0,
    CapType=Slider(0, range=0..100))

# ----
# Printing parameters generator: Single Curve
curve_printpts_2 = GhPythonScript(curve=curve_2, divide_interval=divide_interval, layers=layers, layer_height=number_slider, velocity=velocity)  # -> points, way_points, velocities, blend_radii, extruder_toggles; inputs curve: Curve, layers: Int32, velocity: Int32
# ---------- curve_printpts_2: Python ----------
import Rhino.Geometry as rg
import math as m
import random as r

def divide_crv(crv, divide_interval, endInc):
    """
    Function to divide a curve by closest integer multiple of length
    crv : input curve
    divide_interval : desired length of segments
    endInc : if you want to include the end point
    
    returns : list of points and normals"""
    crv_length = crv.GetLength()
    count = int(crv_length/divide_interval)
    params = crv.DivideByCount(count, endInc)
    points = [crv.PointAt(p) for p in params] 
    tangents = [crv.TangentAt(p) for p in params]
    normals = [rg.Vector3d.CrossProduct(t, rg.Vector3d.ZAxis) for t in tangents]
    return points, normals

def calc_blend_radius(new_pts, buffer=0.1):
    """
    Function to calculate blend radius for a list of points
    new_pts : List(Point3d) list of points to iterate
    buffer : %age of inter point distance to be blended
    
    returns : List of blend radii
    """
    blend_radiuses = []
    for i in range(len (new_pts)-1):
        pt = new_pts[i]
        pt_1 = new_pts[i+1]
        dist = pt.DistanceTo(pt_1)
        blend_radius = dist*buffer
        blend_radiuses.append(blend_radius)
    blend_radiuses.append(blend_radiuses[-1])
    return blend_radiuses



##################################################################################################################################################

#As coding convention we separate the namespace thus the bottom part being the "main" part of the code, which is executed by the python interpreter

if __name__ == '__main__':
    #To simplify life, we can check the type of curve and generate printpoints based on that
    #if curve_degree == 1, it's a polyline
    #if curve_degree != 1, it's a curve
    curve_degree = curve.Degree #rg.Curve.Degree ---> Attribute of class Curve in Rhino.Geometry; notice no paranthesis ()
    #create an empty list of points
    points = [] 
    
    #If polyline
    if curve_degree ==1:
        #means it is a polyline or line curve
        if not curve.IsClosed:
            #if curve is open, we add the start point for the first segment and endpoints for all the rest
            crv_segs = curve.DuplicateSegments()
            for i,seg in enumerate(crv_segs):
                if i==0:
                    points.append(seg.PointAtStart)
                    points.append(seg.PointAtEnd)
                else:
                    points.append(seg.PointAtEnd)
        elif curve.IsClosed:
            #if it is closed, we can add all the endpoints since the start point is also the end of the last one
            crv_segs = curve.DuplicateSegments()
            for seg in crv_segs:
                points.append(seg.PointAtEnd)
    
    #If it is a curve
    elif curve_degree !=1:
        endInc = True
        points,_ = divide_crv(curve, divide_interval, endInc)
    
    way_points = []
    for i in range(layers): #iterate through required number of layers
        layer_points = []
        for pt in points: #go through points on curve and create them for different heights
            way_point = rg.Point3d(pt.X, pt.Y, pt.Z + i*layer_height)
            layer_points.append(way_point)
        #for open curves, reverse every alternate layer to continue the path
        if i%2==1 and not curve.IsClosed:
            layer_points.reverse()
        way_points.extend(layer_points)
    
    #Here we insert a safe point in the beginning
    safe_dis = 10.0
    Lift = rg.Transform.Translation(0, 0, safe_dis)
    safe_pt = way_points[0].Clone()
    safe_pt.Transform(Lift)
    way_points.insert(0,safe_pt)
    
    #Here we create a list of velocity
    velocities=[]
    for pt in way_points:
        velocities.append(velocity) #consrant vevlocity for all waypoints alternatively velocities = [velocity]*len(way_points)
    
    #Here we create a list of blend radius, call the function to calculate a list of blend radii
    blend_radii = calc_blend_radius(way_points, buffer=0.1)
    
    #Here we create a list of extruder toggle, True means the robot sends signal to the extruder motor
    extruder_toggles=[]
    #toggle False means extruder is OFF, True meaning it is ON
    for i,pt in enumerate(way_points):
        if i ==0 or i == len(way_points)-1:
            #for the first point(safety point) and the last point toggle is False
            extruder_toggles.append(False)      
        else:
            extruder_toggles.append(True)
# ---------- end curve_printpts_2 ----------

panel_2 = Panel(filter)

# ---- group: Robot_Send
# Send to UR
z = Slider(0.5, range=0..1000)
fabrication = GhPythonScript(
    ori_pt=pt,
    xAxis_pt=pt_4,
    yAxis_pt=pt_2,
    safe_pt=pt_3,
    inputBase_pt=inputbase_pt,
    robot_pts=curve_printpts.way_points,
    velocities=curve_printpts.velocities,
    blend_radii=curve_printpts.blend_radii,
    extruder_toggles=curve_printpts.extruder_toggles,
    myTCP_z=z,
    send=Button())  # -> script, rhino_base_way_planes, robot_planes; inputs ori_pt: Point3d, xAxis_pt: Point3d, yAxis_pt: Point3d, safe_pt: Point3d, inputBase_pt: Point3d, robot_pts: list, velocities: list, blend_radii: list, extruder_toggles: list
# ---------- fabrication: Python ----------
#to reload the simple ur script and simple comm modules
from compas_rhino import unload_modules
unload_modules('simple_ur_script')
unload_modules('simple_comm')

#import all necessary modules
import Rhino.Geometry as rg
import simple_comm as c
import simple_ur_script as ur
import math as m


def tcp(script):
    """ 
    This function sets tcp of the robot
    variables : [x,y,z,ry,ry,rz] 
    x, y, z : point coordinates (float)
    ry, ry, rz : euler angles for rotation
    """
    script += ur.set_tcp_by_angles(float(15.76), float(-47.24), float(143.04 + myTCP_z), m.radians(0.0), m.radians(180.0), m.radians(90.0))
    return script
#    script += ur.set_tcp_by_angles(float(15.76), float(-47.24), float(143.04), m.radians(0.0), m.radians(180.0), m.radians(90.0))
def set_robot_base_plane_from_pts(ori_pt, xAxis_pt, yAxis_pt):
    """
    set robot base from measured points
    ori_pt : origin
    xAxis_pt : point on the positive x axis
    yAxis_pt : point on the positive XY plane
    """
    robot_base = rg.Plane(ori_pt, xAxis_pt - ori_pt, yAxis_pt - ori_pt)
    return robot_base

def rhino_to_robot_space(rhino_plane):
    """ this funktion translates planes from the rhino cordinate system to
    the robot cordinate system 
    """
    robot_plane = rhino_plane.Clone()
    robotBase_plane = set_robot_base_plane_from_pts(ori_pt, xAxis_pt, yAxis_pt)
    _r_matrix = rg.Transform.PlaneToPlane(rg.Plane(inputBase_pt, rg.Vector3d.XAxis, rg.Vector3d.YAxis), 
                                          robotBase_plane)
    robot_plane.Transform(_r_matrix)
    return robot_plane

def point_to_rhino_plane(point):
    """
    create a standard XY plane from a point
    """
    rhino_plane = rg.Plane(point, -rg.Vector3d.XAxis, -rg.Vector3d.YAxis)
    return rhino_plane

def set_extruder_speed_1(script):
    #turn OFF IO 5 to turn on any extrusion
    script += ur.set_digital_out(5, False)
    #extruder auto speed 1 (aspeed 1 in arduino) is connected to Digital IO 6
    script += ur.set_digital_out(6,True) 
    #make sure IO 7 is off
    script += ur.set_digital_out(7,False)
    #add required lines to script and return
    return script
    
def set_extruder_speed_2(script):
    #turn OFF IO 5 to turn on any extrusion
    script += ur.set_digital_out(5, False)
    #extruder auto speed 1 (aspeed 1 in arduino) is connected to Digital IO 6
    script += ur.set_digital_out(6,False) 
    #extruder auto speed 2 (aspeed 0 in arduino) is connected to Digital IO 7
    script += ur.set_digital_out(7,True)
    return script

def set_extruder_retraction(script):
    #turn OFF IO 5 to turn on any extrusion
    script += ur.set_digital_out(5, False)
    #retraction can be triggered by turning on IO 6 and 7 both
    script += ur.set_digital_out(6, True) 
    script += ur.set_digital_out(7, True)
    #add required lines to script and return
    return script
    
def extrude(plane, vel, blend_radi, extr, script, change_extruder_status):
    #move to desired plane
    script += ur.move_l_blend(plane, vel/1000, blend_radi/1000)
    #check if extruder needs to be toggled, if yes, then check if it is True or False
    if change_extruder_status:
        #if true, then set extruder speed, to turn on the extruder
        if extr:
            #script = set_extruder_speed_1(script)
            script = set_extruder_speed_2(script)
        #otherwise, turn it off by turning on IO 5
        else:
            script += ur.set_digital_out(5, True) 
    return script 

############################################################################################################
# Robotic fabrication procedure
############################################################################################################

if __name__ == '__main__':
    script = "" #c=reate empty string for script
    #set TCP from script if required
    #script = tcp(script)
    
    #Create rhino planes
    rhino_base_way_planes = []
    for point in robot_pts:
        rhino_base_way_planes.append(point_to_rhino_plane(point)) #create a list of standard XY planes
    
    #Translate rhino planes to robot_plane 
    robot_planes = []
    for rhino_plane in (rhino_base_way_planes):
        robot_planes.append(rhino_to_robot_space(rhino_plane))
        
    #create extruder commands
    change_extruder_status = True #default value for state change flag
    #Iterate through all lists; notice use of enumerate and zip together
    for i, (plane, velocity, blend_radi, extruder_toggle) in enumerate(zip(robot_planes, velocities, blend_radii, extruder_toggles)):
        #for every plane after plane 0
        if i>0:
            if extruder_toggle != extruder_toggles[i-1]:
            #if current extruder toggle is not the same as the last one, means extruder state needs to be toggled
                change_extruder_status = True
            else: 
            #otherwise this flag can be False
                change_extruder_status = False
        #go to extrude function to check if extruder is needed to be turned ON
        script = extrude(plane, velocity, blend_radi, extruder_toggle, script, change_extruder_status)
        #for every 5th point, send a log message to the UR controller(helps to know what point you are currently on)
        if i%5 == 0:
            script += ur.textmsg("Pt: %d" % i)
        #For the last point, we send to the last point, and then send to a safe point
        if i == len(robot_pts)-1: 
            script = extrude(plane, velocity, blend_radi, 0, script, change_extruder_status)
            script += ur.move_l_blend(rg.Plane(safe_pt, rg.Vector3d.XAxis, rg.Vector3d.YAxis), velocity/1000, blend_radi/1000)
    
    
    #send the stuff to robot on button press
    if send:
        script = c.concatenate_script(script) #concatenate script before sending
        c.send_script(script, "192.168.10.10") #send to robot #192.168.10.10
# ---------- end fabrication ----------

# ---- group: Send to calibrate table
# Here we calibrate the printing table
# 1.
# "Click send_TCP"
# 2.
# Set "tcp_h" to "0" while calibrating
# Set "tcp_h" >20  after calibration for safety reason
# 3. Click "send"
send_tcp = Button()
send = Button()
conplane = GhPythonScript(pt=filter)  # -> plane; inputs pt: Point3d
# ---------- conplane: Python ----------
import Rhino.Geometry as rg

plane = rg.Plane(pt, rg.Vector3d.XAxis, rg.Vector3d.YAxis)
# ---------- end conplane ----------
tcp_h = Slider(0, range=0..300)
sendtopoint = GhPythonScript(target_plane=conplane, tcp_height=tcp_h, send_TCP=send_tcp, send=send)  # -> rhino_base_way_planes, robot_planes, target_plane, script; inputs target_plane: Plane, send_TCP: Boolean
# ---------- sendtopoint: Python ----------
from compas_rhino import unload_modules
unload_modules('simple_ur_script')
unload_modules('simple_comm')

import simple_comm as c
import simple_ur_script as ur
import Rhino.Geometry as rg
import math as m

if send_TCP:
    script = ""
    script += ur.set_tcp_by_angles(float(15.76), float(-47.24), float(143.04), m.radians(0.0), m.radians(180.0), m.radians(90.0))
    script = c.concatenate_script(script)
    c.send_script(script,"192.168.10.10")

T = rg.Transform.Translation(0,0,tcp_height)
target_plane.Transform(T)

if send:
    script = ""
    script += ur.set_tcp_by_angles(float(15.76), float(-47.24), float(143.04), m.radians(0.0), m.radians(180.0), m.radians(90.0))
    velocity = 0.05
    acceleration = 0.02
    
    script += ur.move_l(target_plane, acceleration, velocity)
    script = c.concatenate_script(script)
    c.send_script(script,"192.168.10.10")
# ---------- end sendtopoint ----------

# ----
moonlight = Moonlight(Mode=Toggle(False))
number_slider_2 = Slider(18, range=0..20)
number_slider_3 = Slider(6, range=0..10)
pln = Plane(fabrication.robot_planes)
panel_3 = Panel(fabrication.script)
rectangular = Rectangular(
    Plane=PlaneXY(0, 0, 0),
    SizeX=Slider(9, range=0..10),
    SizeY=number_slider_3,
    ExtentX=Slider(1, range=0..10),
    ExtentY=number_slider_2)  # -> Cells, Points
point = Point(rectangular.Points)
panel_4 = Panel("""1
0""")
division = Division(A=number_slider_3, B=2)
panel_5 = Panel(sendtopoint.robot_planes)
triangular = Triangular(Plane=PlaneXY(0, 0, 0), Size=Slider(10, range=0..10), ExtentX=Slider(2, range=0..10), ExtentY=Slider(8, range=0..10))  # -> Cells, Points
circle_cnr = CircleCNR(Center=point, Normal=Vector(0, 0, 1), Radius=Slider(5, range=0..10))  # -> flatten(Circle)
addition = Addition(A=number_slider_2, B=1)
unit_y = UnitY(Factor=division)
point_2 = Point(triangular.Points)
slice2dsimple = Slice2DSimple(NumberU=50, NumberV=50, DimensionX=10, DimensionY=10, Plane=PlaneXY(0, 0, 0))  # -> Values, Contours
split_list = SplitList(List=circle_cnr, Index=addition)  # -> ListA, ListB
move = Move(Geometry=split_list.ListB, Motion=unit_y)  # -> Geometry, Transform
dispatch = Dispatch(List=split_list.ListA, DispatchPattern=panel_4)  # -> ListA, ListB
dispatch_2 = Dispatch(List=split_list.ListB, DispatchPattern=panel_4)  # -> ListA, ListB

list_item = ListItem(List=circle_cnr, Index=Slider(7, range=0..10), Wrap=True)
list_item_2 = ListItem(List=dispatch_2.ListB, Index=Slider(0, range=0..10), Wrap=True)

slice2d = Slice2D(NumberU=50, NumberV=50, DimensionX=10, DimensionY=10, Plane=PlaneXY(0, 0, 0), type=0)  # -> Values, Mesh, Contours
move_2 = Move(Motion=Vector(0, 0, 10))  # -> Geometry, Transform
curve_4 = Curve(dispatch_2.ListB)
curve_5 = Curve(dispatch.ListA)
shift_list = ShiftList(List=curve_5, Shift=Slider(1, range=0..10), Wrap=invert(True))
tangent_lines_in = TangentLinesIn(CircleA=shift_list, CircleB=curve_4)  # -> Tangent1, Tangent2
tangent_lines_in_2 = TangentLinesIn(CircleA=curve_5, CircleB=curve_4)  # -> Tangent1, Tangent2
curve_6 = Curve(tangent_lines_in_2.Tangent1)
curve_7 = Curve(tangent_lines_in.Tangent2)
repeat_data = RepeatData()
cull_index = CullIndex(List=curve_6, Indices="-1", Wrap=True)
weave = Weave(Pattern=[0, 1], Stream0=cull_index, Stream1=curve_7, NullGaps=False)
number_slider_4 = Slider(0.4, range=0..1)
weave_2 = Weave(Pattern=[0, 1], Stream0=curve_5, Stream1=curve_4, NullGaps=False)
merge = Merge(Data1=curve_7, Data2=cull_index)
merge_2 = Merge()
list_item_3 = ListItem(List=weave, Index=1, Wrap=True)
list_item_4 = ListItem(List=weave, Index=-2, Wrap=True)
multiplication = Multiplication(A=number_slider_3, B=-2)
multiplication_2 = Multiplication(A=number_slider_3, B=2)
unit_y_2 = UnitY(Factor=multiplication)
unit_y_3 = UnitY(Factor=multiplication_2)
move_3 = Move(Geometry=list_item_3, Motion=unit_y_2)  # -> Geometry, Transform
move_4 = Move(Geometry=list_item_4, Motion=unit_y_3)  # -> Geometry, Transform
insert_items = InsertItems(List=weave, Item=move_3.Geometry, Indices=0, Wrap=True)
insert_items_2 = InsertItems(List=insert_items, Item=move_4.Geometry, Indices=-1, Wrap=True)
end_points = EndPoints(Curve=insert_items_2)  # -> Start, End
weave_3 = Weave(Pattern=[1, 0, 0, 1], Stream0=end_points.Start, Stream1=end_points.End, NullGaps=False)
cull_index_2 = CullIndex(List=weave_3, Indices=[0, -1], Wrap=True)
curveshatter = CurveShatter(Curve=weave_2, Points=cull_index_2, Tolerance=0.01)  # -> flatten(Curves)
list_item_5 = ListItem(List=curveshatter, Index=Slider(7, range=0..100), Wrap=True)
dispatch_3 = Dispatch(List=curveshatter, DispatchPattern=[True, False, False, True])  # -> ListA, ListB
line = Line(insert_items_2)
geometry = Geometry(dispatch_3.ListA)
weave_4 = Weave(Pattern=[0, 1], Stream0=line, Stream1=geometry, NullGaps=False)
join_curves = JoinCurves(Curves=weave_4, Preserve=False)
