# Grasshopper definition pattern_testing_jk.gh (Grasshopper 1.0.7)

number_slider = Slider(50, range=0..100)
curve = Curve(<curve referenced from the Rhino model>)
rectangle = Rectangle(Plane=PlaneXY(0, 0, 0), XSize=number_slider, YSize=number_slider, Radius=0)  # -> Rectangle, Length
populate_2d = Populate2D(Region=rectangle.Rectangle, Count=Slider(10, range=0..10), Seed=Slider(10, range=0..10))
offset_curve = OffsetCurve(Curve=rectangle.Rectangle, Distance=1, Corners=1)  # -> flatten(Curve)
point = Point(flatten(populate_2d))
point_charge = PointCharge(Point=point, Charge=1, Decay=2, Bounds=offset_curve)
circle = Circle(Plane=point, Radius=1)
merge_fields = MergeFields(Fields=point_charge)
divide_curve = DivideCurve(Curve=circle, Count=Slider(67, range=0..100), Kinks=False)  # -> flatten(Points), Tangents, Parameters
field_line = FieldLine(Field=merge_fields, Point=divide_curve.Points, Steps=Slider(1000, range=0..1000), Accuracy=0.1, Method=3)
