# Grasshopper definition puffer-fish-testing-jk.ghx (Grasshopper 1.0.7)
# plug-ins: Pufferfish, DendroGH

# ---- group: RANDOM
U = Slider(2, range=0..10)
w = Slider(1, range=0..10)
v = Slider(8, range=0..10)
range = Range(Domain=Domain(0, 1), Steps=U)
range_2 = Range(Domain=Domain(0, 1), Steps=w)
range_3 = Range(Domain=Domain(0, 1), Steps=v)
curve = Curve([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])
twisted_box_consecutive_curves = TwistedBoxConsecutiveCurves(
    Curves=curve,
    Thickness=Slider(-30, range=-30..10),
    ParametersU=range,
    ParametersV=range_3,
    ParametersW=range_2,
    Weighted=False,
    Loopback=False,
    InterpolationType=1,
    Refit=0,
    PointSample=0)
curve_2 = Curve([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])
group = Group(Objects=curve_2)
box = Box(group)
box_morph = BoxMorph(Geometry=group, Reference=box, Target=twisted_box_consecutive_curves)
ungroup = Ungroup(Group=box_morph)  # -> flatten(Objects)
create_settings = CreateSettings(VoxelSize=Slider(1, range=0..10), Bandwidth=1, Isovalue=0, Adaptivity=0.1)
curve_to_volume = CurveToVolume(Curves=ungroup, CurveRadius=Slider(2.26, range=0..10), Settings=create_settings)
create_material = CreateMaterial(
    Diffuse=ColourSwatch(SwatchColor=RGB(225, 71, 0)),
    Specular=RGB(255, 255, 255),
    Emission=ColourSwatch(SwatchColor=RGB(0, 0, 0)),
    Transparency=0,
    Shine=Slider(6, range=0..10))
custom_preview = CustomPreview(Geometry=curve_to_volume, Material=create_material)

U_2 = Slider(4, range=0..10)
w_2 = Slider(1, range=0..10)
v_2 = Slider(5, range=0..10)
range_4 = Range(Domain=Domain(0, 1), Steps=U_2)
range_5 = Range(Domain=Domain(0, 1), Steps=w_2)
range_6 = Range(Domain=Domain(0, 1), Steps=v_2)
curve_3 = Curve([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])
twisted_box_consecutive_curves_2 = TwistedBoxConsecutiveCurves(
    Curves=curve_3,
    Thickness=Slider(-30, range=-30..10),
    ParametersU=range_4,
    ParametersV=range_6,
    ParametersW=range_5,
    Weighted=False,
    Loopback=False,
    InterpolationType=1,
    Refit=0,
    PointSample=0)
curve_4 = Curve([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])
group_2 = Group(Objects=curve_4)
box_2 = Box(group_2)
box_morph_2 = BoxMorph(Geometry=group_2, Reference=box_2, Target=twisted_box_consecutive_curves_2)
ungroup_2 = Ungroup(Group=box_morph_2)  # -> flatten(Objects)
create_settings_2 = CreateSettings(VoxelSize=Slider(1, range=0..10), Bandwidth=1, Isovalue=0, Adaptivity=0.1)
curve_to_volume_2 = CurveToVolume(Curves=ungroup_2, CurveRadius=Slider(2.26, range=0..10), Settings=create_settings_2)
create_material_2 = CreateMaterial(
    Diffuse=ColourSwatch(SwatchColor=RGB(225, 71, 0)),
    Specular=RGB(255, 255, 255),
    Emission=ColourSwatch(SwatchColor=RGB(0, 0, 0)),
    Transparency=0,
    Shine=Slider(6, range=0..10))
custom_preview_2 = CustomPreview(Geometry=curve_to_volume_2, Material=create_material_2)

# ---- group: Dodecahedrian
U_3 = Slider(4, range=0..10)
w_3 = Slider(1, range=0..10)
v_3 = Slider(5, range=0..10)
range_7 = Range(Domain=Domain(0, 1), Steps=U_3)
range_8 = Range(Domain=Domain(0, 1), Steps=w_3)
range_9 = Range(Domain=Domain(0, 1), Steps=v_3)
surface = Surface([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])
twisted_box_through_surfaces = TwistedBoxThroughSurfaces(
    Surfaces=surface,
    ParametersU=range_7,
    ParametersV=range_9,
    ParametersW=range_8,
    Normalized=True,
    Equalized=False,
    Weighted=False,
    Loopback=False,
    Degree=3,
    InterpolationType=0,
    Refit=0,
    PointSample=0)
curve_5 = Curve([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])
group_3 = Group(Objects=curve_5)
box_3 = Box(group_3)
box_morph_3 = BoxMorph(Geometry=group_3, Reference=box_3, Target=twisted_box_through_surfaces)
ungroup_3 = Ungroup(Group=box_morph_3)  # -> flatten(Objects)
create_settings_3 = CreateSettings(VoxelSize=Slider(1, range=0..10), Bandwidth=1, Isovalue=0, Adaptivity=0.1)
curve_to_volume_3 = CurveToVolume(Curves=ungroup_3, CurveRadius=Slider(2.26, range=0..10), Settings=create_settings_3)
create_material_3 = CreateMaterial(
    Diffuse=ColourSwatch(SwatchColor=RGB(225, 71, 0)),
    Specular=RGB(255, 255, 255),
    Emission=ColourSwatch(SwatchColor=RGB(0, 0, 0)),
    Transparency=0,
    Shine=Slider(6, range=0..10))
custom_preview_3 = CustomPreview(Geometry=curve_to_volume_3, Material=create_material_3)

U_4 = Slider(4, range=0..10)
w_4 = Slider(1, range=0..10)
v_4 = Slider(5, range=0..10)
range_10 = Range(Domain=Domain(0, 1), Steps=U_4)
range_11 = Range(Domain=Domain(0, 1), Steps=w_4)
range_12 = Range(Domain=Domain(0, 1), Steps=v_4)
surface_2 = Surface([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])
twisted_box_through_surfaces_2 = TwistedBoxThroughSurfaces(
    Surfaces=surface_2,
    ParametersU=range_10,
    ParametersV=range_12,
    ParametersW=range_11,
    Normalized=True,
    Equalized=False,
    Weighted=False,
    Loopback=False,
    Degree=3,
    InterpolationType=0,
    Refit=0,
    PointSample=0)
curve_6 = Curve([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])
group_4 = Group(Objects=curve_6)
box_4 = Box(group_4)
box_morph_4 = BoxMorph(Geometry=group_4, Reference=box_4, Target=twisted_box_through_surfaces_2)
ungroup_4 = Ungroup(Group=box_morph_4)  # -> flatten(Objects)
create_settings_4 = CreateSettings(VoxelSize=Slider(1, range=0..10), Bandwidth=1, Isovalue=0, Adaptivity=0.1)
curve_to_volume_4 = CurveToVolume(Curves=ungroup_4, CurveRadius=Slider(2.26, range=0..10), Settings=create_settings_4)
create_material_4 = CreateMaterial(
    Diffuse=ColourSwatch(SwatchColor=RGB(225, 71, 0)),
    Specular=RGB(255, 255, 255),
    Emission=ColourSwatch(SwatchColor=RGB(0, 0, 0)),
    Transparency=0,
    Shine=Slider(6, range=0..10))
custom_preview_4 = CustomPreview(Geometry=curve_to_volume_4, Material=create_material_4)
