# Grasshopper definition sub_structure_testing_22.08.12_jk.gh (Grasshopper 1.0.7)
# plug-ins: Bifocals

number_slider = Slider(189, range=0..1000)
division = Division(A=number_slider, B="5")
int = Integer(division)
range = Range(Domain=Domain(0, 1), Steps=expr("x-1", int))
# I. HOW TO MAKE A STRANGE SURFACE
# Option 2 - GH Python
number_slider_2 = Slider(70, range=0..100)
graph = GraphMapper(
    range,
    x0=0,
    x1=1,
    y0=0,
    y1=1,
    amplitude=0.05347180367,
    container_name="Perlin",
    decay=0.4409280419,
    frequency=0.09208554029,
    x_offset=0.5,
    y_offset=0.5)
pt = Point(Point(484.7457627, 178.6723164, 0))
panel = Panel(graph)
python = GhPythonScript(
    srf_origin=pt,
    srf_radius=number_slider_2,
    srf_height=number_slider,
    pt_count=Slider(51, range=0..100),
    rotate=Toggle(True),
    move=Toggle(True),
    graph_map=graph)  # -> out, a, b, c; inputs srf_origin: Point3d, srf_radius: Int32, srf_height: Int32, pt_count: Int32, move: Boolean, graph_map: list
# ---------- python: Python ----------
"""
MasDfab 22-23
T1 Miniproject
How to make a strange surface

"""

import Rhino.Geometry as rg
import math
import random as r
import ghpythonlib.treehelpers as th


class MySrf(object):
    """
    this is a class that will create random patterened surface from a circle and given height
    
    """
    
    def __init__(self,pt,r,height):
        
        self.pt = pt
        self.r = r
        self.cnt = int(height/5) # change the layer height
        
        self.circles = self.get_crvs()
        self.pts = self.get_pts()
        self.srf = self.get_srf()
    
    def get_crvs(self):
        cls = []
        for i in range(self.cnt):
            origin = self.pt.Clone()
            T = rg.Transform.Translation(0,0,i*5)
            origin.Transform(T)
            c = rg.Circle(origin,self.r*graph_map[i])
            cls.append(c)
        return cls
    
    def get_pts(self):
        all_pts = []
        for i in self.circles:
            pts = []
            crv = i.ToNurbsCurve(2,5)
            params = crv.DivideByCount(pt_count,True)
            pts = [crv.PointAt(i) for i in params]
            all_pts.append(pts)
        if rotate:
            self.rotate_pts(all_pts)
        if move:
            self.move_pts(all_pts)
        
        return all_pts

    def rotate_pts(self,pts):
        r_step = 0
        for lists, origin in zip(pts, self.circles):
            r_step += (math.pi/2)/self.cnt
            for pt in lists:
                T = rg.Transform.Rotation(r_step,origin.Center)
                pt.Transform(T)
    
    def move_pts(self,pts):
        for lists,origins in zip(pts,self.circles):
            for pt in lists:
                vec = pt-origins.Center
                vec.Unitize()
                T = rg.Transform.Translation(vec * r.uniform(0,7.0))
                pt.Transform(T)
    
    def get_srf(self):
        crvs = []
        for layers in self.pts:
            layers.append(layers[0])
            crv = rg.Curve.CreateInterpolatedCurve(layers,3)
            crvs.append(crv)
        srf = rg.Brep.CreateFromLoft(crvs,rg.Point3d.Unset,rg.Point3d.Unset,rg.LoftType(0),False)
        return srf


s = MySrf(srf_origin, srf_radius, srf_height)

a = s.circles
b = th.list_to_tree(s.pts)
c = s.srf
# ---------- end python ----------
brep = Brep(python.c)
crv = Curve(python.a)
pt_2 = Point(python.b)
cap = CapHoles(Brep=brep)

height = Slider(50, range=0..1000)
layer_thickness = Slider(5, range=0..10)
height_2 = Slider(150, range=0..1000)
layer_thickness_2 = Slider(1, range=0..10)
panel_2 = Panel("C:\Users\josep\OneDrive\Desktop\GIT-HUB_Do-Not-MOVE\T1-Mini-Project_non-Planar-3DP\Repository - Teamwork\3d_printing_teamwork\working_file_joe\material_tests\substructure.py")
number_slider_3 = Slider(20, range=0..20)
height_3 = Slider(50, range=0..1000)
layer_thickness_3 = Slider(2, range=0..10)
division_2 = Division(A=height, B=layer_thickness)
division_3 = Division(A=height, B=layer_thickness)
point = Point(Point(0, 0, 0))
division_4 = Division(A=height_2, B=layer_thickness_2)
division_5 = Division(A=height_2, B=layer_thickness_2)
unit_x = UnitX(Factor=Slider(151, range=0..200))
integer = Integer(division_2)
center_box = CenterBox(Base=point, X=number_slider_3, Y=number_slider_3, Z=Slider(1, range=0..10))
integer_2 = Integer(division_3)
division_6 = Division(A=height_3, B=layer_thickness_3)
division_7 = Division(A=height_3, B=layer_thickness_3)
integer_3 = Integer(division_4)
integer_4 = Integer(division_5)
subtraction = Subtraction(A=integer, B="1")
subtraction_2 = Subtraction(A=integer_2, B="1")
subtraction_3 = Subtraction(A=integer_3, B="1")
subtraction_4 = Subtraction(A=integer_4, B="1")
move = Move(Geometry=center_box, Motion=unit_x)  # -> Geometry, Transform
integer_5 = Integer(division_6)
integer_6 = Integer(division_7)
range_2 = Range(Domain=Domain(0, 1), Steps=subtraction)
range_3 = Range(Domain=Domain(0, 1), Steps=subtraction_2)
multiplication = Multiplication(B=2)
subtraction_5 = Subtraction(A=integer_5, B="1")
range_4 = Range(Domain=Domain(0, 1), Steps=subtraction_4)
subtraction_6 = Subtraction(A=integer_6, B="1")
range_5 = Range(Domain=Domain(0, 1), Steps=subtraction_3)
rotation_angle_per_layer = Slider(0, range=0..20)
divide_interval = Slider(7.68, range=0..10)
pole_length = Slider(10, range=0..20)
pole_count = Slider(6, range=0..200)
pole_radius = Slider(6, range=0..10)
radius = Slider(250, range=0..500)
radius_2 = Slider(28, range=0..100)
pole_count_2 = Slider(6, range=0..10)
pole_width = Slider(10, range=0..20)
graph_mapper = GraphMapper(range_2, x0=0, x1=1, y0=0, y1=1, Ox=0.3564979434, Oy=0.1875684261, Px=0.75, Py=0.25, container_name="Parabola")
graph_mapper_2 = GraphMapper(range_3, x0=0, x1=1, y0=0, y1=1, Ox=0.3564979434, Oy=0.1875684261, Px=0.75, Py=0.25, container_name="Parabola")
range_6 = Range(Domain=Domain(0, 1), Steps=subtraction_5)
range_7 = Range(Domain=Domain(0, 1), Steps=subtraction_6)
geometry = Geometry(move.Geometry)
graph_mapper_3 = GraphMapper(
    reverse(range_4),
    x0=0,
    x1=1,
    y0=0,
    y1=1,
    Ox=0.6962983608,
    Oy=0.1619004011,
    Px=0.9195653796,
    Py=0.1540879011,
    container_name="Parabola")
graph_mapper_4 = GraphMapper(
    range_5,
    x0=0,
    x1=1,
    y0=0,
    y1=1,
    amplitude=0.385215044,
    container_name="Perlin",
    decay=0.09323954582,
    frequency=0.1183966994,
    x_offset=0.5166378021,
    y_offset=0.7477564812)
point_2 = Point(Point(0, 0, 0))
read_file = ReadFile(File=panel_2, PerLineParse=False)  # -> Content
#   port File: Uri of file to read
# ---------- read_file: VB line parser ----------
    action = GH_LineParserAction.Include
    Return line

    'Parse the line and return some data that represents the line.
    'If the line cannot be parsed, you can return Nothing and
    'assign a different action.
    'The default implementation is to just return the line itself.
    'If you return types that implement IGH_Goo, this component
    'will work substantially faster.
# ---------- end read_file ----------

preview = CustomPreview(Geometry=cap, Material=ColourSwatch(SwatchColor=RGBA(84, 189, 200, 178)))

pole_count_3 = Slider(6, range=0..10)
pole_radius_2 = Slider(10, range=0..10)
radius_3 = Slider(29, range=0..100)
read_file_2 = ReadFile(PerLineParse=True)
deconstruct_brep = DeconstructBrep(Brep=[geometry, center_box])  # -> Faces, Edges, Vertices
graph_mapper_5 = GraphMapper(range_7, x0=0, x1=1, y0=0, y1=1, Ox=0.3675364554, Oy=0.3572720885, Px=1, Py=0.3589551449, container_name="Parabola")
point_3 = Point(Point(0, 0, 0))
graph_mapper_6 = GraphMapper(
    range_6,
    x0=0,
    x1=1,
    y0=0,
    y1=1,
    A=0.1145028871,
    B=0.6549122623,
    container_name="Linear",
    Graph_x0=0.252586931,
    Graph_x1=0.8880730271,
    Graph_y0=0.6838341951,
    Graph_y1=0.7565991879)
ghpython_script = GhPythonScript(
    origin_pt=point_2,
    radius=radius_2,
    brep_height=height,
    layer_thickness=layer_thickness,
    pole_count=pole_count_2,
    pole_radius=pole_radius,
    pole_graph=graph_mapper,
    graph_val=graph_mapper_2)  # -> out, poles; inputs origin_pt: Point3d, radius: Int32, pole_count: Int32, pole_graph: list of Int32, graph_val: list
# ---------- ghpython_script: Python ----------
import Rhino.Geometry as rg
import ghpythonlib


layer_cnt = int(brep_height/layer_thickness)
contours = []

for i, value in enumerate(graph_val):
    center_pt = origin_pt + rg.Vector3d(0,0,i*layer_thickness)
    #use the rg.vector to create the world xy origin, but not have it exist relation to the origin
    center_plane = rg.Plane(center_pt, rg.Vector3d.XAxis, rg.Vector3d.YAxis)
    contour = rg.Circle(center_plane, radius*graph_val[i])
    contours.append(contour)

pts= []

for c in contours:
    cont_pts = []
    crv = c.ToNurbsCurve(2,5)
    params = crv.DivideByCount(pole_count, True)
    
    for i in params:
        pt = crv.PointAt(i)
        cont_pts.append(pt)
    pts.append(cont_pts)


poles = []

for i in range(pole_count):
    temp = []
    for j in range(layer_cnt):
        temp.append(pts[j][i])
    pole = rg.Curve.CreateInterpolatedCurve(temp, 3)
    poles.append(pole)
# ---------- end ghpython_script ----------
point_4 = Point(Point(0, 0, 0))
split_list = SplitList(List=deconstruct_brep.Vertices, Index=Slider(4, range=0..10))  # -> ListA, ListB
panel_3 = Panel(graph_mapper_4)
ghpython_script_2 = GhPythonScript()  # -> out, a
# ---------- ghpython_script_2: Python ----------
import Rhino.Geometry as rg

trans1 = rg.Transform.Rotation(

rg.Rectangle3d.Transform(
# ---------- end ghpython_script_2 ----------
ghpython_script_3 = GhPythonScript(
    Code=read_file,
    Origin_pt=point_3,
    Radius=radius,
    Brep_height=height_2,
    Layer_thickness=layer_thickness_2,
    Pole_count=pole_count,
    Pole_width=pole_length,
    Pole_length=pole_width,
    Divide_interval=divide_interval,
    Rot_angle=rotation_angle_per_layer,
    Pole_graph=graph_mapper_4,
    Graph_val=graph_mapper_3)  # -> Out, Pts, Contour_srf, Pole_crv, Contours, Poles
ghpython_script_4 = GhPythonScript(
    origin_pt=point_4,
    radius=radius_3,
    brep_height=height_3,
    layer_thickness=layer_thickness_3,
    pole_count=pole_count_3,
    pole_rad_val=pole_radius_2,
    pole_graph=graph_mapper_6,
    graph_val=graph_mapper_5)  # -> out, poles; inputs origin_pt: Point3d, radius: Int32, pole_count: Int32, pole_graph: list, graph_val: list
# ---------- ghpython_script_4: Python ----------
import Rhino.Geometry as rg
import ghpythonlib


layer_cnt = int(brep_height/layer_thickness)
contours = []

for i, value in enumerate(graph_val):
    center_pt = origin_pt + rg.Vector3d(0,0,i*layer_thickness)
    #use the rg.vector to create the world xy origin, but not have it exist relation to the origin
    center_plane = rg.Plane(center_pt, rg.Vector3d.XAxis, rg.Vector3d.YAxis)
    contour = rg.Circle(center_plane, radius*graph_val[i])
    contours.append(contour)

pts= []

for c in contours:
    cont_pts = []
    crv = c.ToNurbsCurve(2,5)
    params = crv.DivideByCount(pole_count, True)
    
    for i in params:
        pt = crv.PointAt(i)
        cont_pts.append(pt)
    pts.append(cont_pts)


poles = []

for i in range(pole_count):
    temp = []
    for j, value in enumerate(pole_graph):
        pole_center_plane = rg.Plane(pts[j][i], rg.Vector3d.XAxis, rg.Vector3d.YAxis)
        pole_rad= rg.Circle(pole_center_plane, pole_rad_val*(0.5*pole_graph[j])).ToNurbsCurve()
        temp.append(pole_rad)
    poles.append(temp)
# ---------- end ghpython_script_4 ----------
panel_4 = Panel(graph_mapper_5)
ghpython_script_5 = GhPythonScript(x=ghpython_script.poles)  # -> out, a
# ---------- ghpython_script_5: Python ----------
a = x
# ---------- end ghpython_script_5 ----------

# ----
# II. HOW TO SLICE A STRANGE SURFACE
# Option 2 - GH Python
number_slider_4 = Slider(80, range=0..100)
python_2 = GhPythonScript(brep=cap, layer_height="3", count=number_slider_4, shift=Toggle(True), p=Slider(4, range=0..10))  # -> out, slice_crvs, slice_pts, first_pts, safe_pts; inputs brep: Brep, layer_height: Int32, count: Int32, shift: Boolean, p: Int32
# ---------- python_2: Python ----------
"""
MasDfab 22-23
T1 Miniproject
How to slice a strange surface

"""

import Rhino
import Rhino.Geometry as rg
import ghpythonlib.treehelpers as th


# get rhino's zero zolerance constant, which is 2^-32.
zero = Rhino.RhinoMath.ZeroTolerance

def slice_brep(brep, layer_thickness):
    """
    this function will slice the closed brep and return the curves
    brep:   any closed brep
    layer height:   layer height
    """
    # get the min_z, max_z and height
    brep_bounding_box = brep.GetBoundingBox(rg.Plane.WorldXY)

    max_x, max_y, max_z = brep_bounding_box.Max
    min_x, min_y, min_z = brep_bounding_box.Min
    
    # intersect brep with a series of planes 
    slice_crvs = []
    
    height = min_z
    
    for i in range (1000):
        height += layer_thickness
        if height < max_z:
            intersection_plane = rg.Plane(rg.Point3d(0,0, height), rg.Vector3d.XAxis, rg.Vector3d.YAxis)
            intersection_events = rg.Intersect.Intersection.BrepPlane(brep, intersection_plane, zero)
            
            # if intersection is True
            if intersection_events[0]:
                # append the intersection curve into the list
                for crv in intersection_events[1]:
                    slice_crvs.append(crv)
            # if intersection is false, then print this message
            else:
                print "sorry, intersection went wrong"
                
        # if the height has reached the max_z of value of the brep, then break 
        else:
            break
        
    return slice_crvs

def slice_pts(crvs, count):
    """
    this function will divide the sliced curves into points and return them
    
    crvs:   list of sliced curves
    count:  divide the curves by count
    """
    
    pts =  []

    for crv in crvs:
    # iterate through the curves, and check the orientation, if any is counterclockwise - then reverse it
        orientation = crv.ClosedCurveOrientation()
        if (orientation == rg.CurveOrientation.CounterClockwise):
            crv.Reverse()
    
    # divide the curve by count
        params = crv.DivideByCount(count, True)
        layer_pts = []
    
        for p in params:
            pt = crv.PointAt(p)
            layer_pts.append(pt)
        
        pts.append(layer_pts)
        
    # if we need to shift the curve seam
    if shift:
        new_pts = []
        print ("shift")
        k = 0
        for list in pts:
            k += 1
            if k > len(list):
                k = k - len(list)
            list = list[k:] + list[:k]
            new_pts.append(list)
        pts = new_pts
    return pts

def safe_pts (crvs, pts):
    """
    this function will return the first drag point and last safe point = "home position"
    
    crvs:   list of sliced curves
    pts:    nested list of points that curves were divided with
    """
    
    # the first point "dragging" point
    crv = slice_crvs[0]
    pt_zero = slice_pts[0][0].Clone()
    
    t = crv.TangentAt(rg.Curve.ClosestPoint(crv,pt_zero)[0])
    v = rg.Vector3d.CrossProduct(rg.Vector3d.ZAxis,t)
    pt_zero.Transform(rg.Transform.Translation(v*50))
    
    # the last point is the center of curve
    crv_last = slice_crvs[-1]
    b = crv_last.GetBoundingBox(rg.Plane.WorldXY)
    pt_last = b.Center
    pt_last.Transform(rg.Transform.Translation(rg.Vector3d.ZAxis * 50))
    
    return [pt_zero, pt_last]
    pass

# slicing brep and getting slicing crvs out
slice_crvs = slice_brep(brep,layer_height)

# diving the curves into points and getting nested list out
slice_pts = slice_pts(slice_crvs, count)

# getting the point zero and last point
safe_pts = safe_pts(slice_crvs, slice_pts)

## extra steps: extending the list with safe points
#flat_list = [j for i in slice_pts for j in i]
#flat_list.insert(0, safe_pts[0])
#flat_list.append(safe_pts[1])
## extra steps: and slicing for fabrication
#t = 1000
#parts_list = [i for i in flat_list[(p*t):(p*t+t)]]

first_pts = [i[0] for i in slice_pts]
slice_pts = th.list_to_tree(slice_pts)
# ---------- end python_2 ----------
geo = Geometry(python_2.slice_crvs)
pt_3 = Point(python_2.slice_pts)
pt_4 = Point(python_2.first_pts)
pt_5 = Point(python_2.safe_pts)

geometry_2 = Geometry(ghpython_script.poles)
construct_plane = ConstructPlane(Origin=split_list.ListB, XAxis=Vector(1, 0, 0), YAxis=Vector(0, 1, 0))  # -> flatten(Plane)
ghpython_script_6 = GhPythonScript(x=ghpython_script_4.poles)  # -> out, a; same code as ghpython_script_5
panel_5 = Panel(ghpython_script_3.Out)
ghpython_script_7 = GhPythonScript(x=ghpython_script_3.Pts)  # -> out, a; same code as ghpython_script_5
geometry_3 = Geometry(ghpython_script_3.Contour_srf)
geometry_4 = Geometry(ghpython_script_3.Contours)
geometry_5 = Geometry(ghpython_script_3.Pole_crv)
geometry_6 = Geometry(ghpython_script_7.a)
geometry_7 = Geometry(ghpython_script_6.a)
ghpython_script_8 = GhPythonScript(x=ghpython_script_3.Poles)  # -> out, a; same code as ghpython_script_5
plane = Plane(construct_plane)
plane_2 = Plane([PlaneXY(131, -20, 1), PlaneXY(171, -20, 1), PlaneXY(171, 20, 1), PlaneXY(131, 20, 1), PlaneXY(-20, -20, 1), PlaneXY(20, -20, 1), PlaneXY(20, 20, 1), PlaneXY(-20, 20, 1)])
geometry_8 = Geometry(ghpython_script_8.a)
xy = XYPlane(Origin=pt_3)

pln = Plane(xy)
preview_2 = CustomPreview(Geometry=pln, Material=ColourSwatch(SwatchColor=RGBA(84, 189, 200, 178)))

# ---- group: BACK_UP_CONTOURS
height_4 = Slider(150, range=0..1000)
layer_thickness_4 = Slider(1, range=0..10)
division_8 = Division(A=height_4, B=layer_thickness_4)
division_9 = Division(A=height_4, B=layer_thickness_4)
integer_7 = Integer(division_8)
integer_8 = Integer(division_9)
subtraction_7 = Subtraction(A=integer_7, B="1")
subtraction_8 = Subtraction(A=integer_8, B="1")
range_8 = Range(Domain=Domain(0, 1), Steps=subtraction_7)
range_9 = Range(Domain=Domain(0, 1), Steps=subtraction_8)
rotation_angle_per_layer_2 = Slider(1, range=0..20)
pole_radius_3 = Slider(10, range=0..20)
divide_interval_2 = Slider(7.68, range=0..10)
pole_count_4 = Slider(15, range=0..200)
radius_4 = Slider(250, range=0..500)
graph_mapper_7 = GraphMapper(
    reverse(range_9),
    x0=0,
    x1=1,
    y0=0,
    y1=1,
    Ox=0.6962983608,
    Oy=0.1619004011,
    Px=0.8952583671,
    Py=0.1527562141,
    container_name="Parabola")
graph_mapper_8 = GraphMapper(
    range_8,
    x0=0,
    x1=1,
    y0=0,
    y1=1,
    amplitude=0.1659305692,
    container_name="Perlin",
    decay=0.09323954582,
    frequency=0.1183966994,
    x_offset=0.5,
    y_offset=0.5)
point_5 = Point(Point(0, 0, 0))
ghpython_script_9 = GhPythonScript(
    origin_pt=point_5,
    radius=radius_4,
    brep_height=height_4,
    layer_thickness=layer_thickness_4,
    pole_count=pole_count_4,
    pole_rad_val=pole_radius_3,
    divide_interval=divide_interval_2,
    rot_angle=rotation_angle_per_layer_2,
    pole_graph=graph_mapper_8,
    graph_val=graph_mapper_7)  # -> out, pts, contours, poles; inputs origin_pt: Point3d, radius: Int32, pole_count: Int32, rot_angle: Int32, pole_graph: list, graph_val: list
# ---------- ghpython_script_9: Python ----------
import Rhino.Geometry as rg
import ghpythonlib
import math


layer_cnt = int(brep_height/layer_thickness)
contours = []
contour_srf = []

for i, value in enumerate(graph_val):
    center_pt = origin_pt + rg.Vector3d(0,0,i*layer_thickness)
    #use the rg.vector to create the world xy origin, but not have it exist relation to the origin
    center_plane = rg.Plane(center_pt, rg.Vector3d.XAxis, rg.Vector3d.YAxis)
    contour = rg.Circle(center_plane, radius*graph_val[i])
    contour.Rotate(math.radians(i*rot_angle),rg.Vector3d.ZAxis)
    
    contours.append(contour)

pts= []

for c in contours:
    cont_pts = []
    crv = c.ToNurbsCurve(2,5)
    params = crv.DivideByCount(pole_count, True)
    
    for i in params:
        pt = crv.PointAt(i)
        cont_pts.append(pt)
    pts.append(cont_pts)

poles = []

for i in range(pole_count):
    temp = []
    for j, value in enumerate(pole_graph):
        pole_center_plane = rg.Plane(pts[j][i], rg.Vector3d.XAxis, rg.Vector3d.YAxis)
        pole_rad= rg.Circle(pole_center_plane, pole_rad_val*(0.5*pole_graph[j]))
        joe = rg.ArcCurve(pole_rad)
        temp.append(joe)
    pole = rg.Brep.CreateFromLoft(temp, rg.Point3d.Unset,rg.Point3d.Unset,rg.LoftType(1),False)
    poles.append(pole)

# # str_planes = []

# # for circ in poles:
# #     str_pts = []
# #     crv_length = circ.get_length()
# #     count = int(crv_length/divide_interval)
# #     params = circ.DivideByCount(pole_count, True)
# #     for i in params:
# #         pt = circ.PointAt(i)
# #         tan = circ.TangentAt(i)

        
    


# # def divide_crv(crv, divide_interval, endInc):
# #     """
# #     Function to divide a curve by closest integer multiple of length
# #     crv : input curve
# #     divide_interval : desired length of segments
# #     endInc : if you want to include the end point
    
# #     returns : list of points and normals"""
# #     crv_length = crv.GetLength()
# #     count = int(crv_length/divide_interval)
# #     params = crv.DivideByCount(count, endInc)
# #     points = [crv.PointAt(p) for p in params] 
# #     tangents = [crv.TangentAt(p) for p in params]
# #     normals = [rg.Vector3d.CrossProduct(t, rg.Vector3d.ZAxis) for t in tangents]
# #     return points, normals
# ---------- end ghpython_script_9 ----------
geometry_9 = Geometry(ghpython_script_9.contours)
ghpython_script_10 = GhPythonScript(x=ghpython_script_9.pts)  # -> out, a; same code as ghpython_script_5
geometry_10 = Geometry(ghpython_script_10.a)
panel_6 = Panel(ghpython_script_9.out)
ghpython_script_11 = GhPythonScript(x=ghpython_script_9.poles)  # -> out, a; same code as ghpython_script_5
geometry_11 = Geometry(ghpython_script_11.a)

# ---- group: BACK_UP_SRF
height_5 = Slider(150, range=0..1000)
layer_thickness_5 = Slider(1, range=0..10)
division_10 = Division(A=height_5, B=layer_thickness_5)
division_11 = Division(A=height_5, B=layer_thickness_5)
integer_9 = Integer(division_10)
integer_10 = Integer(division_11)
subtraction_9 = Subtraction(A=integer_9, B="1")
subtraction_10 = Subtraction(A=integer_10, B="1")
range_10 = Range(Domain=Domain(0, 1), Steps=subtraction_9)
range_11 = Range(Domain=Domain(0, 1), Steps=subtraction_10)
rotation_angle_per_layer_3 = Slider(2, range=0..20)
pole_radius_4 = Slider(10, range=0..20)
divide_interval_3 = Slider(7.68, range=0..10)
pole_count_5 = Slider(15, range=0..200)
radius_5 = Slider(250, range=0..500)
graph_mapper_9 = GraphMapper(
    reverse(range_11),
    x0=0,
    x1=1,
    y0=0,
    y1=1,
    Ox=0.5527821183,
    Oy=0.04443913698,
    Px=0.8971265554,
    Py=0.118324995,
    container_name="Parabola")
graph_mapper_10 = GraphMapper(
    range_10,
    x0=0,
    x1=1,
    y0=0,
    y1=1,
    amplitude=0.1659305692,
    container_name="Perlin",
    decay=0.09323954582,
    frequency=0.1183966994,
    x_offset=0.5,
    y_offset=0.5)
point_6 = Point(Point(0, 0, 0))
ghpython_script_12 = GhPythonScript(
    origin_pt=point_6,
    radius=radius_5,
    brep_height=height_5,
    layer_thickness=layer_thickness_5,
    pole_count=pole_count_5,
    pole_rad_val=pole_radius_4,
    divide_interval=divide_interval_3,
    rot_angle=rotation_angle_per_layer_3,
    pole_graph=graph_mapper_10,
    graph_val=graph_mapper_9)  # -> out, pts, contour_srf, poles; inputs origin_pt: Point3d, radius: Int32, pole_count: Int32, rot_angle: Int32, pole_graph: list, graph_val: list
# ---------- ghpython_script_12: Python ----------
import Rhino.Geometry as rg
import ghpythonlib
import math


layer_cnt = int(brep_height/layer_thickness)
contours = []
contour_srf = []
contour_arc = []


for i, value in enumerate(graph_val):
    center_pt = origin_pt + rg.Vector3d(0,0,i*layer_thickness)
    #use the rg.vector to create the world xy origin, but not have it exist relation to the origin
    center_plane = rg.Plane(center_pt, rg.Vector3d.XAxis, rg.Vector3d.YAxis)
    contour = rg.Circle(center_plane, radius*graph_val[i])
    contour.Rotate(math.radians(i*rot_angle),rg.Vector3d.ZAxis)
    cont_arc = rg.ArcCurve(contour)
    contour_arc.append(cont_arc)
    contours.append(contour)
contour_srf = rg.Brep.CreateFromLoft(contour_arc, rg.Point3d.Unset,rg.Point3d.Unset,rg.LoftType(1),False)


pts= []

for c in contours:
    cont_pts = []
    crv = c.ToNurbsCurve(2,5)
    
    params = crv.DivideByCount(pole_count, True)
    
    for i in params:
        pt = crv.PointAt(i)
        cont_pts.append(pt)
    pts.append(cont_pts)

poles = []

for i in range(pole_count):
    temp = []
    for j, value in enumerate(pole_graph):
        pole_center_plane = rg.Plane(pts[j][i], rg.Vector3d.XAxis, rg.Vector3d.YAxis)
        pole_rad= rg.Circle(pole_center_plane, pole_rad_val*(0.5*pole_graph[j]))
        joe = rg.ArcCurve(pole_rad)
        temp.append(joe)
    pole = rg.Brep.CreateFromLoft(temp, rg.Point3d.Unset,rg.Point3d.Unset,rg.LoftType(1),False)
    poles.append(pole)

# # str_planes = []

# # for circ in poles:
# #     str_pts = []
# #     crv_length = circ.get_length()
# #     count = int(crv_length/divide_interval)
# #     params = circ.DivideByCount(pole_count, True)
# #     for i in params:
# #         pt = circ.PointAt(i)
# #         tan = circ.TangentAt(i)

        
    


# # def divide_crv(crv, divide_interval, endInc):
# #     """
# #     Function to divide a curve by closest integer multiple of length
# #     crv : input curve
# #     divide_interval : desired length of segments
# #     endInc : if you want to include the end point
    
# #     returns : list of points and normals"""
# #     crv_length = crv.GetLength()
# #     count = int(crv_length/divide_interval)
# #     params = crv.DivideByCount(count, endInc)
# #     points = [crv.PointAt(p) for p in params] 
# #     tangents = [crv.TangentAt(p) for p in params]
# #     normals = [rg.Vector3d.CrossProduct(t, rg.Vector3d.ZAxis) for t in tangents]
# #     return points, normals
# ---------- end ghpython_script_12 ----------
geometry_12 = Geometry(ghpython_script_12.contour_srf)
ghpython_script_13 = GhPythonScript(x=ghpython_script_12.pts)  # -> out, a; same code as ghpython_script_5
geometry_13 = Geometry(ghpython_script_13.a)
panel_7 = Panel(ghpython_script_12.out)
ghpython_script_14 = GhPythonScript(x=ghpython_script_12.poles)  # -> out, a; same code as ghpython_script_5
geometry_14 = Geometry(ghpython_script_14.a)

# ---- group: points_working
height_6 = Slider(150, range=0..1000)
layer_thickness_6 = Slider(2, range=0..10)
division_12 = Division(A=height_6, B=layer_thickness_6)
division_13 = Division(A=height_6, B=layer_thickness_6)
integer_11 = Integer(division_12)
integer_12 = Integer(division_13)
subtraction_11 = Subtraction(A=integer_11, B="1")
subtraction_12 = Subtraction(A=integer_12, B="1")
multiplication_2 = Multiplication(B=2)
range_12 = Range(Domain=Domain(0, 1), Steps=subtraction_12)
range_13 = Range(Domain=Domain(0, 1), Steps=subtraction_11)
rotation_angle_per_layer_4 = Slider(1, range=0..20)
pole_radius_5 = Slider(10, range=0..20)
divide_interval_4 = Slider(7.68, range=0..10)
pole_count_6 = Slider(6, range=0..200)
radius_6 = Slider(250, range=0..500)
graph_mapper_11 = GraphMapper(
    reverse(range_12),
    x0=0,
    x1=1,
    y0=0,
    y1=1,
    Ox=0.5526512265,
    Oy=0.1696148515,
    Px=0.9167356491,
    Py=0.131686151,
    container_name="Parabola")
graph_mapper_12 = GraphMapper(
    range_13,
    x0=0,
    x1=1,
    y0=0,
    y1=1,
    amplitude=0.3315669894,
    container_name="Perlin",
    decay=0.09323954582,
    frequency=0.1907781959,
    x_offset=0.5,
    y_offset=0.5)
point_7 = Point(Point(0, 0, 0))
ghpython_script_15 = GhPythonScript(
    origin_pt=point_7,
    radius=radius_6,
    brep_height=height_6,
    layer_thickness=layer_thickness_6,
    pole_count=pole_count_6,
    pole_rad_val=pole_radius_5,
    divide_interval=divide_interval_4,
    rot_angle=rotation_angle_per_layer_4,
    pole_graph=graph_mapper_12,
    graph_val=graph_mapper_11)  # -> out, pts, contour_srf, edge_pts, contours, poles; inputs origin_pt: Point3d, radius: Int32, pole_count: Int32, rot_angle: Int32, pole_graph: list, graph_val: list
# ---------- ghpython_script_15: Python ----------
import Rhino.Geometry as rg
import ghpythonlib
import math


layer_cnt = int(brep_height/layer_thickness)
contours = []
contour_srf = []
contour_arc = []


for i, value in enumerate(graph_val):
    center_pt = origin_pt + rg.Vector3d(0,0,i*layer_thickness)
    #use the rg.vector to create the world xy origin, but not have it exist relation to the origin
    center_plane = rg.Plane(center_pt, rg.Vector3d.XAxis, rg.Vector3d.YAxis)
    contour = rg.Circle(center_plane, radius*graph_val[i])
    contour.Rotate(math.radians(i*rot_angle),rg.Vector3d.ZAxis)
    cont_arc = rg.ArcCurve(contour)
    contour_arc.append(cont_arc)
    contours.append(contour)
contour_srf = rg.Brep.CreateFromLoft(contour_arc, rg.Point3d.Unset,rg.Point3d.Unset,rg.LoftType(1),False)


pts= []

for c in contours:
    cont_pts = []
    crv = c.ToNurbsCurve(2,5)
    params = crv.DivideByCount(pole_count, True)
    for i in params:
        pt = crv.PointAt(i)
        cont_pts.append(pt)
    pts.append(cont_pts)

poles = []
pole_crvs = []


for i in range(pole_count):
    temp = []
    pole_circ = []
    
    for j, value in enumerate(pole_graph):
        pole_center_plane = rg.Plane(pts[j][i], rg.Vector3d.XAxis, rg.Vector3d.YAxis)
        pole_rad= rg.Circle(pole_center_plane, pole_rad_val*(pole_graph[j]))
        pole_arc = rg.ArcCurve(pole_rad)
        temp.append(pole_arc)
        pole_circ.append(pole_rad)
    pole = rg.Brep.CreateFromLoft(temp, rg.Point3d.Unset,rg.Point3d.Unset,rg.LoftType(1),False)
    pole_crvs.append(pole_circ)
    poles.append(pole)

edge_pts = []

for list in pole_crvs:
    circ_pts = []
    for arc in list:
        crv = arc.ToNurbsCurve(2,5)
        params = crv.DivideByCount(4, True)
        for i in params:
            pt = crv.PointAt(i)
            circ_pts.append(pt)
        edge_pts.append(circ_pts)



# # str_planes = []

# # for circ in poles:
# #     str_pts = []
# #     crv_length = circ.get_length()
# #     count = int(crv_length/divide_interval)
# #     params = circ.DivideByCount(pole_count, True)
# #     for i in params:
# #         pt = circ.PointAt(i)
# #         tan = circ.TangentAt(i)

        
    


# # def divide_crv(crv, divide_interval, endInc):
# #     """
# #     Function to divide a curve by closest integer multiple of length
# #     crv : input curve
# #     divide_interval : desired length of segments
# #     endInc : if you want to include the end point
    
# #     returns : list of points and normals"""
# #     crv_length = crv.GetLength()
# #     count = int(crv_length/divide_interval)
# #     params = crv.DivideByCount(count, endInc)
# #     points = [crv.PointAt(p) for p in params] 
# #     tangents = [crv.TangentAt(p) for p in params]
# #     normals = [rg.Vector3d.CrossProduct(t, rg.Vector3d.ZAxis) for t in tangents]
# #     return points, normals
# ---------- end ghpython_script_15 ----------
panel_8 = Panel(graph_mapper_11)
ghpython_script_16 = GhPythonScript(x=ghpython_script_15.pts)  # -> out, a; same code as ghpython_script_5
ghpython_script_17 = GhPythonScript(x=ghpython_script_15.edge_pts)  # -> out, a; same code as ghpython_script_5
geometry_15 = Geometry(ghpython_script_15.contour_srf)
geometry_16 = Geometry(ghpython_script_15.contours)
panel_9 = Panel(ghpython_script_15.out)
geometry_17 = Geometry(ghpython_script_16.a)
geometry_18 = Geometry(ghpython_script_17.a)
ghpython_script_18 = GhPythonScript(x=ghpython_script_15.poles)  # -> out, a; same code as ghpython_script_5
geometry_19 = Geometry(ghpython_script_18.a)

# ---- group: RECTANGLES-WORKING
height_7 = Slider(150, range=0..1000)
layer_thickness_7 = Slider(2, range=0..10)
division_14 = Division(A=height_7, B=layer_thickness_7)
division_15 = Division(A=height_7, B=layer_thickness_7)
integer_13 = Integer(division_14)
integer_14 = Integer(division_15)
subtraction_13 = Subtraction(A=integer_13, B="1")
subtraction_14 = Subtraction(A=integer_14, B="1")
multiplication_3 = Multiplication(B=2)
range_14 = Range(Domain=Domain(0, 1), Steps=subtraction_14)
range_15 = Range(Domain=Domain(0, 1), Steps=subtraction_13)
rotation_angle_per_layer_5 = Slider(0, range=0..20)
pole_length_2 = Slider(8, range=0..20)
pole_width_2 = Slider(26, range=0..200)
divide_interval_5 = Slider(7.68, range=0..10)
pole_count_7 = Slider(8, range=0..200)
radius_7 = Slider(250, range=0..500)
graph_mapper_13 = GraphMapper(
    reverse(range_14),
    x0=0,
    x1=1,
    y0=0,
    y1=1,
    Ox=0.5724567175,
    Oy=0.09091836214,
    Px=0.9254079461,
    Py=0.152695179,
    container_name="Parabola")
graph_mapper_14 = GraphMapper(
    range_15,
    x0=0,
    x1=1,
    y0=0,
    y1=1,
    amplitude=0.4453125,
    container_name="Perlin",
    decay=0.09323954582,
    frequency=0.1642836332,
    x_offset=0.537877202,
    y_offset=0.5688735247)
point_8 = Point(Point(0, 0, 0))
ghpython_script_19 = GhPythonScript(
    origin_pt=point_8,
    radius=radius_7,
    brep_height=height_7,
    layer_thickness=layer_thickness_7,
    pole_count=pole_count_7,
    pole_length=pole_length_2,
    pole_width=pole_width_2,
    divide_interval=divide_interval_5,
    rot_angle=rotation_angle_per_layer_5,
    pole_graph=graph_mapper_14,
    graph_val=graph_mapper_13)  # -> out, pts, contour_srf, edge_pts, contours, poles; inputs origin_pt: Point3d, radius: Int32, pole_count: Int32, pole_width: Int32, rot_angle: Int32, pole_graph: list, graph_val: list
# ---------- ghpython_script_19: Python ----------
import Rhino.Geometry as rg
import ghpythonlib
import math


layer_cnt = int(brep_height/layer_thickness)
contours = []
contour_srf = []
contour_arc = []


for i, value in enumerate(graph_val):
    center_pt = origin_pt + rg.Vector3d(0,0,i*layer_thickness)
    #use the rg.vector to create the world xy origin, but not have it exist relation to the origin
    center_plane = rg.Plane(center_pt, rg.Vector3d.XAxis, rg.Vector3d.YAxis)
    contour = rg.Circle(center_plane, radius*graph_val[i])
    contour.Rotate(math.radians(i*rot_angle),rg.Vector3d.ZAxis)
    cont_arc = rg.ArcCurve(contour)
    contour_arc.append(cont_arc)
    contours.append(contour)
contour_srf = rg.Brep.CreateFromLoft(contour_arc, rg.Point3d.Unset,rg.Point3d.Unset,rg.LoftType(1),False)


pts= []

for c in contours:
    cont_pts = []
    crv = c.ToNurbsCurve(2,5)
    params = crv.DivideByCount(pole_count, True)
    for i in params:
        pt = crv.PointAt(i)
        tgt = crv.TangentAt(i)
        cont_pts.append(pt)
    pts.append(cont_pts)

poles = []
pole_crvs = []


for i in range(pole_count):
    temp = []
    pole_circ = []
    
    for j, value in enumerate(pole_graph):
        pole_center_plane = rg.Plane(pts[j][i], rg.Vector3d.XAxis, rg.Vector3d.YAxis)
        pole_rect= rg.Rectangle3d(pole_center_plane, pole_length*(pole_graph[j]), pole_width*(pole_graph[j]))
        
        temp.append(pole_rect)
    poles.append(temp)


#
#edge_pts = []
#
#for list in pole_crvs:
#    circ_pts = []
#    for arc in list:
#        crv = arc.ToNurbsCurve(2,5)
#        params = crv.DivideByCount(4, True)
#        for i in params:
#            pt = crv.PointAt(i)
#            circ_pts.append(pt)
#        edge_pts.append(circ_pts)


# # str_planes = []

# # for circ in poles:
# #     str_pts = []
# #     crv_length = circ.get_length()
# #     count = int(crv_length/divide_interval)
# #     params = circ.DivideByCount(pole_count, True)
# #     for i in params:
# #         pt = circ.PointAt(i)
# #         tan = circ.TangentAt(i)

        
    


# # def divide_crv(crv, divide_interval, endInc):
# #     """
# #     Function to divide a curve by closest integer multiple of length
# #     crv : input curve
# #     divide_interval : desired length of segments
# #     endInc : if you want to include the end point
    
# #     returns : list of points and normals"""
# #     crv_length = crv.GetLength()
# #     count = int(crv_length/divide_interval)
# #     params = crv.DivideByCount(count, endInc)
# #     points = [crv.PointAt(p) for p in params] 
# #     tangents = [crv.TangentAt(p) for p in params]
# #     normals = [rg.Vector3d.CrossProduct(t, rg.Vector3d.ZAxis) for t in tangents]
# #     return points, normals
# ---------- end ghpython_script_19 ----------
panel_10 = Panel(graph_mapper_13)
ghpython_script_20 = GhPythonScript(x=ghpython_script_19.pts)  # -> out, a; same code as ghpython_script_5
ghpython_script_21 = GhPythonScript(x=ghpython_script_19.edge_pts)  # -> out, a; same code as ghpython_script_5
geometry_20 = Geometry(ghpython_script_19.contour_srf)
geometry_21 = Geometry(ghpython_script_19.contours)
panel_11 = Panel(ghpython_script_19.out)
geometry_22 = Geometry(ghpython_script_20.a)
geometry_23 = Geometry(ghpython_script_21.a)
ghpython_script_22 = GhPythonScript(x=ghpython_script_19.poles)  # -> out, a; same code as ghpython_script_5
geometry_24 = Geometry(ghpython_script_22.a)

# ---- group: Rectangular+Sweep
height_8 = Slider(150, range=0..1000)
layer_thickness_8 = Slider(1, range=0..10)
division_16 = Division(A=height_8, B=layer_thickness_8)
division_17 = Division(A=height_8, B=layer_thickness_8)
integer_15 = Integer(division_16)
integer_16 = Integer(division_17)
subtraction_15 = Subtraction(A=integer_15, B="1")
subtraction_16 = Subtraction(A=integer_16, B="1")
multiplication_4 = Multiplication(B=2)
range_16 = Range(Domain=Domain(0, 1), Steps=subtraction_16)
range_17 = Range(Domain=Domain(0, 1), Steps=subtraction_15)
rotation_angle_per_layer_6 = Slider(0, range=0..20)
divide_interval_6 = Slider(7.68, range=0..10)
pole_length_3 = Slider(10, range=0..20)
pole_count_8 = Slider(6, range=0..200)
radius_8 = Slider(250, range=0..500)
pole_width_3 = Slider(10, range=0..20)
graph_mapper_15 = GraphMapper(
    reverse(range_16),
    x0=0,
    x1=1,
    y0=0,
    y1=1,
    Ox=0.6962983608,
    Oy=0.1619004011,
    Px=0.8952583671,
    Py=0.1527562141,
    container_name="Parabola")
graph_mapper_16 = GraphMapper(
    range_17,
    x0=0,
    x1=1,
    y0=0,
    y1=1,
    amplitude=0.385215044,
    container_name="Perlin",
    decay=0.09323954582,
    frequency=0.1183966994,
    x_offset=0.5166378021,
    y_offset=0.7477564812)
point_9 = Point(Point(0, 0, 0))
panel_12 = Panel(graph_mapper_16)
ghpython_script_23 = GhPythonScript(
    origin_pt=point_9,
    radius=radius_8,
    brep_height=height_8,
    layer_thickness=layer_thickness_8,
    pole_count=pole_count_8,
    pole_width=pole_length_3,
    pole_length=pole_width_3,
    divide_interval=divide_interval_6,
    rot_angle=rotation_angle_per_layer_6,
    pole_graph=graph_mapper_16,
    graph_val=graph_mapper_15)  # -> out, pts, contour_srf, pole_crv, contours, poles; inputs origin_pt: Point3d, radius: Int32, pole_count: Int32, rot_angle: Int32, pole_graph: list, graph_val: list
# ---------- ghpython_script_23: Python ----------
import Rhino.Geometry as rg
import ghpythonlib
import math


layer_cnt = int(brep_height/layer_thickness)
contours = []
contour_srf = []
contour_arc = []


for i, value in enumerate(graph_val):
    center_pt = origin_pt + rg.Vector3d(0,0,i*layer_thickness)
    #use the rg.vector to create the world xy origin, but not have it exist relation to the origin
    center_plane = rg.Plane(center_pt, rg.Vector3d.XAxis, rg.Vector3d.YAxis)
    contour = rg.Circle(center_plane, radius*graph_val[i])
    contour.Rotate(math.radians(i*rot_angle),rg.Vector3d.ZAxis)
    cont_arc = rg.ArcCurve(contour)
    contour_arc.append(cont_arc)
    contours.append(contour)
contour_srf = rg.Brep.CreateFromLoft(contour_arc, rg.Point3d.Unset,rg.Point3d.Unset,rg.LoftType(1),False)


pts= []
x_axis = []
y_axis = []

for c in contours:
    cont_pts = []
    temp = []
    crv = c.ToNurbsCurve(2,5)
    params = crv.DivideByCount(pole_count, True)
    for i in params:
        pt = crv.PointAt(i)
        vec = rg.Vector3d(c.Center - pt)
        temp.append(vec)
        cont_pts.append(pt)
    y_axis.append(temp)
    pts.append(cont_pts)

poles = []
pole_crvs = []


for i in range(pole_count):
    temp = []
    pole_circ = []
    
    for j, value in enumerate(pole_graph):
        pole_center_plane = rg.Plane(pts[j][i], rg.Vector3d.CrossProduct(rg.Vector3d.ZAxis,y_axis[j][i]), y_axis[j][i])
        pole_rect= rg.Rectangle3d(pole_center_plane, pole_length*(pole_graph[j]), pole_width*(pole_graph[j])).ToNurbsCurve()
        temp.append(pole_rect)
    pole = rg.Brep.CreateFromLoft(temp, rg.Point3d.Unset,rg.Point3d.Unset,rg.LoftType(1),False)
    poles.append(pole)
# ---------- end ghpython_script_23 ----------
panel_13 = Panel(ghpython_script_23.out)
ghpython_script_24 = GhPythonScript(x=ghpython_script_23.pts)  # -> out, a; same code as ghpython_script_5
geometry_25 = Geometry(ghpython_script_23.contour_srf)
geometry_26 = Geometry(ghpython_script_23.contours)
geometry_27 = Geometry(ghpython_script_23.pole_crv)
geometry_28 = Geometry(ghpython_script_24.a)
ghpython_script_25 = GhPythonScript(x=ghpython_script_23.poles)  # -> out, a; same code as ghpython_script_5
geometry_29 = Geometry(ghpython_script_25.a)

# ----
pole_width_4 = Slider(26, range=0..200)

# ---- group: points-working
height_9 = Slider(150, range=0..1000)
layer_thickness_9 = Slider(2, range=0..10)
division_18 = Division(A=height_9, B=layer_thickness_9)
division_19 = Division(A=height_9, B=layer_thickness_9)
integer_17 = Integer(division_18)
integer_18 = Integer(division_19)
subtraction_17 = Subtraction(A=integer_17, B="1")
subtraction_18 = Subtraction(A=integer_18, B="1")
multiplication_5 = Multiplication(B=2)
range_18 = Range(Domain=Domain(0, 1), Steps=subtraction_18)
range_19 = Range(Domain=Domain(0, 1), Steps=subtraction_17)
rotation_angle_per_layer_7 = Slider(1, range=0..20)
pole_length_4 = Slider(8, range=0..20)
divide_interval_7 = Slider(7.68, range=0..10)
pole_count_9 = Slider(8, range=0..200)
radius_9 = Slider(250, range=0..500)
graph_mapper_17 = GraphMapper(
    reverse(range_18),
    x0=0,
    x1=1,
    y0=0,
    y1=1,
    Ox=0.5724567175,
    Oy=0.09091836214,
    Px=0.9254079461,
    Py=0.152695179,
    container_name="Parabola")
graph_mapper_18 = GraphMapper(
    range_19,
    x0=0,
    x1=1,
    y0=0,
    y1=1,
    amplitude=0.4453125,
    container_name="Perlin",
    decay=0.09323954582,
    frequency=0.1642836332,
    x_offset=0.537877202,
    y_offset=0.5688735247)
point_10 = Point(Point(0, 0, 0))
ghpython_script_26 = GhPythonScript(
    origin_pt=point_10,
    radius=radius_9,
    brep_height=height_9,
    layer_thickness=layer_thickness_9,
    pole_count=pole_count_9,
    pole_length=pole_length_4,
    pole_width=pole_width_4,
    divide_interval=divide_interval_7,
    rot_angle=rotation_angle_per_layer_7,
    pole_graph=graph_mapper_18,
    graph_val=graph_mapper_17)  # -> out, pts, contour_srf, edge_pts, contours, poles; inputs origin_pt: Point3d, radius: Int32, pole_count: Int32, pole_width: Int32, rot_angle: Int32, pole_graph: list, graph_val: list; same code as ghpython_script_19
panel_14 = Panel(graph_mapper_17)
ghpython_script_27 = GhPythonScript(x=ghpython_script_26.pts)  # -> out, a; same code as ghpython_script_5
ghpython_script_28 = GhPythonScript(x=ghpython_script_26.edge_pts)  # -> out, a; same code as ghpython_script_5
geometry_30 = Geometry(ghpython_script_26.contour_srf)
geometry_31 = Geometry(ghpython_script_26.contours)
panel_15 = Panel(ghpython_script_26.out)
geometry_32 = Geometry(ghpython_script_27.a)
geometry_33 = Geometry(ghpython_script_28.a)
ghpython_script_29 = GhPythonScript(x=ghpython_script_26.poles)  # -> out, a; same code as ghpython_script_5
geometry_34 = Geometry(ghpython_script_29.a)

# ----
layer_height = Slider(6, range=0..10)
layer_count = Slider(30, range=0..100)
# I. HOW TO MAKE A STRANGE SURFACE
# Option 1 - GH
number_slider_5 = Slider(48, range=0..100)
series = Series(Start=0, Step=layer_height, Count=layer_count)
pt_6 = Point(Point(164.6892655, 178.6723164, 0))
cir = Circle(Plane=pt_6, Radius=number_slider_5)
Z = UnitZ(Factor=series)
div_pt_count = Slider(60, range=0..60)
move_2 = Move(Geometry=cir, Motion=Z)  # -> Geometry, Transform
area = Area(Geometry=move_2.Geometry)  # -> Area, graft(Centroid)
divide = DivideCurve(Curve=move_2.Geometry, Count=div_pt_count, Kinks=False)  # -> Points, Tangents, Parameters

# ---- group: OVERALL SHAPE
radians = Slider(0.36, range=0..2)
pi = Pi(Factor=radians)
dom = ConstructDomain(DomainStart=Slider(0.1, range=0..1), DomainEnd=1)
division_20 = Division(A=pi, B=layer_count)
range_20 = Range(Domain=dom, Steps=expr("x-1", layer_count))
series_2 = Series(Start=0, Step=division_20, Count=layer_count)
graph_2 = GraphMapper(
    range_20,
    x0=0,
    x1=1,
    y0=0,
    y1=1,
    amplitude=0.05347180367,
    container_name="Perlin",
    decay=0.4409280419,
    frequency=0.09208554029,
    x_offset=0.5,
    y_offset=0.5)
rotate = Rotate(Geometry=divide.Points, Angle=graft(series_2), Plane=area.Centroid)  # -> Geometry, Transform
dom_2 = ConstructDomain(DomainStart=0, DomainEnd=Slider(1.6, range=0..10))
remap = RemapNumbers(Value=graph_2, Source=Domain(0, 1), Target=dom_2)  # -> Mapped, Clipped
scale = Scale(Geometry=rotate.Geometry, Center=area.Centroid, Factor=graft(remap.Mapped))  # -> Geometry, Transform

# ---- group: SKIN
start = Slider(0, range=-10..0)
end = Slider(5.4, range=0..10)
seed = Slider(60, range=0..100)
dom_3 = ConstructDomain(DomainStart=start, DomainEnd=end)
lng = ListLength(List=flatten(scale.Geometry))
random = Random(Range=dom_3, Number=lng, Seed=seed)
vec2pt = Vector2Pt(PointA=area.Centroid, PointB=scale.Geometry, Unitize=False)  # -> Vector, Length
partition = PartitionList(List=random, Size=div_pt_count)
unit = UnitVector(Vector=vec2pt.Vector)
multiplication_6 = Multiplication(A=partition, B=unit)

# ----
vdis = VectorDisplay(Anchor=scale.Geometry, Vector=unit)
move_3 = Move(Geometry=scale.Geometry, Motion=multiplication_6)  # -> Geometry, Transform
intcrv = Interpolate(Vertices=move_3.Geometry, Degree=3, Periodic=True, KnotStyle=1)  # -> Curve, Length, Domain
loft = Loft(
    Curves=flatten(intcrv.Curve),
    Options={Adjust=False, Closed=False, LoftEnds=0, LoftSimp=0, LoftType=0, Rebuild=10, Refit=0.01})
cap_2 = CapHoles(Brep=loft)

preview_3 = CustomPreview(Geometry=cap_2, Material=ColourSwatch(SwatchColor=RGBA(55, 19, 151, 178)))

# ---- group: INPUT
# II. HOW TO SLICE A STRANGE SURFACE
# Option 1 - GH
center_points = Point(area.Centroid)
closed_brep = Brep(cap_2)
layer_height_2 = Number("3")
base_point = Point(pt_6)

# ---- group: END POINT
item = ListItem(List=flatten(center_points), Index="-1", Wrap=True)
Z_2 = UnitZ(Factor=Slider(65, range=0..100))
move_4 = Move(Geometry=item, Motion=Z_2)  # -> Geometry, Transform
pt_7 = Point(move_4.Geometry)

# ---- group: SLICE YOUR OBJECT
xy_2 = XYPlane(Origin=base_point)
contour = Contour(Shape=closed_brep, Point=xy_2, Direction=Vector(0, 0, 1), Distance=layer_height_2)

# ---- group: SHIFT SEAM
lng_2 = ListLength(List=flatten(contour))
divide_2 = DivideCurve(Curve=contour, Count=Slider(100, range=0..100), Kinks=False)  # -> Points, Tangents, Parameters
series_3 = Series(Start=0, Step=1, Count=lng_2)
shift = ShiftList(List=divide_2.Points, Shift=graft(series_3), Wrap=True)  # -> simplify(List)
filter = StreamFilter(Gate=Toggle(False), Stream0=divide_2.Points, Stream1=shift)

# ---- group: START POINT
branch = TreeBranch(Tree=simplify(divide_2.Points), Path="0", MaintainPaths=True)
pline = PolyLine(Vertices=branch, Closed=True)
item_2 = ListItem(List=branch, Index=0, Wrap=True)
crv_cp = CurveClosestPoint(Point=item_2, Curve=pline)  # -> Point, Parameter, Distance
eval = EvaluateCurve(Curve=pline, Parameter=crv_cp.Parameter)  # -> Point, Tangent, Angle
Z_3 = UnitZ(Factor=1)
xprod = CrossProduct(VectorA=Z_3, VectorB=eval.Tangent, Unitize=False)  # -> Vector, Length
vdis_2 = VectorDisplay(Anchor=eval.Point, Vector=xprod.Vector)
multiplication_7 = Multiplication(A=xprod.Vector, B=Slider(50, range=0..100))
move_5 = Move(Geometry=eval.Point, Motion=multiplication_7)  # -> Geometry, Transform

# ----
all_points = Point(filter)

# ---- group: INSERT START AND END POINT
panel_16 = Panel("""0
-1""")
ins = InsertItems(List=flatten(all_points), Item=[move_5.Geometry, pt_7], Indices=panel_16, Wrap=True)

# ----
lng_3 = ListLength(List=ins)
final_pts = Point(ins)
panel_17 = Panel(lng_3)

# ---- group: PARTITION PLANES
partition_2 = PartitionList(List=final_pts, Size=Slider(1000, range=0..1000))
branch_2 = TreeBranch(Tree=simplify(partition_2), Path=Slider(0, range=0..5), MaintainPaths=True)

# ----
xy_3 = XYPlane(Origin=branch_2)

pln_2 = Plane(xy_3)
preview_4 = CustomPreview(Geometry=pln_2, Material=ColourSwatch(SwatchColor=RGBA(55, 19, 151, 178)))
