# Grasshopper definition skinPattern.ghx (Grasshopper 1.0.7)

# ---- group: THESE ONES
curve = Curve(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)
point = Point([Point(119.674312, 77.56213517, 0), Point(120.627473, 77.04126758, 0), Point(122.3844983, 77.26420275, 0), Point(123.7894686, 77.02464813, 0), Point(125.4400297, 75.93475168, 0), Point(125.0369134, 74.80780875, 0)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])

# ----
# HERE
geometry = Geometry(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)
geometry_2 = Geometry(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)
geometry_3 = Geometry(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)
geometry_4 = Geometry(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)

# ---- group: INPUT CRV, SRF, PT
curve_2 = Curve(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)
surface = Surface(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)
point_2 = Point(<point referenced from the Rhino model>)

# ----
number_slider = Slider(189, range=0..1000)
division = Division(A=number_slider, B="5")
int = Integer(division)
range = Range(Domain=Domain(0, 1), Steps=expr("x-1", int))
graph = GraphMapper(
    range,
    x0=0,
    x1=1,
    y0=0,
    y1=1,
    amplitude=0.05347180367,
    container_name="Perlin",
    decay=0.4409280419,
    frequency=0.09208554029,
    x_offset=0.5,
    y_offset=0.5)
pt = Point(Point(484.7457627, 178.6723164, 0))
python = GhPythonScript(
    srf_origin=pt,
    srf_radius=Slider(70, range=0..100),
    srf_height=number_slider,
    pt_count=Slider(51, range=0..100),
    rotate=Toggle(True),
    move=Toggle(True),
    graph_map=graph)  # -> out, a, b, c; inputs srf_origin: Point3d, srf_radius: Int32, srf_height: Int32, pt_count: Int32, move: Boolean, graph_map: list
# ---------- python: Python ----------
"""
MasDfab 22-23
T1 Miniproject
How to make a strange surface

"""

import Rhino.Geometry as rg
import math
import random as r
import ghpythonlib.treehelpers as th


class MySrf(object):
    """
    this is a class that will create random patterened surface from a circle and given height
    
    """
    
    def __init__(self,pt,r,height):
        
        self.pt = pt
        self.r = r
        self.cnt = int(height/5) # change the layer height
        
        self.circles = self.get_crvs()
        self.pts = self.get_pts()
        self.srf = self.get_srf()
    
    def get_crvs(self):
        cls = []
        for i in range(self.cnt):
            origin = self.pt.Clone()
            T = rg.Transform.Translation(0,0,i*5)
            origin.Transform(T)
            c = rg.Circle(origin,self.r*graph_map[i])
            cls.append(c)
        return cls
    
    def get_pts(self):
        all_pts = []
        for i in self.circles:
            pts = []
            crv = i.ToNurbsCurve(2,5)
            params = crv.DivideByCount(pt_count,True)
            pts = [crv.PointAt(i) for i in params]
            all_pts.append(pts)
        if rotate:
            self.rotate_pts(all_pts)
        if move:
            self.move_pts(all_pts)
        
        return all_pts

    def rotate_pts(self,pts):
        r_step = 0
        for lists, origin in zip(pts, self.circles):
            r_step += (math.pi/2)/self.cnt
            for pt in lists:
                T = rg.Transform.Rotation(r_step,origin.Center)
                pt.Transform(T)
    
    def move_pts(self,pts):
        for lists,origins in zip(pts,self.circles):
            for pt in lists:
                vec = pt-origins.Center
                vec.Unitize()
                T = rg.Transform.Translation(vec * r.uniform(0,7.0))
                pt.Transform(T)
    
    def get_srf(self):
        crvs = []
        for layers in self.pts:
            layers.append(layers[0])
            crv = rg.Curve.CreateInterpolatedCurve(layers,3)
            crvs.append(crv)
        srf = rg.Brep.CreateFromLoft(crvs,rg.Point3d.Unset,rg.Point3d.Unset,rg.LoftType(0),False)
        return srf


s = MySrf(srf_origin, srf_radius, srf_height)

a = s.circles
b = th.list_to_tree(s.pts)
c = s.srf
# ---------- end python ----------
panel = Panel(graph)
crv = Curve(python.a)
pt_2 = Point(python.b)
brep = Brep(python.c)
cap = CapHoles(Brep=brep)

# ---- group: dummy examples
# Writing a class
# Writing a class
ghpython_script = GhPythonScript()  # -> out, a
# ---------- ghpython_script: Python ----------
import Rhino.Geometry as rg

class Cat(object):
    """
    This is a class of a Cat
    """
    def __init__(self, nam, col):
        self.color = col
        self.name = nam
        self.words = None
        
    def talk(self):
        print "meow"



new_cat = Cat('Joe', 'pink')



other_new_cat = Cat('Eleni' , 'orange')
other_new_cat.talk()
# ---------- end ghpython_script ----------
ghpython_script_2 = GhPythonScript()  # -> out, a
# ---------- ghpython_script_2: Python ----------
import Rhino.Geometry as rg

class PrintPoint(object):
    def __init__(self, pt, pln, vel, ind, extruder_toggle = False, blend_radius = 0.0):
        self.point = pt
        self.plane = pln
        self.velocity = vel
        self.index = ind
        self.toggle = extruder_toggle
        self.blend_radius = blend_radius
        self.wait_time = 0.0
    

class PrintLayer(object):
    
    def __init__(self):
        pass

class PrintEverything(object):
    
    def __init__(self):
        pass

printpt = PrintPoint(rg.Point3d(20,0,0), rg.Plane(rg.Point3d(20,0,0), rg.Vector3d.XAxis, rg.Vector3d.YAxis), 10.0, 0)

#if something is true:
printpt.toggle = True


print printpt.toggle
# ---------- end ghpython_script_2 ----------

# ---- group: WORKING FILE
planes_spacing = Slider(10, range=0..20)
length = Length(Curve=curve_2)
division_2 = Division(A=length, B=planes_spacing)
integer = Integer(division_2)

# ----
curve_3 = Curve(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)

curve_4 = Curve(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)
divide_curve = DivideCurve(Curve=curve_4, Count=20, Kinks=False)  # -> Points, Tangents, Parameters
button = Button()
timer = Timer(Interval=50, TimerInterval=50, Target=c_script)  # disabled
c_script = CSharpScript(zPoints=divide_curve.Points, zReset=button, zRadius="2", zEdge=curve_3, zMaxCounts="1000")  # -> out, zOutPoints; inputs zPoints: list of Point3d, zReset: Boolean, zRadius: Double, zEdge: Curve, zMaxCounts: Int32
# ---------- c_script: C# ----------
    if (zReset)
    { zInteration = 0;}
    zInteration++;
    List<Circle> circles = new List<Circle>();
    List<Point3d> OutPoint = new List<Point3d>();
    for (int iteration = 0; iteration < zInteration ; iteration++)
    {
      List<Vector3d> totalVector = new List<Vector3d>();
      List<double> counts = new List<double>();
      for  (int i = 0 ; i < zPoints.Count ; i++)
      {
        totalVector.Add(new Vector3d (0, 0, 0));
        counts.Add(0);}
      for  (int i = 0 ; i < zPoints.Count ; i++)
        for (int j = i + 1 ;j < zPoints.Count;j++)
        {
          double distance = zPoints[i].DistanceTo(zPoints[j]);
          if (2 * zRadius < distance ) continue;
          else
          {

            Vector3d subVector = zPoints[i] - zPoints[j];
            subVector.Unitize();
            subVector *= 0.5 * (  2 * zRadius - distance);
            totalVector[i] += subVector;
            totalVector[j] -= subVector;
            counts[i] += 1;
            counts[j] += 1;

          }
        }
      for (int k = 0 ; k < zPoints.Count; k++)
        if ( counts[k] != 0)
        {
          if (zEdge.Contains(zPoints[k]) == PointContainment.Inside)
          {Vector3d move = totalVector[k] / counts[k];
            zPoints[k] += move;}

        }
      if (zPoints.Count < zMaxCounts)
      {
        List<int> Indices = new List<int>();

        for (int i = 0 ; i < zPoints.Count - 1;i++)
        {
          if(zPoints[i].DistanceTo(zPoints[i + 1]) > zRadius)
          {Indices.Add(i + 1 + Indices.Count);}
        }
        foreach (int Index in Indices)
        {Point3d addPoint = 0.5 * (zPoints[Index - 1] + zPoints[Index]);
          zPoints.Insert(Index, addPoint);}
      }
    }

    foreach (Point3d point in zPoints)
    {
      OutPoint.Add(point);
    }
    zOutPoints = OutPoint;
# ---------- c_script: C# additional code ----------
  int zInteration = 0;
# ---------- end c_script ----------
panel_2 = Panel(c_script.out)
polyline = PolyLine(Vertices=c_script.zOutPoints, Closed=False)

ghpython_script_3 = GhPythonScript(file_name="skinPattern\skinPattern.py")  # -> path
# ---------- ghpython_script_3: Python ----------
a = ghdoc.Path

path = a.split('3d_printing_teamwork')[0]+r'3d_printing_teamwork\\'+file_name
# ---------- end ghpython_script_3 ----------
read_file = ReadFile(File=ghpython_script_3, PerLineParse=False)
ghpython_script_4 = GhPythonScript(Code=read_file, Points=divide_curve.Points, Reset=button, Radius="2", Edge=curve_3, MaxCounts="1000")  # -> Out, OutPoints
panel_3 = Panel(ghpython_script_4.Out)

# ---- group: PRINT ADJUSTMENT LAYER VALUES
layer_height = Slider(0.25, range=0..5)
layer_nbr = Slider(32, range=0..100)

# ---- group: Layer variation plane adjustment
min_layer_height = Slider(0.5, range=0..10)
max_layer_height = Slider(10, range=0..10)

# ----
min_dist = Slider(0, range=0..500)
max_dist = Slider(100, range=0..2000)

# ---- group: WORKING FILE
panel_4 = Panel("C:\Users\josep\OneDrive\Desktop\GIT-HUB_Do-Not-MOVE\T1-Mini-Project_non-Planar-3DP\Repository - Teamwork\3d_printing_teamwork\working_file_joe\skin_testing\pt_variations.py")
read_file_2 = ReadFile(File=panel_4, PerLineParse=False)  # -> Content
#   port File: Uri of file to read
# ---------- read_file_2: VB line parser ----------
    action = GH_LineParserAction.Include
    Return line

    'Parse the line and return some data that represents the line.
    'If the line cannot be parsed, you can return Nothing and
    'assign a different action.
    'The default implementation is to just return the line itself.
    'If you return types that implement IGH_Goo, this component
    'will work substantially faster.
# ---------- end read_file_2 ----------

# ----
preview = CustomPreview(Geometry=cap, Material=ColourSwatch(SwatchColor=RGBA(84, 189, 200, 178)))

# ---- group: WORKING FILE
ghpython_script_5 = GhPythonScript(
    Code=read_file_2,
    Curve=curve_2,
    Divide_number=integer,
    Srf=surface,
    Flip_vect=Toggle(False),
    Layer_height=layer_height,
    Layer_nbr=layer_nbr,
    Plns_move_pt=point_2,
    Min_layer_height=min_layer_height,
    Max_layer_height=max_layer_height,
    Min_dist=min_dist,
    Max_dist=max_dist)  # -> Out, Pts_divisions, Pts_planes, Moved_planes, Layered_planes
panel_5 = Panel(ghpython_script_5.Out)
geometry_5 = Geometry(ghpython_script_5.Layered_planes)
geometry_6 = Geometry(ghpython_script_5.Moved_planes)
geometry_7 = Geometry(ghpython_script_5.Pts_divisions)
geometry_8 = Geometry(ghpython_script_5.Pts_planes)

# ----
curve_5 = Curve(polyline)

python_2 = GhPythonScript(brep=cap, layer_height="3", count=Slider(80, range=0..100), shift=Toggle(True), p=Slider(4, range=0..10))  # -> out, slice_crvs, slice_pts, first_pts, safe_pts; inputs brep: Brep, layer_height: Int32, count: Int32, shift: Boolean, p: Int32
# ---------- python_2: Python ----------
"""
MasDfab 22-23
T1 Miniproject
How to slice a strange surface

"""

import Rhino
import Rhino.Geometry as rg
import ghpythonlib.treehelpers as th


# get rhino's zero zolerance constant, which is 2^-32.
zero = Rhino.RhinoMath.ZeroTolerance

def slice_brep(brep, layer_thickness):
    """
    this function will slice the closed brep and return the curves
    brep:   any closed brep
    layer height:   layer height
    """
    # get the min_z, max_z and height
    brep_bounding_box = brep.GetBoundingBox(rg.Plane.WorldXY)

    max_x, max_y, max_z = brep_bounding_box.Max
    min_x, min_y, min_z = brep_bounding_box.Min
    
    # intersect brep with a series of planes 
    slice_crvs = []
    
    height = min_z
    
    for i in range (1000):
        height += layer_thickness
        if height < max_z:
            intersection_plane = rg.Plane(rg.Point3d(0,0, height), rg.Vector3d.XAxis, rg.Vector3d.YAxis)
            intersection_events = rg.Intersect.Intersection.BrepPlane(brep, intersection_plane, zero)
            
            # if intersection is True
            if intersection_events[0]:
                # append the intersection curve into the list
                for crv in intersection_events[1]:
                    slice_crvs.append(crv)
            # if intersection is false, then print this message
            else:
                print "sorry, intersection went wrong"
                
        # if the height has reached the max_z of value of the brep, then break 
        else:
            break
        
    return slice_crvs

def slice_pts(crvs, count):
    """
    this function will divide the sliced curves into points and return them
    
    crvs:   list of sliced curves
    count:  divide the curves by count
    """
    
    pts =  []

    for crv in crvs:
    # iterate through the curves, and check the orientation, if any is counterclockwise - then reverse it
        orientation = crv.ClosedCurveOrientation()
        if (orientation == rg.CurveOrientation.CounterClockwise):
            crv.Reverse()
    
    # divide the curve by count
        params = crv.DivideByCount(count, True)
        layer_pts = []
    
        for p in params:
            pt = crv.PointAt(p)
            layer_pts.append(pt)
        
        pts.append(layer_pts)
        
    # if we need to shift the curve seam
    if shift:
        new_pts = []
        print ("shift")
        k = 0
        for list in pts:
            k += 1
            if k > len(list):
                k = k - len(list)
            list = list[k:] + list[:k]
            new_pts.append(list)
        pts = new_pts
    return pts

def safe_pts (crvs, pts):
    """
    this function will return the first drag point and last safe point = "home position"
    
    crvs:   list of sliced curves
    pts:    nested list of points that curves were divided with
    """
    
    # the first point "dragging" point
    crv = slice_crvs[0]
    pt_zero = slice_pts[0][0].Clone()
    
    t = crv.TangentAt(rg.Curve.ClosestPoint(crv,pt_zero)[0])
    v = rg.Vector3d.CrossProduct(rg.Vector3d.ZAxis,t)
    pt_zero.Transform(rg.Transform.Translation(v*50))
    
    # the last point is the center of curve
    crv_last = slice_crvs[-1]
    b = crv_last.GetBoundingBox(rg.Plane.WorldXY)
    pt_last = b.Center
    pt_last.Transform(rg.Transform.Translation(rg.Vector3d.ZAxis * 50))
    
    return [pt_zero, pt_last]
    pass

# slicing brep and getting slicing crvs out
slice_crvs = slice_brep(brep,layer_height)

# diving the curves into points and getting nested list out
slice_pts = slice_pts(slice_crvs, count)

# getting the point zero and last point
safe_pts = safe_pts(slice_crvs, slice_pts)

## extra steps: extending the list with safe points
#flat_list = [j for i in slice_pts for j in i]
#flat_list.insert(0, safe_pts[0])
#flat_list.append(safe_pts[1])
## extra steps: and slicing for fabrication
#t = 1000
#parts_list = [i for i in flat_list[(p*t):(p*t+t)]]

first_pts = [i[0] for i in slice_pts]
slice_pts = th.list_to_tree(slice_pts)
# ---------- end python_2 ----------
geo = Geometry(python_2.slice_crvs)
pt_3 = Point(python_2.slice_pts)
pt_4 = Point(python_2.first_pts)
pt_5 = Point(python_2.safe_pts)

param_viewer = ParamViewer(geometry_6)
panel_6 = Panel(geometry_6)

list_item = ListItem(List=geometry_5, Index=Slider(1000, range=0..1000), Wrap=True)

# ---- group: Old Structure
height = Slider(150, range=0..1000)
layer_thickness = Slider(1, range=0..10)
division_3 = Division(A=height, B=layer_thickness)
division_4 = Division(A=height, B=layer_thickness)
integer_2 = Integer(division_3)
integer_3 = Integer(division_4)
subtraction = Subtraction(A=integer_2, B="1")
subtraction_2 = Subtraction(A=integer_3, B="1")
multiplication = Multiplication(B=2)
range_2 = Range(Domain=Domain(0, 1), Steps=subtraction_2)
range_3 = Range(Domain=Domain(0, 1), Steps=subtraction)
rotation_angle_per_layer = Slider(0, range=0..20)
divide_interval = Slider(7.68, range=0..10)
pole_length = Slider(10, range=0..20)
pole_count = Slider(6, range=0..200)
radius = Slider(250, range=0..500)
pole_width = Slider(10, range=0..20)
graph_mapper = GraphMapper(
    reverse(range_2),
    x0=0,
    x1=1,
    y0=0,
    y1=1,
    Ox=0.6962983608,
    Oy=0.1619004011,
    Px=0.9195653796,
    Py=0.1540879011,
    container_name="Parabola")
graph_mapper_2 = GraphMapper(
    range_3,
    x0=0,
    x1=1,
    y0=0,
    y1=1,
    amplitude=0.385215044,
    container_name="Perlin",
    decay=0.09323954582,
    frequency=0.1183966994,
    x_offset=0.5166378021,
    y_offset=0.7477564812)
point_3 = Point(Point(0, 0, 0))
panel_7 = Panel(graph_mapper_2)
ghpython_script_6 = GhPythonScript()  # -> out, a
# ---------- ghpython_script_6: Python ----------
import Rhino.Geometry as rg

trans1 = rg.Transform.Rotation(

rg.Rectangle3d.Transform(
# ---------- end ghpython_script_6 ----------
ghpython_script_7 = GhPythonScript(
    origin_pt=point_3,
    radius=radius,
    brep_height=height,
    layer_thickness=layer_thickness,
    pole_count=pole_count,
    pole_width=pole_length,
    pole_length=pole_width,
    divide_interval=divide_interval,
    rot_angle=rotation_angle_per_layer,
    pole_graph=graph_mapper_2,
    graph_val=graph_mapper)  # -> out, pts, contour_srf, pole_crv, contours, poles; inputs origin_pt: Point3d, radius: Int32, pole_count: Int32, rot_angle: Int32, pole_graph: list, graph_val: list
# ---------- ghpython_script_7: Python ----------
import Rhino.Geometry as rg
import ghpythonlib
import math


layer_cnt = int(brep_height/layer_thickness)
contours = []
contour_srf = []
contour_arc = []


for i, value in enumerate(graph_val):
    center_pt = origin_pt + rg.Vector3d(0,0,i*layer_thickness)
    #use the rg.vector to create the world xy origin, but not have it exist relation to the origin
    center_plane = rg.Plane(center_pt, rg.Vector3d.XAxis, rg.Vector3d.YAxis)
    contour = rg.Circle(center_plane, radius*graph_val[i])
    contour.Rotate(math.radians(i*rot_angle),rg.Vector3d.ZAxis)
    cont_arc = rg.ArcCurve(contour)
    contour_arc.append(cont_arc)
    contours.append(contour)
contour_srf = rg.Brep.CreateFromLoft(contour_arc, rg.Point3d.Unset,rg.Point3d.Unset,rg.LoftType(1),False)


pts= []
x_axis = []
y_axis = []

for c in contours:
    cont_pts = []
    temp = []
    crv = c.ToNurbsCurve(2,5)
    params = crv.DivideByCount(pole_count, True)
    for i in params:
        pt = crv.PointAt(i)
        vec = rg.Vector3d(c.Center - pt)
        temp.append(vec)
        cont_pts.append(pt)
    y_axis.append(temp)
    pts.append(cont_pts)

poles = []
pole_crvs = []


for i in range(pole_count):
    temp = []
    pole_circ = []
    
    for j, value in enumerate(pole_graph):
        pole_center_plane = rg.Plane(pts[j][i], rg.Vector3d.CrossProduct(rg.Vector3d.ZAxis,y_axis[j][i]), y_axis[j][i])
        pole_rect= rg.Rectangle3d(pole_center_plane, pole_length*(pole_graph[j]), pole_width*(pole_graph[j])).ToNurbsCurve()
        temp.append(pole_rect)
    pole = rg.Brep.CreateFromLoft(temp, rg.Point3d.Unset,rg.Point3d.Unset,rg.LoftType(1),False)
    poles.append(pole)
# ---------- end ghpython_script_7 ----------
panel_8 = Panel(ghpython_script_7.out)
ghpython_script_8 = GhPythonScript(x=ghpython_script_7.pts)  # -> out, a
# ---------- ghpython_script_8: Python ----------
a = x
# ---------- end ghpython_script_8 ----------
geometry_9 = Geometry(ghpython_script_7.contour_srf)
geometry_10 = Geometry(ghpython_script_7.contours)
geometry_11 = Geometry(ghpython_script_7.pole_crv)
geometry_12 = Geometry(ghpython_script_8.a)
ghpython_script_9 = GhPythonScript(x=ghpython_script_7.poles)  # -> out, a; same code as ghpython_script_8
geometry_13 = Geometry(ghpython_script_9.a)

# ----
# I. HOW TO MAKE A STRANGE SURFACE
# Option 2 - GH Python
# II. HOW TO SLICE A STRANGE SURFACE
# Option 2 - GH Python
xy = XYPlane(Origin=pt_3)

pln = Plane(xy)
preview_2 = CustomPreview(Geometry=pln, Material=ColourSwatch(SwatchColor=RGBA(84, 189, 200, 178)))

# ---- group: SAVE-FOR-LATER / WORKING PY
pt_count = Slider(6.36, range=0..20)
curve_6 = Curve(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)
ghpython_script_10 = GhPythonScript(curve=curve_6, divide_interval=pt_count)  # -> out, pts_divisions, pts_planes; inputs curve: list of Curve, divide_interval: Int32
# ---------- ghpython_script_10: Python ----------
import Rhino.Geometry as rg
from ghpythonlib import treehelpers as th
from copy import deepcopy


def get_pts(crv):
    
    all_pts = []
    pt_tangents = []
    pts_planes = []

    for c in curve:
        
        pts = []
        tangents = []
        planes = []

        crv = c.ToNurbsCurve(c.Domain)
        crv_length = c.GetLength()
        count = int(crv_length/divide_interval)
        params = crv.DivideByCount(count,True)
        
        for i in params:
            pt = crv.PointAt(i)
            # tan = crv.TangentAt(i)
            pln = crv.FrameAt(i)
            # pln2 = rg.Plane(pt,(rg.Vector3d.CrossProduct(tan, rg.Vector3d.XAxis)))
            pts.append(pt)
            planes.append(pln)
                    
        all_pts.append(pts)
        pts_planes.append(planes)

    
    return all_pts #, planes


# def offset_layers(pts):

#     layer_pts = []

#     for pt in 

    



pts_divisions = th.list_to_tree(get_pts(curve))
# ---------- end ghpython_script_10 ----------

# ----
ghpython_script_11 = GhPythonScript()  # -> out, plane
# ---------- ghpython_script_11: Python ----------
import Rhino.Geometry as rg
from compas_rhino.conversions import plane_to_compas
from compas_rhino.conversions import  plane_to_rhino

plane = rg.Plane(rg.Point3d(-99.0,-187.5,117.9),rg.Vector3d(-0.7,0.6,0),rg.Vector3d(-0.1,-0.1,0.9))


plane = plane_to_rhino(plane_to_compas(plane))
#print(x.YAxis)
# ---------- end ghpython_script_11 ----------
geometry_14 = Geometry(ghpython_script_11.plane)

# ---- group: INPUT CURVE & SRF
surface_2 = Surface(<surface referenced from the Rhino model>)
curve_7 = Curve(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)

# ---- group: BACKUP_MOVED_PLANES
divide_interval_2 = Slider(8.29, range=0..20)
curve_8 = Curve(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)
length_2 = Length(Curve=curve_8)
division_5 = Division(A=length_2, B=divide_interval_2)
integer_4 = Integer(division_5)
subtraction_3 = Subtraction(A=integer_4, B="2")
range_4 = Range(Domain=Domain(0, 1), Steps=subtraction_3)
layer_nbr_2 = Slider(20, range=0..100)
layer_height_2 = Slider(1, range=0..10)
graph_mapper_3 = GraphMapper(
    range_4,
    x0=0,
    x1=1,
    y0=0,
    y1=1,
    amplitude=0.8730894327,
    container_name="Perlin",
    decay=0.09323954582,
    frequency=0.1183966994,
    x_offset=0.5509497523,
    y_offset=0.5797137618)
panel_9 = Panel(graph_mapper_3)
ghpython_script_12 = GhPythonScript(curve=curve_8, divide_number=integer_4, layer_nbr=layer_nbr_2, layer_height=layer_height_2, plns_graph=graph_mapper_3)  # -> out, pts_divisions, pts_planes, moved_planes; inputs curve: Curve, layer_nbr: Int32, plns_graph: list
# ---------- ghpython_script_12: Python ----------
import Rhino.Geometry as rg
import random as r
from ghpythonlib import treehelpers as th

def OrientPlane(plane, guide):
    yPt = plane.Origin + rg.Vector3d(0,0,1)
    project = rg.Transform.ProjectAlong(plane,plane.ZAxis)
    yPt.Transform(project)
    yAxis = rg.Vector3d(yPt-plane.Origin)
    
    zAxis = plane.ZAxis
    if zAxis*guide <0: zAxis = -zAxis

    outPlane = rg.Plane(plane.Origin,-rg.Vector3d.CrossProduct(zAxis,yAxis), yAxis)
    return outPlane

def get_pts(crv):
    
    all_pts = []
        
    crv = curve.ToNurbsCurve(curve.Domain)
    params = crv.DivideByCount(divide_number,True)
    
    for i in params:
        pt = crv.PointAt(i)
        all_pts.append(pt)
 
    return all_pts


def make_planes (plns):

    pts_planes = []

    for j in range(1, len(plns)-1):
        plane = rg.Plane(plns[j], plns[j-1], plns[j+1])
        new_plane = OrientPlane(plane, rg.Vector3d(1,0,0))
        pts_planes.append(new_plane)
    
    return pts_planes
    

def move_planes(plns, plns_graph):

    moved_plns = []
      
    for k, value in enumerate(plns_graph):
        origin = plns[k].Clone()
        trans1 = rg.Transform.Translation(rg.Vector3d(0,0,plns_graph[k]))
        origin.Transform(trans1)
        moved_plns.append(origin)
   
    return moved_plns



pts_divisions = (get_pts(curve))
pts_planes = make_planes(pts_divisions)
moved_planes = move_planes(pts_planes, plns_graph)



    # def get_crvs(self):
    #     cls = []
    #     for i in range(self.cnt):
    #         origin = self.pt.Clone()
    #         T = rg.Transform.Translation(0,0,i*5)
    #         origin.Transform(T)
    #         c = rg.Circle(origin,self.r*graph_map[i])
    #         cls.append(c)
    #     return cls
# ---------- end ghpython_script_12 ----------
geometry_15 = Geometry(ghpython_script_12.pts_divisions)
geometry_16 = Geometry(ghpython_script_12.pts_planes)
panel_10 = Panel(ghpython_script_12.out)
panel_11 = Panel(geometry_15)

# ---- group: INPUT CURVE
curve_9 = Curve(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)

# ---- group: INPUT CRV, SRF, PT
surface_3 = Surface(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)
point_4 = Point(<point referenced from the Rhino model>)
curve_10 = Curve(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)

# ---- group: INPUT CURVE
surface_4 = Surface(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)
curve_11 = Curve(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)

# ----
flip_curve = FlipCurve(Curve=curve_11)  # -> Curve, Flag

# ---- group: SAVE-FOR-LATER
panel_12 = Panel(ghpython_script_10.out)
geometry_17 = Geometry(ghpython_script_10.pts_divisions)

# ----
layer_height_3 = Slider(1, range=0..10)

# ---- group: SAVE FOR LATER
curve_12 = Curve(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)
length_3 = Length(Curve=curve_12)
divide_interval_3 = Slider(9.31, range=0..20)
division_6 = Division(A=length_3, B=divide_interval_3)
integer_5 = Integer(division_6)
subtraction_4 = Subtraction(A=integer_5, B="1")
range_5 = Range(Domain=Domain(0, 1), Steps=subtraction_4)
layer_nbr_3 = Slider(20, range=0..100)
graph_mapper_4 = GraphMapper(
    range_5,
    x0=0,
    x1=1,
    y0=0,
    y1=1,
    amplitude=0.8730894327,
    container_name="Perlin",
    decay=0.09323954582,
    frequency=0.1183966994,
    x_offset=0.5509497523,
    y_offset=0.5797137618)
ghpython_script_13 = GhPythonScript(
    curve=curve_12,
    divide_interval=divide_interval_3,
    layer_nbr=layer_nbr_3,
    layer_height=layer_height_3,
    pts_graph=graph_mapper_4)  # -> out, pts_divisions, pts_planes; inputs curve: list of Curve, layer_nbr: Int32, pts_graph: list
# ---------- ghpython_script_13: Python ----------
import Rhino.Geometry as rg
from ghpythonlib import treehelpers as th

def get_pts(crv):
    
    all_pts = []
    # pt_tangents = []
    pts_planes = []

    for c in curve:
        
        pts = []
        tangents = []
        planes = []
        
        crv_length = c.GetLength()
        count = int(crv_length/divide_interval)
        crv = c.ToNurbsCurve(c.Domain)
        params = crv.DivideByCount(count,True)
        
        for i in params:
            pt = crv.PointAt(i)
            # tan = crv.TangentAt(i)
            pln = crv.FrameAt(i)
            # pln2 = rg.Plane(pt,(rg.Vector3d.CrossProduct(tan, rg.Vector3d.XAxis)))
            pts.append(pt)
            planes.append(pln)
                    
        all_pts.append(pts)
        pts_planes.append(planes)

    
    return all_pts #, planes


# def offset_layers(pts):

#     layer_pts = []

#     layerd_pts = []

#     for i in range(layer_nbr):
#         temp = []
#         pole_circ = []
        
#         for j, value in enumerate(pt_graph):
#             pole_center_plane = rg.Plane(pts[j][i], rg.Vector3d.CrossProduct(rg.Vector3d.ZAxis,y_axis[j][i]), y_axis[j][i])
#             pole_rect= rg.Rectangle3d(pole_center_plane, pole_length*(pole_graph[j]), pole_width*(pole_graph[j])).ToNurbsCurve()
#             temp.append(pole_rect)
#         pole = rg.Brep.CreateFromLoft(temp, rg.Point3d.Unset,rg.Point3d.Unset,rg.LoftType(1),False)
#         poles.append(pole)

pts_divisions = th.list_to_tree(get_pts(curve))
# ---------- end ghpython_script_13 ----------

# ---- group: REMAPPING HEIGHTS WORKING
planes_spacing_2 = Slider(4.5, range=0..20)
length_4 = Length(Curve=curve_10)
division_7 = Division(A=length_4, B=planes_spacing_2)
integer_6 = Integer(division_7)

# ----
layer_height_4 = Slider(1, range=0..10)

# ---- group: WORKING PY_BACK-UP
curve_13 = Curve(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)
length_5 = Length(Curve=curve_13)
divide_interval_4 = Slider(9.31, range=0..20)
division_8 = Division(A=length_5, B=divide_interval_4)
integer_7 = Integer(division_8)
subtraction_5 = Subtraction(A=integer_7, B="1")
range_6 = Range(Domain=Domain(0, 1), Steps=subtraction_5)
layer_nbr_4 = Slider(20, range=0..100)
graph_mapper_5 = GraphMapper(
    range_6,
    x0=0,
    x1=1,
    y0=0,
    y1=1,
    amplitude=0.8730894327,
    container_name="Perlin",
    decay=0.09323954582,
    frequency=0.1183966994,
    x_offset=0.5509497523,
    y_offset=0.5797137618)
ghpython_script_14 = GhPythonScript(
    curve=curve_13,
    divide_interval=divide_interval_4,
    layer_nbr=layer_nbr_4,
    layer_height=layer_height_4,
    pts_graph=graph_mapper_5)  # -> out, pts_divisions, pts_planes; inputs curve: Curve, layer_nbr: Int32, pts_graph: list
# ---------- ghpython_script_14: Python ----------
import Rhino.Geometry as rg
from ghpythonlib import treehelpers as th

def OrientPlane(plane, guide):
    yPt = plane.Origin + rg.Vector3d(0,0,1)
    project = rg.Transform.ProjectAlong(plane,plane.ZAxis)
    yPt.Transform(project)
    yAxis = rg.Vector3d(yPt-plane.Origin)
    
    zAxis = plane.ZAxis
    if zAxis*guide <0: zAxis = -zAxis

    outPlane = rg.Plane(plane.Origin,-rg.Vector3d.CrossProduct(zAxis,yAxis), yAxis)
    return outPlane

def get_pts(crv):
    
    all_pts = []
        
    crv_length = curve.GetLength()
    count = int(crv_length/divide_interval)
    crv = curve.ToNurbsCurve(curve.Domain)
    params = crv.DivideByCount(count,True)
    
    for i in params:
        pt = crv.PointAt(i)
        # new_pln = rg.Plane(pln.Origin, pln.XAxis, pln.ZAxis)
        # new_pln = OrientPlane(new_pln, rg.Vector3d(0,1,0))
        # print (type(pln))
        all_pts.append(pt)
        # planes.append(new_pln)
            
    return all_pts


def make_planes (plns):

    pts_planes = []

    for j in range(1, len(plns)-1):
        plane = rg.Plane(plns[j], plns[j-1], plns[j+1])
        new_plane = OrientPlane(plane, rg.Vector3d(0,1,0))
        pts_planes.append(new_plane)
    
    return pts_planes
    

# def offset_layers(pts):

#     layerd_pts = []

#     for i in range(layer_nbr):
#         temp = []
#         pole_circ = []
        
#         for j, value in enumerate(pt_graph):
#             pole_center_plane = rg.Plane(pts[j][i], rg.Vector3d.CrossProduct(rg.Vector3d.ZAxis,y_axis[j][i]), y_axis[j][i])
#             temp.append(pole_rect)
#         pole = rg.Brep.CreateFromLoft(temp, rg.Point3d.Unset,rg.Point3d.Unset,rg.LoftType(1),False)
#         poles.append(pole)

pts_divisions = (get_pts(curve))
pts_planes = make_planes(pts_divisions)
# ---------- end ghpython_script_14 ----------

# ---- group: BACK_UP
construct_domain = ConstructDomain(DomainStart="0.5", DomainEnd="2.0")

planes_spacing_3 = Slider(4.5, range=0..20)
length_6 = Length(Curve=curve_7)
division_9 = Division(A=length_6, B=planes_spacing_3)
integer_8 = Integer(division_9)
subtraction_6 = Subtraction(A=integer_8, B="2")
range_7 = Range(Domain=construct_domain, Steps=subtraction_6)
graph_mapper_6 = GraphMapper(
    range_7,
    x0=0,
    x1=1,
    y0=0,
    y1=1,
    amplitude=0.9223706722,
    container_name="Perlin",
    decay=0,
    frequency=0.1949728131,
    x_offset=0.5762771368,
    y_offset=0.5503503084)
panel_13 = Panel(graph_mapper_6)

# ---- group: PLANES WORKING FILE
construct_domain_2 = ConstructDomain(DomainStart="0.5", DomainEnd="1.5")

planes_spacing_4 = Slider(8.29, range=0..20)
length_7 = Length(Curve=curve_9)
division_10 = Division(A=length_7, B=planes_spacing_4)
integer_9 = Integer(division_10)
subtraction_7 = Subtraction(A=integer_9, B="2")
range_8 = Range(Domain=construct_domain_2, Steps=subtraction_7)
graph_mapper_7 = GraphMapper(
    range_8,
    x0=0,
    x1=1,
    y0=0,
    y1=1,
    amplitude=0.9223706722,
    container_name="Perlin",
    decay=0,
    frequency=0.1182109118,
    x_offset=0.5655071139,
    y_offset=0.5709080696)
panel_14 = Panel(graph_mapper_7)

# ----
panel_15 = Panel(graph_mapper_4)
panel_16 = Panel(graph_mapper_5)

# ---- group: reversed_surface_PRINT-READY
construct_domain_3 = ConstructDomain(DomainStart="0.5", DomainEnd="1.5")

planes_spacing_5 = Slider(4.5, range=0..20)
length_8 = Length(Curve=curve_11)
division_11 = Division(A=length_8, B=planes_spacing_5)
integer_10 = Integer(division_11)
subtraction_8 = Subtraction(A=integer_10, B="1")
range_9 = Range(Domain=construct_domain_3, Steps=subtraction_8)
graph_mapper_8 = GraphMapper(
    range_9,
    x0=0.5,
    x1=1.5,
    y0=0.5,
    y1=1.5,
    Ox=0.4930526018,
    Oy=0.9945715666,
    Px=0.9300307035,
    Py=0.226708591,
    container_name="Parabola")
panel_17 = Panel(graph_mapper_8)

# ---- group: BACK_UP / PRINT LAYER VALUES
layer_nbr_5 = Slider(5, range=0..100)
layer_height_5 = Slider(1, range=0..10)

# ---- group: PRINT ADJUSTMENT LAYER VALUES
layer_height_6 = Slider(0.25, range=0..5)
layer_nbr_6 = Slider(3, range=0..100)

# ---- group: Layer variation plane adjustment
min_layer_height_2 = Slider(0.5, range=0..10)
max_layer_height_2 = Slider(1.5, range=0..10)

# ----
min_dist_2 = Slider(100, range=0..500)
max_dist_2 = Slider(2000, range=0..2000)

# ---- group: PLANES WORKING FILE / PRINT LAYER VALUES
layer_nbr_7 = Slider(6, range=0..100)
layer_height_7 = Slider(3.52, range=0..10)

# ----
geometry_18 = Geometry(ghpython_script_13.pts_divisions)
panel_18 = Panel(ghpython_script_13.out)
geometry_19 = Geometry(ghpython_script_14.pts_planes)
geometry_20 = Geometry(ghpython_script_14.pts_divisions)
panel_19 = Panel(ghpython_script_14.out)
panel_20 = Panel(geometry_18)
panel_21 = Panel(geometry_20)

# ---- group: reversed_surface_PRINT-READY / PRINT LAYER VALUES
layer_nbr_8 = Slider(13, range=0..100)

# ---- group: BACK_UP
ghpython_script_15 = GhPythonScript(
    curve=curve_7,
    divide_number=integer_8,
    srf=surface_2,
    layer_nbr=layer_nbr_5,
    layer_height=layer_height_5,
    plns_graph=graph_mapper_6)  # -> out, pts_divisions, pts_planes, moved_planes, layered_planes; inputs curve: Curve, srf: Surface, layer_nbr: Int32, plns_graph: list
# ---------- ghpython_script_15: Python ----------
import Rhino.Geometry as rg
import random as r
import ghpythonlib as ghc
from ghpythonlib import treehelpers as th
from copy import deepcopy

def OrientPlane(plane, guide):
    yPt = plane.Origin + rg.Vector3d(0,0,1)
    project = rg.Transform.ProjectAlong(plane,plane.ZAxis)
    yPt.Transform(project)
    yAxis = rg.Vector3d(yPt-plane.Origin)
    
    zAxis = plane.ZAxis
    if zAxis*guide <0: zAxis = -zAxis

    outPlane = rg.Plane(plane.Origin,-rg.Vector3d.CrossProduct(zAxis,yAxis), yAxis)
    return outPlane

def get_pts(crv):
    
    all_pts = []
        
    crv = curve.ToNurbsCurve(curve.Domain)
    params = crv.DivideByCount(divide_number,True)
    
    for i in params:
        pt = crv.PointAt(i)
        all_pts.append(pt)
 
    return all_pts


def make_planes (pts):

    pts_planes = []
    
    for pt in pts:
        point, uv_pt, distance = ghc.components.SurfaceClosestPoint(pt,srf)
        pnt, normal, u, v, f = ghc.components.EvaluateSurface(srf, uv_pt)
        plane = rg.Plane(pt, rg.Vector3d(normal))
        pts_planes.append(plane)

    
    ####################################################################
    
    # for j in range(1, len(plns)-1):
    #     plane = rg.Plane(plns[j], plns[j-1], plns[j+1])
    #     new_plane = OrientPlane(plane, rg.Vector3d(1,0,0))
    #     pts_planes.append(new_plane)
    
    return pts_planes
    

def move_planes(plns, plns_graph):

    moved_plns = []
      
    for k, value in enumerate(plns_graph):
        origin = plns[k].Clone()
        trans1 = rg.Transform.Translation(rg.Vector3d(0,plns_graph[k],0))
        origin.Transform(trans1)
        moved_plns.append(origin)
   
    return moved_plns

def make_layered_planes (plns):

    layered_planes = [plns]
    
    for l in range(layer_nbr):
        temp = []
        for p in layered_planes[l]:
            layer_1 = deepcopy(p)
            trans2 = rg.Transform.Translation(rg.Vector3d(0,layer_height,0))
            layer_1.Transform(trans2)
            temp.append(layer_1)
        
        temp.reverse()
        
        
        layered_planes.append(temp)

    return layered_planes


pts_divisions = (get_pts(curve))
pts_planes = make_planes(pts_divisions)
moved_planes = move_planes(pts_planes, plns_graph)
layered_planes = th.list_to_tree(make_layered_planes (moved_planes))


    # def get_crvs(self):
    #     cls = []
    #     for i in range(self.cnt):
    #         origin = self.pt.Clone()
    #         T = rg.Transform.Translation(0,0,i*5)
    #         origin.Transform(T)
    #         c = rg.Circle(origin,self.r*graph_map[i])
    #         cls.append(c)
    #     return cls



    # def make_layered_planes (plns):

    # layered_planes = []

    # for list in range(layer_nbr):
    #     temp = []
        
    #     for m in list:
    #         layer_1 = deepcopy(plns[l])
    #         trans2 = rg.Transform.Translation(rg.Vector3d(0,layer_height,0))
    #         layer_1.Transform(trans2)
    #         temp.append(layer_1)
        
    #     layered_planes.append(temp)

    # return layered_planes
# ---------- end ghpython_script_15 ----------
panel_22 = Panel(ghpython_script_15.out)
geometry_21 = Geometry(ghpython_script_15.pts_divisions)
geometry_22 = Geometry(ghpython_script_15.pts_planes)
geometry_23 = Geometry(ghpython_script_15.moved_planes)
geometry_24 = Geometry(ghpython_script_15.layered_planes)

# ---- group: PLANES WORKING FILE
ghpython_script_16 = GhPythonScript(curve=curve_9, divide_number=integer_9, layer_nbr=layer_nbr_7, layer_height=layer_height_7, plns_graph=graph_mapper_7)  # -> out, pts_divisions, pts_planes, moved_planes, layered_planes; inputs curve: Curve, layer_nbr: Int32, plns_graph: list
# ---------- ghpython_script_16: Python ----------
import Rhino.Geometry as rg
import random as r
from ghpythonlib import treehelpers as th
from copy import deepcopy

def OrientPlane(plane, guide):
    yPt = plane.Origin + rg.Vector3d(0,0,1)
    project = rg.Transform.ProjectAlong(plane,plane.ZAxis)
    yPt.Transform(project)
    yAxis = rg.Vector3d(yPt-plane.Origin)
    
    zAxis = plane.ZAxis
    if zAxis*guide <0: zAxis = -zAxis

    outPlane = rg.Plane(plane.Origin,-rg.Vector3d.CrossProduct(zAxis,yAxis), yAxis)
    return outPlane

def get_pts(crv):
    
    all_pts = []
        
    crv = curve.ToNurbsCurve(curve.Domain)
    params = crv.DivideByCount(divide_number,True)
    
    for i in params:
        pt = crv.PointAt(i)
        all_pts.append(pt)
 
    return all_pts


def make_planes (plns):

    pts_planes = []

    for j in range(1, len(plns)-1):
        plane = rg.Plane(plns[j], plns[j-1], plns[j+1])
        new_plane = OrientPlane(plane, rg.Vector3d(1,0,0))
        pts_planes.append(new_plane)
    
    return pts_planes
    

def move_planes(plns, plns_graph):

    moved_plns = []
      
    for k, value in enumerate(plns_graph):
        origin = plns[k].Clone()
        trans1 = rg.Transform.Translation(rg.Vector3d(0,plns_graph[k],0))
        origin.Transform(trans1)
        moved_plns.append(origin)
   
    return moved_plns

def make_layered_planes (plns):

    layered_planes = [plns]
    flip = True

    for l in range(layer_nbr):
        temp = []
        for p in layered_planes[l]:
            layer_1 = deepcopy(p)
            trans2 = rg.Transform.Translation(rg.Vector3d(0,layer_height,0))
            layer_1.Transform(trans2)
            temp.append(layer_1)
        if flip:
            temp.reverse
        flip = not flip
        layered_planes.append(temp)

    return layered_planes


pts_divisions = (get_pts(curve))
pts_planes = make_planes(pts_divisions)
moved_planes = move_planes(pts_planes, plns_graph)
layered_planes = th.list_to_tree(make_layered_planes (moved_planes))


    # def get_crvs(self):
    #     cls = []
    #     for i in range(self.cnt):
    #         origin = self.pt.Clone()
    #         T = rg.Transform.Translation(0,0,i*5)
    #         origin.Transform(T)
    #         c = rg.Circle(origin,self.r*graph_map[i])
    #         cls.append(c)
    #     return cls



    # def make_layered_planes (plns):

    # layered_planes = []

    # for list in range(layer_nbr):
    #     temp = []
        
    #     for m in list:
    #         layer_1 = deepcopy(plns[l])
    #         trans2 = rg.Transform.Translation(rg.Vector3d(0,layer_height,0))
    #         layer_1.Transform(trans2)
    #         temp.append(layer_1)
        
    #     layered_planes.append(temp)

    # return layered_planes
# ---------- end ghpython_script_16 ----------
panel_23 = Panel(ghpython_script_16.out)
geometry_25 = Geometry(ghpython_script_16.pts_divisions)
geometry_26 = Geometry(ghpython_script_16.pts_planes)
geometry_27 = Geometry(ghpython_script_16.moved_planes)
geometry_28 = Geometry(ghpython_script_16.layered_planes)

# ----
geometry_29 = Geometry(ghpython_script_12.moved_planes)
panel_24 = Panel(ghpython_script_12.moved_planes)

# ---- group: REMAPPING HEIGHTS WORKING
ghpython_script_17 = GhPythonScript(
    curve=curve_10,
    divide_number=integer_6,
    srf=surface_3,
    flip_vect=Toggle(False),
    layer_height=layer_height_6,
    layer_nbr=layer_nbr_6,
    plns_move_pt=point_4,
    min_layer_height=min_layer_height_2,
    max_layer_height=max_layer_height_2,
    min_dist=min_dist_2,
    max_dist=max_dist_2)  # -> out, pts_divisions, pts_planes, moved_planes, layered_planes; inputs curve: Curve, srf: Surface, layer_nbr: Int32, plns_move_pt: Point3d, min_dist: Int32, max_dist: Int32
# ---------- ghpython_script_17: Python ----------
import Rhino.Geometry as rg
import random as r
import ghpythonlib as ghc
from ghpythonlib import treehelpers as th
from copy import deepcopy
import math


def OrientPlane(plane, guide):
    yPt = plane.Origin + rg.Vector3d(0, 0, 1)
    project = rg.Transform.ProjectAlong(plane, plane.ZAxis)
    yPt.Transform(project)
    yAxis = rg.Vector3d(yPt-plane.Origin)

    zAxis = plane.ZAxis
    if zAxis*guide < 0:
        zAxis = -zAxis

    outPlane = rg.Plane(
        plane.Origin, -rg.Vector3d.CrossProduct(zAxis, yAxis), yAxis)
    return outPlane

def Remap(value, min, max, new_min, new_max):
    
    old_range = max - min
    new_range = new_max - new_min
    
    return (((value - min)* new_range)/ old_range) + new_min

def get_pts(crv):

    all_pts = []

    crv = curve.ToNurbsCurve(curve.Domain)
    # params = crv.DivideByCount(divide_number, True)

    params = crv.DivideByCount(10, True)
    # print(len(params))

    for i in params:
        pt = crv.PointAt(i)
        all_pts.append(pt)

    return all_pts


def make_planes(pts):

    pts_planes = []

    for k, pt in enumerate(pts):
        point, uv_pt, distance = ghc.components.SurfaceClosestPoint(pt, srf)
        pnt, normal, u, v, f = ghc.components.EvaluateSurface(srf, uv_pt)
        plane = rg.Plane(pt, rg.Vector3d(u), rg.Vector3d(v))
        rg.Plane.Rotate(plane, math.radians(-90), plane.ZAxis, plane.Origin)

        # halfLength = len(pts)/2
        # rotation2 = rg.Transform.Rotation((((abs(halfLength-k))/halfLength)*-math.pi*0.5), plane.Normal, plane.Origin)
        # rotation2 = rg.Transform.Rotation(((len(pts)-k)*math.pi/len(pts) + -math.pi*0.5), plane.Normal, plane.Origin)
        # plane.Transform(rotation2)
        pts_planes.append(plane)
    return pts_planes


def move_planes(plns, pt, min_layer_height, max_layer_height):

    # for pln in plns:
    #     if pt.DistanceTo(pln.origin) < min_dist:
    #         min_dist = 
    #     elif pt.DistanceTo(pln.origin) < max_dist: 
    #         max_dist = 

    heights = []

    for pln in plns:
        heights.append(Remap(pt.DistanceTo(pln.Origin), min_dist, max_dist, max_layer_height, min_layer_height))

    print (heights)

    moved_plns = []

    for k, value in enumerate(heights):
        origin = plns[k].Clone()
        trans1 = rg.Transform.Translation(
            rg.Vector3d(plns[k].ZAxis*heights[k]))
        origin.Transform(trans1)
        moved_plns.append(origin)

    print (heights)

    return moved_plns


def make_layered_planes(plns):

    
    if flip_vect:
        for i in range(len(plns)):
            plns[i] = rg.Plane(
                plns[i].Origin, -plns[i].XAxis, plns[i].YAxis)
        # print (new_layer_height)
        # new_layer_height = -new_layer_height
        # print (new_layer_height)
    layered_planes = [plns]

    for l in range(layer_nbr):
        temp = []
        for i, p in enumerate(layered_planes[l]):
            layer_1 = deepcopy(p)
            trans2 = rg.Transform.Translation(
                rg.Vector3d(p.Normal*layer_height))
            layer_1.Transform(trans2)
            temp.append(layer_1)

        temp.reverse()
        layered_planes.append(temp)

    return layered_planes

# print(layer_height)
pts_divisions = (get_pts(curve))
pts_planes = make_planes(pts_divisions)
# print (pts_planes)
moved_planes = move_planes(pts_planes, plns_move_pt, min_layer_height, max_layer_height)
layered_planes = th.list_to_tree(make_layered_planes(pts_planes))
# ---------- end ghpython_script_17 ----------
panel_25 = Panel(ghpython_script_17.out)
geometry_30 = Geometry(ghpython_script_17.layered_planes)
geometry_31 = Geometry(ghpython_script_17.moved_planes)
geometry_32 = Geometry(ghpython_script_17.pts_divisions)
geometry_33 = Geometry(ghpython_script_17.pts_planes)

# ---- group: reversed_surface_PRINT-READY
# Last - Graph mapper
ghpython_script_18 = GhPythonScript(
    curve=curve_11,
    divide_number=integer_10,
    srf=surface_4,
    flip_vect=Toggle(True),
    layer_nbr=layer_nbr_8,
    plns_graph=graph_mapper_8)  # -> out, pts_divisions, pts_planes, moved_planes, layered_planes; inputs curve: Curve, srf: Surface, layer_nbr: Int32, plns_graph: list
# ---------- ghpython_script_18: Python ----------
import Rhino.Geometry as rg
import random as r
import ghpythonlib as ghc
from ghpythonlib import treehelpers as th
from copy import deepcopy
import math


def OrientPlane(plane, guide):
    yPt = plane.Origin + rg.Vector3d(0, 0, 1)
    project = rg.Transform.ProjectAlong(plane, plane.ZAxis)
    yPt.Transform(project)
    yAxis = rg.Vector3d(yPt-plane.Origin)

    zAxis = plane.ZAxis
    if zAxis*guide < 0:
        zAxis = -zAxis

    outPlane = rg.Plane(
        plane.Origin, -rg.Vector3d.CrossProduct(zAxis, yAxis), yAxis)
    return outPlane


def get_pts(crv):

    all_pts = []

    crv = curve.ToNurbsCurve(curve.Domain)
    # params = crv.DivideByCount(divide_number, True)

    params = crv.DivideByCount(divide_number, False)
    print(len(params))

    for i in params:
        pt = crv.PointAt(i)
        all_pts.append(pt)

    return all_pts


def make_planes(pts):

    pts_planes = []

    for k, pt in enumerate(pts):
        point, uv_pt, distance = ghc.components.SurfaceClosestPoint(pt, srf)
        pnt, normal, u, v, f = ghc.components.EvaluateSurface(srf, uv_pt)
        plane = rg.Plane(pt, rg.Vector3d(u), rg.Vector3d(v))
        rg.Plane.Rotate(plane, math.radians(-90), plane.ZAxis, plane.Origin)

        # halfLength = len(pts)/2
        # rotation2 = rg.Transform.Rotation((((abs(halfLength-k))/halfLength)*-math.pi*0.5), plane.Normal, plane.Origin)
        # rotation2 = rg.Transform.Rotation(((len(pts)-k)*math.pi/len(pts) + -math.pi*0.5), plane.Normal, plane.Origin)
        # plane.Transform(rotation2)
        pts_planes.append(plane)
    return pts_planes


# def move_planes(plns, plns_graph):

#     moved_plns = []

#     for k, value in enumerate(plns_graph):
#         origin = plns[k].Clone()
#         trans1 = rg.Transform.Translation(
#             rg.Vector3d(plns[k].Normal*plns_graph[k]))
#         origin.Transform(trans1)
#         moved_plns.append(origin)

#     return moved_plns


def make_layered_planes(plns):

    
    if flip_vect:
        for i in range(len(plns)):
            plns[i] = rg.Plane(
                plns[i].Origin, -plns[i].XAxis, plns[i].YAxis)
        # print (new_layer_height)
        # new_layer_height = -new_layer_height
        # print (new_layer_height)
    layered_planes = [plns]

    for l in range(layer_nbr):
        temp = []
        for i, p in enumerate(layered_planes[l]):
            layer_1 = deepcopy(p)
            trans2 = rg.Transform.Translation(
                rg.Vector3d(p.Normal*plns_graph[i]))
            layer_1.Transform(trans2)
            temp.append(layer_1)

        temp.reverse()
        plns_graph.reverse()
        layered_planes.append(temp)

    return layered_planes

# print(layer_height)
pts_divisions = (get_pts(curve))
pts_planes = make_planes(pts_divisions)
# print (pts_planes)
# moved_planes = move_planes(pts_planes, plns_graph)
layered_planes = th.list_to_tree(make_layered_planes(pts_planes))
# ---------- end ghpython_script_18 ----------
panel_26 = Panel(ghpython_script_18.out)
geometry_34 = Geometry(ghpython_script_18.pts_divisions)
geometry_35 = Geometry(ghpython_script_18.pts_planes)
geometry_36 = Geometry(ghpython_script_18.moved_planes)
geometry_37 = Geometry(ghpython_script_18.layered_planes)

# ----
list_item_2 = ListItem(List=geometry_24, Index=0, Wrap=True)
list_item_3 = ListItem(List=geometry_37, Index=Slider(1000, range=0..1000), Wrap=True)

list_item_4 = ListItem(List=geometry_30, Index=Slider(1000, range=0..1000), Wrap=True)
