# Grasshopper definition skinPattern_working_tozac.ghx (Grasshopper 1.0.7)

surface = Surface(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)
point = Point(Point(-556.4288437, 6.329469364, 0))
surface_2 = Surface(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)

# ---- group: single_curve
curve = Curve(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)

# ---- group: INPUT CRV, SRF, PT
point_2 = Point(Point(-58.83827179, -264.7568337, 114.0518238))
surface_3 = Surface(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)
curve_2 = Curve(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)

# ---- group: WORKING FILE
planes_spacing = Slider(10, range=0..20)
length = Length(Curve=curve_2)
division = Division(A=length, B=planes_spacing)
integer = Integer(division)

# ---- group: Layer variation plane adjustment
min_layer_height = Slider(0.5, range=0..10)
max_layer_height = Slider(10, range=0..10)

# ---- group: PRINT ADJUSTMENT LAYER VALUES
layer_height = Slider(0.25, range=0..5)
layer_nbr = Slider(26, range=0..100)

# ---- group: WORKING FILE
panel = Panel("C:\Users\josep\OneDrive\Desktop\GIT-HUB_Do-Not-MOVE\T1-Mini-Project_non-Planar-3DP\Repository - Teamwork\3d_printing_teamwork\working_file_joe\skin_testing\pts_variations_tozac.py")
read_file = ReadFile(File=panel, PerLineParse=False)  # -> Content
#   port File: Uri of file to read
# ---------- read_file: VB line parser ----------
    action = GH_LineParserAction.Include
    Return line

    'Parse the line and return some data that represents the line.
    'If the line cannot be parsed, you can return Nothing and
    'assign a different action.
    'The default implementation is to just return the line itself.
    'If you return types that implement IGH_Goo, this component
    'will work substantially faster.
# ---------- end read_file ----------

# ---- group: ALL PLANES
geometry = Geometry([Point(20.11241087, -268.0994345, 166.8389438), Point(14.91492845, -266.6103508, 160.828328), Point(21.50814431, -265.3542559, 161.5611426), Point(21.37283391, -265.900737, 162.7330684), Point(18.20059355, -264.8780917, 158.4823961), Point(24.26334024, -262.2164061, 155.575904)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])
geometry_2 = Geometry([Point(20.11241087, -268.0994345, 166.8389438), Point(14.91492845, -266.6103508, 160.828328), Point(21.50814431, -265.3542559, 161.5611426), Point(21.37283391, -265.900737, 162.7330684), Point(18.20059355, -264.8780917, 158.4823961), Point(24.26334024, -262.2164061, 155.575904)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])
geometry_3 = Geometry([Point(20.11241087, -268.0994345, 166.8389438), Point(14.91492845, -266.6103508, 160.828328), Point(21.50814431, -265.3542559, 161.5611426), Point(21.37283391, -265.900737, 162.7330684), Point(18.20059355, -264.8780917, 158.4823961), Point(24.26334024, -262.2164061, 155.575904)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])

# ---- group: 10 PLANES
geometry_4 = Geometry([Plane(origin=(20.00949203, -267.6585518, 167.051147), x=(-0.9765919175, -0.212767767, -0.03159278532), y=(0.06244257573, -0.4209748274, 0.9049205045)), Plane(origin=(18.54185183, -253.8058761, 119.1938906), x=(-0.9698341398, -0.2434366882, -0.01266175937), y=(0.01972924504, -0.1301597398, 0.991296726)), Plane(origin=(2.716405825, -255.3842468, 81.32405356), x=(-0.9814958783, -0.1914477887, 0.003685800351), y=(-0.002470917068, 0.03191004211, 0.9994876907)), Plane(origin=(11.45670435, -257.5554686, 131.5667557), x=(-0.9742020149, -0.2245304731, -0.02272665285), y=(0.02265156901, -0.1974803183, 0.9800451165)), Plane(origin=(-4.043541148, -259.012895, 123.1589417), x=(-0.9824954775, -0.1849965287, -0.02188426413), y=(0.007849735981, -0.1584857942, 0.9873300536)), Plane(origin=(-19.7061908, -260.621374, 58.99762091), x=(-0.9917745565, -0.12704108, 0.01561387489), y=(0.0009991609617, 0.1142984493, 0.9934459553))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])
geometry_5 = Geometry([Plane(origin=(20.00949203, -267.6585518, 167.051147), x=(-0.9765919175, -0.212767767, -0.03159278532), y=(0.06244257573, -0.4209748274, 0.9049205045)), Plane(origin=(18.54185183, -253.8058761, 119.1938906), x=(-0.9698341398, -0.2434366882, -0.01266175937), y=(0.01972924504, -0.1301597398, 0.991296726)), Plane(origin=(2.716405825, -255.3842468, 81.32405356), x=(-0.9814958783, -0.1914477887, 0.003685800351), y=(-0.002470917068, 0.03191004211, 0.9994876907)), Plane(origin=(11.45670435, -257.5554686, 131.5667557), x=(-0.9742020149, -0.2245304731, -0.02272665285), y=(0.02265156901, -0.1974803183, 0.9800451165)), Plane(origin=(-4.043541148, -259.012895, 123.1589417), x=(-0.9824954775, -0.1849965287, -0.02188426413), y=(0.007849735981, -0.1584857942, 0.9873300536)), Plane(origin=(-19.7061908, -260.621374, 58.99762091), x=(-0.9917745565, -0.12704108, 0.01561387489), y=(0.0009991609617, 0.1142984493, 0.9934459553))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])
geometry_6 = Geometry([Plane(origin=(20.00949203, -267.6585518, 167.051147), x=(-0.9765919175, -0.212767767, -0.03159278532), y=(0.06244257573, -0.4209748274, 0.9049205045)), Plane(origin=(18.54185183, -253.8058761, 119.1938906), x=(-0.9698341398, -0.2434366882, -0.01266175937), y=(0.01972924504, -0.1301597398, 0.991296726)), Plane(origin=(2.716405825, -255.3842468, 81.32405356), x=(-0.9814958783, -0.1914477887, 0.003685800351), y=(-0.002470917068, 0.03191004211, 0.9994876907)), Plane(origin=(11.45670435, -257.5554686, 131.5667557), x=(-0.9742020149, -0.2245304731, -0.02272665285), y=(0.02265156901, -0.1974803183, 0.9800451165)), Plane(origin=(-4.043541148, -259.012895, 123.1589417), x=(-0.9824954775, -0.1849965287, -0.02188426413), y=(0.007849735981, -0.1584857942, 0.9873300536)), Plane(origin=(-19.7061908, -260.621374, 58.99762091), x=(-0.9917745565, -0.12704108, 0.01561387489), y=(0.0009991609617, 0.1142984493, 0.9934459553))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])

# ----
entwine = Entwine(Branch00=geometry_4, Branch01=geometry_5, Branch02=geometry_6, FlattenInputs=True)  # -> simplify(Result)

# ---- group: WORKING FILE
ghpython_script = GhPythonScript(
    Code=read_file,
    Nested_list_pts=entwine,
    Srf=surface_3,
    Flip_vect=Toggle(False),
    Layer_height=layer_height,
    Layer_nbr=layer_nbr,
    Plns_move_pt=point_2,
    Min_layer_height=min_layer_height,
    Max_layer_height=max_layer_height)  # -> Out, Pts_divisions, Pts_planes, Moved_planes, Layered_planes
geometry_7 = Geometry(ghpython_script.Layered_planes)
geometry_8 = Geometry(ghpython_script.Moved_planes)
geometry_9 = Geometry(ghpython_script.Pts_divisions)
geometry_10 = Geometry(ghpython_script.Pts_planes)
panel_2 = Panel(ghpython_script.Out)

# ----
param_viewer = ParamViewer(entwine)
panel_3 = Panel(entwine)

list_item = ListItem(List=geometry_7, Index=Slider(1000, range=0..1000), Wrap=True)

panel_4 = Panel(geometry_8)
