# Grasshopper definition demo_surface.gh (Grasshopper 1.0.7)

panel = Panel("C:\Users\Zac\Desktop")
read_file = ReadFile(PerLineParse=False)
ghpython_script = GhPythonScript()  # -> Out, OutTemp
_0_to_1_00 = Slider(0, range=0..1)
_1_to_100 = Slider(0, range=0..100)
c_script = CSharpScript()  # -> Out, A
panel_2 = Panel("C:\Zac\GitHub\3d_printing_teamwork\working_file_zac\shellShape\shellShape.py")
panel_3 = Panel("10")
geometry = Geometry(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)
curve = Curve(<curve referenced from the Rhino model>)
read_file_2 = ReadFile(File=panel_2, PerLineParse=False)
number_slider = Slider(-2, range=-100..100)
ghpython_script_2 = GhPythonScript(
    Code=read_file_2,
    Brep=geometry,
    Curves=curve,
    DivideCount="100",
    LayerNumber="30",
    LayerHight="1.5",
    Inclination=Slider(1, range=0..1))  # -> Out, Visual, Planes, OutTemp
geometry_2 = Geometry([Plane(origin=(-163.4593646, -54.33886412, 60.47774639), x=(-0.1330446518, 0.9911100447, 0), y=(0.02371377137, 0.003183289759, 0.9997137209)), Plane(origin=(-163.4033831, -54.38495197, 62.61099297), x=(-0.07154002968, 0.9974377295, 0), y=(0.02370992804, 0.001700566267, 0.9997174338)), Plane(origin=(-163.1498911, -57.09570523, 64.70196208), x=(-0.07932349946, 0.9968489266, 0), y=(0.02298214278, 0.001828786632, 0.999734203)), Plane(origin=(-162.8723015, -59.84686579, 66.76330292), x=(-0.08787108582, 0.9961318549, 0), y=(0.02209063471, 0.001948665781, 0.999754073)), Plane(origin=(-162.57144, -62.61743125, 68.79438668), x=(-0.09663230395, 0.9953201484, 0), y=(0.0210334972, 0.002042071887, 0.999776686)), Plane(origin=(-162.2465797, -65.40744178, 70.79445384), x=(-0.105618116, 0.9944067646, 0), y=(0.01980487473, 0.002103519033, 0.9998016514))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])
panel_4 = Panel(ghpython_script_2.Out)
