# Grasshopper definition shellShape.ghx (Grasshopper 1.0.7)
# plug-ins: Palette, MetaHopper

panel = Panel("C:\Zac\GitHub\3d_printing_teamwork\working_file_zac\shellShape\shellShape.py")
curve = Curve([<curve referenced from the Rhino model> x3])
read_file = ReadFile(File=panel, PerLineParse=False)
_0_to_1_00 = Slider(0, range=0..1)
_1_to_100 = Slider(0, range=0..100)
panel_2 = Panel("""1.1
1.2
1.3""")
geometry = Geometry(<brep referenced from the Rhino model>)
c_script = CSharpScript()  # -> Out, A
geometry_2 = Geometry([<curve referenced from the Rhino model> x13])
ghpython_script = GhPythonScript(Code=read_file, Mesh=geometry, Curves=curve, Variables=reverse(panel_2))  # -> Out, Visual, Planes, OutTemp
extrude_along = ExtrudeAlong()
perp_frame = PerpFrame()
panel_3 = Panel(ghpython_script.Out)
geometry_3 = Geometry(ghpython_script.OutTemp)
colour_swatch = ColourSwatch(SwatchColor=RGB(255, 255, 255))
palette = Palette(
    ModeCustomStandard=Toggle(True),
    Component_Normal_Deselected_Fill_Color=RGB(200, 200, 200),
    Component_Normal_Deselected_Edge_Color=RGB(50, 50, 50),
    Component_Normal_Deselected_Text_Color=RGB(0, 0, 0),
    Component_Normal_Selected_Fill_Color=RGB(130, 215, 50),
    Component_Normal_Selected_Edge_Color=RGB(0, 50, 0),
    Component_Normal_Selected_Text_Color=RGB(0, 25, 0),
    Component_Hidden_Deselected_Fill_Color=RGB(140, 140, 155),
    Component_Hidden_Deselected_Edge_Color=RGB(35, 35, 35),
    Component_Hidden_Deselected_Text_Color=RGB(0, 0, 0),
    Component_Hidden_Selected_Fill_Color=RGB(80, 180, 10),
    Component_Hidden_Selected_Edge_Color=RGB(0, 35, 0),
    Component_Hidden_Selected_Text_Color=RGB(0, 25, 0),
    Component_Disabled_Deselected_Fill_Color=RGB(120, 120, 120),
    Component_Disabled_Deselected_Edge_Color=RGB(90, 90, 90),
    Component_Disabled_Deselected_Text_Color=RGB(70, 70, 70),
    Component_Disabled_Selected_Fill_Color=RGB(110, 150, 115),
    Component_Disabled_Selected_Edge_Color=RGB(40, 70, 40),
    Component_Disabled_Selected_Text_Color=RGB(75, 100, 65),
    Component_Warning_Deselected_Fill_Color=RGB(255, 140, 20),
    Component_Warning_Deselected_Edge_Color=RGB(80, 10, 0),
    Component_Warning_Deselected_Text_Color=RGB(0, 0, 0),
    Component_Warning_Selected_Fill_Color=RGB(185, 205, 0),
    Component_Warning_Selected_Edge_Color=RGB(0, 50, 0),
    Component_Warning_Selected_Text_Color=RGB(0, 0, 0),
    Component_Error_Deselected_Fill_Color=RGB(200, 0, 0),
    Component_Error_Deselected_Edge_Color=RGB(60, 0, 0),
    Component_Error_Deselected_Text_Color=RGB(0, 0, 0),
    Component_Error_Selected_Fill_Color=RGB(125, 155, 0),
    Component_Error_Selected_Edge_Color=RGB(0, 50, 0),
    Component_Error_Selected_Text_Color=RGB(255, 255, 255),
    Component_Label_Deselected_Fill_Color=RGB(50, 50, 50),
    Component_Label_Deselected_Edge_Color=RGB(0, 0, 0),
    Component_Label_Deselected_Text_Color=RGB(255, 255, 255),
    Component_Label_Selected_Fill_Color=RGB(25, 60, 25),
    Component_Label_Selected_Edge_Color=RGB(0, 35, 0),
    Component_Label_Selected_Text_Color=RGB(190, 250, 180),
    Galapagos_Deselected_Fill_Color=RGB(255, 0, 125),
    Galapagos_Deselected_Edge_Color=RGB(100, 0, 50),
    Galapagos_Selected_Fill_Color=RGB(160, 210, 30),
    Galapagos_Selected_Edge_Color=RGB(0, 50, 0),
    Wire_Normal_Color=colour_swatch,
    Wire_Empty_Color=RGBA(255, 60, 0, 180),
    Wire_Selected_Start_Color=RGB(125, 210, 40),
    Wire_Selected_End_Color=colour_swatch,
    Panel_Default_Color=ColourSwatch(SwatchColor=RGBA(255, 255, 255, 200)),
    Group_Default_Color=ColourSwatch(SwatchColor=RGBA(255, 255, 255, 80)),
    Canvas_Background_Color=RGB(212, 208, 200),
    Canvas_Gridline_Color=RGBA(0, 0, 0, 30),
    Canvas_Gridline_Width=150,
    Canvas_Gridline_Height=50,
    Canvas_Edge_Color=RGB(0, 0, 0),
    Canvas_Shadow_Color=RGBA(0, 0, 0, 80),
    Canvas_Shadow_Size=30,
    MonochromaticOnOff=Toggle(True),
    Monochromatic_Color=ColourSwatch(SwatchColor=RGB(0, 0, 0)))
capture_gh_canvas = CaptureGHCanvas(
    Capture=Button(),
    ScaleFactor=1,
    SaveLocation="C:\Users\Zac\Desktop\GH_Capture.png",
    BackgroundColor=ColourSwatch(SwatchColor=RGB(0, 0, 0)))
