# Grasshopper definition toJoe.gh (Grasshopper 1.0.7)

geometry = Geometry([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])
list_length = ListLength(List=geometry)
series = Series(Start=0, Step=1, Count=list_length)
unit_z = UnitZ(Factor=series)
move = Move(Geometry=geometry, Motion=unit_z)  # -> Geometry, Transform
loft = Loft(Curves=move.Geometry, Options={Adjust=False, Closed=False, LoftEnds=0, LoftSimp=0, LoftType=0, Rebuild=10, Refit=0.01})

geometry_2 = Geometry([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])
list_length_2 = ListLength(List=geometry_2)
series_2 = Series(Start=0, Step=1, Count=list_length_2)
unit_z_2 = UnitZ(Factor=series_2)
move_2 = Move(Geometry=geometry_2, Motion=unit_z_2)  # -> Geometry, Transform
loft_2 = Loft(Curves=move_2.Geometry, Options={Adjust=False, Closed=False, LoftEnds=0, LoftSimp=0, LoftType=0, Rebuild=10, Refit=0.01})
