# Grasshopper definition visualization.ghx (Grasshopper 1.0.7)

# INPUT
safe_robot_acc = Slider(0.1, range=0..1)
safe_robot_vel = Slider(0.1, range=0..1)
safe_sleep_time = Slider(0.1, range=0..1)
safe_dist = Slider(100, range=50..200)
# WORKING FILES
panel = Panel("\dependencies\master_navigation_data.json")
ghpython_script = GhPythonScript(file_name=panel)  # -> ROBOT_IP, TCP, ROBOT_BASE
# ---------- ghpython_script: Python ----------
import Rhino.Geometry as rg

def set_robot_base():
    pt_0 = rg.Point3d(data['origin'][0],data['origin'][1],data['origin'][2]) # base plane origin
    pt_1 = rg.Point3d(data['origin_x'][0],data['origin_x'][1],data['origin_x'][2]) # point on positive x axis
    pt_2 = rg.Point3d(data['origin_y'][0],data['origin_y'][1],data['origin_y'][2]) # point on positive xy plane
    robot_base = rg.Plane(pt_0,pt_1-pt_0,pt_2-pt_0)
    return robot_base


a = ghdoc.Path

path = a.split('3d_printing_teamwork')[0]+r'3d_printing_teamwork\\'+file_name
import json
with open(path) as f:
   data = json.load(f)

ROBOT_IP = data['ip']
TCP = data['tcp']
ROBOT_BASE = set_robot_base()
# ---------- end ghpython_script ----------
ghpython_script_2 = GhPythonScript(file_name="/working_file_zac/excution.py")  # -> path
# ---------- ghpython_script_2: Python ----------
a = ghdoc.Path

path = a.split('3d_printing_teamwork')[0]+r'3d_printing_teamwork\\'+file_name
# ---------- end ghpython_script_2 ----------
read_file = ReadFile(File=ghpython_script_2, PerLineParse=False)
python = GhPythonScript(ROBOT_IP=ghpython_script.ROBOT_IP, TCP=ghpython_script.TCP, ROBOT_BASE=ghpython_script.ROBOT_BASE)  # -> out, script; inputs IO: Int32, TABLE_NAVIGATION_POINTS: list of Point3d, count: Int32, picking_planes: list of Plane, brick_planes: list of Plane, gluePlane: Plane, continuous_picking_planes: list of Plane, continuous_brick_planes: list of Plane, stop_configurations: list, fabricate: Boolean, is_debug_mode: Boolean, debug_plane: Plane
# ---------- python: Python ----------
from imp import reload
import Rhino.Geometry as rg
import simple_ur_script as ur
reload(ur)
import simple_comm as c
reload(c)
import math as m
from compas.geometry import Frame
from compas_rhino.conversions import frame_to_rhino


# change these values if needed
ROBOT_IP = "192.168.10.10"
SAFE_ROBOT_ACC = 0.1
SAFE_ROBOT_VEL = 0.3
IO = 0 # 0


sleep_time = 0.2

def tcp(script):
    script += ur.set_tcp_by_angles(0.0, 0.0, 80.0, m.radians(0.0), m.radians(180.0),m.radians(0.0))
    
    return script


def set_robot_base():
    pt_0 = rg.Point3d(-249.62,-750.86,-587.98) # base plane origin
    pt_1 = rg.Point3d(-252.73,-1064.50,-587.82) # point on positive x axis
    pt_2 = rg.Point3d(826.13,-752.45,-587.91) # point on positive xy plane
    robot_base = rg.Plane(pt_0,pt_1-pt_0,pt_2-pt_0)
    return robot_base


def rhino_to_robot_space(rhino_plane):
    plane = rhino_plane.Clone()
    robot_base_plane = set_robot_base()
    rhino_matrix = rg.Transform.PlaneToPlane(rg.Plane.WorldXY,robot_base_plane)
    plane.Transform(rhino_matrix)
    return plane


def pickup_brick(script,pick_up_plane):
    planes = []
    #change the distance if needed
    SAFE_DIST = 150
    
    safe_plane = pick_up_plane.Clone()
#    safe_plane.Translate(rhinoplane.ZAxis*SAFE_DIST)
    safe_plane.Translate(rg.Vector3d.ZAxis*SAFE_DIST)
    
    ## add to the path: go to the safe plane
    script += ur.move_l(safe_plane, SAFE_ROBOT_ACC, SAFE_ROBOT_VEL)
    planes.append(safe_plane)
    
    ## add to the path: go to the pick up plane
    script += ur.move_l(pick_up_plane, SAFE_ROBOT_ACC, SAFE_ROBOT_VEL)
    planes.append(pick_up_plane)
    
    ## add to the path: turn on the vacuum and wait 1 sec.
    script += ur.set_digital_out(IO,True)
    script += ur.sleep(sleep_time)

    # add to the path: go back to the safe_plane
    script += ur.move_l(safe_plane, SAFE_ROBOT_ACC, SAFE_ROBOT_VEL)
    planes.append(safe_plane)
    
    
    return script, planes


def place_brick(script, place_plane):
    
    planes = []
    
    SAFE_DIST = 100
    safe_plane = place_plane.Clone()
    safe_plane.Translate(rg.Vector3d.ZAxis*SAFE_DIST)
    
    # add to the path: go to the safe plane
    script += ur.move_l(safe_plane, SAFE_ROBOT_ACC, SAFE_ROBOT_VEL)
    planes.append(safe_plane)
    
    # add to the path: go to the place plane
    script += ur.move_l(place_plane, SAFE_ROBOT_ACC, SAFE_ROBOT_VEL)
    planes.append(place_plane)
    
    ## add to the path: turn off the vacuum and wait 1 second (hold the brick)
    script += ur.set_digital_out(IO,False)
    script += ur.sleep(sleep_time)
 
    # add to the path: go back to the safe plane
    script += ur.move_l(safe_plane, SAFE_ROBOT_ACC, SAFE_ROBOT_VEL)
    planes.append(safe_plane)
    
    return script,planes


def send(script):
    script = c.concatenate_script(script)
    c.send_script(script, ROBOT_IP)
    return script 


#location of a pick up station
axisangle = Frame.from_axis_angle_vector([2.403,2.421,-4.166],[677.46,-886.44,-492.82])

pickup_planes = []
"""
for plan in  picking_plans:
    x = rg.Transform.PlaneToPlane(picking_plans[0], plan)
    plan.Transform(x)
    pickup_planes.append(rg.Plane(plan))
"""
# print rhinoplane
# pick_station = rg.Plane(rhinoplane)#Rotate Plane



#  picking_planes


script = ""
#skip this step
script = tcp(script)
vis_planes = []



# translate from rhino to robot_space and iterate through all planes
robot_planes = []

for p in brick_planes:
    r_plane = rhino_to_robot_space(p)
    robot_planes.append(r_plane)


for i in range(len(robot_planes)):
    
    script, p = pickup_brick(script,picking_plans[0])
    vis_planes.extend(p) #only to visualize the planes
    
    script, p = place_brick(script,robot_planes[i])
    vis_planes.extend(p)


if fabricate:
    send(script)
# ---------- end python ----------
